# Grasshopper definition GDS_General.gh (Grasshopper 1.0.8)
# plug-ins: RhinoCodePluginGH, MetaHopper

# Version Align
toggle = BooleanToggle(True)
syncghfile = LBSyncGrasshopperFile(sync=toggle)  # -> report; plug-in component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
panel = Panel(syncghfile)

# ----
# HUB
# GBE REFINER
hub_run = Button()
refiner_run = Button()
gds_mod_hub = IronPython2Script(RUN=hub_run)  # inputs RUN: Boolean
# ---------- gds_mod_hub: IronPython ----------
# -*- coding: utf-8 -*-
"""
GDS Hub
=======

SPDX-License-Identifier: BSD-3-Clause
Copyright (c) 2026 SyracuseCoE, Syracuse University. All rights reserved.

Redistribution and use in source and binary forms, with or without
modification, are permitted provided that the conditions stated in the
LICENSE file distributed with this project are met.

Author: Chengbo Du <cdu113@syr.edu>

Tabbed input panel for GDS workflows. Six modules:

    1. Space      - Geometry, conditioning status, program inputs
    2. Enclosure  - Aperture and door definition
    3. Service    - Program assembly, service hot water, thermal comfort
    4. HVAC       - HVAC system selection from templates
    5. Site       - Site, weather, PV, solar hot water
    6. Advanced   - Battery, wind, IDF injection and preview

Module outputs are written to named GH components on the canvas.
"""

# --------------------------- CONFIG ------------------------------------------
# Space Module
NAME_SLIDER_DUP = "Dup"
NAME_SLIDER_ACH = "Zone_ACH"
NAME_TOGGLE     = "RUN_SIM"
NAME_BUTTON     = "GEO_OVERWRITE"
NAME_BREP       = "SELECTED_GEO"
NAME_BLDS       = "Blds"

NAME_PANELS_IN  = ["Building Name", "Layer to Bake&Refer", "GDS Database Path"]
NAME_SPACE_OUTPUTS = ["Design Parameters", "Control Parameters", 
                      "State Variables", "Interface Variables"]
NAME_PERFORMANCE   = "Performance"

# Enclosure Module
NAME_PREVIEW_BREP  = "GDS_Preview"  # Unified preview for Enclosure & Service modules
NAME_APERTURE_SRF  = "aperture surfaces"
NAME_APERTURE_SYNC = "ap_sync"
NAME_DOOR_SRF      = "door surfaces"
NAME_DOOR_SYNC     = "door_sync"
NAME_ENV_OUTPUTS   = ["GDS_Envelope_Design", "GDS_Envelope_Control",
                      "GDS_Envelope_State", "GDS_Envelope_Interface"]
NAME_ENV_PERF      = "GDS_Envelope_Performance"

# Service Module
NAME_HB_ROOMS_IN = "HB_Rooms"
NAME_PROGRAM_OUTPUT = "GDS_Program"
NAME_SHW_SYSTEM = "GDS_SHW_System"  # Panel for SHW equipment type output
SHW_STICKY_KEY = "GDS_SHW_SYSTEM"  # sc.sticky key for Refiner to read
NAME_CUSTOM_SCHEDULES = "GDS_Custom_Schedules"  # Panel to store custom schedules JSON

# Space Module - Conditioning Status
NAME_COND_STATUS = "GDS_Cond_Status"  # Data component for conditioning status (boolean list)

# Site Module
NAME_SITE_CONTEXT  = "site_context"
NAME_SITE_INDEX    = "site_index"
NAME_SITE_NAME     = "site_name"
NAME_SITE_BUTTON   = "site_overwrite"
NAME_INC_CONTEXT   = "IncCont?"  # Toggle for including context geometry in HB Model
NAME_WEATHER_PATH  = "weather_path"
NAME_SITE_OUTPUTS  = ["GDS_Site_Design", "GDS_Site_Control",
                      "GDS_Site_State", "GDS_Site_Interface"]
NAME_SITE_PERF     = "GDS_Site_Performance"

# HVAC Module
NAME_HVAC_ROOMS_IN  = "HB_Rooms"        # Input: HB Rooms (same as Schedule module)
NAME_HVAC_ROOMS_OUT = "HB_Rooms_HVAC"   # Output: Rooms with HVAC assigned
NAME_HVAC_SYSTEM    = "HVAC_System"     # Output: HVAC system object
HVAC_CONFIG_KEY     = "GDS_HVAC_CONFIG" # Storage key for HVAC config (used by GDSGBE)

# Advanced (IDF Injection) Module
NAME_IDF_INJECTION  = "GDS_IDF_Injection"  # Panel to receive IDF strings for injection

# Thermal Comfort Settings
NAME_COMFORT_SETTINGS = "GDS_Comfort_Settings"  # Panel for comfort simulation settings

WINDOW_TITLE    = "GDS - Building Hub"
WINDOW_SIZE     = (1050, 780)
DUP_DEFAULT     = 2
ACH_DEFAULT     = 0.5
OUT_MAX_ITEMS   = 200
# -----------------------------------------------------------------------------

import Eto.Forms as Forms
import Eto.Drawing as Drawing
import Rhino
import Rhino.Geometry as rg
import Rhino.Input as ri
import Rhino.DocObjects as rdo
import Grasshopper as gh
import Grasshopper.Kernel as gk
import Grasshopper.Kernel.Types as gkt
import scriptcontext as sc
import System
import math
import json
import os

DOC = ghenv.Component.OnPingDocument()
KEY = "GDS_HubPanel_STICKY"
SERVICE_STORAGE_KEY = "GDS_SERVICE_STATE"  # sc.sticky key for Service Module persistence

RESULT_BG_COLOR = Drawing.Color.FromArgb(245, 247, 250)

# --- SCHEDULE PRESETS ---
SCHEDULE_PRESETS = {
    "Always On": [1.0] * 24,
    "Always Off": [0.0] * 24,
    "Office Weekday": [0, 0, 0, 0, 0, 0, 0.1, 0.2, 0.95, 0.95, 0.95, 0.5, 0.95, 0.95, 0.95, 0.95, 0.95, 0.3, 0.1, 0.05, 0, 0, 0, 0],
    "Office Weekend": [0, 0, 0, 0, 0, 0, 0.05, 0.05, 0.1, 0.1, 0.1, 0.1, 0.1, 0.1, 0.05, 0.05, 0, 0, 0, 0, 0, 0, 0, 0],
    "Retail": [0, 0, 0, 0, 0, 0, 0, 0.1, 0.2, 0.5, 0.8, 0.9, 0.9, 0.9, 0.9, 0.9, 0.9, 0.8, 0.5, 0.2, 0, 0, 0, 0],
    "Hospital 24/7": [0.8, 0.7, 0.6, 0.6, 0.6, 0.7, 0.8, 0.9, 1.0, 1.0, 1.0, 1.0, 1.0, 1.0, 1.0, 1.0, 1.0, 0.9, 0.9, 0.9, 0.9, 0.9, 0.8, 0.8],
    "School": [0, 0, 0, 0, 0, 0, 0.1, 0.5, 0.95, 0.95, 0.95, 0.95, 0.5, 0.95, 0.95, 0.5, 0.1, 0, 0, 0, 0, 0, 0, 0],
    "Residential": [0.9, 0.9, 0.9, 0.9, 0.9, 0.9, 0.7, 0.4, 0.4, 0.2, 0.2, 0.2, 0.2, 0.2, 0.2, 0.3, 0.5, 0.7, 0.8, 0.9, 0.9, 0.9, 0.9, 0.9],
}

SETPOINT_PRESETS = {
    "Office Heating": [15.6, 15.6, 15.6, 15.6, 15.6, 15.6, 18, 21, 21, 21, 21, 21, 21, 21, 21, 21, 21, 21, 15.6, 15.6, 15.6, 15.6, 15.6, 15.6],
    "Office Cooling": [29.4, 29.4, 29.4, 29.4, 29.4, 29.4, 26, 24, 24, 24, 24, 24, 24, 24, 24, 24, 24, 24, 29.4, 29.4, 29.4, 29.4, 29.4, 29.4],
    "Residential Heating": [18, 18, 18, 18, 18, 18, 20, 21, 21, 18, 18, 18, 18, 18, 18, 18, 21, 21, 21, 21, 21, 20, 18, 18],
    "Residential Cooling": [28, 28, 28, 28, 28, 28, 26, 25, 25, 28, 28, 28, 28, 28, 28, 28, 25, 25, 25, 25, 25, 26, 28, 28],
    "Constant 21C": [21] * 24,
    "Constant 24C": [24] * 24,
}

ACTIVITY_PRESETS = {
    "Office Seated": [120] * 24,
    "Office Light Work": [126] * 24,
    "Standing/Walking": [150] * 24,
    "Light Labor": [180] * 24,
    "Heavy Labor": [300] * 24,
}

INTENSITY_DEFAULTS = {
    "Office": {
        "people_per_area": 0.0565,
        "lighting_power": 10.76,
        "equipment_power": 10.76,
        "infiltration_rate": 0.0003,
        "ventilation_per_person": 0.006,
        "ventilation_per_area": 0.0003,
    },
    "Retail": {
        "people_per_area": 0.108,
        "lighting_power": 16.0,
        "equipment_power": 5.0,
        "infiltration_rate": 0.0003,
        "ventilation_per_person": 0.0075,
        "ventilation_per_area": 0.0006,
    },
    "Residential": {
        "people_per_area": 0.04,
        "lighting_power": 6.0,
        "equipment_power": 5.0,
        "infiltration_rate": 0.0003,
        "ventilation_per_person": 0.0025,
        "ventilation_per_area": 0.0003,
    },
    "Laboratory": {
        "people_per_area": 0.05,
        "lighting_power": 14.0,
        "equipment_power": 20.0,
        "infiltration_rate": 0.0003,
        "ventilation_per_person": 0.006,
        "ventilation_per_area": 0.0009,
    },
    "Hospital": {
        "people_per_area": 0.1,
        "lighting_power": 12.0,
        "equipment_power": 15.0,
        "infiltration_rate": 0.0003,
        "ventilation_per_person": 0.006,
        "ventilation_per_area": 0.0006,
    },
}

# --- SERVICE HOT WATER PRESETS ---
SHW_PRESETS = {
    "None": {
        "flow_per_area": 0.0,
        "target_temp": 49.0,
        "sensible_fraction": 0.0,
        "latent_fraction": 0.0,
    },
    "Residential": {
        "flow_per_area": 0.05,      # L/h/m² 
        "target_temp": 49.0,        # °C (120°F)
        "sensible_fraction": 0.2,
        "latent_fraction": 0.05,
    },
    "Residential - ABC Baseline": {
        "flow_per_area": 0.05,
        "target_temp": 48.9,        # 120°F from paper
        "sensible_fraction": 0.2,
        "latent_fraction": 0.05,
    },
    "Office": {
        "flow_per_area": 0.01,
        "target_temp": 43.0,
        "sensible_fraction": 0.2,
        "latent_fraction": 0.05,
    },
    "Hotel": {
        "flow_per_area": 0.08,
        "target_temp": 49.0,
        "sensible_fraction": 0.2,
        "latent_fraction": 0.05,
    },
}

# SHW equipment types (determines fuel source for domestic hot water)
SHW_EQUIPMENT_TYPES = [
    "Gas_WaterHeater",          # Natural gas (HB default)
    "Electric_WaterHeater",     # Electric resistance
    "HeatPump_WaterHeater",     # Electric heat pump (high COP)
    "Gas_TanklessHeater",       # Gas tankless/instantaneous
    "Electric_TanklessHeater",  # Electric tankless/instantaneous
]

# Tank parameter defaults per equipment type (for conditional UI)
SHW_EQUIPMENT_DEFAULTS = {
    "Gas_WaterHeater":          {"efficiency": 0.8,  "tank_ua": 6.0, "has_tank": True},
    "Electric_WaterHeater":     {"efficiency": 1.0,  "tank_ua": 6.0, "has_tank": True},
    "HeatPump_WaterHeater":     {"efficiency": 3.5,  "tank_ua": 6.0, "has_tank": True},
    "Gas_TanklessHeater":       {"efficiency": 0.82, "tank_ua": 0.0, "has_tank": False},
    "Electric_TanklessHeater":  {"efficiency": 1.0,  "tank_ua": 0.0, "has_tank": False},
}

# --- HVAC SYSTEM TEMPLATES ---
HVAC_CATEGORIES = {
    "Ideal Air (Loads Only)": {
        "description": "Perfect heating/cooling for load calculations",
        "class": "IdealAirSystem",
        "equipment_types": ["IdealAirSystem"],
        "has_economizer": True,
        "has_heat_recovery": True,
        "has_dcv": True,
    },
    "All-Air: VAV": {
        "description": "Variable Air Volume - large commercial buildings",
        "class": "VAV",
        "equipment_types": [
            "VAV_Chiller_Boiler", "VAV_Chiller_ASHP", "VAV_Chiller_DHW",
            "VAV_Chiller_PFP", "VAV_Chiller_GasCoil",
            "VAV_ACChiller_Boiler", "VAV_ACChiller_ASHP", "VAV_ACChiller_DHW",
            "VAV_DCW_Boiler", "VAV_DCW_ASHP", "VAV_DCW_DHW"
        ],
        "has_economizer": True,
        "has_heat_recovery": True,
        "has_dcv": True,
    },
    "All-Air: PVAV": {
        "description": "Packaged VAV - medium commercial",
        "class": "PVAV",
        "equipment_types": [
            "PVAV_Boiler", "PVAV_ASHP", "PVAV_DHW",
            "PVAV_PFP", "PVAV_BoilerElectricReheat"
        ],
        "has_economizer": True,
        "has_heat_recovery": True,
        "has_dcv": True,
    },
    "All-Air: PSZ": {
        "description": "Packaged Single Zone - small commercial/retail",
        "class": "PSZ",
        "equipment_types": [
            "PSZAC_ElectricBaseboard", "PSZAC_BoilerBaseboard", "PSZAC_GasHeaters",
            "PSZAC_ElectricCoil", "PSZAC_GasCoil", "PSZAC_Boiler", "PSZAC_ASHP",
            "PSZAC", "PSZHP"
        ],
        "has_economizer": True,
        "has_heat_recovery": True,
        "has_dcv": True,
    },
    "DOAS + FCU": {
        "description": "Dedicated OA + Fan Coil Units - offices, hotels",
        "class": "FCUwithDOAS",
        "equipment_types": [
            "DOAS_FCU_Chiller_Boiler", "DOAS_FCU_Chiller_ASHP", "DOAS_FCU_Chiller_DHW",
            "DOAS_FCU_ACChiller_Boiler", "DOAS_FCU_ACChiller_ASHP",
            "DOAS_FCU_DCW_Boiler", "DOAS_FCU_DCW_ASHP"
        ],
        "has_economizer": False,
        "has_heat_recovery": True,
        "has_dcv": True,
    },
    "DOAS + VRF": {
        "description": "Dedicated OA + Variable Refrigerant Flow",
        "class": "VRFwithDOAS",
        "equipment_types": ["DOAS_VRF"],
        "has_economizer": False,
        "has_heat_recovery": True,
        "has_dcv": True,
    },
    "DOAS + Radiant": {
        "description": "Dedicated OA + Radiant Floors/Ceilings - high efficiency",
        "class": "RadiantwithDOAS",
        "equipment_types": [
            "DOAS_Radiant_Chiller_Boiler", "DOAS_Radiant_Chiller_ASHP",
            "DOAS_Radiant_ACChiller_Boiler", "DOAS_Radiant_DCW_Boiler"
        ],
        "has_economizer": False,
        "has_heat_recovery": True,
        "has_dcv": True,
        "has_radiant_type": True,
    },
    "DOAS + WSHP": {
        "description": "Dedicated OA + Water Source Heat Pumps",
        "class": "WSHPwithDOAS",
        "equipment_types": [
            "DOAS_WSHP_FluidCooler_Boiler", "DOAS_WSHP_CoolingTower_Boiler",
            "DOAS_WSHP_GSHP", "DOAS_WSHP_DCW_DHW"
        ],
        "has_economizer": False,
        "has_heat_recovery": True,
        "has_dcv": True,
    },
    "HeatCool: Residential": {
        "description": "Residential AC/HP/Furnace - no ventilation air",
        "class": "Residential",
        "equipment_types": [
            "ResidentialAC_ElectricBaseboard", "ResidentialAC_BoilerBaseboard",
            "ResidentialAC_ResidentialFurnace", "ResidentialAC",
            "ResidentialHP", "ResidentialHPNoCool", "ResidentialFurnace"
        ],
        "has_economizer": False,
        "has_heat_recovery": False,
        "has_dcv": False,
    },
    "HeatCool: Baseboard": {
        "description": "Baseboard heating only - no cooling/ventilation",
        "class": "Baseboard",
        "equipment_types": [
            "ElectricBaseboard", "BoilerBaseboard", "ASHPBaseboard", "DHWBaseboard"
        ],
        "has_economizer": False,
        "has_heat_recovery": False,
        "has_dcv": False,
    },
    "HeatCool: Radiant": {
        "description": "Radiant floors/ceilings - no ventilation",
        "class": "Radiant",
        "equipment_types": [
            "Radiant_Chiller_Boiler", "Radiant_Chiller_ASHP",
            "Radiant_ACChiller_Boiler", "Radiant_DCW_Boiler"
        ],
        "has_economizer": False,
        "has_heat_recovery": False,
        "has_dcv": False,
        "has_radiant_type": True,
    },
}

HVAC_VINTAGES = [
    "ASHRAE_2019", "ASHRAE_2016", "ASHRAE_2013", "ASHRAE_2010",
    "ASHRAE_2007", "ASHRAE_2004", "DOE_Ref_1980_2004", "DOE_Ref_Pre_1980"
]

HVAC_ECONOMIZER_TYPES = [
    "NoEconomizer", "DifferentialDryBulb", "DifferentialEnthalpy",
    "DifferentialDryBulbAndEnthalpy", "FixedDryBulb", "FixedEnthalpy"
]

HVAC_RADIANT_TYPES = ["Floor", "Ceiling", "FloorWithCarpet", "CeilingMetalPanel"]

HVAC_QUICK_PRESETS = {
    "Office Standard": {
        "category": "All-Air: VAV",
        "equipment_type": "VAV_Chiller_Boiler",
        "vintage": "ASHRAE_2019",
        "economizer": "DifferentialDryBulb",
        "sensible_hr": 0.0,
        "latent_hr": 0.0,
        "dcv": False,
    },
    "Office High-Eff": {
        "category": "DOAS + FCU",
        "equipment_type": "DOAS_FCU_Chiller_Boiler",
        "vintage": "ASHRAE_2019",
        "economizer": "NoEconomizer",
        "sensible_hr": 0.7,
        "latent_hr": 0.65,
        "dcv": True,
    },
    "Retail": {
        "category": "All-Air: PSZ",
        "equipment_type": "PSZAC_GasCoil",
        "vintage": "ASHRAE_2019",
        "economizer": "DifferentialDryBulb",
        "sensible_hr": 0.0,
        "latent_hr": 0.0,
        "dcv": False,
    },
    "Residential": {
        "category": "HeatCool: Residential",
        "equipment_type": "ResidentialHP",
        "vintage": "ASHRAE_2019",
        "economizer": "NoEconomizer",
        "sensible_hr": 0.0,
        "latent_hr": 0.0,
        "dcv": False,
    },
    "Lab High-Vent": {
        "category": "All-Air: VAV",
        "equipment_type": "VAV_Chiller_Boiler",
        "vintage": "ASHRAE_2019",
        "economizer": "NoEconomizer",
        "sensible_hr": 0.7,
        "latent_hr": 0.65,
        "dcv": False,
    },
    "Hospital": {
        "category": "All-Air: VAV",
        "equipment_type": "VAV_Chiller_Boiler",
        "vintage": "ASHRAE_2019",
        "economizer": "NoEconomizer",
        "sensible_hr": 0.0,
        "latent_hr": 0.0,
        "dcv": False,
    },
    "Radiant High-Eff": {
        "category": "DOAS + Radiant",
        "equipment_type": "DOAS_Radiant_Chiller_Boiler",
        "vintage": "ASHRAE_2019",
        "economizer": "NoEconomizer",
        "sensible_hr": 0.75,
        "latent_hr": 0.7,
        "dcv": True,
        "radiant_type": "Floor",
    },
}

# Building type presets for simplified HVAC module
HVAC_BUILDING_PRESETS = {
    "Office - Standard": {
        "description": "VAV system with chiller/boiler",
        "class": "VAV",
        "equipment_type": "VAV_Chiller_Boiler",
        "vintage": "ASHRAE_2019",
        "economizer_type": "DifferentialDryBulb",
        "sensible_heat_recovery": 0.0,
        "latent_heat_recovery": 0.0,
        "demand_controlled_ventilation": True,
    },
    "Office - High Efficiency": {
        "description": "DOAS + FCU with heat recovery",
        "class": "FCUwithDOAS",
        "equipment_type": "DOAS_FCU_Chiller_Boiler",
        "vintage": "ASHRAE_2019",
        "economizer_type": "NoEconomizer",
        "sensible_heat_recovery": 0.7,
        "latent_heat_recovery": 0.65,
        "demand_controlled_ventilation": True,
    },
    "Residential": {
        "description": "Residential heat pump",
        "class": "Residential",
        "equipment_type": "ResidentialHP",
        "vintage": "ASHRAE_2019",
        "economizer_type": "NoEconomizer",
        "sensible_heat_recovery": 0.0,
        "latent_heat_recovery": 0.0,
        "demand_controlled_ventilation": False,
    },
    "Retail": {
        "description": "Packaged rooftop units",
        "class": "PSZ",
        "equipment_type": "PSZAC_GasCoil",
        "vintage": "ASHRAE_2019",
        "economizer_type": "DifferentialDryBulb",
        "sensible_heat_recovery": 0.0,
        "latent_heat_recovery": 0.0,
        "demand_controlled_ventilation": False,
    },
    "Hotel": {
        "description": "DOAS + FCU for guest rooms",
        "class": "FCUwithDOAS",
        "equipment_type": "DOAS_FCU_Chiller_Boiler",
        "vintage": "ASHRAE_2019",
        "economizer_type": "NoEconomizer",
        "sensible_heat_recovery": 0.6,
        "latent_heat_recovery": 0.5,
        "demand_controlled_ventilation": True,
    },
    "School": {
        "description": "DOAS + VRF for classrooms",
        "class": "VRFwithDOAS",
        "equipment_type": "DOAS_VRF",
        "vintage": "ASHRAE_2019",
        "economizer_type": "NoEconomizer",
        "sensible_heat_recovery": 0.6,
        "latent_heat_recovery": 0.5,
        "demand_controlled_ventilation": True,
    },
    "Hospital": {
        "description": "VAV with high ventilation",
        "class": "VAV",
        "equipment_type": "VAV_Chiller_Boiler",
        "vintage": "ASHRAE_2019",
        "economizer_type": "NoEconomizer",
        "sensible_heat_recovery": 0.7,
        "latent_heat_recovery": 0.65,
        "demand_controlled_ventilation": False,
    },
    "Ideal Air (Loads Only)": {
        "description": "Perfect HVAC for load calculations",
        "class": "IdealAirSystem",
        "equipment_type": "IdealAirSystem",
        "vintage": "ASHRAE_2019",
        "economizer_type": "NoEconomizer",
        "sensible_heat_recovery": 0.0,
        "latent_heat_recovery": 0.0,
        "demand_controlled_ventilation": False,
    },
}

HVAC_DEFAULT_KEY = "GDS_HVAC_DEFAULT"

# --- PHOTOVOLTAIC PRESETS ---
PV_PRESETS = {
    "Standard Silicon": {
        "description": "Typical poly/mono-crystalline (14-17% eff)",
        "efficiency": 0.15,
        "module_type": "Standard",
        "mounting": "FixedOpenRack",
        "loss_fraction": 0.14,
        "tracking_gcr": 0.4,
    },
    "Premium Silicon": {
        "description": "High-efficiency mono-crystalline (18-20% eff)",
        "efficiency": 0.19,
        "module_type": "Premium", 
        "mounting": "FixedOpenRack",
        "loss_fraction": 0.12,
        "tracking_gcr": 0.4,
    },
    "Thin Film": {
        "description": "Amorphous silicon or CdTe (<12% eff)",
        "efficiency": 0.10,
        "module_type": "ThinFilm",
        "mounting": "FixedOpenRack",
        "loss_fraction": 0.16,
        "tracking_gcr": 0.4,
    },
    "BIPV Facade": {
        "description": "Building-integrated on vertical facade",
        "efficiency": 0.12,
        "module_type": "Standard",
        "mounting": "FixedRoofMounted",
        "loss_fraction": 0.18,
        "tracking_gcr": 0.4,
    },
    "Roof Flush Mount": {
        "description": "Panels flush with roof surface",
        "efficiency": 0.16,
        "module_type": "Standard",
        "mounting": "FixedRoofMounted",
        "loss_fraction": 0.15,
        "tracking_gcr": 0.4,
    },
    "Single-Axis Tracker": {
        "description": "Ground-mount with E-W tracking",
        "efficiency": 0.17,
        "module_type": "Premium",
        "mounting": "OneAxis",
        "loss_fraction": 0.12,
        "tracking_gcr": 0.4,
    },
    "Dual-Axis Tracker": {
        "description": "Full sun tracking (highest yield)",
        "efficiency": 0.18,
        "module_type": "Premium",
        "mounting": "TwoAxis",
        "loss_fraction": 0.10,
        "tracking_gcr": 0.4,
    },
}

PV_MODULE_TYPES = ['Standard', 'Premium', 'ThinFilm']
PV_MOUNTING_TYPES = ['FixedOpenRack', 'FixedRoofMounted', 'OneAxis', 
                     'OneAxisBacktracking', 'TwoAxis']

# --- BATTERY PRESETS ---
BATTERY_PRESETS = {
    "Residential Small (5 kWh)": {
        "capacity_kwh": 5,
        "power_kw": 3.8,
        "efficiency": 0.89,
    },
    "Residential Medium (13.5 kWh)": {
        "capacity_kwh": 13.5,
        "power_kw": 5.0,
        "efficiency": 0.90,
    },
    "Residential Large (20 kWh)": {
        "capacity_kwh": 20,
        "power_kw": 10.0,
        "efficiency": 0.90,
    },
    "Commercial Small (50 kWh)": {
        "capacity_kwh": 50,
        "power_kw": 25,
        "efficiency": 0.88,
    },
    "Commercial Medium (200 kWh)": {
        "capacity_kwh": 200,
        "power_kw": 100,
        "efficiency": 0.88,
    },
}

# --- WIND TURBINE PRESETS ---
WIND_PRESETS = {
    "Micro Turbine (1 kW)": {
        "rated_power_kw": 1.0,
        "rotor_diameter_m": 2.5,
        "hub_height_m": 10,
    },
    "Small Turbine (5 kW)": {
        "rated_power_kw": 5.0,
        "rotor_diameter_m": 5.0,
        "hub_height_m": 18,
    },
    "Medium Turbine (10 kW)": {
        "rated_power_kw": 10.0,
        "rotor_diameter_m": 7.0,
        "hub_height_m": 25,
    },
    "VAWT Rooftop (2 kW)": {
        "rated_power_kw": 2.0,
        "rotor_diameter_m": 2.0,
        "hub_height_m": 5,
    },
}

# --- SOLAR HOT WATER PRESETS ---
SOLHW_PRESETS = {
    "Flat Plate - Standard": {
        "efficiency": 0.50,
        "collector_type": "FlatPlate",
    },
    "Flat Plate - Premium": {
        "efficiency": 0.65,
        "collector_type": "FlatPlate",
    },
    "Evacuated Tube": {
        "efficiency": 0.55,
        "collector_type": "TubularEvacuated",
    },
}

# --- GDS SCHEDULE/PROGRAM PARSER ---
class GDSScheduleParser:
    """Parse GDS module database for schedules and program types"""
    
    def __init__(self, json_path=None):
        self.json_path = json_path
        self.schedules = {}
        self.setpoints = {}
        self.programs = {}
        self.intensities = {}
        
        if json_path:
            self._load_and_parse()
    
    def _load_and_parse(self):
        """Load and parse GDS JSON database"""
        try:
            with open(self.json_path, 'r') as f:
                data = json.load(f)
            
            modules = data.get('modules', {})
            
            # Temporary raw storage for schedule grouping
            self._raw_schedule_entries = {}
            
            for module_key, module_data in modules.items():
                if module_key.startswith('schedule.'):
                    self._parse_schedule_module(module_key, module_data)
                elif module_key.startswith('program.') or module_key.startswith('space_type.'):
                    self._parse_program_module(module_key, module_data)
                elif module_key.startswith('loads.'):
                    self._parse_loads_module(module_key, module_data)
            
            # Post-processing: resolve seasonal groups from # convention
            self._resolve_seasonal_groups()
                    
        except Exception as e:
            print("GDS Schedule Parser error: {}".format(e))
    
    def _parse_schedule_module(self, module_key, module_data):
        """Parse a schedule module from GDS JSON into raw storage.
        
        Seasonal convention:
            schedule.XX       — standalone or base (default) schedule
            schedule.XX#1     — seasonal override #1 (must have start_date/end_date)
            schedule.XX#2     — seasonal override #2
            ...
        If no #-suffixed companions exist, the base works as a plain entry.
        If companions exist, they are composed into a single seasonal schedule.
        """
        short_key = module_key.replace('schedule.', '')
        meta = module_data.get('meta', {})
        display_name = meta.get('display_name', short_key)
        
        design = module_data.get('design', {})
        
        hourly = design.get('hourly_values', [])
        if not hourly:
            hourly = design.get('values', [])
        
        if hourly and len(hourly) == 24:
            schedule_type = design.get('schedule_type', 'fractional')
            
            entry = {
                'module_key': module_key,
                'identifier': short_key,
                'display_name': display_name,
                'values': hourly,
                'type': schedule_type,
                'weekend_values': design.get('weekend_values', hourly),
                'start_date': design.get('start_date', None),
                'end_date': design.get('end_date', None),
                'label': meta.get('description', display_name),
            }
            
            # Store by short_key (preserves #suffix)
            self._raw_schedule_entries[short_key] = entry
    
    def _resolve_seasonal_groups(self):
        """Group #-suffixed schedule entries into seasonal composites.
        
        Logic:
          1. Split each key on '#': base_name and suffix (if any).
          2. Entries with no '#' and no companions are standalone — stored as-is.
          3. If companions (same base, different #suffix) exist:
             - The entry with no suffix or #0 is the BASE (default/fallback).
             - Entries with #1, #2, ... are OVERRIDES (must have start_date + end_date).
             - The composed entry gets a 'seasonal_rules' list.
             - Only the BASE display_name appears in dropdown (with [S] appended by UI).
          4. Validation: overrides without dates raise a warning.
        """
        # Group by base name
        groups = {}  # base_name -> {'base': entry_or_None, 'overrides': [entries]}
        
        for short_key, entry in self._raw_schedule_entries.items():
            if '#' in short_key:
                parts = short_key.split('#', 1)
                base_name = parts[0]
                suffix = parts[1]
            else:
                base_name = short_key
                suffix = None
            
            if base_name not in groups:
                groups[base_name] = {'base': None, 'overrides': []}
            
            if suffix is None or suffix == '0':
                groups[base_name]['base'] = entry
            else:
                entry['_suffix'] = suffix
                groups[base_name]['overrides'].append(entry)
        
        # Resolve each group
        for base_name, group in groups.items():
            base = group['base']
            overrides = group['overrides']
            
            if not overrides:
                # --- Standalone entry (no companions) — store as-is ---
                if base is None:
                    continue
                self._store_schedule_entry(base, seasonal_rules=None)
            else:
                # --- Seasonal group ---
                if base is None:
                    # No base found — use the first override as base and warn
                    print("GDS Schedule Warning: seasonal group '{}' has no base "
                          "entry (schedule.{} or schedule.{}#0). Using first override "
                          "as default.".format(base_name, base_name, base_name))
                    base = overrides.pop(0)
                
                # Validate overrides: each must have start_date and end_date
                valid_overrides = []
                for ovr in overrides:
                    if ovr['start_date'] and ovr['end_date']:
                        valid_overrides.append(ovr)
                    else:
                        print("GDS Schedule Warning: override '{}' missing start_date/"
                              "end_date — skipped.".format(ovr['identifier']))
                
                # Check for date range overlaps (advisory only)
                self._check_date_overlaps(base_name, valid_overrides)
                
                # Build seasonal_rules list
                seasonal_rules = []
                for ovr in valid_overrides:
                    seasonal_rules.append({
                        'label': ovr.get('_suffix', ovr['display_name']),
                        'weekday_values': ovr['values'],
                        'weekend_values': ovr['weekend_values'],
                        'start_date': ovr['start_date'],
                        'end_date': ovr['end_date'],
                    })
                
                self._store_schedule_entry(base, seasonal_rules=seasonal_rules)
        
        # Clean up temporary storage
        del self._raw_schedule_entries
    
    def _store_schedule_entry(self, entry, seasonal_rules=None):
        """Store a resolved schedule entry into self.schedules or self.setpoints."""
        display_name = entry['display_name']
        schedule_type = entry['type']
        
        data = {
            'identifier': entry['identifier'],
            'values': entry['values'],
            'type': schedule_type,
            'weekend_values': entry['weekend_values'],
        }
        
        if seasonal_rules:
            data['seasonal_rules'] = seasonal_rules
            data['is_seasonal'] = True
        
        if schedule_type in ['temperature', 'setpoint']:
            self.setpoints[display_name] = data
        else:
            self.schedules[display_name] = data
    
    def _check_date_overlaps(self, base_name, overrides):
        """Advisory check for date range overlaps between overrides."""
        if len(overrides) < 2:
            return
        
        def to_doy(md):
            """Approximate month-day to day-of-year."""
            month_days = [0, 31, 59, 90, 120, 151, 181, 212, 243, 273, 304, 334]
            return month_days[md[0] - 1] + md[1]
        
        # Expand ranges (handle cross-year by splitting)
        ranges = []
        for ovr in overrides:
            sd, ed = ovr['start_date'], ovr['end_date']
            s_doy, e_doy = to_doy(sd), to_doy(ed)
            if s_doy <= e_doy:
                ranges.append((s_doy, e_doy, ovr.get('_suffix', '?')))
            else:
                # Cross-year: Dec→Jan
                ranges.append((s_doy, 365, ovr.get('_suffix', '?')))
                ranges.append((1, e_doy, ovr.get('_suffix', '?')))
        
        # Sort and check pairwise overlap
        ranges.sort()
        for i in range(len(ranges) - 1):
            if ranges[i][1] >= ranges[i + 1][0]:
                print("GDS Schedule Warning: date overlap in seasonal group '{}' "
                      "between #{} and #{}.".format(
                          base_name, ranges[i][2], ranges[i + 1][2]))
    
    def _parse_program_module(self, module_key, module_data):
        """Parse a program type module from GDS JSON"""
        short_key = module_key.replace('program.', '').replace('space_type.', '')
        meta = module_data.get('meta', {})
        display_name = meta.get('display_name', short_key)
        
        design = module_data.get('design', {})
        
        program_dict = {
            'identifier': short_key,
            'display_name': display_name,
        }
        
        people = design.get('people', {})
        if people:
            program_dict['people'] = {
                'people_per_area': people.get('people_per_area', 0.0565),
                'occupancy_schedule': people.get('occupancy_schedule', 'Office Weekday'),
                'activity_schedule': people.get('activity_schedule', 'Office Seated'),
            }
        
        lighting = design.get('lighting', {})
        if lighting:
            program_dict['lighting'] = {
                'watts_per_area': lighting.get('watts_per_area', 10.76),
                'schedule': lighting.get('schedule', 'Office Weekday'),
            }
        
        equipment = design.get('electric_equipment', design.get('equipment', {}))
        if equipment:
            program_dict['electric_equipment'] = {
                'watts_per_area': equipment.get('watts_per_area', 10.76),
                'schedule': equipment.get('schedule', 'Office Weekday'),
            }
        
        infiltration = design.get('infiltration', {})
        if infiltration:
            program_dict['infiltration'] = {
                'flow_per_exterior_area': infiltration.get('flow_per_exterior_area', 0.0003),
                'schedule': infiltration.get('schedule', 'Always On'),
            }
        
        ventilation = design.get('ventilation', {})
        if ventilation:
            program_dict['ventilation'] = {
                'outdoor_air_per_person': ventilation.get('outdoor_air_per_person', 0.006),
                'outdoor_air_per_area': ventilation.get('outdoor_air_per_area', 0.0003),
            }
        
        setpoint = design.get('setpoint', {})
        if setpoint:
            program_dict['setpoint'] = {
                'heating_schedule': setpoint.get('heating_schedule', 'Office Heating'),
                'cooling_schedule': setpoint.get('cooling_schedule', 'Office Cooling'),
            }
        
        self.programs[display_name] = program_dict
    
    def _parse_loads_module(self, module_key, module_data):
        """Parse a loads intensity module from GDS JSON"""
        short_key = module_key.replace('loads.', '')
        meta = module_data.get('meta', {})
        display_name = meta.get('display_name', short_key)
        
        design = module_data.get('design', {})
        
        self.intensities[display_name] = {
            'people_per_area': design.get('people_per_area', 0.0565),
            'lighting_power': design.get('lighting_power', design.get('watts_per_area_lighting', 10.76)),
            'equipment_power': design.get('equipment_power', design.get('watts_per_area_equipment', 10.76)),
            'infiltration_rate': design.get('infiltration_rate', design.get('flow_per_exterior_area', 0.0003)),
            'ventilation_per_person': design.get('ventilation_per_person', design.get('outdoor_air_per_person', 0.006)),
            'ventilation_per_area': design.get('ventilation_per_area', design.get('outdoor_air_per_area', 0.0003)),
            # Service Hot Water
            'shw_flow_per_area': design.get('shw_flow_per_area', 0.0),
            'shw_target_temp': design.get('shw_target_temp', 49.0),
        }
    
    def get_schedule_values(self, display_name):
        """Get 24-hour values for a schedule by display name"""
        if display_name in self.schedules:
            return self.schedules[display_name]['values']
        return None
    
    def get_schedule_full_data(self, display_name):
        """Get full schedule data including seasonal_rules if present.
        
        Returns dict with 'values', 'weekend_values', and optionally
        'seasonal_rules' (list of override dicts). Returns None if not found.
        """
        if display_name in self.schedules:
            return self.schedules[display_name]
        return None
    
    def get_setpoint_full_data(self, display_name):
        """Get full setpoint data including seasonal_rules if present."""
        if display_name in self.setpoints:
            return self.setpoints[display_name]
        return None
    
    def is_seasonal(self, display_name):
        """Check if a schedule is seasonal (has #-override companions)."""
        data = self.schedules.get(display_name) or self.setpoints.get(display_name)
        return data.get('is_seasonal', False) if data else False
    
    def get_setpoint_values(self, display_name):
        """Get 24-hour values for a setpoint schedule by display name"""
        if display_name in self.setpoints:
            return self.setpoints[display_name]['values']
        return None

# --- HB LIBRARY LOADERS ---
def load_hb_library_programs():
    """Load ProgramType identifiers from HB library"""
    programs = []
    try:
        from honeybee_energy.lib.programtypes import PROGRAM_TYPES
        programs = sorted(list(PROGRAM_TYPES))
    except Exception as e:
        pass
    return programs

def load_hb_library_schedules():
    """Load Schedule identifiers from HB library"""
    schedules = []
    try:
        from honeybee_energy.lib.schedules import SCHEDULES
        schedules = sorted(list(SCHEDULES))
    except Exception as e:
        pass
    return schedules

def get_hb_program_by_id(program_id):
    """Get a ProgramType object from HB library by identifier"""
    try:
        from honeybee_energy.lib.programtypes import program_type_by_identifier
        return program_type_by_identifier(program_id)
    except Exception as e:
        return None

def get_hb_schedule_by_id(schedule_id):
    """Get a ScheduleRuleset object from HB library by identifier"""
    try:
        from honeybee_energy.lib.schedules import schedule_by_identifier
        return schedule_by_identifier(schedule_id)
    except Exception as e:
        return None

# --- PROGRAM DATA CLASS ---
class GDSProgramData:
    """Holds all program type data for a space - outputs FULL format for HB String to Object"""
    
    def __init__(self, identifier="GDS_Custom_Program"):
        self.identifier = identifier
        
        self.people_per_area = 0.0565
        self.lighting_power = 10.76
        self.equipment_power = 10.76
        self.gas_equipment_power = 0.0
        self.infiltration_rate = 0.0003
        self.ventilation_per_person = 0.006
        self.ventilation_per_area = 0.0003
        
        # Service Hot Water
        self.shw_flow_per_area = 0.0        # L/h/m² (0 = disabled)
        self.shw_target_temp = 49.0         # °C
        self.shw_sensible_fraction = 0.2
        self.shw_latent_fraction = 0.05
        self.shw_schedule = "Residential"
        
        self.occupancy_schedule = "Office Weekday"
        self.occupancy_weekend = "Office Weekend"
        self.activity_schedule = "Office Seated"
        self.lighting_schedule = "Office Weekday"
        self.equipment_schedule = "Office Weekday"
        self.infiltration_schedule = "Always On"
        self.heating_setpoint = "Office Heating"
        self.cooling_setpoint = "Office Cooling"
        
        self.custom_schedules = {}
    
    def get_schedule_values(self, schedule_name, is_setpoint=False, gds_parser=None):
        if schedule_name.startswith("Custom:"):
            key = schedule_name[7:]
            if key in self.custom_schedules:
                return self.custom_schedules[key]
            return [0]*24
        
        if schedule_name.startswith("[GDS] "):
            name = schedule_name[6:]
            if name.endswith(" [S]"):
                name = name[:-4]
            if gds_parser:
                if is_setpoint:
                    return gds_parser.get_setpoint_values(name)
                else:
                    return gds_parser.get_schedule_values(name)
            return None
        
        if schedule_name.startswith("[HB] "):
            hb_id = schedule_name[5:]
            schedule = get_hb_schedule_by_id(hb_id)
            if schedule:
                try:
                    return schedule.values()[0:24] if hasattr(schedule, 'values') else None
                except:
                    return None
            return None
        
        if is_setpoint:
            return SETPOINT_PRESETS.get(schedule_name, [21]*24)
        elif "Activity" in schedule_name or schedule_name in ACTIVITY_PRESETS:
            return ACTIVITY_PRESETS.get(schedule_name, [120]*24)
        else:
            return SCHEDULE_PRESETS.get(schedule_name, [0]*24)
    
    def _make_schedule_full(self, name, weekday_vals, weekend_vals=None,
                            type_limit="Fractional", seasonal_rules=None):
        """Create ScheduleRuleset dict for JSON serialization.
        
        Args:
            name: Schedule identifier string.
            weekday_vals: 24 hourly values for weekday.
            weekend_vals: 24 hourly values for weekend/default.
            type_limit: "Fractional", "Temperature", or "ActivityLevel".
            seasonal_rules: Optional list of seasonal override dicts from parser.
                Each dict: label, weekday_values, weekend_values, start_date, end_date.
                If provided, base weekday/weekend become the default and each
                override becomes a date-bounded ScheduleRule pair (WD + WE).
        """
        # Type limit definitions
        type_limits = {
            "Fractional": {"type": "ScheduleTypeLimit", "identifier": "Fractional", 
                          "lower_limit": 0, "upper_limit": 1, "numeric_type": "Continuous", "unit_type": "Dimensionless"},
            "Temperature": {"type": "ScheduleTypeLimit", "identifier": "Temperature",
                           "lower_limit": -273.15, "upper_limit": 200, "numeric_type": "Continuous", "unit_type": "Temperature"},
            "ActivityLevel": {"type": "ScheduleTypeLimit", "identifier": "Activity Level",
                             "lower_limit": 0, "upper_limit": 1000, "numeric_type": "Continuous", "unit_type": "ActivityLevel"},
        }
        
        if weekend_vals is None:
            weekend_vals = weekday_vals
        weekday_vals = [float(v) for v in weekday_vals]
        weekend_vals = [float(v) for v in weekend_vals]
        times_24 = [[i, 0] for i in range(24)]
        
        # --- Non-seasonal path (backward compatible) ---
        if not seasonal_rules:
            default_day_id = "{}_Default".format(name)
            weekday_day_id = "{}_Weekday".format(name)
            return {
                "type": "ScheduleRuleset",
                "identifier": name,
                "schedule_type_limit": type_limits.get(type_limit, type_limits["Fractional"]),
                "day_schedules": [
                    {"type": "ScheduleDay", "identifier": default_day_id,
                     "values": weekend_vals, "times": times_24},
                    {"type": "ScheduleDay", "identifier": weekday_day_id,
                     "values": weekday_vals, "times": times_24}
                ],
                "default_day_schedule": default_day_id,
                "schedule_rules": [{
                    "type": "ScheduleRuleAbridged",
                    "schedule_day": weekday_day_id,
                    "apply_sunday": False, "apply_monday": True,
                    "apply_tuesday": True, "apply_wednesday": True,
                    "apply_thursday": True, "apply_friday": True,
                    "apply_saturday": False,
                    "start_date": [1, 1], "end_date": [12, 31]
                }]
            }
        
        # --- Seasonal path: multiple date-bounded rules ---
        day_schedules = []
        schedule_rules = []
        seen_day_ids = set()
        
        # Base weekend values serve as the default (fallback for uncovered dates)
        default_day_id = "{}_Default".format(name)
        day_schedules.append({
            "type": "ScheduleDay", "identifier": default_day_id,
            "values": weekend_vals, "times": times_24
        })
        
        # Base weekday also needs a rule for dates NOT covered by overrides.
        # The default_day_schedule handles weekends/uncovered; we add a
        # year-spanning base weekday rule at lowest priority (appended last).
        base_wd_id = "{}_Base_WD".format(name)
        day_schedules.append({
            "type": "ScheduleDay", "identifier": base_wd_id,
            "values": weekday_vals, "times": times_24
        })
        
        # Override rules (higher priority — added first so HB evaluates them first)
        for rule in seasonal_rules:
            label = str(rule['label'])
            wd_vals = [float(v) for v in rule['weekday_values']]
            we_vals = [float(v) for v in rule['weekend_values']]
            
            wd_day_id = "{}_{}_WD".format(name, label)
            if wd_day_id not in seen_day_ids:
                day_schedules.append({
                    "type": "ScheduleDay", "identifier": wd_day_id,
                    "values": wd_vals, "times": times_24
                })
                seen_day_ids.add(wd_day_id)
            
            we_day_id = "{}_{}_WE".format(name, label)
            if we_day_id not in seen_day_ids:
                day_schedules.append({
                    "type": "ScheduleDay", "identifier": we_day_id,
                    "values": we_vals, "times": times_24
                })
                seen_day_ids.add(we_day_id)
            
            # Auto-split cross-year-boundary ranges (e.g. [12,1]→[1,31])
            # HB does start_doy <= doy <= end_doy — fails when start > end
            start = rule['start_date']
            end = rule['end_date']
            if start[0] > end[0]:
                date_ranges = [(start, [12, 31]), ([1, 1], end)]
            else:
                date_ranges = [(start, end)]
            
            for dr_start, dr_end in date_ranges:
                schedule_rules.append({
                    "type": "ScheduleRuleAbridged",
                    "schedule_day": wd_day_id,
                    "apply_sunday": False, "apply_monday": True,
                    "apply_tuesday": True, "apply_wednesday": True,
                    "apply_thursday": True, "apply_friday": True,
                    "apply_saturday": False,
                    "start_date": dr_start, "end_date": dr_end
                })
                schedule_rules.append({
                    "type": "ScheduleRuleAbridged",
                    "schedule_day": we_day_id,
                    "apply_sunday": True, "apply_monday": False,
                    "apply_tuesday": False, "apply_wednesday": False,
                    "apply_thursday": False, "apply_friday": False,
                    "apply_saturday": True,
                    "start_date": dr_start, "end_date": dr_end
                })
        
        # Base weekday rule — covers any dates not claimed by overrides
        schedule_rules.append({
            "type": "ScheduleRuleAbridged",
            "schedule_day": base_wd_id,
            "apply_sunday": False, "apply_monday": True,
            "apply_tuesday": True, "apply_wednesday": True,
            "apply_thursday": True, "apply_friday": True,
            "apply_saturday": False,
            "start_date": [1, 1], "end_date": [12, 31]
        })
        
        return {
            "type": "ScheduleRuleset",
            "identifier": name,
            "schedule_type_limit": type_limits.get(type_limit, type_limits["Fractional"]),
            "day_schedules": day_schedules,
            "default_day_schedule": default_day_id,
            "schedule_rules": schedule_rules
        }
    
    def _get_seasonal_rules(self, schedule_name, gds_parser, is_setpoint=False):
        """Get seasonal_rules for a GDS schedule if it has # companions.
        Returns list of rule dicts, or None for non-seasonal schedules.
        """
        if not gds_parser or not schedule_name.startswith("[GDS] "):
            return None
        name = schedule_name[6:]
        if name.endswith(" [S]"):
            name = name[:-4]
        if is_setpoint:
            data = gds_parser.get_setpoint_full_data(name)
        else:
            data = gds_parser.get_schedule_full_data(name)
        if data and data.get('is_seasonal'):
            return data.get('seasonal_rules')
        return None
    
    def to_program_dict(self, gds_parser=None):
        """Generate FULL ProgramType JSON - works directly with HB Load Objects"""
        base_id = self.identifier.replace(" ", "_")
        
        occ_wd = self.get_schedule_values(self.occupancy_schedule, gds_parser=gds_parser)
        if occ_wd is None:
            occ_wd = SCHEDULE_PRESETS.get("Office Weekday", [0]*24)
        occ_we = self.get_schedule_values(self.occupancy_weekend, gds_parser=gds_parser)
        if occ_we is None:
            occ_we = SCHEDULE_PRESETS.get("Office Weekend", occ_wd)
        occ_seasonal = self._get_seasonal_rules(self.occupancy_schedule, gds_parser)
        occ_sched = self._make_schedule_full("{}_Occupancy".format(base_id), occ_wd, occ_we, "Fractional", occ_seasonal)
        
        act_vals = self.get_schedule_values(self.activity_schedule, gds_parser=gds_parser)
        if act_vals is None:
            act_vals = ACTIVITY_PRESETS.get("Office Seated", [120]*24)
        act_sched = self._make_schedule_full("{}_Activity".format(base_id), act_vals, act_vals, "ActivityLevel")
        
        light_vals = self.get_schedule_values(self.lighting_schedule, gds_parser=gds_parser)
        if light_vals is None:
            light_vals = SCHEDULE_PRESETS.get("Office Weekday", [0]*24)
        light_seasonal = self._get_seasonal_rules(self.lighting_schedule, gds_parser)
        light_sched = self._make_schedule_full("{}_Lighting".format(base_id), light_vals, [v*0.1 for v in light_vals], "Fractional", light_seasonal)
        
        equip_vals = self.get_schedule_values(self.equipment_schedule, gds_parser=gds_parser)
        if equip_vals is None:
            equip_vals = SCHEDULE_PRESETS.get("Office Weekday", [0]*24)
        equip_seasonal = self._get_seasonal_rules(self.equipment_schedule, gds_parser)
        equip_sched = self._make_schedule_full("{}_Equipment".format(base_id), equip_vals, [v*0.3 for v in equip_vals], "Fractional", equip_seasonal)
        
        infil_vals = self.get_schedule_values(self.infiltration_schedule, gds_parser=gds_parser)
        if infil_vals is None:
            infil_vals = [1.0]*24
        infil_seasonal = self._get_seasonal_rules(self.infiltration_schedule, gds_parser)
        infil_sched = self._make_schedule_full("{}_Infiltration".format(base_id), infil_vals, infil_vals, "Fractional", infil_seasonal)
        
        vent_sched = self._make_schedule_full("{}_Ventilation".format(base_id), occ_wd, [0]*24, "Fractional")
        
        heat_vals = self.get_schedule_values(self.heating_setpoint, is_setpoint=True, gds_parser=gds_parser)
        if heat_vals is None:
            heat_vals = SETPOINT_PRESETS.get("Office Heating", [21]*24)
        heat_seasonal = self._get_seasonal_rules(self.heating_setpoint, gds_parser, is_setpoint=True)
        heat_sched = self._make_schedule_full("{}_Heating".format(base_id), heat_vals, [v-2 for v in heat_vals], "Temperature", heat_seasonal)
        
        cool_vals = self.get_schedule_values(self.cooling_setpoint, is_setpoint=True, gds_parser=gds_parser)
        if cool_vals is None:
            cool_vals = SETPOINT_PRESETS.get("Office Cooling", [24]*24)
        cool_seasonal = self._get_seasonal_rules(self.cooling_setpoint, gds_parser, is_setpoint=True)
        cool_sched = self._make_schedule_full("{}_Cooling".format(base_id), cool_vals, [v+2 for v in cool_vals], "Temperature", cool_seasonal)
        
        program = {
            "type": "ProgramType",
            "identifier": base_id,
            "display_name": self.identifier,
            
            "people": {
                "type": "People",
                "identifier": "{}_People".format(base_id),
                "people_per_area": self.people_per_area,
                "occupancy_schedule": occ_sched,
                "activity_schedule": act_sched,
                "radiant_fraction": 0.3,
                "latent_fraction": {"type": "Autocalculate"}
            },
            
            "lighting": {
                "type": "Lighting",
                "identifier": "{}_Lighting".format(base_id),
                "watts_per_area": self.lighting_power,
                "schedule": light_sched,
                "visible_fraction": 0.25,
                "radiant_fraction": 0.32,
                "return_air_fraction": 0.0
            },
            
            "electric_equipment": {
                "type": "ElectricEquipment",
                "identifier": "{}_ElecEquip".format(base_id),
                "watts_per_area": self.equipment_power,
                "schedule": equip_sched,
                "radiant_fraction": 0.5,
                "latent_fraction": 0.0,
                "lost_fraction": 0.0
            },
            
            "infiltration": {
                "type": "Infiltration",
                "identifier": "{}_Infiltration".format(base_id),
                "flow_per_exterior_area": self.infiltration_rate,
                "schedule": infil_sched,
                "constant_coefficient": 1.0,
                "temperature_coefficient": 0.0,
                "velocity_coefficient": 0.0
            },
            
            "ventilation": {
                "type": "Ventilation",
                "identifier": "{}_Ventilation".format(base_id),
                "flow_per_person": self.ventilation_per_person,
                "flow_per_area": self.ventilation_per_area,
                "air_changes_per_hour": 0.0,
                "schedule": vent_sched
            },
            
            "setpoint": {
                "type": "Setpoint",
                "identifier": "{}_Setpoint".format(base_id),
                "heating_schedule": heat_sched,
                "cooling_schedule": cool_sched
            }
        }
        
        if self.gas_equipment_power > 0:
            program["gas_equipment"] = {
                "type": "GasEquipment",
                "identifier": "{}_GasEquip".format(base_id),
                "watts_per_area": self.gas_equipment_power,
                "schedule": equip_sched,
                "radiant_fraction": 0.3,
                "latent_fraction": 0.0,
                "lost_fraction": 0.0
            }
        
        # Service Hot Water (only if flow > 0)
        if self.shw_flow_per_area > 0:
            shw_vals = self.get_schedule_values(self.shw_schedule, gds_parser=gds_parser)
            if shw_vals is None:
                shw_vals = SCHEDULE_PRESETS.get("Residential", [0.5]*24)
            shw_sched = self._make_schedule_full("{}_SHW".format(base_id), shw_vals, shw_vals, "Fractional",
                                                   self._get_seasonal_rules(self.shw_schedule, gds_parser))
            
            program["service_hot_water"] = {
                "type": "ServiceHotWater",
                "identifier": "{}_SHW".format(base_id),
                "flow_per_area": self.shw_flow_per_area,
                "schedule": shw_sched,
                "target_temperature": self.shw_target_temp,
                "sensible_fraction": self.shw_sensible_fraction,
                "latent_fraction": self.shw_latent_fraction
            }
        
        return program

# --------------------------- helpers -----------------------------------------
def schedule(action):
    def cb(doc):
        try:
            action()
        except Exception as e:
            print("Schedule error: {}".format(e))
    if DOC:
        DOC.ScheduleSolution(1, gk.GH_Document.GH_ScheduleDelegate(cb))

def find_objs(type_name, nickname):
    hits = []
    if not DOC:
        return hits
    try:
        for obj in DOC.Objects:
            if obj and obj.NickName == nickname and obj.GetType().Name == type_name:
                hits.append(obj)
    except:
        pass
    return hits

def get_breps_from_param(nickname):
    breps = []
    if not DOC:
        return breps
    
    for obj in DOC.Objects:
        try:
            if obj.NickName != nickname:
                continue
            if "Brep" not in obj.GetType().Name:
                continue
            
            if hasattr(obj, 'VolatileData') and obj.VolatileData is not None:
                vd = obj.VolatileData
                if not vd.IsEmpty:
                    for path in vd.Paths:
                        branch = vd.get_Branch(path)
                        if branch:
                            for item in branch:
                                geom = None
                                if hasattr(item, 'Value'):
                                    geom = item.Value
                                if geom and isinstance(geom, rg.Brep):
                                    breps.append(geom.DuplicateBrep())
            
            if not breps and hasattr(obj, 'PersistentData') and obj.PersistentData is not None:
                pd = obj.PersistentData
                if not pd.IsEmpty:
                    for path in pd.Paths:
                        branch = pd.get_Branch(path)
                        if branch:
                            for item in branch:
                                geom = None
                                if hasattr(item, 'Value'):
                                    geom = item.Value
                                if geom and isinstance(geom, rg.Brep):
                                    breps.append(geom.DuplicateBrep())
        except Exception as e:
            print("Error reading from {}: {}".format(nickname, e))
    
    return breps

def get_slider_info(name, default_val=1.0):
    sliders = find_objs("GH_NumberSlider", name)
    if not sliders:
        return (0.0, 10.0, float(default_val), 0)
    sld = sliders[0]
    try:
        mn = float(sld.Slider.Minimum)
        mx = float(sld.Slider.Maximum)
        val = float(sld.CurrentValue) if hasattr(sld, "CurrentValue") else float(sld.Slider.Value)
        dec = sld.Slider.DecimalPlaces if hasattr(sld.Slider, 'DecimalPlaces') else 0
        return (mn, mx, val, dec)
    except:
        return (0.0, 10.0, float(default_val), 0)

def set_slider_value(name, value):
    targets = find_objs("GH_NumberSlider", name)
    if not targets:
        return
    v = float(value)
    def do():
        for sld in targets:
            try:
                mn = float(sld.Slider.Minimum)
                mx = float(sld.Slider.Maximum)
                sld.SetSliderValue(max(mn, min(mx, v)))
                sld.ExpireSolution(True)
            except:
                pass
    schedule(do)

def get_toggles_aggregate(name):
    tgs = find_objs("GH_BooleanToggle", name)
    if not tgs:
        return False
    states = []
    for t in tgs:
        if hasattr(t, 'Value'):
            states.append(bool(t.Value))
    if not states:
        return False
    if all(states):
        return True
    if not any(states):
        return False
    return None

def _panel_display_text(panel, max_items=OUT_MAX_ITEMS):
    try:
        if panel and panel.SourceCount > 0 and panel.VolatileData is not None:
            dt = panel.VolatileData
            lines = []
            for path in dt.Paths:
                branch = dt.get_Branch(path)
                if not branch:
                    continue
                vals = []
                for i, goo in enumerate(branch):
                    if i >= max_items:
                        vals.append(u"...(+{} more)".format(len(branch) - max_items))
                        break
                    v = getattr(goo, "Value", None)
                    vals.append(unicode(v) if v is not None else unicode(goo))
                lines.append(u"{}: {}".format(path, u", ".join(vals)))
            return u"\n".join(lines) if lines else u""
        elif panel:
            return unicode(panel.UserText or u"")
        return u""
    except Exception as e:
        return u"Error: {}".format(e)

def get_output_panels_text(name):
    pans = find_objs("GH_Panel", name)
    if not pans:
        return u""
    chunks = []
    for i, p in enumerate(pans, 1):
        txt = _panel_display_text(p)
        header = u"— {} #{} —".format(name, i) if len(pans) > 1 else u""
        if txt:
            chunks.append((header + "\n" if header else u"") + txt)
    return u"\n\n".join(chunks) if chunks else u""

def get_first_input_panel_text(name):
    pans = find_objs("GH_Panel", name)
    if not pans:
        return u""
    try:
        if pans[0] and hasattr(pans[0], 'UserText'):
            return unicode(pans[0].UserText or u"")
    except:
        pass
    return u""

def set_panel_text(name, text):
    targets = find_objs("GH_Panel", name)
    if not targets:
        return
    def do():
        for p in targets:
            try:
                p.UserText = text
                p.ExpireSolution(True)
            except:
                pass
    schedule(do)

def set_bool_data_component(nickname, bool_list):
    """
    Set boolean values to a Data component (Param_GenericObject or Param_Boolean).
    Used for conditioning status output to HB Room from Solid.
    """
    targets = []
    for obj in DOC.Objects:
        # Look for data params with matching nickname
        obj_type = obj.GetType().Name
        if obj.NickName == nickname and ("Param_" in obj_type or "Data" in obj_type):
            targets.append(obj)
    
    if not targets or not bool_list:
        return False
    
    def do():
        for comp in targets:
            try:
                comp.PersistentData.Clear()
                comp.ClearData()
                for val in bool_list:
                    # Use GH_Boolean for proper type
                    comp.PersistentData.Append(gkt.GH_Boolean(bool(val)))
                comp.ExpireSolution(True)
            except Exception as ex:
                print("Error setting bool data: {}".format(ex))
    schedule(do)
    return True

def set_brep_components(breps, nickname):
    targets = []
    for obj in DOC.Objects:
        if obj.NickName == nickname and "Brep" in obj.GetType().Name:
            targets.append(obj)
    if not targets or not breps:
        return
    for comp in targets:
        try:
            comp.PersistentData.Clear()
            comp.ClearData()
            for brep in breps:
                comp.PersistentData.Append(gkt.GH_Brep(brep))
            comp.ExpireSolution(True)
        except Exception as e:
            print("Error setting Brep: {}".format(e))

def press_button(name):
    targets = find_objs("GH_ButtonObject", name)
    if not targets:
        return
    def press():
        for btn in targets:
            try:
                btn.ButtonDown = True
                btn.ExpireSolution(True)
            except:
                pass
    def release():
        for btn in targets:
            try:
                btn.ButtonDown = False
                btn.ExpireSolution(True)
            except:
                pass
    schedule(press)
    schedule(release)

def create_coplanar_aperture_by_ratio(face_brep, ratio):
    try:
        srf = face_brep.Faces[0]
        amp = rg.AreaMassProperties.Compute(face_brep)
        if not amp:
            return None, 0, 0
        
        face_area = amp.Area
        centroid = amp.Centroid
        
        rc, u, v = srf.ClosestPoint(centroid)
        if not rc:
            u = (srf.Domain(0).T0 + srf.Domain(0).T1) / 2.0
            v = (srf.Domain(1).T0 + srf.Domain(1).T1) / 2.0
        
        rc, frame = srf.FrameAt(u, v)
        if not rc:
            return None, 0, 0
        
        center_pt = frame.Origin
        normal = frame.ZAxis
        x_axis = frame.XAxis
        y_axis = frame.YAxis
        
        if abs(normal.Z) < 0.7:
            z_world = rg.Vector3d.ZAxis
            z_in_plane = z_world - normal * (z_world * normal)
            if z_in_plane.Length > 0.01:
                z_in_plane.Unitize()
                y_axis = z_in_plane
                x_axis = rg.Vector3d.CrossProduct(y_axis, normal)
                x_axis.Unitize()
        
        local_plane = rg.Plane(center_pt, x_axis, y_axis)
        bb = face_brep.GetBoundingBox(local_plane)
        face_width = bb.Max.X - bb.Min.X
        face_height = bb.Max.Y - bb.Min.Y
        
        if face_width < 0.01:
            face_width = 1.0
        if face_height < 0.01:
            face_height = 1.0
        
        aperture_area = face_area * ratio
        aspect = face_width / face_height
        ap_height = math.sqrt(aperture_area / aspect)
        ap_width = aperture_area / ap_height if ap_height > 0.01 else math.sqrt(aperture_area)
        
        max_width = face_width * 0.95
        max_height = face_height * 0.95
        ap_width = min(max(ap_width, 0.1), max_width)
        ap_height = min(max(ap_height, 0.1), max_height)
        
        plane = rg.Plane(center_pt, x_axis, y_axis)
        rect = rg.Rectangle3d(plane,
                              rg.Interval(-ap_width/2.0, ap_width/2.0),
                              rg.Interval(-ap_height/2.0, ap_height/2.0))
        
        curve = rect.ToNurbsCurve()
        aperture_breps = rg.Brep.CreatePlanarBreps(curve, 0.001)
        
        if aperture_breps and len(aperture_breps) > 0:
            return aperture_breps[0], ap_width, ap_height
            
    except Exception as e:
        print("Aperture by ratio error: {}".format(e))
    return None, 0, 0

def create_coplanar_aperture_by_dims(face_brep, width, height):
    try:
        srf = face_brep.Faces[0]
        amp = rg.AreaMassProperties.Compute(face_brep)
        if not amp:
            return None, 0, 0
        
        centroid = amp.Centroid
        rc, u, v = srf.ClosestPoint(centroid)
        if not rc:
            u = (srf.Domain(0).T0 + srf.Domain(0).T1) / 2.0
            v = (srf.Domain(1).T0 + srf.Domain(1).T1) / 2.0
        
        rc, frame = srf.FrameAt(u, v)
        if not rc:
            return None, 0, 0
        
        center_pt = frame.Origin
        normal = frame.ZAxis
        x_axis = frame.XAxis
        y_axis = frame.YAxis
        
        if abs(normal.Z) < 0.7:
            z_world = rg.Vector3d.ZAxis
            z_in_plane = z_world - normal * (z_world * normal)
            if z_in_plane.Length > 0.01:
                z_in_plane.Unitize()
                y_axis = z_in_plane
                x_axis = rg.Vector3d.CrossProduct(y_axis, normal)
                x_axis.Unitize()
        
        local_plane = rg.Plane(center_pt, x_axis, y_axis)
        bb = face_brep.GetBoundingBox(local_plane)
        face_width = bb.Max.X - bb.Min.X
        face_height = bb.Max.Y - bb.Min.Y
        
        if face_width < 0.01:
            face_width = 1.0
        if face_height < 0.01:
            face_height = 1.0
        
        ap_width = float(width)
        ap_height = float(height)
        
        max_width = face_width * 0.95
        max_height = face_height * 0.95
        ap_width = min(max(ap_width, 0.1), max_width)
        ap_height = min(max(ap_height, 0.1), max_height)
        
        plane = rg.Plane(center_pt, x_axis, y_axis)
        rect = rg.Rectangle3d(plane,
                              rg.Interval(-ap_width/2.0, ap_width/2.0),
                              rg.Interval(-ap_height/2.0, ap_height/2.0))
        
        curve = rect.ToNurbsCurve()
        aperture_breps = rg.Brep.CreatePlanarBreps(curve, 0.001)
        
        if aperture_breps and len(aperture_breps) > 0:
            return aperture_breps[0], ap_width, ap_height
            
    except Exception as e:
        print("Aperture by dims error: {}".format(e))
    return None, 0, 0

def create_coplanar_door_by_ratio(face_brep, ratio, sill_height=0.0):
    """Create a door surface on a face by ratio, with sill height offset"""
    try:
        srf = face_brep.Faces[0]
        amp = rg.AreaMassProperties.Compute(face_brep)
        if not amp:
            return None, 0, 0
        
        face_area = amp.Area
        centroid = amp.Centroid
        
        rc, u, v = srf.ClosestPoint(centroid)
        if not rc:
            u = (srf.Domain(0).T0 + srf.Domain(0).T1) / 2.0
            v = (srf.Domain(1).T0 + srf.Domain(1).T1) / 2.0
        
        rc, frame = srf.FrameAt(u, v)
        if not rc:
            return None, 0, 0
        
        center_pt = frame.Origin
        normal = frame.ZAxis
        x_axis = frame.XAxis
        y_axis = frame.YAxis
        
        if abs(normal.Z) < 0.7:
            z_world = rg.Vector3d.ZAxis
            z_in_plane = z_world - normal * (z_world * normal)
            if z_in_plane.Length > 0.01:
                z_in_plane.Unitize()
                y_axis = z_in_plane
                x_axis = rg.Vector3d.CrossProduct(y_axis, normal)
                x_axis.Unitize()
        
        local_plane = rg.Plane(center_pt, x_axis, y_axis)
        bb = face_brep.GetBoundingBox(local_plane)
        face_width = bb.Max.X - bb.Min.X
        face_height = bb.Max.Y - bb.Min.Y
        
        if face_width < 0.01:
            face_width = 1.0
        if face_height < 0.01:
            face_height = 1.0
        
        door_area = face_area * ratio
        aspect = 0.45
        door_height = math.sqrt(door_area / aspect)
        door_width = door_area / door_height if door_height > 0.01 else math.sqrt(door_area)
        
        max_width = face_width * 0.95
        max_height = face_height * 0.95 - sill_height
        door_width = min(max(door_width, 0.1), max_width)
        door_height = min(max(door_height, 0.1), max_height)
        
        bottom_center = rg.Point3d(center_pt)
        bottom_center = bottom_center - y_axis * (face_height / 2.0 - sill_height - door_height / 2.0)
        
        plane = rg.Plane(bottom_center, x_axis, y_axis)
        rect = rg.Rectangle3d(plane,
                              rg.Interval(-door_width/2.0, door_width/2.0),
                              rg.Interval(-door_height/2.0, door_height/2.0))
        
        curve = rect.ToNurbsCurve()
        door_breps = rg.Brep.CreatePlanarBreps(curve, 0.001)
        
        if door_breps and len(door_breps) > 0:
            return door_breps[0], door_width, door_height
            
    except Exception as e:
        print("Door by ratio error: {}".format(e))
    return None, 0, 0

def create_coplanar_door_by_dims(face_brep, width, height, sill_height=0.0):
    """Create a door surface on a face by dimensions, with sill height offset"""
    try:
        srf = face_brep.Faces[0]
        amp = rg.AreaMassProperties.Compute(face_brep)
        if not amp:
            return None, 0, 0
        
        centroid = amp.Centroid
        rc, u, v = srf.ClosestPoint(centroid)
        if not rc:
            u = (srf.Domain(0).T0 + srf.Domain(0).T1) / 2.0
            v = (srf.Domain(1).T0 + srf.Domain(1).T1) / 2.0
        
        rc, frame = srf.FrameAt(u, v)
        if not rc:
            return None, 0, 0
        
        center_pt = frame.Origin
        normal = frame.ZAxis
        x_axis = frame.XAxis
        y_axis = frame.YAxis
        
        if abs(normal.Z) < 0.7:
            z_world = rg.Vector3d.ZAxis
            z_in_plane = z_world - normal * (z_world * normal)
            if z_in_plane.Length > 0.01:
                z_in_plane.Unitize()
                y_axis = z_in_plane
                x_axis = rg.Vector3d.CrossProduct(y_axis, normal)
                x_axis.Unitize()
        
        local_plane = rg.Plane(center_pt, x_axis, y_axis)
        bb = face_brep.GetBoundingBox(local_plane)
        face_width = bb.Max.X - bb.Min.X
        face_height = bb.Max.Y - bb.Min.Y
        
        if face_width < 0.01:
            face_width = 1.0
        if face_height < 0.01:
            face_height = 1.0
        
        door_width = float(width)
        door_height = float(height)
        
        max_width = face_width * 0.95
        max_height = face_height * 0.95 - sill_height
        door_width = min(max(door_width, 0.1), max_width)
        door_height = min(max(door_height, 0.1), max_height)
        
        bottom_center = rg.Point3d(center_pt)
        bottom_center = bottom_center - y_axis * (face_height / 2.0 - sill_height - door_height / 2.0)
        
        plane = rg.Plane(bottom_center, x_axis, y_axis)
        rect = rg.Rectangle3d(plane,
                              rg.Interval(-door_width/2.0, door_width/2.0),
                              rg.Interval(-door_height/2.0, door_height/2.0))
        
        curve = rect.ToNurbsCurve()
        door_breps = rg.Brep.CreatePlanarBreps(curve, 0.001)
        
        if door_breps and len(door_breps) > 0:
            return door_breps[0], door_width, door_height
            
    except Exception as e:
        print("Door by dims error: {}".format(e))
    return None, 0, 0

def get_hb_rooms_from_param(nickname):
    """Get HB Room objects from a GH parameter by nickname"""
    rooms = []
    if not DOC:
        return rooms
    
    for obj in DOC.Objects:
        try:
            if obj.NickName != nickname:
                continue
            
            if hasattr(obj, 'VolatileData') and obj.VolatileData is not None:
                vd = obj.VolatileData
                if not vd.IsEmpty:
                    for path in vd.Paths:
                        branch = vd.get_Branch(path)
                        if branch:
                            for item in branch:
                                val = getattr(item, 'Value', item)
                                if val is not None and hasattr(val, 'display_name') and hasattr(val, 'floor_area'):
                                    rooms.append(val)
            
            if not rooms and hasattr(obj, 'PersistentData') and obj.PersistentData is not None:
                pd = obj.PersistentData
                if not pd.IsEmpty:
                    for path in pd.Paths:
                        branch = pd.get_Branch(path)
                        if branch:
                            for item in branch:
                                val = getattr(item, 'Value', item)
                                if val is not None and hasattr(val, 'display_name') and hasattr(val, 'floor_area'):
                                    rooms.append(val)
        except Exception as e:
            print("Error reading HB rooms from {}: {}".format(nickname, e))
    
    return rooms

def set_hb_rooms_to_param(rooms, nickname):
    """Set HB Room objects to a GH parameter by nickname"""
    targets = []
    for obj in DOC.Objects:
        if obj.NickName == nickname:
            targets.append(obj)
    
    if not targets or not rooms:
        return False
    
    try:
        for comp in targets:
            comp.PersistentData.Clear()
            comp.ClearData()
            for room in rooms:
                from Grasshopper.Kernel.Types import GH_ObjectWrapper
                comp.PersistentData.Append(GH_ObjectWrapper(room))
            comp.ExpireSolution(True)
        return True
    except Exception as e:
        print("Error setting HB rooms: {}".format(e))
        return False

def create_shaded_groupbox(title):
    grp = Forms.GroupBox(Text=title)
    grp.BackgroundColor = RESULT_BG_COLOR
    return grp

def get_hb_shades_from_param(nickname):
    """Get HB Shade objects from a GH parameter by nickname"""
    shades = []
    if not DOC:
        return shades
    
    for obj in DOC.Objects:
        try:
            if obj.NickName != nickname:
                continue
            
            if hasattr(obj, 'VolatileData') and obj.VolatileData is not None:
                vd = obj.VolatileData
                if not vd.IsEmpty:
                    for path in vd.Paths:
                        branch = vd.get_Branch(path)
                        if branch:
                            for item in branch:
                                val = getattr(item, 'Value', item)
                                # Check if it looks like an HB Shade
                                if val is not None and hasattr(val, 'geometry') and hasattr(val, 'identifier'):
                                    shades.append(val)
            
            if not shades and hasattr(obj, 'PersistentData') and obj.PersistentData is not None:
                pd = obj.PersistentData
                if not pd.IsEmpty:
                    for path in pd.Paths:
                        branch = pd.get_Branch(path)
                        if branch:
                            for item in branch:
                                val = getattr(item, 'Value', item)
                                if val is not None and hasattr(val, 'geometry') and hasattr(val, 'identifier'):
                                    shades.append(val)
        except Exception as e:
            print("Error reading HB shades from {}: {}".format(nickname, e))
    
    return shades

# --------------------------- UI class ----------------------------------------
class GDSHubPanel(Forms.Form):
    def __init__(self):
        super(GDSHubPanel, self).__init__()
        self.Title = WINDOW_TITLE
        self.ClientSize = Drawing.Size(WINDOW_SIZE[0], WINDOW_SIZE[1])
        self.Padding = Drawing.Padding(10)
        self.Resizable = True
        
        self.selected_breps = []
        self.collected_breps = []
        self.envelope_breps = []
        self.surface_list = []
        self._full_surface_list = []   # unfiltered backup
        self._full_face_items = []     # [(label_str, bc_str, orient_str, brep), ...]
        self.aperture_surfaces = []
        self.door_surfaces = []
        # Cumulative lists for all applied apertures/doors (append mode)
        self.applied_apertures = []
        self.applied_doors = []
        self._on_solution_end = None
        
        # Schedule module data
        self.program_data = GDSProgramData()
        self.gds_parser = None
        self.hb_library_schedules = []
        self.hb_library_programs = []
        
        # Room storage
        self.hb_rooms = []
        self.hb_rooms_info = []
        
        # Pending program assignments: {room_index: program_dict}
        self.pending_assignments = {}
        
        # Applied (sent to GH) program names: {room_index: program_name}
        # Persists after Apply so grid still shows what was assigned
        self.applied_programs = {}
        
        # Stored program definitions: {program_name: program_dict (HB JSON)}
        # Accumulates across Assign clicks, persists in session file for re-Apply
        self.program_definitions = {}
        
        # Error tracking
        self._last_program_error = None
        
        # Custom schedules loaded from GH Panel
        self.saved_custom_schedules = {}
        
        # HVAC module data
        self.hvac_rooms = []           # HB rooms for HVAC assignment
        self.hvac_rooms_info = []      # Room info cache
        self.pending_hvac = {}         # {room_index: hvac_config_dict}
        self.current_hvac_config = {}  # Current UI HVAC configuration
        
        # Renewable energy module data
        self.pv_shades = []            # HB Shade objects for PV
        self.pv_shade_breps = []       # Rhino Brep geometries (when picked directly)
        
        self._create_ui()
        self._setup_events()
        self._load_hb_library()
        self._load_custom_schedules_silent()
        
        # Auto-load GDS database from GH panel so dropdowns have [GDS] items
        # before we try to restore saved state
        self._auto_load_gds_database()
        
        # Re-populate dropdowns now that GDS database may be loaded
        self._populate_schedule_dropdowns()
        
        # NOW restore saved state (dropdowns have all items including [GDS])
        self._restore_service_state()
        
        # Show hint if stored session is available for re-Apply
        if self.program_definitions and self.applied_programs:
            n_defs = len(self.program_definitions)
            n_rooms = len(self.applied_programs)
            self.lbl_init_status.Text = "Session available: {} program(s), {} room(s) — click Restore Session".format(
                n_defs, n_rooms)
            self.lbl_init_status.TextColor = Drawing.Color.FromArgb(0, 120, 60)
    
    def _load_hb_library(self):
        """Load HB library schedules and programs"""
        self.hb_library_schedules = load_hb_library_schedules()
        self.hb_library_programs = load_hb_library_programs()
    
    def _load_custom_schedules_silent(self):
        """Load custom schedules from GH Panel on startup (silent)"""
        try:
            existing_json = get_first_input_panel_text(NAME_CUSTOM_SCHEDULES)
            if existing_json.strip():
                all_schedules = json.loads(existing_json)
                self.saved_custom_schedules = all_schedules
                for name, data in all_schedules.items():
                    self.program_data.custom_schedules[name] = data.get("values", [0]*24)
        except:
            pass
    
    def _auto_load_gds_database(self):
        """Auto-load GDS database from GH panel on startup (silent).
        This ensures [GDS] items are in dropdowns before _restore_service_state()."""
        try:
            self._load_gds_database()
            if self.gds_parser:
                sched_count = len(self.gds_parser.schedules) if self.gds_parser.schedules else 0
                setp_count = len(self.gds_parser.setpoints) if self.gds_parser.setpoints else 0
                if hasattr(self, 'lbl_gds_status'):
                    self.lbl_gds_status.Text = "GDS auto-loaded: {} sched, {} setp".format(
                        sched_count, setp_count)
        except Exception:
            pass
    
    def _load_gds_database(self, path=None):
        """Load GDS database from path"""
        if path is None:
            path = get_first_input_panel_text("GDS Database Path")
        
        if path and path.strip():
            self.gds_parser = GDSScheduleParser(path.strip())
            return True
        return False
    
    def _create_ui(self):
        self.tab_control = Forms.TabControl()
        
        self.tab_space = Forms.TabPage(Text="1. Space Module")
        self._create_space_module()
        self.tab_control.Pages.Add(self.tab_space)
        
        self.tab_envelope = Forms.TabPage(Text="2. Enclosure Module")
        self._create_envelope_module()
        self.tab_control.Pages.Add(self.tab_envelope)
        
        self.tab_schedule = Forms.TabPage(Text="3. Service Module")
        self._create_schedule_module()
        self.tab_control.Pages.Add(self.tab_schedule)
        
        self.tab_hvac = Forms.TabPage(Text="4. HVAC Module")
        self._create_hvac_module()
        self.tab_control.Pages.Add(self.tab_hvac)
        
        self.tab_site = Forms.TabPage(Text="5. Site Module")
        self._create_site_module()
        self.tab_control.Pages.Add(self.tab_site)
        
        self.tab_renewables = Forms.TabPage(Text="6. Advanced (IDF)")
        self._create_renewables_module()
        self.tab_control.Pages.Add(self.tab_renewables)
        
        # Quick Evaluation is now a separate panel, not a tab
        self._create_quick_eval_panel()
        
        # Main content container - holds either tab_control or quick_eval_panel
        self.main_container = Forms.Panel()
        self.main_container.Content = self.tab_control
        self.showing_quick_eval = False
        
        # Navigation bar with Prev/Next on left, Quick Evaluation toggle on right
        nav_layout = Forms.DynamicLayout()
        nav_layout.BeginHorizontal()
        
        # Left side: Prev/Next
        self.btn_prev = Forms.Button(Text="< Previous")
        self.btn_prev.Enabled = False
        self.btn_next = Forms.Button(Text="Next >")
        nav_layout.Add(self.btn_prev)
        nav_layout.Add(self.btn_next)
        
        nav_layout.Add(None)  # Spacer
        
        # Right side: Quick Evaluation toggle button
        self.btn_toggle_qe = Forms.Button(Text="Quick Evaluation ▶")
        self.btn_toggle_qe.Width = 140
        nav_layout.Add(self.btn_toggle_qe)
        
        nav_layout.EndHorizontal()
        
        root = Forms.DynamicLayout()
        root.DefaultSpacing = Drawing.Size(0, 8)
        root.Add(self.main_container, xscale=True, yscale=True)
        root.Add(nav_layout)
        self.Content = root
    
    def _create_space_module(self):
        """Module 1: Space
        Layout: 2 columns (4:6 width ratio)
        - Column 1: Geometry Definition (top) + Input Panels (bottom), height 1:1
        - Column 2: Parameters (top) + Performance (bottom), height 6:4
        """
        layout = Forms.DynamicLayout()
        layout.DefaultSpacing = Drawing.Size(8, 8)
        layout.Padding = Drawing.Padding(10)
        
        columns = Forms.DynamicLayout()
        columns.DefaultSpacing = Drawing.Size(8, 0)
        columns.BeginHorizontal()
        
        # --- COLUMN 1: Geometry Definition + Input Panels (stacked) ---
        col1_layout = Forms.DynamicLayout()
        col1_layout.DefaultSpacing = Drawing.Size(0, 8)
        
        # --- Geometry Definition (Top) ---
        grp_def = Forms.GroupBox(Text="Geometry Definition")
        def_layout = Forms.DynamicLayout()
        def_layout.DefaultSpacing = Drawing.Size(5, 5)
        def_layout.Padding = Drawing.Padding(8)
        
        def_layout.AddRow(Forms.Label(Text="Selected Brep(s):"))
        self.txt_brep_info = Forms.TextArea()
        self.txt_brep_info.ReadOnly = True
        self.txt_brep_info.Text = "No Breps selected"
        self.txt_brep_info.Height = 100  
        def_layout.Add(self.txt_brep_info, xscale=True)
        
        # Buttons row - each takes 50% width using xscale=True
        btn_geo_row = Forms.DynamicLayout()
        btn_geo_row.BeginHorizontal()
        self.btn_select = Forms.Button(Text="Select")
        btn_geo_row.Add(self.btn_select, xscale=True)  # 50% width
        self.btn_load = Forms.Button(Text="Load/Reload")
        btn_geo_row.Add(self.btn_load, xscale=True)    # 50% width
        btn_geo_row.EndHorizontal()
        def_layout.Add(btn_geo_row, xscale=True)
        
        dup_info = get_slider_info(NAME_SLIDER_DUP, DUP_DEFAULT)
        dup_row = Forms.DynamicLayout()
        dup_row.BeginHorizontal()
        dup_row.Add(Forms.Label(Text="# Duplicates:"))
        self.num_dup = Forms.NumericUpDown()
        self.num_dup.MinValue = dup_info[0]
        self.num_dup.MaxValue = dup_info[1]
        self.num_dup.DecimalPlaces = dup_info[0]
        self.num_dup.Increment = 1
        self.num_dup.Value = dup_info[2]
        self.num_dup.Width = 55
        dup_row.Add(self.num_dup)
        dup_row.Add(None)
        dup_row.EndHorizontal()
        def_layout.Add(dup_row)
        
        self.chk_run = Forms.CheckBox(Text="RUN_SIM")
        self.chk_run.Checked = get_toggles_aggregate(NAME_TOGGLE)
        def_layout.AddRow(self.chk_run)
        
        def_layout.Add(None, yscale=True)
        grp_def.Content = def_layout
        
        # --- Input Panels (Bottom) ---
        grp_in = Forms.GroupBox(Text="Input Panels")
        in_layout = Forms.DynamicLayout()
        in_layout.DefaultSpacing = Drawing.Size(5, 4)
        in_layout.Padding = Drawing.Padding(8)
        
        self.txt_in_list = []
        for name in NAME_PANELS_IN:
            in_layout.AddRow(Forms.Label(Text=name + ":"))
            ta = Forms.TextArea()
            ta.Text = get_first_input_panel_text(name)
            ta.Height = 35
            self.txt_in_list.append((name, ta))
            in_layout.Add(ta, xscale=True)
        
        # Panel action buttons: Apply | Clear (50-50)
        btn_row1 = Forms.DynamicLayout()
        btn_row1.BeginHorizontal()
        self.btn_apply_in = Forms.Button(Text="Apply")
        self.btn_clear = Forms.Button(Text="Clear")
        btn_row1.Add(self.btn_apply_in, xscale=True)
        btn_row1.Add(self.btn_clear, xscale=True)
        btn_row1.EndHorizontal()
        in_layout.AddRow(btn_row1)
        
        in_layout.Add(None, yscale=True)
        grp_in.Content = in_layout
        
        # Stack Geometry Definition and Input Panels (1:1 height ratio)
        self._space_col1_split = Forms.Splitter()
        self._space_col1_split.Orientation = Forms.Orientation.Vertical
        self._space_col1_split.Panel1 = grp_def
        self._space_col1_split.Panel2 = grp_in
        self._space_col1_split.Position = 200
        
        col1_layout.Add(self._space_col1_split, xscale=True, yscale=True)
        
        # --- COLUMN 2: Space Conditioning ---
        col2_layout = Forms.DynamicLayout()
        col2_layout.DefaultSpacing = Drawing.Size(0, 8)
        
        grp_cond = Forms.GroupBox(Text="Space Conditioning")
        cond_layout = Forms.DynamicLayout()
        cond_layout.DefaultSpacing = Drawing.Size(5, 6)
        cond_layout.Padding = Drawing.Padding(8)
        
        # Status label
        self.lbl_cond_status = Forms.Label(Text="Set each space as conditioned (heated/cooled) or unconditioned")
        cond_layout.AddRow(self.lbl_cond_status)
        
        cond_layout.AddSpace()
        
        # Grid label + Load button in one row
        cond_label_row = Forms.DynamicLayout()
        cond_label_row.BeginHorizontal()
        cond_label_row.Add(Forms.Label(Text="Spaces (check = conditioned, uncheck = unconditioned):"), xscale=True)
        self.btn_load_space_geo = Forms.Button(Text="Load Space Geometry")
        self.btn_load_space_geo.Width = 150
        cond_label_row.Add(self.btn_load_space_geo, xscale=False)
        cond_label_row.EndHorizontal()
        cond_layout.AddRow(cond_label_row)
        
        self.grid_cond = Forms.GridView()
        self.grid_cond.Height = 280
        self.grid_cond.AllowMultipleSelection = True
        
        # Column: Index
        col_idx = Forms.GridColumn()
        col_idx.HeaderText = "#"
        col_idx.DataCell = Forms.TextBoxCell(0)
        col_idx.Width = 35
        col_idx.Editable = False
        self.grid_cond.Columns.Add(col_idx)
        
        # Column: Name/ID
        col_name = Forms.GridColumn()
        col_name.HeaderText = "Space ID"
        col_name.DataCell = Forms.TextBoxCell(1)
        col_name.Width = 120
        col_name.Editable = False
        self.grid_cond.Columns.Add(col_name)
        
        # Column: Volume
        col_vol = Forms.GridColumn()
        col_vol.HeaderText = "Volume (m³)"
        col_vol.DataCell = Forms.TextBoxCell(2)
        col_vol.Width = 80
        col_vol.Editable = False
        self.grid_cond.Columns.Add(col_vol)
        
        # Column: Conditioned checkbox
        col_cond = Forms.GridColumn()
        col_cond.HeaderText = "Conditioned"
        col_cond.DataCell = Forms.CheckBoxCell(3)
        col_cond.Width = 80
        col_cond.Editable = True
        self.grid_cond.Columns.Add(col_cond)
        
        cond_layout.Add(self.grid_cond, xscale=True, yscale=True)
        
        # Preview button (own row)
        self.btn_cond_preview = Forms.Button(Text="Preview Selection")
        cond_layout.AddRow(self.btn_cond_preview)
        
        # Select All / Deselect All (50-50 split)
        sel_row = Forms.DynamicLayout()
        sel_row.BeginHorizontal()
        self.btn_cond_select_all = Forms.Button(Text="Select All")
        self.btn_cond_deselect_all = Forms.Button(Text="Deselect All")
        sel_row.Add(self.btn_cond_select_all, xscale=True)
        sel_row.Add(self.btn_cond_deselect_all, xscale=True)
        sel_row.EndHorizontal()
        cond_layout.AddRow(sel_row)
        
        cond_layout.AddSpace()
        
        # Apply button
        self.btn_apply_cond = Forms.Button(Text="Apply to GH (GDS_Cond_Status)")
        cond_layout.AddRow(self.btn_apply_cond)
        
        grp_cond.Content = cond_layout
        col2_layout.Add(grp_cond, xscale=True, yscale=True)
        
        # Initialize conditioning data storage
        self.cond_breps_data = []  # List of [index, name, volume, is_conditioned]
        self.cond_breps = []       # Actual brep objects for preview
        
        # Store column references for dynamic sizing (4:6 ratio)
        self._space_col_left = col1_layout
        self._space_col_right = col2_layout
        
        columns.Add(col1_layout, xscale=False, yscale=True)
        columns.Add(col2_layout, xscale=True, yscale=True)
        columns.EndHorizontal()
        
        layout.Add(columns, xscale=True, yscale=True)
        
        self.tab_space.Content = layout
    
    def _create_envelope_module(self):
        layout = Forms.DynamicLayout()
        layout.DefaultSpacing = Drawing.Size(8, 8)
        layout.Padding = Drawing.Padding(10)
        
        columns = Forms.DynamicLayout()
        columns.DefaultSpacing = Drawing.Size(8, 0)
        columns.BeginHorizontal()
        
        # --- LEFT: Surface Selection ---
        grp_surf = Forms.GroupBox(Text="Surface Selection")
        surf_layout = Forms.DynamicLayout()
        surf_layout.DefaultSpacing = Drawing.Size(5, 6)
        surf_layout.Padding = Drawing.Padding(8)
        
        self.lbl_envelope_status = Forms.Label(Text="Use rooms from Space Module or re-define geometry")
        surf_layout.AddRow(self.lbl_envelope_status)
        
        self.btn_use_space_breps = Forms.Button(Text="Use Upstream Rooms")
        surf_layout.AddRow(self.btn_use_space_breps)
        
        self.btn_select_envelope = Forms.Button(Text="Re-define Geometry")
        surf_layout.AddRow(self.btn_select_envelope)
        
        surf_layout.AddSpace()
        
        self.btn_deconstruct = Forms.Button(Text="Deconstruct to Faces")
        self.btn_deconstruct.Enabled = False
        surf_layout.AddRow(self.btn_deconstruct)
        
        filter_row = Forms.DynamicLayout()
        filter_row.BeginHorizontal()
        filter_row.Add(Forms.Label(Text="Filter:"))
        self.dd_face_orient = Forms.DropDown()
        self.dd_face_orient.Items.Add("All")
        self.dd_face_orient.Items.Add("Wall")
        self.dd_face_orient.Items.Add("Roof")
        self.dd_face_orient.Items.Add("Floor")
        self.dd_face_orient.SelectedIndex = 0
        filter_row.Add(self.dd_face_orient)
        self.dd_face_bc = Forms.DropDown()
        self.dd_face_bc.Items.Add("All")
        self.dd_face_bc.Items.Add("Ext")
        self.dd_face_bc.Items.Add("Int")
        self.dd_face_bc.SelectedIndex = 0
        filter_row.Add(self.dd_face_bc)
        filter_row.EndHorizontal()
        surf_layout.AddRow(filter_row)
        
        surf_layout.AddRow(Forms.Label(Text="Faces (Ctrl+Click multi):"))
        self.grid_faces = Forms.GridView()
        self.grid_faces.Height = 280
        self.grid_faces.AllowMultipleSelection = True
        
        col = Forms.GridColumn()
        col.HeaderText = "Face Info"
        col.DataCell = Forms.TextBoxCell(0)
        col.Width = 200
        self.grid_faces.Columns.Add(col)
        
        col_type = Forms.GridColumn()
        col_type.HeaderText = "Type"
        col_type.DataCell = Forms.TextBoxCell(1)
        col_type.Width = 50
        self.grid_faces.Columns.Add(col_type)
        
        surf_layout.Add(self.grid_faces, yscale=False)
        
        self.btn_preview = Forms.Button(Text="Preview Selection")
        surf_layout.AddRow(self.btn_preview)
        
        self.lbl_selection = Forms.Label(Text="")
        surf_layout.AddRow(self.lbl_selection)
        grp_surf.Content = surf_layout
        self._env_col_left = grp_surf
        
        # --- MIDDLE: Aperture Definition ---
        middle_layout = Forms.DynamicLayout()
        middle_layout.DefaultSpacing = Drawing.Size(5, 6)
        self._env_col_mid = middle_layout
        
        grp_ap = Forms.GroupBox(Text="Aperture Definition")
        ap_layout = Forms.DynamicLayout()
        ap_layout.DefaultSpacing = Drawing.Size(5, 6)
        ap_layout.Padding = Drawing.Padding(8)
        
        mode_row = Forms.DynamicLayout()
        mode_row.BeginHorizontal()
        mode_row.Add(Forms.Label(Text="Mode:"))
        self.dropdown_ap_mode = Forms.DropDown()
        self.dropdown_ap_mode.Items.Add("By Ratio (WWR)")
        self.dropdown_ap_mode.Items.Add("By Dimensions")
        self.dropdown_ap_mode.SelectedIndex = 0
        mode_row.Add(self.dropdown_ap_mode)
        mode_row.EndHorizontal()
        ap_layout.Add(mode_row)
        
        ap_layout.AddSpace()
        
        ap_layout.AddRow(Forms.Label(Text="Ratio (0.05-0.95):"))
        self.num_ratio = Forms.NumericUpDown()
        self.num_ratio.MinValue = 0.05
        self.num_ratio.MaxValue = 0.95
        self.num_ratio.DecimalPlaces = 2
        self.num_ratio.Increment = 0.05
        self.num_ratio.Value = 0.4
        ap_layout.AddRow(self.num_ratio)
        
        ap_layout.AddSpace()
        ap_layout.AddRow(Forms.Label(Text="Dimensions (W x H):"))
        
        dim_row = Forms.DynamicLayout()
        dim_row.BeginHorizontal()
        dim_row.Add(Forms.Label(Text="W:"))
        self.num_width = Forms.NumericUpDown()
        self.num_width.MinValue = 0.1
        self.num_width.MaxValue = 100.0
        self.num_width.DecimalPlaces = 2
        self.num_width.Value = 1.5
        self.num_width.Enabled = False
        dim_row.Add(self.num_width)
        dim_row.Add(Forms.Label(Text="H:"))
        self.num_height = Forms.NumericUpDown()
        self.num_height.MinValue = 0.1
        self.num_height.MaxValue = 100.0
        self.num_height.DecimalPlaces = 2
        self.num_height.Value = 1.2
        self.num_height.Enabled = False
        dim_row.Add(self.num_height)
        dim_row.EndHorizontal()
        ap_layout.Add(dim_row)
        
        ap_layout.AddSpace()
        self.btn_gen_aperture = Forms.Button(Text="Generate Aperture(s)")
        self.btn_bake_aperture = Forms.Button(Text="Bake to Layer")
        self.btn_send_to_gh = Forms.Button(Text="Apply to GH (Append)")
        gen_bake_apply_ap_row = Forms.DynamicLayout()
        gen_bake_apply_ap_row.BeginHorizontal()
        gen_bake_apply_ap_row.Add(self.btn_gen_aperture, xscale=True)
        gen_bake_apply_ap_row.Add(self.btn_bake_aperture, xscale=True)
        gen_bake_apply_ap_row.Add(self.btn_send_to_gh, xscale=True)
        gen_bake_apply_ap_row.EndHorizontal()
        ap_layout.Add(gen_bake_apply_ap_row)
        
        # Clear + Re-sync buttons row (3-column split)
        clear_ap_row = Forms.DynamicLayout()
        clear_ap_row.BeginHorizontal()
        self.btn_clear_applied_ap = Forms.Button(Text="Clear GH")
        self.btn_clear_baked_ap = Forms.Button(Text="Clear Geometry")
        self.btn_resync_ap = Forms.Button(Text="Re-sync")
        clear_ap_row.Add(self.btn_clear_applied_ap, xscale=True)
        clear_ap_row.Add(self.btn_clear_baked_ap, xscale=True)
        clear_ap_row.Add(self.btn_resync_ap, xscale=True)
        clear_ap_row.EndHorizontal()
        ap_layout.Add(clear_ap_row)
        
        self.lbl_applied_ap_count = Forms.Label(Text="Applied: 0 aperture(s)")
        ap_layout.AddRow(self.lbl_applied_ap_count)
        
        grp_ap.Content = ap_layout
        
        grp_preview = Forms.GroupBox(Text="Aperture Preview")
        prev_layout = Forms.DynamicLayout()
        prev_layout.DefaultSpacing = Drawing.Size(5, 4)
        prev_layout.Padding = Drawing.Padding(8)
        
        self.txt_aperture_info = Forms.TextArea()
        self.txt_aperture_info.ReadOnly = True
        self.txt_aperture_info.Text = "Generated apertures info"
        self.txt_aperture_info.Height = 150
        try:
            self.txt_aperture_info.Font = Drawing.Font("Consolas", 9)
        except:
            pass
        prev_layout.Add(self.txt_aperture_info, xscale=True, yscale=True)
        
        self.lbl_aperture_status = Forms.Label(Text="")
        prev_layout.AddRow(self.lbl_aperture_status)
        grp_preview.Content = prev_layout
        
        middle_layout.Add(grp_ap, xscale=True, yscale=False)
        middle_layout.Add(grp_preview, xscale=True, yscale=True)
        
        # --- RIGHT: Door Definition ---
        right_layout = Forms.DynamicLayout()
        right_layout.DefaultSpacing = Drawing.Size(5, 6)
        self._env_col_right = right_layout
        
        grp_door = Forms.GroupBox(Text="Door Definition")
        door_layout = Forms.DynamicLayout()
        door_layout.DefaultSpacing = Drawing.Size(5, 6)
        door_layout.Padding = Drawing.Padding(8)
        
        door_mode_row = Forms.DynamicLayout()
        door_mode_row.BeginHorizontal()
        door_mode_row.Add(Forms.Label(Text="Mode:"))
        self.dropdown_door_mode = Forms.DropDown()
        self.dropdown_door_mode.Items.Add("By Ratio")
        self.dropdown_door_mode.Items.Add("By Dimensions")
        self.dropdown_door_mode.SelectedIndex = 1
        door_mode_row.Add(self.dropdown_door_mode)
        door_mode_row.EndHorizontal()
        door_layout.Add(door_mode_row)
        
        door_layout.AddSpace()
        
        door_layout.AddRow(Forms.Label(Text="Ratio (0.05-0.95):"))
        self.num_door_ratio = Forms.NumericUpDown()
        self.num_door_ratio.MinValue = 0.05
        self.num_door_ratio.MaxValue = 0.95
        self.num_door_ratio.DecimalPlaces = 2
        self.num_door_ratio.Increment = 0.05
        self.num_door_ratio.Value = 0.3
        self.num_door_ratio.Enabled = False
        door_layout.AddRow(self.num_door_ratio)
        
        door_layout.AddSpace()
        door_layout.AddRow(Forms.Label(Text="Dimensions (W x H):"))
        
        door_dim_row = Forms.DynamicLayout()
        door_dim_row.BeginHorizontal()
        door_dim_row.Add(Forms.Label(Text="W:"))
        self.num_door_width = Forms.NumericUpDown()
        self.num_door_width.MinValue = 0.1
        self.num_door_width.MaxValue = 100.0
        self.num_door_width.DecimalPlaces = 2
        self.num_door_width.Value = 0.9
        door_dim_row.Add(self.num_door_width)
        door_dim_row.Add(Forms.Label(Text="H:"))
        self.num_door_height = Forms.NumericUpDown()
        self.num_door_height.MinValue = 0.1
        self.num_door_height.MaxValue = 100.0
        self.num_door_height.DecimalPlaces = 2
        self.num_door_height.Value = 2.1
        door_dim_row.Add(self.num_door_height)
        door_dim_row.EndHorizontal()
        door_layout.Add(door_dim_row)
        
        door_layout.AddSpace()
        
        sill_row = Forms.DynamicLayout()
        sill_row.BeginHorizontal()
        sill_row.Add(Forms.Label(Text="Sill Height:"))
        self.num_door_sill = Forms.NumericUpDown()
        self.num_door_sill.MinValue = 0.0
        self.num_door_sill.MaxValue = 10.0
        self.num_door_sill.DecimalPlaces = 2
        self.num_door_sill.Value = 0.0
        sill_row.Add(self.num_door_sill)
        sill_row.Add(Forms.Label(Text="m"))
        sill_row.EndHorizontal()
        door_layout.Add(sill_row)
        
        door_layout.AddSpace()
        self.btn_gen_door = Forms.Button(Text="Generate Door(s)")
        self.btn_bake_door = Forms.Button(Text="Bake to Layer")
        self.btn_send_door_to_gh = Forms.Button(Text="Apply to GH (Append)")
        gen_bake_apply_door_row = Forms.DynamicLayout()
        gen_bake_apply_door_row.BeginHorizontal()
        gen_bake_apply_door_row.Add(self.btn_gen_door, xscale=True)
        gen_bake_apply_door_row.Add(self.btn_bake_door, xscale=True)
        gen_bake_apply_door_row.Add(self.btn_send_door_to_gh, xscale=True)
        gen_bake_apply_door_row.EndHorizontal()
        door_layout.Add(gen_bake_apply_door_row)
        
        # Clear + Re-sync buttons row (3-column split)
        clear_door_row = Forms.DynamicLayout()
        clear_door_row.BeginHorizontal()
        self.btn_clear_applied_door = Forms.Button(Text="Clear GH")
        self.btn_clear_baked_door = Forms.Button(Text="Clear Geometry")
        self.btn_resync_door = Forms.Button(Text="Re-sync")
        clear_door_row.Add(self.btn_clear_applied_door, xscale=True)
        clear_door_row.Add(self.btn_clear_baked_door, xscale=True)
        clear_door_row.Add(self.btn_resync_door, xscale=True)
        clear_door_row.EndHorizontal()
        door_layout.Add(clear_door_row)
        
        self.lbl_applied_door_count = Forms.Label(Text="Applied: 0 door(s)")
        door_layout.AddRow(self.lbl_applied_door_count)
        
        grp_door.Content = door_layout
        
        grp_door_preview = Forms.GroupBox(Text="Door Preview")
        door_prev_layout = Forms.DynamicLayout()
        door_prev_layout.DefaultSpacing = Drawing.Size(5, 4)
        door_prev_layout.Padding = Drawing.Padding(8)
        
        self.txt_door_info = Forms.TextArea()
        self.txt_door_info.ReadOnly = True
        self.txt_door_info.Text = "Generated doors info"
        self.txt_door_info.Height = 150
        try:
            self.txt_door_info.Font = Drawing.Font("Consolas", 9)
        except:
            pass
        door_prev_layout.Add(self.txt_door_info, xscale=True, yscale=True)
        
        self.lbl_door_status = Forms.Label(Text="")
        door_prev_layout.AddRow(self.lbl_door_status)
        grp_door_preview.Content = door_prev_layout
        
        right_layout.Add(grp_door, xscale=True, yscale=False)
        right_layout.Add(grp_door_preview, xscale=True, yscale=True)
        
        columns.Add(grp_surf, xscale=False, yscale=True)
        columns.Add(middle_layout, xscale=False, yscale=True)
        columns.Add(right_layout, xscale=True, yscale=True)
        columns.EndHorizontal()
        
        layout.Add(columns, xscale=True, yscale=True)
        
        self.tab_envelope.Content = layout
    
    def _create_schedule_module(self):
        layout = Forms.DynamicLayout()
        layout.DefaultSpacing = Drawing.Size(8, 8)
        layout.Padding = Drawing.Padding(10)
        
        columns = Forms.DynamicLayout()
        columns.DefaultSpacing = Drawing.Size(8, 0)
        columns.BeginHorizontal()
        
        # --- LEFT: Room Selection (Scrollable) ---
        grp_rooms = Forms.GroupBox(Text="Room Selection")
        self._sched_col_left = grp_rooms  # Store reference for dynamic sizing
        left_scrollable = Forms.Scrollable()
        left_scrollable.ExpandContentWidth = True
        left_scrollable.ExpandContentHeight = False
        rooms_layout = Forms.DynamicLayout()
        rooms_layout.DefaultSpacing = Drawing.Size(5, 5)
        rooms_layout.Padding = Drawing.Padding(8)
        
        self.lbl_rooms_status = Forms.Label(Text="Use Upstream Rooms")
        rooms_layout.AddRow(self.lbl_rooms_status)
        
        self.btn_load_rooms = Forms.Button(Text="Use Upstream Rooms")
        rooms_layout.AddRow(self.btn_load_rooms)
        
        self.btn_reload_gds = Forms.Button(Text="Reload GDS Database")
        rooms_layout.AddRow(self.btn_reload_gds)
        
        self.lbl_gds_status = Forms.Label(Text="GDS: Not loaded")
        rooms_layout.AddRow(self.lbl_gds_status)
        
        rooms_layout.AddRow(Forms.Label(Text="Rooms (Ctrl+Click for multiple):"))
        self.grid_rooms = Forms.GridView()
        self.grid_rooms.Height = 250
        self.grid_rooms.AllowMultipleSelection = True
        
        col_name = Forms.GridColumn()
        col_name.HeaderText = "Room"
        col_name.DataCell = Forms.TextBoxCell(0)
        col_name.Width = 120
        self.grid_rooms.Columns.Add(col_name)
        
        col_area = Forms.GridColumn()
        col_area.HeaderText = "Area"
        col_area.DataCell = Forms.TextBoxCell(1)
        col_area.Width = 60
        self.grid_rooms.Columns.Add(col_area)
        
        col_prog = Forms.GridColumn()
        col_prog.HeaderText = "Preset Program"
        col_prog.DataCell = Forms.TextBoxCell(2)
        col_prog.Width = 120
        self.grid_rooms.Columns.Add(col_prog)
        
        rooms_layout.Add(self.grid_rooms, yscale=True)
        
        self.btn_preview_rooms = Forms.Button(Text="Preview Selection")
        rooms_layout.AddRow(self.btn_preview_rooms)
        
        self.lbl_room_selection = Forms.Label(Text="")
        rooms_layout.AddRow(self.lbl_room_selection)
        
        # Room examination panel
        rooms_layout.AddRow(Forms.Label(Text="Selected Room Info:"))
        self.txt_room_exam = Forms.TextArea()
        self.txt_room_exam.ReadOnly = True
        self.txt_room_exam.Height = 80
        try:
            self.txt_room_exam.Font = Drawing.Font("Consolas", 8)
        except:
            pass
        rooms_layout.Add(self.txt_room_exam, xscale=True)
        
        # ─── Thermal Comfort Simulation ───
        grp_comfort = Forms.GroupBox(Text="Thermal Comfort Simulation")
        comfort_layout = Forms.DynamicLayout()
        comfort_layout.DefaultSpacing = Drawing.Size(3, 3)
        comfort_layout.Padding = Drawing.Padding(6)
        
        self.chk_comfort_enable = Forms.CheckBox(Text="Enable Fanger Comfort Model")
        self.chk_comfort_enable.Checked = False
        comfort_layout.AddRow(self.chk_comfort_enable)
        
        self.pnl_comfort_params = Forms.Panel()
        comfort_params_layout = Forms.DynamicLayout()
        comfort_params_layout.DefaultSpacing = Drawing.Size(3, 3)
        
        model_row = Forms.DynamicLayout()
        model_row.BeginHorizontal()
        lbl_model = Forms.Label(Text="Model:")
        lbl_model.Width = 75
        model_row.Add(lbl_model)
        self.dd_comfort_model = Forms.DropDown()
        for m in ["Fanger", "Pierce", "KSU", "AdaptiveASH55", "AdaptiveCEN15251"]:
            self.dd_comfort_model.Items.Add(m)
        self.dd_comfort_model.SelectedIndex = 0
        self.dd_comfort_model.Width = 110
        self.dd_comfort_model.Height = 21
        model_row.Add(self.dd_comfort_model)
        model_row.EndHorizontal()
        comfort_params_layout.Add(model_row)
        
        def add_comfort_row(label, attr, unit, decimals, default, min_val=0, max_val=10):
            row = Forms.DynamicLayout()
            row.BeginHorizontal()
            lbl = Forms.Label(Text=label)
            lbl.Width = 75
            row.Add(lbl)
            num = Forms.NumericUpDown()
            num.MinValue = min_val
            num.MaxValue = max_val
            num.DecimalPlaces = decimals
            num.Value = default
            num.Width = 65
            setattr(self, "num_comfort_" + attr, num)
            row.Add(num)
            row.Add(Forms.Label(Text=unit))
            row.EndHorizontal()
            comfort_params_layout.Add(row)
        
        add_comfort_row("Clothing:", "clothing", "clo", 2, 0.7, 0, 2)
        add_comfort_row("Air Velocity:", "air_vel", "m/s", 2, 0.1, 0, 2)
        add_comfort_row("Work Eff:", "work_eff", "", 2, 0.0, 0, 1)
        add_comfort_row("Ankle Vel:", "ankle_vel", "m/s", 2, 0.0, 0, 2)
        
        self.chk_ashrae_warnings = Forms.CheckBox(Text="ASHRAE 55 Warnings")
        self.chk_ashrae_warnings.Checked = False
        comfort_params_layout.AddRow(self.chk_ashrae_warnings)
        
        preset_comfort_row = Forms.DynamicLayout()
        preset_comfort_row.BeginHorizontal()
        self.btn_comfort_office = Forms.Button(Text="Office")
        self.btn_comfort_office.Width = 50
        preset_comfort_row.Add(self.btn_comfort_office)
        self.btn_comfort_residential = Forms.Button(Text="Resid")
        self.btn_comfort_residential.Width = 50
        preset_comfort_row.Add(self.btn_comfort_residential)
        self.btn_comfort_summer = Forms.Button(Text="Summer")
        self.btn_comfort_summer.Width = 50
        preset_comfort_row.Add(self.btn_comfort_summer)
        preset_comfort_row.Add(None)
        preset_comfort_row.EndHorizontal()
        comfort_params_layout.Add(preset_comfort_row)
        
        self.pnl_comfort_params.Content = comfort_params_layout
        self.pnl_comfort_params.Visible = False
        comfort_layout.Add(self.pnl_comfort_params)
        
        send_comfort_row = Forms.DynamicLayout()
        send_comfort_row.BeginHorizontal()
        self.btn_send_comfort = Forms.Button(Text="Send to GH")
        self.btn_send_comfort.Enabled = False
        send_comfort_row.Add(self.btn_send_comfort)
        send_comfort_row.Add(None)
        send_comfort_row.EndHorizontal()
        comfort_layout.Add(send_comfort_row)
        
        self.lbl_comfort_status = Forms.Label(Text="")
        comfort_layout.AddRow(self.lbl_comfort_status)
        
        grp_comfort.Content = comfort_layout
        rooms_layout.Add(grp_comfort, xscale=True)
        
        left_scrollable.Content = rooms_layout
        grp_rooms.Content = left_scrollable
        
        # --- MIDDLE: Program Definition (Scrollable) ---
        middle_scrollable = Forms.Scrollable()
        middle_scrollable.ExpandContentWidth = True
        middle_scrollable.ExpandContentHeight = False
        self._sched_col_mid = middle_scrollable  # Store reference for dynamic sizing
        
        middle_layout = Forms.DynamicLayout()
        middle_layout.DefaultSpacing = Drawing.Size(5, 4)
        
        # Load Intensities
        grp_loads = Forms.GroupBox(Text="Load Intensities")
        loads_layout = Forms.DynamicLayout()
        loads_layout.DefaultSpacing = Drawing.Size(5, 3)
        loads_layout.Padding = Drawing.Padding(6)
        
        loads_layout.AddRow(Forms.Label(Text="Program Name:"))
        self.txt_program_id = Forms.TextBox()
        self.txt_program_id.Text = "GDS_Custom_Program"
        loads_layout.AddRow(self.txt_program_id)
        
        preset_row = Forms.DynamicLayout()
        preset_row.BeginHorizontal()
        preset_row.Add(Forms.Label(Text="Preset:"))
        self.dropdown_space_type = Forms.DropDown()
        preset_row.Add(self.dropdown_space_type)
        self.btn_apply_preset = Forms.Button(Text="Apply")
        self.btn_apply_preset.Width = 45
        preset_row.Add(self.btn_apply_preset)
        preset_row.EndHorizontal()
        loads_layout.Add(preset_row)
        
        def add_intensity_row(label, attr, unit, decimals=4, default=0.0):
            row = Forms.DynamicLayout()
            row.BeginHorizontal()
            lbl = Forms.Label(Text=label)
            lbl.Width = 75
            row.Add(lbl)
            num = Forms.NumericUpDown()
            num.MinValue = 0
            num.MaxValue = 1000
            num.DecimalPlaces = decimals
            num.Value = default
            num.Width = 65
            setattr(self, "num_" + attr, num)
            row.Add(num)
            row.Add(Forms.Label(Text=unit))
            row.EndHorizontal()
            loads_layout.Add(row)
        
        add_intensity_row("People:", "people_density", "p/m²", 4, 0.0565)
        add_intensity_row("Lighting:", "lighting_power", "W/m²", 2, 10.76)
        add_intensity_row("Elec Equip:", "equipment_power", "W/m²", 2, 10.76)
        add_intensity_row("Gas Equip:", "gas_power", "W/m²", 2, 0.0)
        add_intensity_row("Infiltration:", "infiltration", "m³/s/m²", 5, 0.0003)
        add_intensity_row("Vent/Person:", "vent_person", "m³/s/p", 4, 0.006)
        add_intensity_row("Vent/Area:", "vent_area", "m³/s/m²", 5, 0.0003)
        
        # ─── Service Hot Water separator ───
        shw_sep = Forms.Label(Text="─── Service Hot Water ───")
        shw_sep.TextAlignment = Forms.TextAlignment.Center
        loads_layout.AddRow(shw_sep)
        
        # SHW Preset row
        shw_preset_row = Forms.DynamicLayout()
        shw_preset_row.BeginHorizontal()
        shw_preset_row.Add(Forms.Label(Text="SHW Preset:"))
        self.dd_shw_load_preset = Forms.DropDown()
        for p in ["None", "Residential", "Residential - ABC Baseline", "Office", "Hotel"]:
            self.dd_shw_load_preset.Items.Add(p)
        self.dd_shw_load_preset.SelectedIndex = 0
        self.dd_shw_load_preset.Width = 95
        self.dd_shw_load_preset.Height = 21
        shw_preset_row.Add(self.dd_shw_load_preset)
        self.btn_apply_shw_preset = Forms.Button(Text="Apply")
        self.btn_apply_shw_preset.Width = 45
        shw_preset_row.Add(self.btn_apply_shw_preset)
        shw_preset_row.EndHorizontal()
        loads_layout.Add(shw_preset_row)
        
        # SHW intensity rows (reuse same pattern)
        def add_shw_row(label, attr, unit, decimals=2, default=0.0, max_val=100):
            row = Forms.DynamicLayout()
            row.BeginHorizontal()
            lbl = Forms.Label(Text=label)
            lbl.Width = 75
            row.Add(lbl)
            num = Forms.NumericUpDown()
            num.MinValue = 0
            num.MaxValue = max_val
            num.DecimalPlaces = decimals
            num.Value = default
            num.Width = 65
            setattr(self, "num_shw_" + attr, num)
            row.Add(num)
            row.Add(Forms.Label(Text=unit))
            row.EndHorizontal()
            loads_layout.Add(row)
        
        add_shw_row("Flow/Area:", "flow", "L/h/m²", 3, 0.0, 50.0)
        add_shw_row("Target Temp:", "temp", "°C", 1, 49.0, 100.0)
        add_shw_row("Sensible:", "sensible", "", 2, 0.2, 1.0)
        add_shw_row("Latent:", "latent", "", 2, 0.05, 1.0)
        
        # SHW Schedule dropdown
        shw_sched_row = Forms.DynamicLayout()
        shw_sched_row.BeginHorizontal()
        lbl = Forms.Label(Text="SHW Sched:")
        lbl.Width = 75
        shw_sched_row.Add(lbl)
        self.dd_shw_schedule = Forms.DropDown()
        self.dd_shw_schedule.Width = 115
        self.dd_shw_schedule.Height = 21
        shw_sched_row.Add(self.dd_shw_schedule)
        shw_sched_row.EndHorizontal()
        loads_layout.Add(shw_sched_row)
        
        # SHW Equipment Type dropdown (determines fuel source)
        shw_equip_row = Forms.DynamicLayout()
        shw_equip_row.BeginHorizontal()
        lbl_equip = Forms.Label(Text="SHW Equip:")
        lbl_equip.Width = 75
        shw_equip_row.Add(lbl_equip)
        self.dd_shw_equipment = Forms.DropDown()
        for et in SHW_EQUIPMENT_TYPES:
            self.dd_shw_equipment.Items.Add(et)
        self.dd_shw_equipment.SelectedIndex = 0
        self.dd_shw_equipment.Width = 115
        self.dd_shw_equipment.Height = 21
        shw_equip_row.Add(self.dd_shw_equipment)
        shw_equip_row.EndHorizontal()
        loads_layout.Add(shw_equip_row)
        
        # ── SHW Tank Parameters (shown only for tank-type heaters) ──
        self.shw_tank_panel = Forms.DynamicLayout()
        self.shw_tank_panel.DefaultSpacing = Drawing.Size(5, 2)
        
        # Tank UA row
        ua_row = Forms.DynamicLayout()
        ua_row.BeginHorizontal()
        lbl_ua = Forms.Label(Text="Tank UA:")
        lbl_ua.Width = 75
        ua_row.Add(lbl_ua)
        self.num_shw_tank_ua = Forms.NumericStepper()
        self.num_shw_tank_ua.DecimalPlaces = 1
        self.num_shw_tank_ua.MinValue = 0.0
        self.num_shw_tank_ua.MaxValue = 100.0
        self.num_shw_tank_ua.Value = 6.0
        self.num_shw_tank_ua.Width = 70
        self.num_shw_tank_ua.Height = 21
        self.num_shw_tank_ua.Increment = 0.5
        ua_row.Add(self.num_shw_tank_ua)
        ua_row.Add(Forms.Label(Text="W/K"))
        ua_row.EndHorizontal()
        self.shw_tank_panel.Add(ua_row)
        
        # Ambient temperature row
        amb_row = Forms.DynamicLayout()
        amb_row.BeginHorizontal()
        lbl_amb = Forms.Label(Text="Ambient:")
        lbl_amb.Width = 75
        amb_row.Add(lbl_amb)
        self.num_shw_ambient = Forms.NumericStepper()
        self.num_shw_ambient.DecimalPlaces = 1
        self.num_shw_ambient.MinValue = 0.0
        self.num_shw_ambient.MaxValue = 50.0
        self.num_shw_ambient.Value = 22.0
        self.num_shw_ambient.Width = 70
        self.num_shw_ambient.Height = 21
        self.num_shw_ambient.Increment = 0.5
        amb_row.Add(self.num_shw_ambient)
        amb_row.Add(Forms.Label(Text="°C"))
        amb_row.EndHorizontal()
        self.shw_tank_panel.Add(amb_row)
        
        # Efficiency row
        eff_row = Forms.DynamicLayout()
        eff_row.BeginHorizontal()
        lbl_eff = Forms.Label(Text="Efficiency:")
        lbl_eff.Width = 75
        eff_row.Add(lbl_eff)
        self.num_shw_efficiency = Forms.NumericStepper()
        self.num_shw_efficiency.DecimalPlaces = 2
        self.num_shw_efficiency.MinValue = 0.1
        self.num_shw_efficiency.MaxValue = 5.0
        self.num_shw_efficiency.Value = 1.0
        self.num_shw_efficiency.Width = 70
        self.num_shw_efficiency.Height = 21
        self.num_shw_efficiency.Increment = 0.05
        eff_row.Add(self.num_shw_efficiency)
        eff_row.EndHorizontal()
        self.shw_tank_panel.Add(eff_row)
        
        loads_layout.Add(self.shw_tank_panel)
        self._update_shw_tank_visibility()
        
        grp_loads.Content = loads_layout
        middle_layout.Add(grp_loads, xscale=True)
        
        # Schedule Assignments
        grp_sched = Forms.GroupBox(Text="Schedule Assignments")
        sched_layout = Forms.DynamicLayout()
        sched_layout.DefaultSpacing = Drawing.Size(5, 3)
        sched_layout.Padding = Drawing.Padding(6)
        
        def add_schedule_row(label, attr):
            row = Forms.DynamicLayout()
            row.BeginHorizontal()
            lbl = Forms.Label(Text=label)
            lbl.Width = 70
            row.Add(lbl)
            dd = Forms.DropDown()
            dd.Width = 115
            dd.Height = 21
            setattr(self, "dd_" + attr, dd)
            row.Add(dd)
            row.EndHorizontal()
            sched_layout.Add(row)
        
        add_schedule_row("Occ (WD):", "occ_wd")
        add_schedule_row("Occ (WE):", "occ_we")
        add_schedule_row("Lighting:", "lighting")
        add_schedule_row("Equipment:", "equipment")
        add_schedule_row("Infiltration:", "infiltration")
        add_schedule_row("Heating:", "heating")
        add_schedule_row("Cooling:", "cooling")
        add_schedule_row("Activity:", "activity")
        
        grp_sched.Content = sched_layout
        middle_layout.Add(grp_sched, xscale=True, yscale=False)
        
        # Custom Schedule Editor (inline)
        grp_custom = Forms.GroupBox(Text="Custom Schedule Editor")
        custom_layout = Forms.DynamicLayout()
        custom_layout.DefaultSpacing = Drawing.Size(3, 2)
        custom_layout.Padding = Drawing.Padding(6)
        
        # Name and type row
        name_type_row = Forms.DynamicLayout()
        name_type_row.BeginHorizontal()
        name_type_row.Add(Forms.Label(Text="Name:"))
        self.txt_custom_sched_name = Forms.TextBox()
        self.txt_custom_sched_name.Text = "My_Schedule"
        self.txt_custom_sched_name.Width = 80
        name_type_row.Add(self.txt_custom_sched_name)
        name_type_row.Add(Forms.Label(Text="Type:"))
        self.dd_custom_type = Forms.DropDown()
        self.dd_custom_type.Items.Add("Fractional")
        self.dd_custom_type.Items.Add("Setpoint")
        self.dd_custom_type.Items.Add("Activity")
        self.dd_custom_type.SelectedIndex = 0
        self.dd_custom_type.Width = 70
        self.dd_custom_type.Height = 21
        name_type_row.Add(self.dd_custom_type)
        name_type_row.EndHorizontal()
        custom_layout.Add(name_type_row)
        
        # 24-hour values as single text input
        custom_layout.AddRow(Forms.Label(Text="24 values (comma-separated):"))
        self.txt_custom_values = Forms.TextArea()
        self.txt_custom_values.Text = "0,0,0,0,0,0,0.1,0.2,0.95,0.95,0.95,0.5,0.95,0.95,0.95,0.95,0.95,0.3,0.1,0,0,0,0,0"
        self.txt_custom_values.Height = 36
        custom_layout.Add(self.txt_custom_values, xscale=True)
        
        # Quick fill buttons
        fill_row = Forms.DynamicLayout()
        fill_row.BeginHorizontal()
        self.btn_fill_office = Forms.Button(Text="Office")
        self.btn_fill_office.Width = 50
        fill_row.Add(self.btn_fill_office)
        self.btn_fill_residential = Forms.Button(Text="Resid")
        self.btn_fill_residential.Width = 50
        fill_row.Add(self.btn_fill_residential)
        self.btn_fill_constant = Forms.Button(Text="Const")
        self.btn_fill_constant.Width = 50
        fill_row.Add(self.btn_fill_constant)
        fill_row.Add(None)
        fill_row.EndHorizontal()
        custom_layout.Add(fill_row)
        
        # Save button
        save_row = Forms.DynamicLayout()
        save_row.BeginHorizontal()
        self.btn_save_custom = Forms.Button(Text="Save to GH Panel")
        save_row.Add(self.btn_save_custom)
        self.btn_load_custom = Forms.Button(Text="Load from GH")
        save_row.Add(self.btn_load_custom)
        save_row.Add(None)
        save_row.EndHorizontal()
        custom_layout.Add(save_row)
        
        self.lbl_custom_status = Forms.Label(Text="")
        custom_layout.AddRow(self.lbl_custom_status)
        
        grp_custom.Content = custom_layout
        middle_layout.Add(grp_custom, xscale=True, yscale=True)
        
        
        # --- RIGHT: Preview & Actions ---
        right_layout = Forms.DynamicLayout()
        right_layout.DefaultSpacing = Drawing.Size(5, 6)
        
        grp_summary = create_shaded_groupbox("Program Summary")
        summary_layout = Forms.DynamicLayout()
        summary_layout.Padding = Drawing.Padding(4)
        summary_layout.BackgroundColor = RESULT_BG_COLOR
        
        self.txt_program_summary = Forms.TextArea()
        self.txt_program_summary.ReadOnly = True
        self.txt_program_summary.Height = 140
        try:
            self.txt_program_summary.Font = Drawing.Font("Consolas", 8)
        except:
            pass
        summary_layout.Add(self.txt_program_summary, xscale=True, yscale=True)
        
        summary_layout.AddRow(Forms.Label(Text="JSON Preview"))
        self.txt_json_output = Forms.TextArea()
        self.txt_json_output.ReadOnly = True
        self.txt_json_output.Height = 120
        try:
            self.txt_json_output.Font = Drawing.Font("Consolas", 8)
        except:
            pass
        summary_layout.Add(self.txt_json_output, xscale=True, yscale=True)
        grp_summary.Content = summary_layout
        
        right_layout.Add(grp_summary, xscale=True, yscale=True)
        
        middle_scrollable.Content = middle_layout
        
        columns.Add(grp_rooms, xscale=False, yscale=True)
        columns.Add(middle_scrollable, xscale=False, yscale=True)
        columns.Add(right_layout, xscale=True, yscale=True)
        columns.EndHorizontal()
        
        layout.Add(columns, xscale=True, yscale=True)
        
        # Bottom buttons
        btn_bar = Forms.DynamicLayout()
        btn_bar.BeginHorizontal()
        btn_bar.Add(None)
        self.btn_preview_program = Forms.Button(Text="Preview Program")
        self.btn_assign_program = Forms.Button(Text="Assign to Selected Rooms")
        self.btn_clear_pending = Forms.Button(Text="Clear Pending")
        self.btn_output_programs = Forms.Button(Text="Apply")
        self.btn_export_json = Forms.Button(Text="Export JSON")
        btn_bar.Add(self.btn_preview_program)
        btn_bar.Add(self.btn_assign_program)
        btn_bar.Add(self.btn_clear_pending)
        # Spacer between workflow buttons and output buttons
        spacer = Forms.Label(Text="   |   ")
        btn_bar.Add(spacer)
        btn_bar.Add(self.btn_output_programs)
        btn_bar.Add(self.btn_export_json)
        spacer2 = Forms.Label(Text="   |   ")
        btn_bar.Add(spacer2)
        self.btn_restore_session = Forms.Button(Text="Restore Session")
        btn_bar.Add(self.btn_restore_session)
        btn_bar.Add(None)
        # Initialization status label
        self.lbl_init_status = Forms.Label(Text="")
        self.lbl_init_status.TextColor = Drawing.Color.FromArgb(80, 80, 80)  # Gray initially
        btn_bar.Add(self.lbl_init_status)
        btn_bar.EndHorizontal()
        layout.Add(btn_bar)
        
        self.tab_schedule.Content = layout
        
        # Initialize dropdowns with presets only (GDS database not loaded yet)
        self._populate_schedule_dropdowns()
        # NOTE: _restore_service_state() is called from __init__ AFTER GDS database auto-load
    
    def _populate_schedule_dropdowns(self):
        """Populate all schedule dropdowns with presets, GDS, HB library, and custom items"""
        def populate_dd(dd, presets, gds_source=None, hb_filter=None, custom_type=None):
            current = str(dd.SelectedValue) if dd.SelectedIndex >= 0 else None
            dd.Items.Clear()
            
            # Add hardcoded presets first
            for p in presets.keys():
                dd.Items.Add(p)
            
            # Add saved custom schedules
            if self.saved_custom_schedules:
                for name, data in self.saved_custom_schedules.items():
                    # Filter by type if specified
                    if custom_type:
                        sched_type = data.get("type", "fractional")
                        if custom_type == "setpoint" and sched_type not in ["setpoint", "temperature"]:
                            continue
                        elif custom_type == "activity" and sched_type != "activity":
                            continue
                        elif custom_type == "fractional" and sched_type not in ["fractional", ""]:
                            continue
                    dd.Items.Add("Custom:" + name)
            
            # Add GDS items (append [S] tag for seasonal composites)
            if gds_source:
                for name in sorted(gds_source.keys()):
                    if gds_source[name].get('is_seasonal', False):
                        dd.Items.Add("[GDS] " + name + " [S]")
                    else:
                        dd.Items.Add("[GDS] " + name)
            
            # Add HB library items
            if self.hb_library_schedules and hb_filter:
                for sched_id in self.hb_library_schedules:
                    if hb_filter(sched_id):
                        dd.Items.Add("[HB] " + sched_id)
            
            if dd.Items.Count > 0:
                dd.SelectedIndex = 0
            
            # Restore selection if possible
            if current:
                for i in range(dd.Items.Count):
                    if str(dd.Items[i]) == current:
                        dd.SelectedIndex = i
                        break
        
        gds_sched = self.gds_parser.schedules if self.gds_parser else {}
        gds_setp = self.gds_parser.setpoints if self.gds_parser else {}
        
        populate_dd(self.dd_occ_wd, SCHEDULE_PRESETS, gds_sched, lambda x: 'occ' in x.lower(), "fractional")
        populate_dd(self.dd_occ_we, SCHEDULE_PRESETS, gds_sched, lambda x: 'occ' in x.lower(), "fractional")
        populate_dd(self.dd_lighting, SCHEDULE_PRESETS, gds_sched, lambda x: 'light' in x.lower(), "fractional")
        populate_dd(self.dd_equipment, SCHEDULE_PRESETS, gds_sched, lambda x: 'equip' in x.lower() or 'plug' in x.lower(), "fractional")
        populate_dd(self.dd_infiltration, SCHEDULE_PRESETS, gds_sched, lambda x: 'infil' in x.lower(), "fractional")
        populate_dd(self.dd_heating, SETPOINT_PRESETS, gds_setp, lambda x: 'htg' in x.lower() or 'heat' in x.lower(), "setpoint")
        populate_dd(self.dd_cooling, SETPOINT_PRESETS, gds_setp, lambda x: 'clg' in x.lower() or 'cool' in x.lower(), "setpoint")
        populate_dd(self.dd_activity, ACTIVITY_PRESETS, {}, lambda x: 'activity' in x.lower(), "activity")
        
        # SHW Schedule dropdown
        if hasattr(self, 'dd_shw_schedule'):
            self.dd_shw_schedule.Items.Clear()
            for s in ["Residential", "Office Weekday", "Always On"]:
                self.dd_shw_schedule.Items.Add(s)
            if self.gds_parser and self.gds_parser.schedules:
                for name in sorted(self.gds_parser.schedules.keys()):
                    tag = " [S]" if self.gds_parser.schedules[name].get('is_seasonal', False) else ""
                    self.dd_shw_schedule.Items.Add("[GDS] " + name + tag)
            if self.dd_shw_schedule.Items.Count > 0:
                self.dd_shw_schedule.SelectedIndex = 0
        
        # Update intensity dropdown
        self.dropdown_space_type.Items.Clear()
        for st in ["Office", "Retail", "Residential", "Laboratory", "Hospital"]:
            self.dropdown_space_type.Items.Add(st)
        if self.gds_parser and self.gds_parser.intensities:
            for name in sorted(self.gds_parser.intensities.keys()):
                self.dropdown_space_type.Items.Add("[GDS] " + name)
        if self.dropdown_space_type.Items.Count > 0:
            self.dropdown_space_type.SelectedIndex = 0
    
    def _create_hvac_module(self):
        """Simple HVAC module"""
        layout = Forms.DynamicLayout()
        layout.DefaultSpacing = Drawing.Size(10, 10)
        layout.Padding = Drawing.Padding(15)
        
        layout.AddRow(Forms.Label(Text="Set default HVAC system for all rooms:"))
        
        layout.AddRow(Forms.Label(Text="Building Type:"))
        self.dd_hvac_preset = Forms.DropDown()
        self.dd_hvac_preset.Items.Add("Office - Standard")
        self.dd_hvac_preset.Items.Add("Office - High Efficiency")
        self.dd_hvac_preset.Items.Add("Residential")
        self.dd_hvac_preset.Items.Add("Retail")
        self.dd_hvac_preset.Items.Add("Hotel")
        self.dd_hvac_preset.Items.Add("School")
        self.dd_hvac_preset.Items.Add("Hospital")
        self.dd_hvac_preset.Items.Add("Ideal Air (Loads Only)")
        self.dd_hvac_preset.SelectedIndex = 0
        layout.AddRow(self.dd_hvac_preset)
        
        layout.AddSpace()
        
        layout.AddRow(Forms.Label(Text="System Details:"))
        self.txt_hvac_details = Forms.TextArea()
        self.txt_hvac_details.ReadOnly = True
        self.txt_hvac_details.Height = 150
        layout.Add(self.txt_hvac_details, xscale=True, yscale=True)
        
        layout.AddSpace()
        
        self.btn_hvac_set = Forms.Button(Text="Set as Default for All Rooms")
        layout.AddRow(self.btn_hvac_set)
        
        self.lbl_hvac_status = Forms.Label(Text="")
        layout.AddRow(self.lbl_hvac_status)
        
        note = Forms.Label(Text="Reference case uses Ideal Air (loads only).\nDesign case HVAC is applied automatically via GDS GBE Refiner.\nFor room-by-room override, use Refiner's HVAC tab.")
        note.TextColor = Drawing.Color.FromArgb(120, 120, 120)
        layout.AddRow(note)
        
        self.tab_hvac.Content = layout
    
    def _create_site_module(self):
        """Module 5: Site + Weather + Renewables (HB Native)
        Layout: 3 columns (4:3:3 ratio)
        - Column 1: Site Definition (top) + Weather Definition (bottom) stacked
        - Column 2: Renewable Energy tabs (PV + SHW)
        - Column 3: System Summary
        """
        layout = Forms.DynamicLayout()
        layout.DefaultSpacing = Drawing.Size(8, 8)
        layout.Padding = Drawing.Padding(10)
        
        columns = Forms.DynamicLayout()
        columns.DefaultSpacing = Drawing.Size(8, 0)
        columns.BeginHorizontal()
        
        # --- COLUMN 1: Site + Weather (Stacked) ---
        col1_layout = Forms.DynamicLayout()
        col1_layout.DefaultSpacing = Drawing.Size(0, 8)
        
        # --- Site Definition (Top) ---
        grp_site = Forms.GroupBox(Text="Site Definition")
        site_layout = Forms.DynamicLayout()
        site_layout.DefaultSpacing = Drawing.Size(5, 5)
        site_layout.Padding = Drawing.Padding(8)
        
        # Include context geometry checkbox (at top)
        self.chk_inc_context = Forms.CheckBox(Text="Include context geometry in simulation")
        self.chk_inc_context.Checked = get_toggles_aggregate(NAME_INC_CONTEXT)
        self.chk_inc_context.ToolTip = "When enabled, context geometry (surrounding buildings, terrain)\nwill be included as shading surfaces in the Model.\nDisable to speed up simulation or isolate building performance."
        site_layout.AddRow(self.chk_inc_context)
        
        site_layout.AddRow(Forms.Label(Text="Site Context Path:"))
        self.txt_site_context = Forms.TextArea()
        self.txt_site_context.Text = get_first_input_panel_text(NAME_SITE_CONTEXT)
        self.txt_site_context.Height = 40
        site_layout.Add(self.txt_site_context, xscale=True)
        
        site_layout.AddRow(Forms.Label(Text="Site Name:"))
        self.txt_site_name = Forms.TextArea()
        self.txt_site_name.Text = get_first_input_panel_text(NAME_SITE_NAME)
        self.txt_site_name.Height = 25
        site_layout.Add(self.txt_site_name, xscale=True)
        
        site_idx_info = get_slider_info(NAME_SITE_INDEX, 0)
        idx_row = Forms.DynamicLayout()
        idx_row.BeginHorizontal()
        idx_row.Add(Forms.Label(Text="Site Index:"))
        self.num_site_index = Forms.NumericUpDown()
        self.num_site_index.MinValue = site_idx_info[0]
        self.num_site_index.MaxValue = site_idx_info[1]
        self.num_site_index.DecimalPlaces = site_idx_info[0]
        self.num_site_index.Increment = 1
        self.num_site_index.Value = site_idx_info[2]
        self.num_site_index.Width = 60
        idx_row.Add(self.num_site_index)
        idx_row.Add(None)
        idx_row.EndHorizontal()
        site_layout.Add(idx_row)
        
        site_btn_row = Forms.DynamicLayout()
        site_btn_row.BeginHorizontal()
        self.btn_site_apply = Forms.Button(Text="Apply")
        self.btn_site_apply.Width = 60
        site_btn_row.Add(self.btn_site_apply)
        self.btn_site_overwrite = Forms.Button(Text="Overwrite")
        self.btn_site_overwrite.Width = 70
        site_btn_row.Add(self.btn_site_overwrite)
        site_btn_row.Add(None)
        site_btn_row.EndHorizontal()
        site_layout.Add(site_btn_row)
        
        # Add spacer to prevent buttons from stretching vertically
        site_layout.Add(None, yscale=True)
        
        grp_site.Content = site_layout
        
        # --- Weather Definition (Bottom) ---
        grp_weather = Forms.GroupBox(Text="Weather Definition")
        weather_layout = Forms.DynamicLayout()
        weather_layout.DefaultSpacing = Drawing.Size(5, 5)
        weather_layout.Padding = Drawing.Padding(8)
        
        weather_layout.AddRow(Forms.Label(Text="Weather File Path (EPW):"))
        self.txt_weather_path = Forms.TextArea()
        self.txt_weather_path.Text = get_first_input_panel_text(NAME_WEATHER_PATH)
        self.txt_weather_path.Height = 50
        weather_layout.Add(self.txt_weather_path, xscale=True)
        
        self.btn_weather_apply = Forms.Button(Text="Apply Weather Path")
        weather_layout.AddRow(self.btn_weather_apply)
        
        weather_layout.Add(None, yscale=True)
        grp_weather.Content = weather_layout
        
        # Stack Site and Weather using splitter (1:1 height ratio)
        self._site_col1_split = Forms.Splitter()
        self._site_col1_split.Orientation = Forms.Orientation.Vertical
        self._site_col1_split.Panel1 = grp_site
        self._site_col1_split.Panel2 = grp_weather
        self._site_col1_split.Position = 180
        
        col1_layout.Add(self._site_col1_split, xscale=True, yscale=True)
        
        # --- COLUMN 2: Renewable Energy (PV + SHW tabs) ---
        grp_renewables = Forms.GroupBox(Text="Renewable Energy (HB Native)")
        renewables_layout = Forms.DynamicLayout()
        renewables_layout.Padding = Drawing.Padding(4)
        
        self.tab_site_renewables = Forms.TabControl()
        
        # -------- PV TAB --------
        tab_pv = Forms.TabPage(Text="Photovoltaic")
        pv_layout = Forms.DynamicLayout()
        pv_layout.DefaultSpacing = Drawing.Size(4, 4)
        pv_layout.Padding = Drawing.Padding(6)
        
        # Preset selection
        preset_row = Forms.DynamicLayout()
        preset_row.BeginHorizontal()
        preset_row.Add(Forms.Label(Text="Preset:"))
        self.dd_pv_preset = Forms.DropDown()
        self.dd_pv_preset.Width = 130
        self.dd_pv_preset.Height = 21
        for preset in PV_PRESETS.keys():
            self.dd_pv_preset.Items.Add(preset)
        self.dd_pv_preset.SelectedIndex = 0
        preset_row.Add(self.dd_pv_preset)
        preset_row.Add(None)
        preset_row.EndHorizontal()
        pv_layout.Add(preset_row)
        
        # Efficiency and Active Area
        eff_row = Forms.DynamicLayout()
        eff_row.BeginHorizontal()
        eff_row.Add(Forms.Label(Text="Eff:"))
        self.num_pv_efficiency = Forms.NumericUpDown()
        self.num_pv_efficiency.MinValue = 0.05
        self.num_pv_efficiency.MaxValue = 0.25
        self.num_pv_efficiency.DecimalPlaces = 2
        self.num_pv_efficiency.Increment = 0.01
        self.num_pv_efficiency.Value = 0.15
        self.num_pv_efficiency.Width = 55
        eff_row.Add(self.num_pv_efficiency)
        eff_row.Add(Forms.Label(Text="Active:"))
        self.num_pv_active = Forms.NumericUpDown()
        self.num_pv_active.MinValue = 0.5
        self.num_pv_active.MaxValue = 1.0
        self.num_pv_active.DecimalPlaces = 2
        self.num_pv_active.Increment = 0.05
        self.num_pv_active.Value = 0.9
        self.num_pv_active.Width = 50
        eff_row.Add(self.num_pv_active)
        eff_row.Add(None)
        eff_row.EndHorizontal()
        pv_layout.Add(eff_row)
        
        # Module type and Loss fraction
        mod_row = Forms.DynamicLayout()
        mod_row.BeginHorizontal()
        mod_row.Add(Forms.Label(Text="Module:"))
        self.dd_pv_module_type = Forms.DropDown()
        self.dd_pv_module_type.Width = 75
        self.dd_pv_module_type.Height = 21
        for mt in PV_MODULE_TYPES:
            self.dd_pv_module_type.Items.Add(mt)
        self.dd_pv_module_type.SelectedIndex = 0
        mod_row.Add(self.dd_pv_module_type)
        mod_row.Add(Forms.Label(Text="Loss:"))
        self.num_pv_loss = Forms.NumericUpDown()
        self.num_pv_loss.MinValue = 0.0
        self.num_pv_loss.MaxValue = 0.5
        self.num_pv_loss.DecimalPlaces = 2
        self.num_pv_loss.Increment = 0.01
        self.num_pv_loss.Value = 0.14
        self.num_pv_loss.Width = 50
        mod_row.Add(self.num_pv_loss)
        mod_row.Add(None)
        mod_row.EndHorizontal()
        pv_layout.Add(mod_row)
        
        # Mounting type
        mount_row = Forms.DynamicLayout()
        mount_row.BeginHorizontal()
        mount_row.Add(Forms.Label(Text="Mounting:"))
        self.dd_pv_mounting = Forms.DropDown()
        self.dd_pv_mounting.Width = 120
        self.dd_pv_mounting.Height = 21
        for mt in PV_MOUNTING_TYPES:
            self.dd_pv_mounting.Items.Add(mt)
        self.dd_pv_mounting.SelectedIndex = 0
        mount_row.Add(self.dd_pv_mounting)
        mount_row.Add(None)
        mount_row.EndHorizontal()
        pv_layout.Add(mount_row)
        
        # Tracking GCR (only for OneAxis)
        gcr_row = Forms.DynamicLayout()
        gcr_row.BeginHorizontal()
        gcr_row.Add(Forms.Label(Text="GCR:"))
        self.num_pv_gcr = Forms.NumericUpDown()
        self.num_pv_gcr.MinValue = 0.1
        self.num_pv_gcr.MaxValue = 0.9
        self.num_pv_gcr.DecimalPlaces = 2
        self.num_pv_gcr.Increment = 0.05
        self.num_pv_gcr.Value = 0.4
        self.num_pv_gcr.Width = 50
        self.num_pv_gcr.Enabled = False
        gcr_row.Add(self.num_pv_gcr)
        self.lbl_gcr_note = Forms.Label(Text="(OneAxis only)")
        gcr_row.Add(self.lbl_gcr_note)
        gcr_row.Add(None)
        gcr_row.EndHorizontal()
        pv_layout.Add(gcr_row)
        
        pv_layout.AddSpace()
        
        # Shade selection
        pv_layout.AddRow(Forms.Label(Text="PV Surfaces (HB Shades):"))
        
        shade_btn_row = Forms.DynamicLayout()
        shade_btn_row.BeginHorizontal()
        self.btn_load_pv_shades = Forms.Button(Text="Load")
        self.btn_load_pv_shades.Width = 50
        shade_btn_row.Add(self.btn_load_pv_shades)
        self.btn_pick_pv_shades = Forms.Button(Text="Pick")
        self.btn_pick_pv_shades.Width = 45
        shade_btn_row.Add(self.btn_pick_pv_shades)
        shade_btn_row.Add(None)
        shade_btn_row.EndHorizontal()
        pv_layout.Add(shade_btn_row)
        
        self.lbl_pv_shade_status = Forms.Label(Text="0 shades (0 m²)")
        pv_layout.AddRow(self.lbl_pv_shade_status)
        
        # Action buttons
        pv_action_row = Forms.DynamicLayout()
        pv_action_row.BeginHorizontal()
        self.btn_apply_pv = Forms.Button(Text="Apply PV")
        self.btn_apply_pv.Width = 70
        pv_action_row.Add(self.btn_apply_pv)
        self.btn_clear_pv = Forms.Button(Text="Clear")
        self.btn_clear_pv.Width = 50
        pv_action_row.Add(self.btn_clear_pv)
        pv_action_row.Add(None)
        pv_action_row.EndHorizontal()
        pv_layout.Add(pv_action_row)
        
        pv_layout.Add(None, yscale=True)
        
        tab_pv.Content = pv_layout
        self.tab_site_renewables.Pages.Add(tab_pv)
        
        # -------- SOLAR HOT WATER TAB --------
        tab_solhw = Forms.TabPage(Text="Solar Hot Water")
        solhw_layout = Forms.DynamicLayout()
        solhw_layout.DefaultSpacing = Drawing.Size(4, 4)
        solhw_layout.Padding = Drawing.Padding(6)
        
        solhw_layout.AddRow(Forms.Label(Text="Solar Hot Water (HB SHW)"))
        solhw_layout.AddSpace()
        
        # Equipment type
        equip_row = Forms.DynamicLayout()
        equip_row.BeginHorizontal()
        equip_row.Add(Forms.Label(Text="Equipment:"))
        self.dd_solhw_equipment = Forms.DropDown()
        self.dd_solhw_equipment.Width = 140
        solhw_equipment_types = [
            "Gas_WaterHeater",
            "Electric_WaterHeater",
            "HeatPump_WaterHeater",
            "Gas_TanklessHeater",
            "Electric_TanklessHeater",
        ]
        for eq in solhw_equipment_types:
            self.dd_solhw_equipment.Items.Add(eq)
        self.dd_solhw_equipment.SelectedIndex = 0
        equip_row.Add(self.dd_solhw_equipment)
        equip_row.Add(None)
        equip_row.EndHorizontal()
        solhw_layout.Add(equip_row)
        
        # Collector preset
        solhw_preset_row = Forms.DynamicLayout()
        solhw_preset_row.BeginHorizontal()
        solhw_preset_row.Add(Forms.Label(Text="Collector:"))
        self.dd_solhw_preset = Forms.DropDown()
        self.dd_solhw_preset.Width = 140
        for preset in SOLHW_PRESETS.keys():
            self.dd_solhw_preset.Items.Add(preset)
        self.dd_solhw_preset.SelectedIndex = 0
        solhw_preset_row.Add(self.dd_solhw_preset)
        solhw_preset_row.Add(None)
        solhw_preset_row.EndHorizontal()
        solhw_layout.Add(solhw_preset_row)
        
        # Area and Efficiency
        solhw_area_row = Forms.DynamicLayout()
        solhw_area_row.BeginHorizontal()
        solhw_area_row.Add(Forms.Label(Text="Area (m²):"))
        self.num_solhw_area = Forms.NumericUpDown()
        self.num_solhw_area.MinValue = 1
        self.num_solhw_area.MaxValue = 100
        self.num_solhw_area.Value = 4
        self.num_solhw_area.Width = 50
        solhw_area_row.Add(self.num_solhw_area)
        solhw_area_row.Add(Forms.Label(Text="Eff:"))
        self.num_solhw_efficiency = Forms.NumericUpDown()
        self.num_solhw_efficiency.MinValue = 0.3
        self.num_solhw_efficiency.MaxValue = 0.8
        self.num_solhw_efficiency.DecimalPlaces = 2
        self.num_solhw_efficiency.Value = 0.50
        self.num_solhw_efficiency.Width = 50
        solhw_area_row.Add(self.num_solhw_efficiency)
        solhw_area_row.Add(None)
        solhw_area_row.EndHorizontal()
        solhw_layout.Add(solhw_area_row)
        
        solhw_layout.AddSpace()
        
        self.chk_solhw_enable = Forms.CheckBox(Text="Enable Solar Hot Water")
        solhw_layout.AddRow(self.chk_solhw_enable)
        
        solhw_layout.AddSpace()
        
        self.btn_apply_solhw = Forms.Button(Text="Apply Solar HW Config")
        solhw_layout.AddRow(self.btn_apply_solhw)
        
        solhw_layout.AddSpace()
        solhw_layout.AddRow(Forms.Label(Text="Use with HB SHW System"))
        
        solhw_layout.Add(None, yscale=True)
        
        tab_solhw.Content = solhw_layout
        self.tab_site_renewables.Pages.Add(tab_solhw)
        
        renewables_layout.Add(self.tab_site_renewables, xscale=True, yscale=True)
        grp_renewables.Content = renewables_layout
        
        # --- COLUMN 3: System Summary ---
        grp_results = create_shaded_groupbox("System Summary")
        results_layout = Forms.DynamicLayout()
        results_layout.Padding = Drawing.Padding(4)
        results_layout.BackgroundColor = RESULT_BG_COLOR
        
        self.txt_pv_summary = Forms.TextArea()
        self.txt_pv_summary.ReadOnly = True
        try:
            self.txt_pv_summary.Font = Drawing.Font("Consolas", 9)
        except:
            pass
        self.txt_pv_summary.Text = "No renewable systems configured.\n\nPV: Select shades, Apply PV\nSolar HW: Enable, Apply Config\n\nFor Battery & Wind (IDF),\nsee Module 6: Advanced."
        results_layout.Add(self.txt_pv_summary, xscale=True, yscale=True)
        grp_results.Content = results_layout
        
        # Store column references for dynamic sizing (4:3:3 ratio)
        self._site_col_left = col1_layout
        self._site_col_mid = grp_renewables
        self._site_col_right = grp_results
        
        columns.Add(col1_layout, xscale=False, yscale=True)
        columns.Add(grp_renewables, xscale=False, yscale=True)
        columns.Add(grp_results, xscale=True, yscale=True)
        columns.EndHorizontal()
        
        layout.Add(columns, xscale=True, yscale=True)
        
        btn_bar_site = Forms.DynamicLayout()
        btn_bar_site.BeginHorizontal()
        btn_bar_site.Add(None)
        self.btn_site_resync = Forms.Button(Text="Re-sync Outputs")
        btn_bar_site.Add(self.btn_site_resync)
        btn_bar_site.Add(None)
        btn_bar_site.EndHorizontal()
        layout.Add(btn_bar_site)
        
        self.tab_site.Content = layout
    
    def _create_renewables_module(self):
        """Module 6: Advanced (IDF Injection) - Battery and Wind only
        Layout: Two columns (3:1 ratio) - Config tabs | IDF Preview
        """
        layout = Forms.DynamicLayout()
        layout.DefaultSpacing = Drawing.Size(8, 8)
        layout.Padding = Drawing.Padding(10)
        
        # Two-column layout
        columns = Forms.DynamicLayout()
        columns.BeginHorizontal()
        
        # --- LEFT COLUMN (3): Configuration Tabs ---
        grp_config = Forms.GroupBox(Text="System Configuration")
        config_layout = Forms.DynamicLayout()
        config_layout.Padding = Drawing.Padding(4)
        
        self.tab_renewables_systems = Forms.TabControl()
        
        # -------- BATTERY TAB --------
        tab_battery = Forms.TabPage(Text="Battery Storage")
        batt_layout = Forms.DynamicLayout()
        batt_layout.DefaultSpacing = Drawing.Size(5, 6)
        batt_layout.Padding = Drawing.Padding(8)
        
        batt_layout.AddRow(Forms.Label(Text="Battery Energy Storage System"))
        batt_layout.AddSpace()
        
        # Enable checkbox
        self.chk_battery = Forms.CheckBox(Text="Enable Battery Storage")
        batt_layout.AddRow(self.chk_battery)
        batt_layout.AddSpace()
        
        # Preset
        batt_preset_row = Forms.DynamicLayout()
        batt_preset_row.BeginHorizontal()
        batt_preset_row.Add(Forms.Label(Text="Preset:"))
        self.dd_batt_preset = Forms.DropDown()
        self.dd_batt_preset.Width = 180
        for preset in BATTERY_PRESETS.keys():
            self.dd_batt_preset.Items.Add(preset)
        self.dd_batt_preset.SelectedIndex = 1
        batt_preset_row.Add(self.dd_batt_preset)
        batt_preset_row.Add(None)
        batt_preset_row.EndHorizontal()
        batt_layout.Add(batt_preset_row)
        
        # Capacity
        batt_cap_row = Forms.DynamicLayout()
        batt_cap_row.BeginHorizontal()
        batt_cap_row.Add(Forms.Label(Text="Capacity (kWh):"))
        self.num_batt_capacity = Forms.NumericUpDown()
        self.num_batt_capacity.MinValue = 1
        self.num_batt_capacity.MaxValue = 1000
        self.num_batt_capacity.DecimalPlaces = 1
        self.num_batt_capacity.Value = 13.5
        self.num_batt_capacity.Width = 70
        batt_cap_row.Add(self.num_batt_capacity)
        batt_cap_row.Add(None)
        batt_cap_row.EndHorizontal()
        batt_layout.Add(batt_cap_row)
        
        # Power
        batt_pwr_row = Forms.DynamicLayout()
        batt_pwr_row.BeginHorizontal()
        batt_pwr_row.Add(Forms.Label(Text="Power (kW):"))
        self.num_batt_power = Forms.NumericUpDown()
        self.num_batt_power.MinValue = 1
        self.num_batt_power.MaxValue = 500
        self.num_batt_power.DecimalPlaces = 1
        self.num_batt_power.Value = 5.0
        self.num_batt_power.Width = 70
        batt_pwr_row.Add(self.num_batt_power)
        batt_pwr_row.Add(None)
        batt_pwr_row.EndHorizontal()
        batt_layout.Add(batt_pwr_row)
        
        # Efficiency
        batt_eff_row = Forms.DynamicLayout()
        batt_eff_row.BeginHorizontal()
        batt_eff_row.Add(Forms.Label(Text="Round-trip Eff:"))
        self.num_batt_efficiency = Forms.NumericUpDown()
        self.num_batt_efficiency.MinValue = 0.7
        self.num_batt_efficiency.MaxValue = 0.98
        self.num_batt_efficiency.DecimalPlaces = 2
        self.num_batt_efficiency.Value = 0.90
        self.num_batt_efficiency.Width = 60
        batt_eff_row.Add(self.num_batt_efficiency)
        batt_eff_row.Add(None)
        batt_eff_row.EndHorizontal()
        batt_layout.Add(batt_eff_row)
        
        # Control mode
        batt_ctrl_row = Forms.DynamicLayout()
        batt_ctrl_row.BeginHorizontal()
        batt_ctrl_row.Add(Forms.Label(Text="Control Mode:"))
        self.dd_batt_control = Forms.DropDown()
        self.dd_batt_control.Width = 160
        self.dd_batt_control.Items.Add("Self-Consumption (PV)")
        self.dd_batt_control.Items.Add("Peak Shaving")
        self.dd_batt_control.Items.Add("Schedule-Based")
        self.dd_batt_control.SelectedIndex = 0
        batt_ctrl_row.Add(self.dd_batt_control)
        batt_ctrl_row.Add(None)
        batt_ctrl_row.EndHorizontal()
        batt_layout.Add(batt_ctrl_row)
        
        batt_layout.AddSpace()
        self.chk_batt_pair_pv = Forms.CheckBox(Text="Pair with PV System (DC-coupled)")
        self.chk_batt_pair_pv.Checked = True
        batt_layout.AddRow(self.chk_batt_pair_pv)
        
        batt_layout.Add(None, yscale=True)
        
        self.lbl_batt_status = Forms.Label(Text="Configure settings and click 'Generate IDF'")
        batt_layout.AddRow(self.lbl_batt_status)
        
        tab_battery.Content = batt_layout
        self.tab_renewables_systems.Pages.Add(tab_battery)
        
        # -------- WIND TAB --------
        tab_wind = Forms.TabPage(Text="Wind Turbine")
        wind_layout = Forms.DynamicLayout()
        wind_layout.DefaultSpacing = Drawing.Size(5, 6)
        wind_layout.Padding = Drawing.Padding(8)
        
        wind_layout.AddRow(Forms.Label(Text="Wind Turbine Generator"))
        wind_layout.AddSpace()
        
        # Enable checkbox
        self.chk_wind = Forms.CheckBox(Text="Enable Wind Turbine")
        wind_layout.AddRow(self.chk_wind)
        wind_layout.AddSpace()
        
        # Preset
        wind_preset_row = Forms.DynamicLayout()
        wind_preset_row.BeginHorizontal()
        wind_preset_row.Add(Forms.Label(Text="Preset:"))
        self.dd_wind_preset = Forms.DropDown()
        self.dd_wind_preset.Width = 160
        for preset in WIND_PRESETS.keys():
            self.dd_wind_preset.Items.Add(preset)
        self.dd_wind_preset.SelectedIndex = 1
        wind_preset_row.Add(self.dd_wind_preset)
        wind_preset_row.Add(None)
        wind_preset_row.EndHorizontal()
        wind_layout.Add(wind_preset_row)
        
        # Rated power
        wind_pwr_row = Forms.DynamicLayout()
        wind_pwr_row.BeginHorizontal()
        wind_pwr_row.Add(Forms.Label(Text="Rated Power (kW):"))
        self.num_wind_power = Forms.NumericUpDown()
        self.num_wind_power.MinValue = 0.5
        self.num_wind_power.MaxValue = 100
        self.num_wind_power.DecimalPlaces = 1
        self.num_wind_power.Value = 5.0
        self.num_wind_power.Width = 60
        wind_pwr_row.Add(self.num_wind_power)
        wind_pwr_row.Add(None)
        wind_pwr_row.EndHorizontal()
        wind_layout.Add(wind_pwr_row)
        
        # Hub height
        wind_hub_row = Forms.DynamicLayout()
        wind_hub_row.BeginHorizontal()
        wind_hub_row.Add(Forms.Label(Text="Hub Height (m):"))
        self.num_wind_hub = Forms.NumericUpDown()
        self.num_wind_hub.MinValue = 5
        self.num_wind_hub.MaxValue = 100
        self.num_wind_hub.Value = 18
        self.num_wind_hub.Width = 60
        wind_hub_row.Add(self.num_wind_hub)
        wind_hub_row.Add(None)
        wind_hub_row.EndHorizontal()
        wind_layout.Add(wind_hub_row)
        
        # Rotor diameter
        wind_rotor_row = Forms.DynamicLayout()
        wind_rotor_row.BeginHorizontal()
        wind_rotor_row.Add(Forms.Label(Text="Rotor Diameter (m):"))
        self.num_wind_rotor = Forms.NumericUpDown()
        self.num_wind_rotor.MinValue = 1
        self.num_wind_rotor.MaxValue = 50
        self.num_wind_rotor.DecimalPlaces = 1
        self.num_wind_rotor.Value = 5.0
        self.num_wind_rotor.Width = 60
        wind_rotor_row.Add(self.num_wind_rotor)
        wind_rotor_row.Add(None)
        wind_rotor_row.EndHorizontal()
        wind_layout.Add(wind_rotor_row)
        
        wind_layout.Add(None, yscale=True)
        
        self.lbl_wind_status = Forms.Label(Text="Note: Wind requires site with good wind resource")
        wind_layout.AddRow(self.lbl_wind_status)
        
        tab_wind.Content = wind_layout
        self.tab_renewables_systems.Pages.Add(tab_wind)
        
        config_layout.Add(self.tab_renewables_systems, xscale=True, yscale=True)
        grp_config.Content = config_layout
        
        # --- RIGHT COLUMN (1): IDF Preview ---
        grp_preview = create_shaded_groupbox("IDF Preview")
        preview_layout = Forms.DynamicLayout()
        preview_layout.DefaultSpacing = Drawing.Size(4, 4)
        preview_layout.Padding = Drawing.Padding(4)
        preview_layout.BackgroundColor = RESULT_BG_COLOR
        
        self.txt_idf_preview = Forms.TextArea()
        self.txt_idf_preview.ReadOnly = True
        self._idf_customizing = False  # Track edit mode
        try:
            self.txt_idf_preview.Font = Drawing.Font("Consolas", 8)
        except:
            pass
        self.txt_idf_preview.Text = "! EnergyPlus IDF objects\n! will appear here after\n! clicking 'Generate IDF'\n!\n! Enable Battery or Wind,\n! configure settings,\n! then generate."
        preview_layout.Add(self.txt_idf_preview, xscale=True, yscale=True)
        
        # Buttons under preview
        self.btn_generate_idf = Forms.Button(Text="Generate IDF")
        preview_layout.AddRow(self.btn_generate_idf)
        
        self.btn_customize_idf = Forms.Button(Text="Customize from Here")
        preview_layout.AddRow(self.btn_customize_idf)
        
        self.btn_send_idf_to_gh = Forms.Button(Text="Send to GH")
        preview_layout.AddRow(self.btn_send_idf_to_gh)
        
        self.btn_copy_idf = Forms.Button(Text="Copy to Clipboard")
        preview_layout.AddRow(self.btn_copy_idf)
        
        grp_preview.Content = preview_layout
        
        # Store column references for dynamic sizing (3:1 ratio)
        self._adv_col_left = grp_config
        self._adv_col_right = grp_preview
        
        columns.Add(grp_config, xscale=True, yscale=True)
        columns.Add(grp_preview, xscale=False, yscale=True)
        columns.EndHorizontal()
        
        layout.Add(columns, xscale=True, yscale=True)
        
        # Bottom info bar
        info_layout = Forms.DynamicLayout()
        info_layout.BeginHorizontal()
        info_layout.Add(Forms.Label(Text="PV and SHW (HB native) are in Module 5. Target Panel: '{}'".format(NAME_IDF_INJECTION)))
        info_layout.Add(None)
        info_layout.EndHorizontal()
        layout.Add(info_layout)
        
        self.tab_renewables.Content = layout
    
    def _create_quick_eval_panel(self):
        """Quick Evaluation Panel (v62)
        Contains Parameters and Performance displays.
        Shown via toggle button, separate from definition modules.
        """
        layout = Forms.DynamicLayout()
        layout.DefaultSpacing = Drawing.Size(8, 8)
        layout.Padding = Drawing.Padding(10)
        
        # Header label
        header = Forms.Label(Text="Quick Evaluation - View simulation parameters and performance results")
        header.TextColor = Drawing.Color.FromArgb(80, 80, 80)
        layout.AddRow(header)
        
        # Main content: Parameters (left) + Performance (right)
        columns = Forms.DynamicLayout()
        columns.DefaultSpacing = Drawing.Size(8, 0)
        columns.BeginHorizontal()
        
        # --- LEFT: Parameters ---
        grp_params = create_shaded_groupbox("Parameters")
        params_layout = Forms.DynamicLayout()
        params_layout.Padding = Drawing.Padding(4)
        params_layout.BackgroundColor = RESULT_BG_COLOR
        
        self.tab_eval_outputs = Forms.TabControl()
        self.txt_eval_out_tabs = []
        for name in NAME_SPACE_OUTPUTS:
            ta = Forms.TextArea()
            ta.ReadOnly = True
            ta.Text = get_output_panels_text(name)
            try:
                ta.Font = Drawing.Font("Consolas", 9)
            except:
                pass
            self.txt_eval_out_tabs.append((name, ta))
            p = Forms.TabPage(Text=name.replace("Parameters", "Params").replace("Variables", "Vars"))
            p.Content = ta
            self.tab_eval_outputs.Pages.Add(p)
        
        params_layout.Add(self.tab_eval_outputs, xscale=True, yscale=True)
        grp_params.Content = params_layout
        
        # --- RIGHT: Performance ---
        grp_perf = create_shaded_groupbox("Performance")
        perf_layout = Forms.DynamicLayout()
        perf_layout.Padding = Drawing.Padding(4)
        perf_layout.BackgroundColor = RESULT_BG_COLOR
        
        self.txt_eval_performance = Forms.TextArea()
        self.txt_eval_performance.ReadOnly = True
        self.txt_eval_performance.Text = get_output_panels_text(NAME_PERFORMANCE)
        try:
            self.txt_eval_performance.Font = Drawing.Font("Consolas", 9)
        except:
            pass
        perf_layout.Add(self.txt_eval_performance, xscale=True, yscale=True)
        grp_perf.Content = perf_layout
        
        columns.Add(grp_params, xscale=True, yscale=True)
        columns.Add(grp_perf, xscale=True, yscale=True)
        columns.EndHorizontal()
        
        layout.Add(columns, xscale=True, yscale=True)
        
        # Bottom: Re-sync button (centered)
        btn_bar = Forms.DynamicLayout()
        btn_bar.BeginHorizontal()
        btn_bar.Add(None)
        self.btn_resync_eval = Forms.Button(Text="Re-sync Outputs")
        btn_bar.Add(self.btn_resync_eval)
        btn_bar.Add(None)
        btn_bar.EndHorizontal()
        layout.Add(btn_bar)
        
        self.quick_eval_panel = layout
    
    def _setup_events(self):
        # Space Module
        self.btn_select.Click += self._select_breps
        self.btn_load.Click += self._press_load_button
        self.btn_apply_in.Click += self._apply_input_notes
        
        self.btn_clear.Click += self._clear_breps
        self.num_dup.ValueChanged += self._set_dup
        self.chk_run.CheckedChanged += self._set_run
        
        # Space Conditioning
        self.btn_load_space_geo.Click += self._load_blds_for_conditioning
        self.btn_cond_select_all.Click += self._cond_select_all
        self.btn_cond_deselect_all.Click += self._cond_deselect_all
        self.btn_cond_preview.Click += self._preview_cond_selection
        self.btn_apply_cond.Click += self._apply_conditioning_status
        
        # Quick Evaluation
        self.btn_resync_eval.Click += self._resync_eval
        self.btn_toggle_qe.Click += self._toggle_quick_eval
        
        # Enclosure Module
        self.btn_select_envelope.Click += self._select_envelope_breps
        self.btn_use_space_breps.Click += self._use_space_breps
        self.btn_deconstruct.Click += self._deconstruct_breps
        self.btn_preview.Click += self._preview_selection
        self.dd_face_orient.SelectedIndexChanged += self._on_face_filter_changed
        self.dd_face_bc.SelectedIndexChanged += self._on_face_filter_changed
        self.btn_gen_aperture.Click += self._generate_apertures
        self.btn_bake_aperture.Click += self._bake_apertures
        self.btn_send_to_gh.Click += self._send_apertures_to_gh
        self.btn_clear_applied_ap.Click += self._clear_applied_apertures
        self.btn_clear_baked_ap.Click += self._clear_baked_apertures
        self.btn_resync_ap.Click += self._resync_apertures
        self.dropdown_ap_mode.SelectedIndexChanged += self._toggle_aperture_mode
        self.dropdown_door_mode.SelectedIndexChanged += self._toggle_door_mode
        self.btn_gen_door.Click += self._generate_doors
        self.btn_bake_door.Click += self._bake_doors
        self.btn_send_door_to_gh.Click += self._send_doors_to_gh
        self.btn_clear_applied_door.Click += self._clear_applied_doors
        self.btn_clear_baked_door.Click += self._clear_baked_doors
        self.btn_resync_door.Click += self._resync_doors
        
        # Service Module
        self.btn_apply_preset.Click += self._apply_load_preset
        self.btn_apply_shw_preset.Click += self._apply_shw_preset
        self.dd_shw_equipment.SelectedIndexChanged += self._on_shw_equipment_changed
        self.btn_preview_program.Click += self._preview_program
        self.btn_export_json.Click += self._export_program_json
        self.btn_load_rooms.Click += self._load_hb_rooms
        self.btn_preview_rooms.Click += self._preview_rooms
        self.btn_assign_program.Click += self._assign_program_to_rooms
        self.btn_clear_pending.Click += self._clear_pending_assignments
        self.btn_output_programs.Click += self._send_modified_rooms_to_gh
        self.btn_restore_session.Click += self._restore_session_to_pending
        self.btn_reload_gds.Click += self._reload_gds_database
        self.grid_rooms.SelectionChanged += self._on_room_selection_changed
        
        # Custom schedule editor
        self.btn_fill_office.Click += self._fill_custom_office
        self.btn_fill_residential.Click += self._fill_custom_residential
        self.btn_fill_constant.Click += self._fill_custom_constant
        self.btn_save_custom.Click += self._save_custom_schedule
        self.btn_load_custom.Click += self._load_custom_schedules
        
        # Thermal Comfort settings
        self.chk_comfort_enable.CheckedChanged += self._on_comfort_enable_changed
        self.btn_send_comfort.Click += self._send_comfort_to_gh
        self.btn_comfort_office.Click += self._comfort_preset_office
        self.btn_comfort_residential.Click += self._comfort_preset_residential
        self.btn_comfort_summer.Click += self._comfort_preset_summer
        
        # HVAC Module (simplified)
        self.dd_hvac_preset.SelectedIndexChanged += self._on_hvac_preset_changed
        self.btn_hvac_set.Click += self._hvac_set_default
        
        # Site Module
        self.btn_site_apply.Click += self._apply_site_settings
        self.btn_site_overwrite.Click += self._press_site_overwrite
        self.btn_weather_apply.Click += self._apply_weather_path
        self.btn_site_resync.Click += self._resync_site
        self.num_site_index.ValueChanged += self._set_site_index
        self.chk_inc_context.CheckedChanged += self._set_inc_context
        
        # Renewable Energy Module (PV + SolHW in Site module - Module 5)
        self.dd_pv_preset.SelectedIndexChanged += self._on_pv_preset_changed
        self.dd_pv_mounting.SelectedIndexChanged += self._on_pv_mounting_changed
        self.btn_load_pv_shades.Click += self._load_pv_shades_from_model
        self.btn_pick_pv_shades.Click += self._pick_pv_shades_in_rhino
        self.btn_apply_pv.Click += self._apply_pv_properties
        self.btn_clear_pv.Click += self._clear_pv_properties
        self.dd_solhw_preset.SelectedIndexChanged += self._on_solhw_preset_changed
        self.btn_apply_solhw.Click += self._apply_solhw_config
        
        # Advanced Module (Battery + Wind IDF - Module 6)
        self.dd_batt_preset.SelectedIndexChanged += self._on_batt_preset_changed
        self.dd_wind_preset.SelectedIndexChanged += self._on_wind_preset_changed
        self.btn_generate_idf.Click += self._generate_all_idf
        self.btn_customize_idf.Click += self._toggle_idf_customize
        self.btn_send_idf_to_gh.Click += self._send_idf_to_gh
        self.btn_copy_idf.Click += self._copy_idf_to_clipboard
        
        # Navigation
        self.btn_prev.Click += self._go_prev
        self.btn_next.Click += self._go_next
        self.tab_control.SelectedIndexChanged += self._on_tab_changed
        
        # Window resize handling for dynamic column widths
        self.SizeChanged += self._on_size_changed
        self._update_column_widths()  # Initial sizing
        
        if DOC:
            def _on_sol_end(sender, e):
                try:
                    self._resync()
                except:
                    pass
            DOC.SolutionEnd += _on_sol_end
            self._on_solution_end = _on_sol_end
    
    # Navigation
    def _go_next(self, s, e):
        if self.tab_control.SelectedIndex < len(self.tab_control.Pages) - 1:
            self.tab_control.SelectedIndex += 1
            self._update_nav_buttons()
    
    def _go_prev(self, s, e):
        if self.tab_control.SelectedIndex > 0:
            self.tab_control.SelectedIndex -= 1
            self._update_nav_buttons()
    
    def _on_size_changed(self, s, e):
        """Handle window resize to update column widths"""
        self._update_column_widths()
    
    def _update_column_widths(self):
        """Update column widths and splitter positions based on current window size"""
        try:
            # Get available dimensions (subtract padding and spacing)
            available_width = self.ClientSize.Width - 60
            available_height = self.ClientSize.Height - 120  # Account for tabs, nav bar, padding
            
            # --- COLUMN WIDTH RATIOS ---
            
            # Calculate widths for 2:3:3 ratio (Envelope module)
            unit_233 = available_width / 8.0
            left_233 = int(unit_233 * 2)
            mid_233 = int(unit_233 * 3)
            right_233 = int(unit_233 * 3)
            
            # Calculate widths for 4:3:3 ratio (Site module)
            unit_433 = available_width / 10.0
            left_433 = int(unit_433 * 4)
            mid_433 = int(unit_433 * 3)
            right_433 = int(unit_433 * 3)
            
            # Calculate widths for 3.5:4:2.5 ratio (Service/Schedule module)
            unit_343 = available_width / 10.0
            left_343 = int(unit_343 * 3.5)
            mid_343 = int(unit_343 * 4)
            right_343 = int(unit_343 * 2.5)
            
            # Calculate widths for 4:6 ratio (Space module)
            unit_46 = available_width / 10.0
            left_46 = int(unit_46 * 4)
            
            # Minimum widths to prevent UI collapse
            left_233 = max(left_233, 180)
            mid_233 = max(mid_233, 220)
            right_233 = max(right_233, 220)
            left_433 = max(left_433, 280)
            mid_433 = max(mid_433, 200)
            right_433 = max(right_433, 200)
            left_343 = max(left_343, 290)
            mid_343 = max(mid_343, 280)
            right_343 = max(right_343, 200)
            left_46 = max(left_46, 280)
            
            # Update Space module columns (4:6 ratio)
            if hasattr(self, '_space_col_left') and self._space_col_left:
                self._space_col_left.Width = left_46
            
            # Update Envelope module columns (2:3:3 ratio)
            if hasattr(self, '_env_col_left') and self._env_col_left:
                self._env_col_left.Width = left_233
            if hasattr(self, '_env_col_mid') and self._env_col_mid:
                self._env_col_mid.Width = mid_233
            if hasattr(self, '_env_col_right') and self._env_col_right:
                self._env_col_right.Width = right_233
            
            # Update Schedule module columns (3:4:3 ratio)
            if hasattr(self, '_sched_col_left') and self._sched_col_left:
                self._sched_col_left.Width = left_343
            if hasattr(self, '_sched_col_mid') and self._sched_col_mid:
                self._sched_col_mid.Width = mid_343
            
            # Update Site & Weather module columns (4:3:3 ratio)
            if hasattr(self, '_site_col_left') and self._site_col_left:
                self._site_col_left.Width = left_433
            if hasattr(self, '_site_col_mid') and self._site_col_mid:
                self._site_col_mid.Width = mid_433
            
            # Update Advanced (IDF) module columns (3:1 ratio)
            unit_31 = available_width / 4.0
            right_31 = max(int(unit_31 * 1), 180)
            if hasattr(self, '_adv_col_right') and self._adv_col_right:
                self._adv_col_right.Width = right_31
            
            # --- VERTICAL SPLITTER RATIOS ---
            
            # Space Module - Column 1: Geometry Def / Input Panels = 1:1
            if hasattr(self, '_space_col1_split') and self._space_col1_split:
                pos_1_1 = int(available_height * 0.5)  # 50% for 1:1 ratio
                self._space_col1_split.Position = max(pos_1_1, 150)
            
            # Note: Space Module Column 2 no longer has a splitter (v62 - Space Conditioning)
            
            # Site Module - Column 1: Site Def / Weather Def = 1:1
            if hasattr(self, '_site_col1_split') and self._site_col1_split:
                pos_1_1 = int(available_height * 0.5)  # 50% for 1:1 ratio
                self._site_col1_split.Position = max(pos_1_1, 150)
            
        except:
            pass  # Silently handle any errors during resize
    
    def _on_tab_changed(self, s, e):
        self._update_nav_buttons()
        idx = self.tab_control.SelectedIndex
        if idx == 1:
            self._refresh_envelope_module()
        elif idx == 2:
            self._update_program_summary()
        elif idx == 3:
            self._update_hvac_details()
        elif idx == 4:
            self._resync_site()
    
    def _update_nav_buttons(self):
        # Only update if showing definition tabs (not Quick Eval)
        if self.showing_quick_eval:
            return
            
        idx = self.tab_control.SelectedIndex
        max_idx = len(self.tab_control.Pages) - 1
        self.btn_prev.Enabled = idx > 0
        self.btn_next.Enabled = idx < max_idx
        
        if idx == 0:
            self.btn_next.Text = "Next: Enclosure >"
        elif idx == 1:
            self.btn_next.Text = "Next: Service >"
        elif idx == 2:
            self.btn_next.Text = "Next: HVAC >"
        elif idx == 3:
            self.btn_next.Text = "Next: Site >"
        elif idx == 4:
            self.btn_next.Text = "Next: Advanced >"
        else:
            self.btn_next.Text = "Finish"
    
    def _refresh_envelope_module(self):
        count = len(self.envelope_breps)
        if count > 0:
            self.lbl_envelope_status.Text = "{} brep(s) loaded".format(count)
            self.btn_deconstruct.Enabled = True
        else:
            blds_breps = get_breps_from_param(NAME_BLDS)
            if blds_breps:
                self.lbl_envelope_status.Text = "{} room(s) available. Click 'Use Upstream Rooms'".format(len(blds_breps))
            else:
                self.lbl_envelope_status.Text = "No breps - select from Rhino or use Space Module"
            self.btn_deconstruct.Enabled = False
    
    # Space Module handlers
    def _select_breps(self, s, e):
        self.Visible = False
        try:
            old_ctx = sc.doc
            if Rhino.RhinoDoc.ActiveDoc:
                sc.doc = Rhino.RhinoDoc.ActiveDoc
            
            go = ri.Custom.GetObject()
            go.SetCommandPrompt("Select Breps")
            go.GeometryFilter = rdo.ObjectType.Brep | rdo.ObjectType.Surface
            go.SubObjectSelect = False
            go.EnablePreSelect(False, True)
            
            res = go.GetMultiple(0, 0)
            if res == ri.GetResult.Object:
                self.selected_breps = []
                self.collected_breps = []
                
                for obj_ref in go.Objects():
                    if not obj_ref:
                        continue
                    rhino_obj = obj_ref.Object()
                    if not rhino_obj:
                        continue
                    
                    self.selected_breps.append(rhino_obj.Id)
                    geom = obj_ref.Geometry()
                    brep = None
                    if geom:
                        if geom.ObjectType == rdo.ObjectType.Brep:
                            brep = geom.DuplicateBrep()
                        elif geom.ObjectType == rdo.ObjectType.Surface:
                            brep = geom.ToBrep()
                    
                    if brep:
                        self.collected_breps.append(brep)
                
                if self.collected_breps:
                    self.txt_brep_info.Text = "{} Brep(s) selected".format(len(self.collected_breps))
                    
                    def update():
                        set_brep_components(self.collected_breps, NAME_BREP)
                    schedule(update)
                    
                    # Auto-populate Space Conditioning grid from selected breps
                    try:
                        self.cond_breps = list(self.collected_breps)
                        self.cond_breps_data = []
                        for i, brep in enumerate(self.collected_breps):
                            try:
                                vol = brep.GetVolume()
                                vol_str = "{:.1f}".format(vol) if vol > 0 else "N/A"
                            except:
                                vol_str = "N/A"
                            self.cond_breps_data.append([
                                str(i + 1), "Space_{}".format(i + 1),
                                vol_str, True
                            ])
                        self.grid_cond.DataStore = self.cond_breps_data
                        self.lbl_cond_status.Text = "{} space(s) loaded".format(len(self.collected_breps))
                    except:
                        pass
                else:
                    self.txt_brep_info.Text = "No Breps selected"
            else:
                self.txt_brep_info.Text = "Selection cancelled"
        except Exception as ex:
            self.txt_brep_info.Text = "Error: {}".format(str(ex))
        finally:
            try:
                sc.doc = old_ctx
            except:
                pass
            self.Visible = True
            self.BringToFront()
    
    def _set_dup(self, s, e):
        set_slider_value(NAME_SLIDER_DUP, self.num_dup.Value)
    
    def _set_run(self, s, e):
        targets = find_objs("GH_BooleanToggle", NAME_TOGGLE)
        if not targets:
            return
        state = self.chk_run.Checked
        if state is None:
            return
        def do():
            for tog in targets:
                try:
                    tog.Value = bool(state)
                    tog.ExpireSolution(True)
                except:
                    pass
        schedule(do)
    
    def _press_load_button(self, s, e):
        press_button(NAME_BUTTON)
    
    def _apply_input_notes(self, s, e):
        for name, ta in self.txt_in_list:
            set_panel_text(name, ta.Text)
    
    def _resync(self, s=None, e=None):
        try:
            dup_info = get_slider_info(NAME_SLIDER_DUP, DUP_DEFAULT)
            self.num_dup.MinValue = dup_info[0]
            self.num_dup.MaxValue = dup_info[1]
            self.num_dup.Value = dup_info[2]
            
            self.chk_run.Checked = get_toggles_aggregate(NAME_TOGGLE)
            
            for name, ta in self.txt_in_list:
                ta.Text = get_first_input_panel_text(name)
            
            # Update Quick Evaluation panel outputs
            for name, ta in self.txt_eval_out_tabs:
                ta.Text = get_output_panels_text(name)
            self.txt_eval_performance.Text = get_output_panels_text(NAME_PERFORMANCE)
        except Exception as ex:
            print("Resync error: {}".format(ex))
    
    def _clear_breps(self, s, e):
        self.selected_breps = []
        self.collected_breps = []
        self.txt_brep_info.Text = "No Breps selected"
    
    # Space Conditioning handlers
    def _load_blds_for_conditioning(self, s, e):
        """Load breps from Blds component and populate conditioning grid"""
        blds_breps = get_breps_from_param(NAME_BLDS)
        if not blds_breps:
            self.lbl_cond_status.Text = "No spaces found. Define geometry first."
            return
        
        # Store actual breps for preview
        self.cond_breps = blds_breps
        
        # Clear existing data
        self.cond_breps_data = []
        
        # Build data for grid
        for i, brep in enumerate(blds_breps):
            try:
                vol = brep.GetVolume()
                vol_str = "{:.1f}".format(vol) if vol > 0 else "N/A"
            except:
                vol_str = "N/A"
            
            # Default all to conditioned=True
            self.cond_breps_data.append([
                str(i + 1),           # Index
                "Space_{}".format(i + 1),  # Name
                vol_str,              # Volume
                True                  # Conditioned (default True)
            ])
        
        # Update grid
        self.grid_cond.DataStore = self.cond_breps_data
        self.lbl_cond_status.Text = "{} space(s) loaded".format(len(blds_breps))
    
    def _cond_select_all(self, s, e):
        """Set all spaces to conditioned"""
        for row in self.cond_breps_data:
            row[3] = True
        self.grid_cond.DataStore = self.cond_breps_data
    
    def _cond_deselect_all(self, s, e):
        """Set all spaces to unconditioned"""
        for row in self.cond_breps_data:
            row[3] = False
        self.grid_cond.DataStore = self.cond_breps_data
    
    def _preview_cond_selection(self, s, e):
        """Preview selected spaces in GDS_Preview component"""
        selected = list(self.grid_cond.SelectedRows)
        if not selected:
            self.lbl_cond_status.Text = "No spaces selected for preview"
            return
        
        if not hasattr(self, 'cond_breps') or not self.cond_breps:
            self.lbl_cond_status.Text = "Load geometry first before preview"
            return
        
        # Find GDS_Preview component
        targets = []
        for obj in DOC.Objects:
            if obj.NickName == NAME_PREVIEW_BREP and "Brep" in obj.GetType().Name:
                targets.append(obj)
        
        if targets:
            def do():
                for comp in targets:
                    comp.PersistentData.Clear()
                    for idx in selected:
                        if idx < len(self.cond_breps):
                            comp.PersistentData.Append(gkt.GH_Brep(self.cond_breps[idx]))
                    comp.ExpireSolution(True)
            schedule(do)
            self.lbl_cond_status.Text = "{} space(s) sent to '{}'".format(len(selected), NAME_PREVIEW_BREP)
        else:
            self.lbl_cond_status.Text = "GDS_Preview component not found on canvas"
    
    def _apply_conditioning_status(self, s, e):
        """Send conditioning status list to GDS_Cond_Status data component"""
        if not self.cond_breps_data:
            self.lbl_cond_status.Text = "No spaces loaded — select geometry in the left panel first"
            return
        
        # Build boolean list matching Blds order
        bool_list = []
        cond_count = 0
        uncond_count = 0
        for row in self.cond_breps_data:
            is_cond = row[3]
            bool_list.append(is_cond)
            if is_cond:
                cond_count += 1
            else:
                uncond_count += 1
        
        # Send to data component as actual booleans
        success = set_bool_data_component(NAME_COND_STATUS, bool_list)
        
        if success:
            self.lbl_cond_status.Text = "Applied: {} conditioned, {} unconditioned → '{}'".format(
                cond_count, uncond_count, NAME_COND_STATUS)
        else:
            self.lbl_cond_status.Text = "Error: Data component '{}' not found on canvas".format(NAME_COND_STATUS)
    
    # Quick Evaluation handlers
    def _resync_eval(self, s=None, e=None):
        """Re-sync outputs in Quick Evaluation panel"""
        try:
            for name, ta in self.txt_eval_out_tabs:
                ta.Text = get_output_panels_text(name)
            self.txt_eval_performance.Text = get_output_panels_text(NAME_PERFORMANCE)
        except Exception as ex:
            print("Resync eval error: {}".format(ex))
    
    def _toggle_quick_eval(self, s=None, e=None):
        """Toggle between Definition tabs and Quick Evaluation panel"""
        if self.showing_quick_eval:
            # Switch back to Definition tabs
            self.main_container.Content = self.tab_control
            self.btn_toggle_qe.Text = "Quick Evaluation ▶"
            self.btn_prev.Enabled = self.tab_control.SelectedIndex > 0
            self.btn_next.Enabled = self.tab_control.SelectedIndex < len(self.tab_control.Pages) - 1
            self.showing_quick_eval = False
            self._update_nav_buttons()
        else:
            # Switch to Quick Evaluation
            self._resync_eval()  # Refresh data first
            self.main_container.Content = self.quick_eval_panel
            self.btn_toggle_qe.Text = "◀ Back to Definition"
            self.btn_prev.Enabled = False
            self.btn_next.Enabled = False
            self.showing_quick_eval = True
    
    # Enclosure Module handlers
    def _select_envelope_breps(self, s, e):
        self.Visible = False
        try:
            old_ctx = sc.doc
            if Rhino.RhinoDoc.ActiveDoc:
                sc.doc = Rhino.RhinoDoc.ActiveDoc
            
            go = ri.Custom.GetObject()
            go.SetCommandPrompt("Select Breps for Envelope")
            go.GeometryFilter = rdo.ObjectType.Brep | rdo.ObjectType.Surface
            go.SubObjectSelect = False
            go.EnablePreSelect(False, True)
            
            res = go.GetMultiple(0, 0)
            if res == ri.GetResult.Object:
                self.envelope_breps = []
                
                for obj_ref in go.Objects():
                    if not obj_ref:
                        continue
                    geom = obj_ref.Geometry()
                    brep = None
                    if geom:
                        if geom.ObjectType == rdo.ObjectType.Brep:
                            brep = geom.DuplicateBrep()
                        elif geom.ObjectType == rdo.ObjectType.Surface:
                            brep = geom.ToBrep()
                    
                    if brep:
                        self.envelope_breps.append(brep)
                
                count = len(self.envelope_breps)
                if count > 0:
                    self.lbl_envelope_status.Text = "{} brep(s) selected from Rhino".format(count)
                    self.btn_deconstruct.Enabled = True
                else:
                    self.lbl_envelope_status.Text = "No breps selected"
            else:
                self.lbl_envelope_status.Text = "Selection cancelled"
        except Exception as ex:
            self.lbl_envelope_status.Text = "Error: {}".format(str(ex)[:40])
        finally:
            try:
                sc.doc = old_ctx
            except:
                pass
            self.Visible = True
            self.BringToFront()
    
    def _use_space_breps(self, s, e):
        self.envelope_breps = get_breps_from_param(NAME_BLDS)
        count = len(self.envelope_breps)
        if count > 0:
            self.lbl_envelope_status.Text = "{} brep(s) loaded from '{}'".format(count, NAME_BLDS)
            self.btn_deconstruct.Enabled = True
        else:
            self.lbl_envelope_status.Text = "No breps found in '{}'".format(NAME_BLDS)
            self.btn_deconstruct.Enabled = False
    
    def _deconstruct_breps(self, s, e):
        if not self.envelope_breps:
            self.lbl_envelope_status.Text = "No breps to deconstruct"
            return
        
        self.surface_list = []
        items = []
        
        # Collect all faces first to analyze adjacency
        all_faces = []
        for b_idx, brep in enumerate(self.envelope_breps):
            for f_idx, face in enumerate(brep.Faces):
                face_brep = face.DuplicateFace(False)
                if face_brep:
                    all_faces.append((b_idx, f_idx, face, face_brep))
        
        # Analyze each face
        for b_idx, f_idx, face, face_brep in all_faces:
            self.surface_list.append(face_brep)
            amp = rg.AreaMassProperties.Compute(face_brep)
            area = amp.Area if amp else 0
            normal = face.NormalAt(0.5, 0.5)
            
            # Determine orientation
            if normal.Z > 0.7:
                orient = "Roof"
                face_type = "Ext"
            elif normal.Z < -0.7:
                orient = "Floor"
                face_type = "Ext"
            else:
                orient = "Wall"
                # Check if wall is interior or exterior by testing adjacency
                face_type = self._classify_wall_face(face_brep, all_faces, b_idx, f_idx)
            
            items.append(["[B{}] F{}: {:.1f}m2 ({})".format(b_idx, f_idx, area, orient), face_type])
        
        self.grid_faces.DataStore = items
        self.lbl_envelope_status.Text = "{} faces from {} breps".format(len(self.surface_list), len(self.envelope_breps))
        
        # Populate backup for filter (additive — existing logic above is untouched)
        self._full_face_items = []
        for i, item in enumerate(items):
            label, bc = item[0], item[1]
            orient = "Wall"
            if "(Roof)" in label:
                orient = "Roof"
            elif "(Floor)" in label:
                orient = "Floor"
            self._full_face_items.append((label, bc, orient, self.surface_list[i]))
        self._full_surface_list = list(self.surface_list)
        self.dd_face_orient.SelectedIndex = 0
        self.dd_face_bc.SelectedIndex = 0
    
    def _on_face_filter_changed(self, s, e):
        """Event handler for filter dropdown changes."""
        if not self._full_face_items:
            return
        self._apply_face_filter()
    
    def _apply_face_filter(self):
        """Rebuild surface_list and DataStore from backup, keeping grid[i]==surface_list[i]."""
        orient_map = {1: "Wall", 2: "Roof", 3: "Floor"}
        bc_map = {1: "Ext", 2: "Int"}
        orient_filter = orient_map.get(self.dd_face_orient.SelectedIndex, None)
        bc_filter = bc_map.get(self.dd_face_bc.SelectedIndex, None)
        
        new_items = []
        new_surfaces = []
        for label, bc, orient, brep in self._full_face_items:
            if orient_filter and orient != orient_filter:
                continue
            if bc_filter and bc != bc_filter:
                continue
            new_items.append([label, bc])
            new_surfaces.append(brep)
        
        self.surface_list = new_surfaces
        self.grid_faces.DataStore = new_items
        self.lbl_selection.Text = "Showing {} of {} faces".format(len(new_items), len(self._full_face_items))
    
    def _classify_wall_face(self, face_brep, all_faces, current_b_idx, current_f_idx):
        """Classify wall as Interior or Exterior based on adjacency to other breps"""
        try:
            amp = rg.AreaMassProperties.Compute(face_brep)
            if not amp:
                return "Ext"
            
            centroid = amp.Centroid
            face_normal = face_brep.Faces[0].NormalAt(0.5, 0.5)
            
            # Check against faces from OTHER breps
            for b_idx, f_idx, face, other_brep in all_faces:
                if b_idx == current_b_idx:
                    continue  # Skip faces from same brep
                
                other_amp = rg.AreaMassProperties.Compute(other_brep)
                if not other_amp:
                    continue
                
                other_centroid = other_amp.Centroid
                other_normal = other_brep.Faces[0].NormalAt(0.5, 0.5)
                
                # Check if faces are close and opposing (normals pointing at each other)
                dist = centroid.DistanceTo(other_centroid)
                if dist < 0.5:  # Within 0.5m tolerance
                    dot = face_normal * other_normal
                    if dot < -0.9:  # Normals opposing
                        return "Int"
            
            return "Ext"
        except:
            return "Ext"
    
    def _preview_selection(self, s, e):
        selected = list(self.grid_faces.SelectedRows)
        if not selected:
            self.lbl_selection.Text = "No faces selected"
            return
        
        self.lbl_selection.Text = "{} face(s) selected".format(len(selected))
        
        targets = []
        for obj in DOC.Objects:
            if obj.NickName == NAME_PREVIEW_BREP and "Brep" in obj.GetType().Name:
                targets.append(obj)
        
        if targets:
            def do():
                for comp in targets:
                    comp.PersistentData.Clear()
                    for idx in selected:
                        if idx < len(self.surface_list):
                            comp.PersistentData.Append(gkt.GH_Brep(self.surface_list[idx]))
                    comp.ExpireSolution(True)
            schedule(do)
    
    def _toggle_aperture_mode(self, s, e):
        use_ratio = self.dropdown_ap_mode.SelectedIndex == 0
        self.num_ratio.Enabled = use_ratio
        self.num_width.Enabled = not use_ratio
        self.num_height.Enabled = not use_ratio
    
    def _generate_apertures(self, s, e):
        selected = list(self.grid_faces.SelectedRows)
        if not selected:
            self.lbl_aperture_status.Text = "Select faces first"
            return
        
        self.aperture_surfaces = []
        info_lines = []
        
        use_ratio = self.dropdown_ap_mode.SelectedIndex == 0
        ratio_val = float(self.num_ratio.Value)
        width_val = float(self.num_width.Value)
        height_val = float(self.num_height.Value)
        
        for idx in selected:
            if idx >= len(self.surface_list):
                continue
            face = self.surface_list[idx]
            
            if use_ratio:
                ap, ap_w, ap_h = create_coplanar_aperture_by_ratio(face, ratio_val)
                mode_info = "Ratio: {:.0%}".format(ratio_val)
            else:
                ap, ap_w, ap_h = create_coplanar_aperture_by_dims(face, width_val, height_val)
                mode_info = "Dims: {:.2f}x{:.2f}".format(width_val, height_val)
            
            if ap:
                self.aperture_surfaces.append(ap)
                amp = rg.AreaMassProperties.Compute(ap)
                area = amp.Area if amp else 0
                info_lines.append("Ap{}: {:.2f}m2 (W:{:.2f} H:{:.2f}) [{}]".format(
                    len(self.aperture_surfaces), area, ap_w, ap_h, mode_info))
            else:
                info_lines.append("Face {}: Failed".format(idx))
        
        self.txt_aperture_info.Text = "\n".join(info_lines) if info_lines else "No apertures generated"
        self.lbl_aperture_status.Text = "{} aperture(s) created".format(len(self.aperture_surfaces))
    
    def _bake_apertures(self, s, e):
        if not self.aperture_surfaces:
            self.lbl_aperture_status.Text = "Generate apertures first"
            return
        
        layer_name = get_first_input_panel_text("Layer to Bake&Refer")
        if not layer_name:
            layer_name = "Apertures"
        
        try:
            old_ctx = sc.doc
            sc.doc = Rhino.RhinoDoc.ActiveDoc
            
            layer_idx = sc.doc.Layers.Find(layer_name, True)
            if layer_idx < 0:
                layer_idx = sc.doc.Layers.Add(layer_name, System.Drawing.Color.Blue)
            
            attrs = rdo.ObjectAttributes()
            attrs.LayerIndex = layer_idx
            
            count = 0
            for ap in self.aperture_surfaces:
                if sc.doc.Objects.AddBrep(ap, attrs) != System.Guid.Empty:
                    count += 1
            
            sc.doc.Views.Redraw()
            self.lbl_aperture_status.Text = "Baked {} to '{}'".format(count, layer_name)
        except Exception as ex:
            self.lbl_aperture_status.Text = "Bake error: {}".format(str(ex)[:30])
        finally:
            sc.doc = old_ctx
    
    def _send_apertures_to_gh(self, s, e):
        if not self.aperture_surfaces:
            self.lbl_aperture_status.Text = "Generate apertures first"
            return
        
        targets = []
        for obj in DOC.Objects:
            if obj.NickName == NAME_APERTURE_SRF and "Brep" in obj.GetType().Name:
                targets.append(obj)
        
        if not targets:
            self.lbl_aperture_status.Text = "Component '{}' not found".format(NAME_APERTURE_SRF)
            return
        
        # Append newly generated apertures to cumulative list
        batch_count = len(self.aperture_surfaces)
        for ap in self.aperture_surfaces:
            self.applied_apertures.append(ap)
        self.aperture_surfaces = []
        
        def do():
            for comp in targets:
                comp.PersistentData.Clear()
                # Add all cumulative apertures
                for ap in self.applied_apertures:
                    comp.PersistentData.Append(gkt.GH_Brep(ap))
                comp.ExpireSolution(True)
        schedule(do)
        
        # Press sync button to release the data dam
        press_button(NAME_APERTURE_SYNC)
        
        self.lbl_aperture_status.Text = "Added {} (total: {})".format(
            batch_count, len(self.applied_apertures))
        self.lbl_applied_ap_count.Text = "Applied: {} aperture(s)".format(len(self.applied_apertures))
    
    # Door handlers
    def _toggle_door_mode(self, s, e):
        mode = self.dropdown_door_mode.SelectedIndex
        if mode == 0:  # By Ratio
            self.num_door_ratio.Enabled = True
            self.num_door_width.Enabled = False
            self.num_door_height.Enabled = False
        else:  # By Dimensions
            self.num_door_ratio.Enabled = False
            self.num_door_width.Enabled = True
            self.num_door_height.Enabled = True
    
    def _generate_doors(self, s, e):
        selected_indices = list(self.grid_faces.SelectedRows)
        if not selected_indices:
            self.lbl_door_status.Text = "Select face(s) first"
            return
        
        self.door_surfaces = []
        mode = self.dropdown_door_mode.SelectedIndex
        info_lines = []
        
        for idx in selected_indices:
            if idx >= len(self.surface_list):
                continue
            face_brep = self.surface_list[idx]
            
            if mode == 0:  # By Ratio
                ratio = self.num_door_ratio.Value
                door, door_w, door_h = create_coplanar_door_by_ratio(
                    face_brep, ratio, self.num_door_sill.Value)
                mode_info = "R={:.0%}".format(ratio)
            else:  # By Dimensions
                width = self.num_door_width.Value
                height = self.num_door_height.Value
                door, door_w, door_h = create_coplanar_door_by_dims(
                    face_brep, width, height, self.num_door_sill.Value)
                mode_info = "{}x{}".format(width, height)
            
            if door:
                self.door_surfaces.append(door)
                amp = rg.AreaMassProperties.Compute(door)
                area = amp.Area if amp else 0
                info_lines.append("Door{}: {:.2f}m2 (W:{:.2f} H:{:.2f}) [{}]".format(
                    len(self.door_surfaces), area, door_w, door_h, mode_info))
            else:
                info_lines.append("Face {}: Failed".format(idx))
        
        self.txt_door_info.Text = "\n".join(info_lines) if info_lines else "No doors generated"
        self.lbl_door_status.Text = "{} door(s) created".format(len(self.door_surfaces))
    
    def _bake_doors(self, s, e):
        if not self.door_surfaces:
            self.lbl_door_status.Text = "Generate doors first"
            return
        
        layer_name = get_first_input_panel_text("Layer to Bake&Refer")
        if not layer_name:
            layer_name = "Doors"
        
        try:
            old_ctx = sc.doc
            sc.doc = Rhino.RhinoDoc.ActiveDoc
            
            layer_idx = sc.doc.Layers.Find(layer_name, True)
            if layer_idx < 0:
                layer_idx = sc.doc.Layers.Add(layer_name, System.Drawing.Color.Brown)
            
            attrs = rdo.ObjectAttributes()
            attrs.LayerIndex = layer_idx
            
            count = 0
            for door in self.door_surfaces:
                if sc.doc.Objects.AddBrep(door, attrs) != System.Guid.Empty:
                    count += 1
            
            sc.doc.Views.Redraw()
            self.lbl_door_status.Text = "Baked {} to '{}'".format(count, layer_name)
        except Exception as ex:
            self.lbl_door_status.Text = "Bake error: {}".format(str(ex)[:30])
        finally:
            sc.doc = old_ctx
    
    def _send_doors_to_gh(self, s, e):
        if not self.door_surfaces:
            self.lbl_door_status.Text = "Generate doors first"
            return
        
        targets = []
        for obj in DOC.Objects:
            if obj.NickName == NAME_DOOR_SRF and "Brep" in obj.GetType().Name:
                targets.append(obj)
        
        if not targets:
            self.lbl_door_status.Text = "Component '{}' not found".format(NAME_DOOR_SRF)
            return
        
        # Append newly generated doors to cumulative list
        batch_count = len(self.door_surfaces)
        for door in self.door_surfaces:
            self.applied_doors.append(door)
        self.door_surfaces = []
        
        def do():
            for comp in targets:
                comp.PersistentData.Clear()
                # Add all cumulative doors
                for door in self.applied_doors:
                    comp.PersistentData.Append(gkt.GH_Brep(door))
                comp.ExpireSolution(True)
        schedule(do)
        
        # Press sync button to release the data dam
        press_button(NAME_DOOR_SYNC)
        
        self.lbl_door_status.Text = "Added {} (total: {})".format(
            batch_count, len(self.applied_doors))
        self.lbl_applied_door_count.Text = "Applied: {} door(s)".format(len(self.applied_doors))
    
    def _restore_applied_from_gh(self):
        """Read existing breps from GH panels into cumulative lists on startup."""
        try:
            for obj in DOC.Objects:
                if obj.NickName == NAME_APERTURE_SRF and "Brep" in obj.GetType().Name:
                    pd = obj.PersistentData
                    if pd.BranchCount > 0:
                        branch = pd.get_Branch(0)
                        for i in range(branch.Count):
                            gh_brep = branch[i]
                            if gh_brep and hasattr(gh_brep, 'Value') and gh_brep.Value:
                                self.applied_apertures.append(gh_brep.Value)
                    break
        except Exception:
            pass
        try:
            for obj in DOC.Objects:
                if obj.NickName == NAME_DOOR_SRF and "Brep" in obj.GetType().Name:
                    pd = obj.PersistentData
                    if pd.BranchCount > 0:
                        branch = pd.get_Branch(0)
                        for i in range(branch.Count):
                            gh_brep = branch[i]
                            if gh_brep and hasattr(gh_brep, 'Value') and gh_brep.Value:
                                self.applied_doors.append(gh_brep.Value)
                    break
        except Exception:
            pass
        if self.applied_apertures:
            self.lbl_applied_ap_count.Text = "Applied: {} aperture(s)".format(len(self.applied_apertures))
        if self.applied_doors:
            self.lbl_applied_door_count.Text = "Applied: {} door(s)".format(len(self.applied_doors))
    
    def _clear_applied_apertures(self, s, e):
        """Clear all applied apertures from cumulative list and GH component"""
        self.applied_apertures = []
        self.aperture_surfaces = []
        
        targets = []
        for obj in DOC.Objects:
            if obj.NickName == NAME_APERTURE_SRF and "Brep" in obj.GetType().Name:
                targets.append(obj)
        
        if targets:
            def do():
                for comp in targets:
                    comp.PersistentData.Clear()
                    comp.ExpireSolution(True)
            schedule(do)
        
        self.lbl_aperture_status.Text = "Cleared GH component"
        self.lbl_applied_ap_count.Text = "Applied: 0 aperture(s)"
        self.txt_aperture_info.Text = "GH apertures cleared"
    
    def _clear_baked_apertures(self, s, e):
        """Delete baked aperture objects from Rhino layer"""
        try:
            layer_name = get_first_input_panel_text("Layer to Bake&Refer")
            if not layer_name:
                layer_name = "Apertures"
            
            old_ctx = sc.doc
            sc.doc = Rhino.RhinoDoc.ActiveDoc
            
            layer_idx = sc.doc.Layers.Find(layer_name, True)
            if layer_idx >= 0:
                objs_to_delete = []
                for obj in sc.doc.Objects:
                    if obj.Attributes.LayerIndex == layer_idx:
                        objs_to_delete.append(obj.Id)
                
                count = 0
                for obj_id in objs_to_delete:
                    if sc.doc.Objects.Delete(obj_id, True):
                        count += 1
                
                sc.doc.Views.Redraw()
                self.lbl_aperture_status.Text = "Deleted {} from '{}'".format(count, layer_name)
            else:
                self.lbl_aperture_status.Text = "Layer '{}' not found".format(layer_name)
            
        except Exception as ex:
            self.lbl_aperture_status.Text = "Error: {}".format(str(ex)[:30])
        finally:
            sc.doc = old_ctx
    
    def _clear_applied_doors(self, s, e):
        """Clear all applied doors from cumulative list and GH component"""
        self.applied_doors = []
        self.door_surfaces = []
        
        targets = []
        for obj in DOC.Objects:
            if obj.NickName == NAME_DOOR_SRF and "Brep" in obj.GetType().Name:
                targets.append(obj)
        
        if targets:
            def do():
                for comp in targets:
                    comp.PersistentData.Clear()
                    comp.ExpireSolution(True)
            schedule(do)
        
        self.lbl_door_status.Text = "Cleared GH component"
        self.lbl_applied_door_count.Text = "Applied: 0 door(s)"
        self.txt_door_info.Text = "GH doors cleared"
    
    def _clear_baked_doors(self, s, e):
        """Delete baked door objects from Rhino layer"""
        try:
            layer_name = get_first_input_panel_text("Layer to Bake&Refer")
            if not layer_name:
                layer_name = "Doors"
            
            old_ctx = sc.doc
            sc.doc = Rhino.RhinoDoc.ActiveDoc
            
            layer_idx = sc.doc.Layers.Find(layer_name, True)
            if layer_idx >= 0:
                objs_to_delete = []
                for obj in sc.doc.Objects:
                    if obj.Attributes.LayerIndex == layer_idx:
                        objs_to_delete.append(obj.Id)
                
                count = 0
                for obj_id in objs_to_delete:
                    if sc.doc.Objects.Delete(obj_id, True):
                        count += 1
                
                sc.doc.Views.Redraw()
                self.lbl_door_status.Text = "Deleted {} from '{}'".format(count, layer_name)
            else:
                self.lbl_door_status.Text = "Layer '{}' not found".format(layer_name)
            
        except Exception as ex:
            self.lbl_door_status.Text = "Error: {}".format(str(ex)[:30])
        finally:
            sc.doc = old_ctx
    
    def _resync_apertures(self, s, e):
        """Press the ap_sync button on canvas to re-sync aperture data"""
        try:
            press_button(NAME_APERTURE_SYNC)
            self.lbl_aperture_status.Text = "Re-synced apertures"
        except Exception as ex:
            self.lbl_aperture_status.Text = "Re-sync error: {}".format(str(ex)[:30])
    
    def _resync_doors(self, s, e):
        """Press the door_sync button on canvas to re-sync door data"""
        try:
            press_button(NAME_DOOR_SYNC)
            self.lbl_door_status.Text = "Re-synced doors"
        except Exception as ex:
            self.lbl_door_status.Text = "Re-sync error: {}".format(str(ex)[:30])
    
    # Service Module handlers
    def _reload_gds_database(self, s, e):
        """Reload GDS database from path"""
        if self._load_gds_database():
            sched_count = len(self.gds_parser.schedules) if self.gds_parser else 0
            setp_count = len(self.gds_parser.setpoints) if self.gds_parser else 0
            prog_count = len(self.gds_parser.programs) if self.gds_parser else 0
            int_count = len(self.gds_parser.intensities) if self.gds_parser else 0
            seasonal_count = sum(1 for v in (self.gds_parser.schedules or {}).values() if v.get('is_seasonal')) + \
                             sum(1 for v in (self.gds_parser.setpoints or {}).values() if v.get('is_seasonal')) if self.gds_parser else 0
            
            status = "GDS: {} sched, {} setp, {} prog, {} int".format(
                sched_count, setp_count, prog_count, int_count)
            if seasonal_count > 0:
                status += " ({} seasonal)".format(seasonal_count)
            self.lbl_gds_status.Text = status
            
            # Repopulate dropdowns
            self._populate_schedule_dropdowns()
            
            # Re-apply saved dropdown selections now that [GDS] items are available
            self._restore_service_dropdown_selections()
        else:
            self.lbl_gds_status.Text = "GDS: Failed to load (check path)"
    
    def _load_hb_rooms(self, s, e):
        """Load HB Rooms from GH component"""
        self.hb_rooms = get_hb_rooms_from_param(NAME_HB_ROOMS_IN)
        self.pending_assignments.clear()  # Clear pending when loading new rooms
        # NOTE: do NOT clear applied_programs or program_definitions here
        # — they are needed for Restore Session after Rhino restart
        
        if not self.hb_rooms:
            self.lbl_rooms_status.Text = "No rooms found in '{}'".format(NAME_HB_ROOMS_IN)
            self.grid_rooms.DataStore = []
            return
        
        items = []
        self.hb_rooms_info = []
        for i, room in enumerate(self.hb_rooms):
            try:
                name = getattr(room, 'display_name', getattr(room, 'identifier', 'Room_{}'.format(i)))
                area = getattr(room, 'floor_area', 0)
                
                prog_name = "None"
                if hasattr(room, 'properties') and hasattr(room.properties, 'energy'):
                    prog = getattr(room.properties.energy, 'program_type', None)
                    if prog:
                        prog_name = getattr(prog, 'identifier', str(prog))[:15]
                
                items.append([name[:20], "{:.1f}".format(area), prog_name])
                self.hb_rooms_info.append({
                    'index': i,
                    'name': name,
                    'area': area,
                    'program': prog_name
                })
            except Exception as ex:
                items.append(["Room_{}".format(i), "?", "Error"])
                self.hb_rooms_info.append({'index': i, 'name': 'Room_{}'.format(i), 'area': 0, 'program': 'Error'})
        
        self.grid_rooms.DataStore = items
        self.lbl_rooms_status.Text = "{} room(s) loaded".format(len(self.hb_rooms))
    
    def _on_room_selection_changed(self, s, e):
        """Handle room selection change and show room details"""
        selected = list(self.grid_rooms.SelectedRows)
        if not selected:
            self.lbl_room_selection.Text = ""
            self.txt_room_exam.Text = ""
            return
        
        self.lbl_room_selection.Text = "{} room(s) selected".format(len(selected))
        self._update_room_exam_panel(selected)
    
    def _preview_rooms(self, s, e):
        """Send selected room geometry as Breps to GH component for preview"""
        selected = list(self.grid_rooms.SelectedRows)
        if not selected:
            self.lbl_room_selection.Text = "No rooms selected"
            return
        
        if not self.hb_rooms:
            self.lbl_room_selection.Text = "No rooms loaded"
            return
        
        # Find Brep component
        targets = []
        for obj in DOC.Objects:
            if obj.NickName == NAME_PREVIEW_BREP and "Brep" in obj.GetType().Name:
                targets.append(obj)
        
        if not targets:
            self.lbl_room_selection.Text = "Brep '{}' not found".format(NAME_PREVIEW_BREP)
            return
        
        # Extract geometry from selected rooms - one joined brep per room
        room_breps = []
        for idx in selected:
            if idx < len(self.hb_rooms):
                room = self.hb_rooms[idx]
                face_breps = []
                if hasattr(room, 'faces'):
                    for face in room.faces:
                        try:
                            vertices = face.geometry.boundary
                            if vertices and len(vertices) >= 3:
                                pts = [rg.Point3d(v.x, v.y, v.z) for v in vertices]
                                pts.append(pts[0])
                                polyline = rg.Polyline(pts)
                                curve = polyline.ToNurbsCurve()
                                if curve:
                                    tol = Rhino.RhinoDoc.ActiveDoc.ModelAbsoluteTolerance
                                    breps = rg.Brep.CreatePlanarBreps(curve, tol)
                                    if breps and len(breps) > 0:
                                        face_breps.append(breps[0])
                        except:
                            pass
                
                # Join all faces of this room into one brep
                if face_breps:
                    if len(face_breps) == 1:
                        room_breps.append(face_breps[0])
                    else:
                        tol = Rhino.RhinoDoc.ActiveDoc.ModelAbsoluteTolerance
                        joined = rg.Brep.JoinBreps(face_breps, tol)
                        if joined and len(joined) > 0:
                            room_breps.append(joined[0])
                        else:
                            # Fallback: add all faces if join fails
                            room_breps.extend(face_breps)
        
        if not room_breps:
            self.lbl_room_selection.Text = "No geometry extracted"
            return
        
        def do():
            for comp in targets:
                comp.PersistentData.Clear()
                for brep in room_breps:
                    comp.PersistentData.Append(gkt.GH_Brep(brep))
                comp.ExpireSolution(True)
        schedule(do)
        
        self.lbl_room_selection.Text = "{} room(s) → '{}'".format(len(selected), NAME_PREVIEW_BREP)
    
    def _clear_pending_assignments(self, s, e):
        """Clear all pending program assignments"""
        self.pending_assignments.clear()
        self._refresh_room_grid()
        
        # Update examination panel
        selected = list(self.grid_rooms.SelectedRows)
        if selected:
            self._update_room_exam_panel(selected)
        
        self.txt_program_summary.Text = "Cleared all pending assignments."
    
    # Custom Schedule Editor handlers
    def _fill_custom_office(self, s, e):
        sched_type = str(self.dd_custom_type.SelectedValue)
        if sched_type == "Setpoint":
            vals = "15.6,15.6,15.6,15.6,15.6,15.6,18,21,21,21,21,21,21,21,21,21,21,21,15.6,15.6,15.6,15.6,15.6,15.6"
        elif sched_type == "Activity":
            vals = "120,120,120,120,120,120,120,120,120,120,120,120,120,120,120,120,120,120,120,120,120,120,120,120"
        else:
            vals = "0,0,0,0,0,0,0.1,0.2,0.95,0.95,0.95,0.5,0.95,0.95,0.95,0.95,0.95,0.3,0.1,0,0,0,0,0"
        self.txt_custom_values.Text = vals
    
    def _fill_custom_residential(self, s, e):
        sched_type = str(self.dd_custom_type.SelectedValue)
        if sched_type == "Setpoint":
            vals = "18,18,18,18,18,18,20,21,21,18,18,18,18,18,18,18,21,21,21,21,21,20,18,18"
        elif sched_type == "Activity":
            vals = "72,72,72,72,72,72,108,108,144,144,144,144,144,144,144,144,144,144,108,108,108,108,72,72"
        else:
            vals = "0.9,0.9,0.9,0.9,0.9,0.9,0.7,0.4,0.4,0.2,0.2,0.2,0.2,0.2,0.2,0.3,0.5,0.7,0.8,0.9,0.9,0.9,0.9,0.9"
        self.txt_custom_values.Text = vals
    
    def _fill_custom_constant(self, s, e):
        sched_type = str(self.dd_custom_type.SelectedValue)
        if sched_type == "Setpoint":
            vals = ",".join(["21"] * 24)
        elif sched_type == "Activity":
            vals = ",".join(["120"] * 24)
        else:
            vals = ",".join(["1"] * 24)
        self.txt_custom_values.Text = vals
    
    def _save_custom_schedule(self, s, e):
        """Save custom schedule to GH Panel as JSON"""
        try:
            # Parse values
            val_str = self.txt_custom_values.Text.strip()
            values = [float(v.strip()) for v in val_str.split(",")]
            
            if len(values) != 24:
                self.lbl_custom_status.Text = "Error: Need exactly 24 values, got {}".format(len(values))
                return
            
            # Get name and type
            name = self.txt_custom_sched_name.Text.strip().replace(" ", "_")
            if not name:
                name = "Custom_Schedule"
            
            sched_type = str(self.dd_custom_type.SelectedValue).lower()
            
            # Load existing schedules from panel
            existing_json = get_first_input_panel_text(NAME_CUSTOM_SCHEDULES)
            if existing_json.strip():
                try:
                    all_schedules = json.loads(existing_json)
                except:
                    all_schedules = {}
            else:
                all_schedules = {}
            
            # Add/update this schedule
            all_schedules[name] = {
                "type": sched_type,
                "values": values
            }
            
            # Save back to panel
            new_json = json.dumps(all_schedules, indent=2)
            set_panel_text(NAME_CUSTOM_SCHEDULES, new_json)
            
            # Update local cache and dropdowns
            self.saved_custom_schedules = all_schedules
            self.program_data.custom_schedules[name] = values
            self._populate_schedule_dropdowns()
            
            self.lbl_custom_status.Text = "Saved '{}' ({} values)".format(name, len(values))
            
        except Exception as ex:
            self.lbl_custom_status.Text = "Error: {}".format(str(ex)[:40])
    
    def _load_custom_schedules(self, s, e):
        """Load custom schedules from GH Panel"""
        try:
            existing_json = get_first_input_panel_text(NAME_CUSTOM_SCHEDULES)
            if not existing_json.strip():
                self.lbl_custom_status.Text = "No custom schedules in panel"
                return
            
            all_schedules = json.loads(existing_json)
            self.saved_custom_schedules = all_schedules
            
            # Also load into program_data.custom_schedules
            for name, data in all_schedules.items():
                self.program_data.custom_schedules[name] = data.get("values", [0]*24)
            
            # Refresh dropdowns
            self._populate_schedule_dropdowns()
            
            self.lbl_custom_status.Text = "Loaded {} custom schedule(s)".format(len(all_schedules))
            
        except Exception as ex:
            self.lbl_custom_status.Text = "Error: {}".format(str(ex)[:40])
    
    # Thermal Comfort Settings handlers
    def _on_comfort_enable_changed(self, s, e):
        """Show/hide comfort parameters based on checkbox"""
        enabled = self.chk_comfort_enable.Checked
        self.pnl_comfort_params.Visible = enabled
        self.btn_send_comfort.Enabled = enabled
        if enabled:
            self.lbl_comfort_status.Text = "Configure and click 'Send to GH'"
        else:
            self.lbl_comfort_status.Text = ""
    
    def _comfort_preset_office(self, s, e):
        """Office preset: typical indoor office conditions"""
        self.num_comfort_clothing.Value = 0.7
        self.num_comfort_air_vel.Value = 0.1
        self.num_comfort_work_eff.Value = 0.0
        self.num_comfort_ankle_vel.Value = 0.0
        self.dd_comfort_model.SelectedIndex = 0  # Fanger
        self.chk_ashrae_warnings.Checked = False
    
    def _comfort_preset_residential(self, s, e):
        """Residential preset: relaxed clothing, less activity"""
        self.num_comfort_clothing.Value = 0.5
        self.num_comfort_air_vel.Value = 0.1
        self.num_comfort_work_eff.Value = 0.0
        self.num_comfort_ankle_vel.Value = 0.0
        self.dd_comfort_model.SelectedIndex = 0  # Fanger
        self.chk_ashrae_warnings.Checked = False
    
    def _comfort_preset_summer(self, s, e):
        """Summer preset: light clothing"""
        self.num_comfort_clothing.Value = 0.5
        self.num_comfort_air_vel.Value = 0.15
        self.num_comfort_work_eff.Value = 0.0
        self.num_comfort_ankle_vel.Value = 0.0
        self.dd_comfort_model.SelectedIndex = 0  # Fanger
        self.chk_ashrae_warnings.Checked = False
    
    def _send_comfort_to_gh(self, s, e):
        """Format comfort settings and send to GH Panel"""
        if not self.chk_comfort_enable.Checked:
            self.lbl_comfort_status.Text = "Comfort simulation disabled"
            return
        
        # Build settings string (key=value format)
        parts = []
        parts.append("clothing={}".format(self.num_comfort_clothing.Value))
        parts.append("air_vel={}".format(self.num_comfort_air_vel.Value))
        
        # Only include if non-zero
        if self.num_comfort_work_eff.Value > 0:
            parts.append("work_eff={}".format(self.num_comfort_work_eff.Value))
        if self.num_comfort_ankle_vel.Value > 0:
            parts.append("ankle_vel={}".format(self.num_comfort_ankle_vel.Value))
        
        # Comfort model
        model = str(self.dd_comfort_model.SelectedValue)
        if model and model != "Fanger":  # Only include if not default
            parts.append("comfort_model={}".format(model))
        
        # ASHRAE warnings
        if self.chk_ashrae_warnings.Checked:
            parts.append("ashrae_warnings=true")
        
        settings_str = ";".join(parts)
        
        # Send to GH Panel
        try:
            set_panel_text(NAME_COMFORT_SETTINGS, settings_str)
            self.lbl_comfort_status.Text = "Sent to '{}'".format(NAME_COMFORT_SETTINGS)
            self.lbl_comfort_status.TextColor = Drawing.Color.FromArgb(0, 128, 0)
        except Exception as ex:
            self.lbl_comfort_status.Text = "Error: {}".format(ex)
            self.lbl_comfort_status.TextColor = Drawing.Color.FromArgb(200, 0, 0)
    
    def _apply_load_preset(self, s, e):
        selected = str(self.dropdown_space_type.SelectedValue)
        
        defaults = None
        if selected.startswith("[GDS] "):
            name = selected[6:]
            if self.gds_parser and name in self.gds_parser.intensities:
                defaults = self.gds_parser.intensities[name]
        elif selected in INTENSITY_DEFAULTS:
            defaults = INTENSITY_DEFAULTS[selected]
        
        if not defaults:
            return
        
        self.num_people_density.Value = defaults.get("people_per_area", 0.0565)
        self.num_lighting_power.Value = defaults.get("lighting_power", 10.76)
        self.num_equipment_power.Value = defaults.get("equipment_power", 10.76)
        self.num_infiltration.Value = defaults.get("infiltration_rate", 0.0003)
        self.num_vent_person.Value = defaults.get("ventilation_per_person", 0.006)
        self.num_vent_area.Value = defaults.get("ventilation_per_area", 0.0003)
        
        # Also apply SHW if present in GDS preset
        if hasattr(self, 'num_shw_flow'):
            shw_flow = defaults.get("shw_flow_per_area", 0.0)
            shw_temp = defaults.get("shw_target_temp", 49.0)
            self.num_shw_flow.Value = shw_flow
            self.num_shw_temp.Value = shw_temp
        
        self._update_program_summary()
    
    def _apply_shw_preset(self, s, e):
        """Apply SHW preset values to input fields"""
        try:
            selected = str(self.dd_shw_load_preset.SelectedValue)
            if selected in SHW_PRESETS:
                preset = SHW_PRESETS[selected]
                self.num_shw_flow.Value = preset["flow_per_area"]
                self.num_shw_temp.Value = preset["target_temp"]
                self.num_shw_sensible.Value = preset["sensible_fraction"]
                self.num_shw_latent.Value = preset["latent_fraction"]
                self._update_program_summary()
        except Exception as ex:
            print("SHW preset error: {}".format(ex))
    
    def _update_shw_tank_visibility(self):
        """Show/hide tank parameter fields based on equipment type selection."""
        try:
            equip = str(self.dd_shw_equipment.SelectedValue) if self.dd_shw_equipment.SelectedIndex >= 0 else "Gas_WaterHeater"
            defaults = SHW_EQUIPMENT_DEFAULTS.get(equip, SHW_EQUIPMENT_DEFAULTS["Gas_WaterHeater"])
            self.shw_tank_panel.Visible = defaults["has_tank"]
        except:
            self.shw_tank_panel.Visible = True
    
    def _on_shw_equipment_changed(self, sender, e):
        """Update visibility and auto-populate defaults on equipment type change."""
        try:
            equip = str(self.dd_shw_equipment.SelectedValue)
            defaults = SHW_EQUIPMENT_DEFAULTS.get(equip, {})
            self._update_shw_tank_visibility()
            if defaults:
                self.num_shw_efficiency.Value = defaults["efficiency"]
                self.num_shw_tank_ua.Value = defaults["tank_ua"]
        except Exception as ex:
            print("SHW equip change: {}".format(ex))
    
    def _collect_program_data(self):
        self.program_data.identifier = self.txt_program_id.Text
        
        self.program_data.people_per_area = float(self.num_people_density.Value)
        self.program_data.lighting_power = float(self.num_lighting_power.Value)
        self.program_data.equipment_power = float(self.num_equipment_power.Value)
        self.program_data.gas_equipment_power = float(self.num_gas_power.Value)
        self.program_data.infiltration_rate = float(self.num_infiltration.Value)
        self.program_data.ventilation_per_person = float(self.num_vent_person.Value)
        self.program_data.ventilation_per_area = float(self.num_vent_area.Value)
        
        def get_schedule_selection(dropdown):
            val = str(dropdown.SelectedValue) if dropdown.SelectedValue else ""
            if val == "Custom...":
                return "Custom:Custom_Schedule"
            return val
        
        self.program_data.occupancy_schedule = get_schedule_selection(self.dd_occ_wd)
        self.program_data.occupancy_weekend = get_schedule_selection(self.dd_occ_we)
        self.program_data.lighting_schedule = get_schedule_selection(self.dd_lighting)
        self.program_data.equipment_schedule = get_schedule_selection(self.dd_equipment)
        self.program_data.infiltration_schedule = get_schedule_selection(self.dd_infiltration)
        self.program_data.heating_setpoint = get_schedule_selection(self.dd_heating)
        self.program_data.cooling_setpoint = get_schedule_selection(self.dd_cooling)
        self.program_data.activity_schedule = get_schedule_selection(self.dd_activity)
        
        # Service Hot Water
        if hasattr(self, 'num_shw_flow'):
            self.program_data.shw_flow_per_area = float(self.num_shw_flow.Value)
            self.program_data.shw_target_temp = float(self.num_shw_temp.Value)
            self.program_data.shw_sensible_fraction = float(self.num_shw_sensible.Value)
            self.program_data.shw_latent_fraction = float(self.num_shw_latent.Value)
            if hasattr(self, 'dd_shw_schedule') and self.dd_shw_schedule.SelectedValue:
                self.program_data.shw_schedule = str(self.dd_shw_schedule.SelectedValue)
    
    def _get_session_path(self):
        """Derive session JSON path from GH document filepath."""
        try:
            gh_path = DOC.FilePath
            if gh_path:
                base = os.path.splitext(gh_path)[0]
                return base + "_gds_session.json"
        except Exception:
            pass
        return None
    
    def _save_service_state(self):
        """Save Service Module widget state to sc.sticky for persistence across reopens."""
        def dd_val(dd):
            try:
                return str(dd.SelectedValue) if dd.SelectedIndex >= 0 else ""
            except:
                return ""
        
        state = {
            # Program identity
            'program_id': self.txt_program_id.Text,
            # Load intensities
            'people_density': float(self.num_people_density.Value),
            'lighting_power': float(self.num_lighting_power.Value),
            'equipment_power': float(self.num_equipment_power.Value),
            'gas_power': float(self.num_gas_power.Value),
            'infiltration': float(self.num_infiltration.Value),
            'vent_person': float(self.num_vent_person.Value),
            'vent_area': float(self.num_vent_area.Value),
            # SHW
            'shw_flow': float(self.num_shw_flow.Value),
            'shw_temp': float(self.num_shw_temp.Value),
            'shw_sensible': float(self.num_shw_sensible.Value),
            'shw_latent': float(self.num_shw_latent.Value),
            'shw_schedule': dd_val(self.dd_shw_schedule),
            'shw_equipment': dd_val(self.dd_shw_equipment) if hasattr(self, 'dd_shw_equipment') else "Gas_WaterHeater",
            'shw_tank_ua': float(self.num_shw_tank_ua.Value) if hasattr(self, 'num_shw_tank_ua') else 6.0,
            'shw_ambient': float(self.num_shw_ambient.Value) if hasattr(self, 'num_shw_ambient') else 22.0,
            'shw_efficiency': float(self.num_shw_efficiency.Value) if hasattr(self, 'num_shw_efficiency') else 1.0,
            'shw_preset': dd_val(self.dd_shw_load_preset),
            # Schedule assignments
            'sched_occ_wd': dd_val(self.dd_occ_wd),
            'sched_occ_we': dd_val(self.dd_occ_we),
            'sched_lighting': dd_val(self.dd_lighting),
            'sched_equipment': dd_val(self.dd_equipment),
            'sched_infiltration': dd_val(self.dd_infiltration),
            'sched_heating': dd_val(self.dd_heating),
            'sched_cooling': dd_val(self.dd_cooling),
            'sched_activity': dd_val(self.dd_activity),
            # Comfort settings
            'comfort_enable': bool(self.chk_comfort_enable.Checked),
            'comfort_model': dd_val(self.dd_comfort_model),
            'comfort_clothing': float(self.num_comfort_clothing.Value),
            'comfort_air_vel': float(self.num_comfort_air_vel.Value),
            'comfort_work_eff': float(self.num_comfort_work_eff.Value),
            'comfort_ankle_vel': float(self.num_comfort_ankle_vel.Value),
            'ashrae_warnings': bool(self.chk_ashrae_warnings.Checked),
            # Pending assignments (serializable)
            'pending_assignments': {str(k): v for k, v in self.pending_assignments.items()},
            # Applied programs (sent to GH, for display only)
            'applied_programs': {str(k): v for k, v in self.applied_programs.items()},
            # Program definitions (HB JSON dicts, for re-Apply after reopen)
            'program_definitions': dict(self.program_definitions) if self.program_definitions else {},
            # Custom schedules
            'custom_schedules': dict(self.saved_custom_schedules) if self.saved_custom_schedules else {},
        }
        sc.sticky[SERVICE_STORAGE_KEY] = state
        
        # Also persist to file for survival across Rhino restarts
        try:
            fpath = self._get_session_path()
            if fpath:
                with open(fpath, 'w') as f:
                    json.dump(state, f, indent=2)
                print("[GDS] Service state saved to file: {}".format(fpath))
            else:
                print("[GDS] Service state NOT saved to file (no GH file path)")
        except Exception as ex:
            print("[GDS] Service state file save error: {}".format(ex))
    
    def _publish_contam_occupancy(self):
        """Publish per-room occupancy data to sc.sticky for CONTAM pipeline.
        
        Reads from self.applied_programs (room_index -> program_name) and
        self.program_definitions (program_name -> HB ProgramType dict) to
        build a lightweight occupancy dict keyed by room name.
        
        Stored in sc.sticky["GDS_CONTAM_OCC"] for wireless pickup by RUNNER.
        """
        if not self.applied_programs or not self.program_definitions:
            return
        if not self.hb_rooms_info:
            return
        
        occ_data = {"rooms": {}}
        published = 0
        
        for idx_str, prog_name in self.applied_programs.items():
            idx = int(idx_str)
            if idx >= len(self.hb_rooms_info):
                continue
            
            prog_dict = self.program_definitions.get(prog_name)
            if not prog_dict or not isinstance(prog_dict, dict):
                continue
            
            room_info = self.hb_rooms_info[idx]
            room_name = room_info.get('name', 'Room_{}'.format(idx))
            room_area = room_info.get('area', 30.0)
            
            # Extract occupancy from HB ProgramType dict
            people = prog_dict.get('people', {})
            if not people:
                continue
            
            ppa = people.get('people_per_area', 0)
            if ppa is None or not isinstance(ppa, (int, float)):
                ppa = 0
            occ_count = max(1, int(round(ppa * room_area))) if ppa > 0 else 1
            
            # Parse occupancy schedule (HB ScheduleRuleset format)
            occ_sched = people.get('occupancy_schedule', {})
            if not isinstance(occ_sched, dict):
                continue
            
            # Build day_schedule value lookup
            ds_map = {}
            for ds in occ_sched.get('day_schedules', []):
                if isinstance(ds, dict) and 'identifier' in ds:
                    vals = ds.get('values', [0.0] * 24)
                    if isinstance(vals, list) and len(vals) == 24:
                        ds_map[ds['identifier']] = vals
            
            if not ds_map:
                continue
            
            # Weekend = default_day_schedule
            default_name = occ_sched.get('default_day_schedule', '')
            weekend_vals = ds_map.get(default_name, [0.0] * 24)
            
            # Weekday = first rule with apply_monday
            weekday_vals = None
            for rule in occ_sched.get('schedule_rules', []):
                if isinstance(rule, dict) and (rule.get('apply_monday') or
                                                rule.get('apply_tuesday')):
                    wd_name = rule.get('schedule_day', '')
                    weekday_vals = ds_map.get(wd_name)
                    break
            if weekday_vals is None:
                weekday_vals = weekend_vals
            
            # Extract seasonal rules (rules with date ranges different from Jan1-Dec31)
            seasonal = []
            for rule in occ_sched.get('schedule_rules', []):
                if not isinstance(rule, dict):
                    continue
                sd = rule.get('start_date', [1, 1])
                ed = rule.get('end_date', [12, 31])
                # Skip the default full-year rule (already captured as weekday/weekend)
                if sd == [1, 1] and ed == [12, 31]:
                    continue
                
                sch_day_name = rule.get('schedule_day', '')
                rule_vals = ds_map.get(sch_day_name)
                if not rule_vals:
                    continue
                
                is_wd = rule.get('apply_monday') or rule.get('apply_tuesday')
                is_we = rule.get('apply_saturday') or rule.get('apply_sunday')
                
                # Build seasonal entry — use rule vals for the appropriate day type
                sr = {
                    "start": sd,
                    "end": ed,
                    "weekday": rule_vals if is_wd else weekday_vals,
                    "weekend": rule_vals if is_we else weekend_vals,
                }
                seasonal.append(sr)
            
            # Store room entry
            room_entry = {
                "occupants": occ_count,
                "weekday": weekday_vals,
                "weekend": weekend_vals,
            }
            if seasonal:
                room_entry["seasonal"] = seasonal
            
            occ_data["rooms"][room_name] = room_entry
            published += 1
        
        # Publish to sc.sticky
        if published > 0:
            sc.sticky["GDS_CONTAM_OCC"] = occ_data
            print("[GDS] CONTAM occupancy published: {} rooms".format(published))
    
    def _restore_service_state(self):
        """Restore Service Module widget state from sc.sticky or session file."""
        state = None
        if SERVICE_STORAGE_KEY in sc.sticky:
            state = sc.sticky[SERVICE_STORAGE_KEY]
            print("[GDS] Service state loaded from sc.sticky")
        else:
            # Fallback: read from session file (survives Rhino restart)
            try:
                fpath = self._get_session_path()
                print("[GDS] Session file path: {}".format(fpath))
                if fpath and os.path.isfile(fpath):
                    with open(fpath, 'r') as f:
                        state = json.load(f)
                    sc.sticky[SERVICE_STORAGE_KEY] = state
                    print("[GDS] Service state loaded from file ({} keys)".format(len(state)))
                else:
                    print("[GDS] Session file not found")
            except Exception as ex:
                print("[GDS] Session file read error: {}".format(ex))
        
        if not isinstance(state, dict):
            print("[GDS] No service state to restore")
            return
        
        def set_dd(dd, val):
            """Set dropdown selection by matching value string."""
            if not val:
                return
            for i in range(dd.Items.Count):
                if str(dd.Items[i]) == val:
                    dd.SelectedIndex = i
                    return
        
        try:
            # Program identity
            self.txt_program_id.Text = state.get('program_id', 'GDS_Custom_Program')
            
            # Load intensities
            self.num_people_density.Value = state.get('people_density', 0.0)
            self.num_lighting_power.Value = state.get('lighting_power', 10.76)
            self.num_equipment_power.Value = state.get('equipment_power', 10.76)
            self.num_gas_power.Value = state.get('gas_power', 0.0)
            self.num_infiltration.Value = state.get('infiltration', 0.0003)
            self.num_vent_person.Value = state.get('vent_person', 0.006)
            self.num_vent_area.Value = state.get('vent_area', 0.0003)
            
            # SHW
            self.num_shw_flow.Value = state.get('shw_flow', 0.0)
            self.num_shw_temp.Value = state.get('shw_temp', 49.0)
            self.num_shw_sensible.Value = state.get('shw_sensible', 0.2)
            self.num_shw_latent.Value = state.get('shw_latent', 0.05)
            set_dd(self.dd_shw_load_preset, state.get('shw_preset', ''))
            if hasattr(self, 'dd_shw_equipment'):
                set_dd(self.dd_shw_equipment, state.get('shw_equipment', 'Gas_WaterHeater'))
            if hasattr(self, 'num_shw_tank_ua'):
                self.num_shw_tank_ua.Value = state.get('shw_tank_ua', 6.0)
            if hasattr(self, 'num_shw_ambient'):
                self.num_shw_ambient.Value = state.get('shw_ambient', 22.0)
            if hasattr(self, 'num_shw_efficiency'):
                self.num_shw_efficiency.Value = state.get('shw_efficiency', 1.0)
            self._update_shw_tank_visibility()
            
            # Schedule assignments (dropdowns must be populated first)
            set_dd(self.dd_occ_wd, state.get('sched_occ_wd', ''))
            set_dd(self.dd_occ_we, state.get('sched_occ_we', ''))
            set_dd(self.dd_lighting, state.get('sched_lighting', ''))
            set_dd(self.dd_equipment, state.get('sched_equipment', ''))
            set_dd(self.dd_infiltration, state.get('sched_infiltration', ''))
            set_dd(self.dd_heating, state.get('sched_heating', ''))
            set_dd(self.dd_cooling, state.get('sched_cooling', ''))
            set_dd(self.dd_activity, state.get('sched_activity', ''))
            set_dd(self.dd_shw_schedule, state.get('shw_schedule', ''))
            
            # Comfort settings
            self.chk_comfort_enable.Checked = state.get('comfort_enable', False)
            set_dd(self.dd_comfort_model, state.get('comfort_model', 'Fanger'))
            self.num_comfort_clothing.Value = state.get('comfort_clothing', 0.7)
            self.num_comfort_air_vel.Value = state.get('comfort_air_vel', 0.1)
            self.num_comfort_work_eff.Value = state.get('comfort_work_eff', 0.0)
            self.num_comfort_ankle_vel.Value = state.get('comfort_ankle_vel', 0.0)
            self.chk_ashrae_warnings.Checked = state.get('ashrae_warnings', False)
            self.pnl_comfort_params.Visible = state.get('comfort_enable', False)
            self.btn_send_comfort.Enabled = state.get('comfort_enable', False)
            
            # Pending assignments
            pending = state.get('pending_assignments', {})
            if pending:
                self.pending_assignments = {int(k): v for k, v in pending.items()}
            
            # Applied programs (display tracking)
            applied = state.get('applied_programs', {})
            if applied:
                self.applied_programs = {int(k): v for k, v in applied.items()}
            
            # Program definitions (for re-Apply)
            prog_defs = state.get('program_definitions', {})
            if prog_defs:
                self.program_definitions = prog_defs
                print("[GDS] Restored {} program definition(s): {}".format(
                    len(prog_defs), ", ".join(prog_defs.keys())))
            
            # Custom schedules
            custom = state.get('custom_schedules', {})
            if custom:
                self.saved_custom_schedules = custom
            
        except Exception as ex:
            print("[GDS] Service state restore error: {}".format(ex))
            import traceback
            traceback.print_exc()
    
    def _restore_service_dropdown_selections(self):
        """Re-apply only dropdown selections from saved state.
        Called after GDS database reload, when [GDS] items become available.
        Does NOT touch spinbox values (those are already correct)."""
        state = None
        if SERVICE_STORAGE_KEY in sc.sticky:
            state = sc.sticky[SERVICE_STORAGE_KEY]
        if not isinstance(state, dict):
            return
        
        def set_dd(dd, val):
            if not val:
                return
            for i in range(dd.Items.Count):
                if str(dd.Items[i]) == val:
                    dd.SelectedIndex = i
                    return
        
        try:
            set_dd(self.dd_occ_wd, state.get('sched_occ_wd', ''))
            set_dd(self.dd_occ_we, state.get('sched_occ_we', ''))
            set_dd(self.dd_lighting, state.get('sched_lighting', ''))
            set_dd(self.dd_equipment, state.get('sched_equipment', ''))
            set_dd(self.dd_infiltration, state.get('sched_infiltration', ''))
            set_dd(self.dd_heating, state.get('sched_heating', ''))
            set_dd(self.dd_cooling, state.get('sched_cooling', ''))
            set_dd(self.dd_activity, state.get('sched_activity', ''))
            if hasattr(self, 'dd_shw_schedule'):
                set_dd(self.dd_shw_schedule, state.get('shw_schedule', ''))
            if hasattr(self, 'dd_shw_equipment'):
                set_dd(self.dd_shw_equipment, state.get('shw_equipment', ''))
            set_dd(self.dd_shw_load_preset, state.get('shw_preset', ''))
            set_dd(self.dd_comfort_model, state.get('comfort_model', ''))
        except Exception as ex:
            print("Dropdown selection restore error: {}".format(ex))
    
    def _update_program_summary(self):
        self._collect_program_data()
        
        selected = list(self.grid_rooms.SelectedRows)
        sel_info = "{} room(s) selected".format(len(selected)) if selected else "No rooms selected"
        
        # Count pending assignments
        pending_count = len(self.pending_assignments)
        pending_info = "  ({} pending)".format(pending_count) if pending_count > 0 else ""
        
        lines = [
            u"Program: {}".format(self.program_data.identifier),
            u"Target: {}{}".format(sel_info, pending_info),
            u"",
            u"═══ Load Intensities ═══",
            u"People:       {:.4f} p/m²".format(self.program_data.people_per_area),
            u"Lighting:     {:.2f} W/m²".format(self.program_data.lighting_power),
            u"Elec Equip:   {:.2f} W/m²".format(self.program_data.equipment_power),
            u"Gas Equip:    {:.2f} W/m²".format(self.program_data.gas_equipment_power),
            u"Infiltration: {:.5f} m³/s/m²".format(self.program_data.infiltration_rate),
            u"Vent/Person:  {:.4f} m³/s/p".format(self.program_data.ventilation_per_person),
            u"Vent/Area:    {:.5f} m³/s/m²".format(self.program_data.ventilation_per_area),
            u"",
            u"═══ Schedules ═══",
            u"Occ Weekday:  {}".format(self.program_data.occupancy_schedule[:25]),
            u"Occ Weekend:  {}".format(self.program_data.occupancy_weekend[:25]),
            u"Lighting:     {}".format(self.program_data.lighting_schedule[:25]),
            u"Equipment:    {}".format(self.program_data.equipment_schedule[:25]),
            u"Infiltration: {}".format(self.program_data.infiltration_schedule[:25]),
            u"Activity:     {}".format(self.program_data.activity_schedule[:25]),
            u"",
            u"═══ Setpoints ═══",
            u"Heating:      {}".format(self.program_data.heating_setpoint[:25]),
            u"Cooling:      {}".format(self.program_data.cooling_setpoint[:25]),
        ]
        
        # Service Hot Water section (always show)
        if hasattr(self, 'num_shw_flow'):
            lines.append(u"")
            lines.append(u"═══ Service Hot Water ═══")
            lines.append(u"Flow/Area:    {:.3f} L/h/m²".format(self.program_data.shw_flow_per_area))
            lines.append(u"Target Temp:  {:.1f} °C".format(self.program_data.shw_target_temp))
            lines.append(u"Sensible:     {:.2f}".format(self.program_data.shw_sensible_fraction))
            lines.append(u"Latent:       {:.2f}".format(self.program_data.shw_latent_fraction))
            lines.append(u"Schedule:     {}".format(self.program_data.shw_schedule[:25]))
        
        self.txt_program_summary.Text = u"\n".join(lines)
    
    def _preview_program(self, s, e):
        self._collect_program_data()
        
        program_dict = self.program_data.to_program_dict(self.gds_parser)
        self.txt_json_output.Text = json.dumps(program_dict, indent=2)
        self._update_program_summary()
    
    def _assign_program_to_rooms(self, s, e):
        """Queue program assignment to selected rooms (in-memory, applied on Send)"""
        selected = list(self.grid_rooms.SelectedRows)
        if not selected:
            self.txt_program_summary.Text = "No rooms selected. Select rooms first."
            return
        
        if not self.hb_rooms:
            self.txt_program_summary.Text = "No rooms loaded. Load rooms first."
            return
        
        self._collect_program_data()
        program_dict = self.program_data.to_program_dict(self.gds_parser)
        program_name = self.program_data.identifier
        
        # Store program definition for re-Apply persistence
        self.program_definitions[program_name] = program_dict
        
        # Store pending assignment for each selected room
        for idx in selected:
            if idx < len(self.hb_rooms):
                self.pending_assignments[idx] = {
                    'program_dict': program_dict,
                    'program_name': program_name
                }
        
        # Update grid to show pending assignments
        self._refresh_room_grid()
        
        # Update examination panel to show pending
        self._update_room_exam_panel(selected)
        
        self.txt_program_summary.Text = "Queued '{}' for {} room(s).\n\nPending assignments shown with * prefix.\nClick 'Apply' to apply and export.".format(
            program_name, len(selected))
        
        # Save state for persistence
        self._save_service_state()
    
    def _restore_session_to_pending(self, s, e):
        """Restore all room-program assignments from stored session directly to GH canvas.
        Writes to GDS_Program panel exactly like Apply does — no room loading needed."""
        if not self.program_definitions or not self.applied_programs:
            self.txt_program_summary.Text = "No stored session found. Define programs and Apply first."
            return
        
        def expire_with_group(comp):
            comp.ExpireSolution(True)
            try:
                for obj in DOC.Objects:
                    if hasattr(obj, 'Objects'):
                        if comp in obj.Objects():
                            obj.ExpireSolution(True)
            except:
                pass
        
        try:
            from Grasshopper.Kernel.Types import GH_ObjectWrapper
            
            # Determine total room count from stored mapping
            max_idx = max(int(k) for k in self.applied_programs.keys())
            total_rooms = max_idx + 1
            
            # Build program JSON list 1:1 matching room indices
            program_jsons = []
            restored_count = 0
            missing_defs = set()
            
            for i in range(total_rooms):
                prog_name = self.applied_programs.get(i, self.applied_programs.get(str(i), None))
                if prog_name and prog_name in self.program_definitions:
                    program_dict = dict(self.program_definitions[prog_name])  # copy
                    program_dict['identifier'] = "{}_R{}".format(prog_name, i)
                    program_jsons.append(json.dumps(program_dict))
                    restored_count += 1
                elif prog_name:
                    missing_defs.add(prog_name)
                    program_jsons.append("")
                else:
                    program_jsons.append("")
            
            # Write to GDS_Program panel on canvas
            program_targets = []
            for obj in DOC.Objects:
                if obj.NickName == NAME_PROGRAM_OUTPUT:
                    program_targets.append(obj)
            
            if not program_targets:
                self.txt_program_summary.Text = "Error: '{}' panel not found on canvas.".format(NAME_PROGRAM_OUTPUT)
                return
            
            def do_program_output():
                for comp in program_targets:
                    comp.PersistentData.Clear()
                    for prog_json in program_jsons:
                        comp.PersistentData.Append(GH_ObjectWrapper(prog_json))
                    expire_with_group(comp)
            schedule(do_program_output)
            
            # Also restore SHW config from current widget state
            shw_equip_type = str(self.dd_shw_equipment.SelectedValue) if hasattr(self, 'dd_shw_equipment') and self.dd_shw_equipment.SelectedValue else "Gas_WaterHeater"
            shw_system_config = {
                "equipment_type": shw_equip_type,
                "efficiency": float(self.num_shw_efficiency.Value) if hasattr(self, 'num_shw_efficiency') else 1.0,
                "tank_ua": float(self.num_shw_tank_ua.Value) if hasattr(self, 'num_shw_tank_ua') else 6.0,
                "ambient": float(self.num_shw_ambient.Value) if hasattr(self, 'num_shw_ambient') else 22.0,
            }
            sc.sticky[SHW_STICKY_KEY] = shw_system_config
            
            shw_targets = []
            for obj in DOC.Objects:
                if obj.NickName == NAME_SHW_SYSTEM:
                    shw_targets.append(obj)
            if shw_targets:
                def do_shw_output():
                    for comp in shw_targets:
                        comp.PersistentData.Clear()
                        comp.PersistentData.Append(GH_ObjectWrapper(shw_equip_type))
                        expire_with_group(comp)
                schedule(do_shw_output)
            
            # Publish occupancy for CONTAM pipeline (wireless bridge)
            self._publish_contam_occupancy()
            
            # Summary
            summary = "Restored {} of {} room(s) from {} program(s): {}\nSHW: {}".format(
                restored_count, total_rooms,
                len(self.program_definitions),
                ", ".join(sorted(self.program_definitions.keys())),
                shw_equip_type)
            if missing_defs:
                summary += "\nMissing definitions: {}".format(", ".join(sorted(missing_defs)))
            self.txt_program_summary.Text = summary
            print("[GDS] Session restored to GH: {} rooms, {} definitions".format(
                restored_count, len(self.program_definitions)))
        
        except Exception as ex:
            self.txt_program_summary.Text = "Restore error: {}".format(ex)
            print("[GDS] Restore session error: {}".format(ex))
            import traceback
            traceback.print_exc()
    
    def _update_room_exam_panel(self, selected_indices):
        """Update the room examination panel for given indices"""
        if not selected_indices:
            self.txt_room_exam.Text = ""
            return
        
        info_lines = []
        for idx in selected_indices[:3]:
            if idx >= len(self.hb_rooms):
                continue
            
            room = self.hb_rooms[idx]
            try:
                name = getattr(room, 'display_name', getattr(room, 'identifier', 'Room_{}'.format(idx)))
                area = getattr(room, 'floor_area', 0)
                volume = getattr(room, 'volume', 0)
                
                info_lines.append(u"─── {} ───".format(name))
                info_lines.append(u"Area: {:.2f} m²  Vol: {:.2f} m³".format(area, volume))
                
                # Check pending assignment first (higher priority)
                if idx in self.pending_assignments:
                    pending_prog = self.pending_assignments[idx]['program_name']
                    info_lines.append(u"★ PENDING: {}".format(pending_prog))
                    # Show pending program details
                    pending_dict = self.pending_assignments[idx]['program_dict']
                    if 'people' in pending_dict:
                        ppa = pending_dict['people'].get('people_per_area', 0)
                        info_lines.append(u"  People: {:.4f} p/m²".format(ppa))
                    if 'lighting' in pending_dict:
                        lpd = pending_dict['lighting'].get('watts_per_area', 0)
                        info_lines.append(u"  Lighting: {:.2f} W/m²".format(lpd))
                    if 'electric_equipment' in pending_dict:
                        epd = pending_dict['electric_equipment'].get('watts_per_area', 0)
                        info_lines.append(u"  Equipment: {:.2f} W/m²".format(epd))
                elif idx in self.applied_programs:
                    info_lines.append(u"\u2713 APPLIED: {}".format(self.applied_programs[idx]))
                else:
                    # Show current program info
                    if hasattr(room, 'properties') and hasattr(room.properties, 'energy'):
                        energy = room.properties.energy
                        prog = getattr(energy, 'program_type', None)
                        if prog:
                            prog_id = getattr(prog, 'identifier', str(prog))
                            info_lines.append(u"Current: {}".format(prog_id))
                            
                            if hasattr(prog, 'people') and prog.people:
                                ppa = getattr(prog.people, 'people_per_area', 0)
                                info_lines.append(u"  People: {:.4f} p/m²".format(ppa))
                            if hasattr(prog, 'lighting') and prog.lighting:
                                lpd = getattr(prog.lighting, 'watts_per_area', 0)
                                info_lines.append(u"  Lighting: {:.2f} W/m²".format(lpd))
                            if hasattr(prog, 'electric_equipment') and prog.electric_equipment:
                                epd = getattr(prog.electric_equipment, 'watts_per_area', 0)
                                info_lines.append(u"  Equipment: {:.2f} W/m²".format(epd))
                        else:
                            info_lines.append(u"Current: None")
                
                info_lines.append(u"")
            except Exception as ex:
                info_lines.append(u"Error reading room {}: {}".format(idx, str(ex)[:30]))
        
        if len(selected_indices) > 3:
            info_lines.append(u"... and {} more room(s)".format(len(selected_indices) - 3))
        
        self.txt_room_exam.Text = u"\n".join(info_lines)
    
    def _refresh_room_grid(self):
        """Refresh the room grid to show current state and pending assignments"""
        if not self.hb_rooms:
            return
        
        items = []
        for i, room in enumerate(self.hb_rooms):
            try:
                name = getattr(room, 'display_name', getattr(room, 'identifier', 'Room_{}'.format(i)))
                area = getattr(room, 'floor_area', 0)
                
                # Tier priority: pending (not yet sent) > applied (sent to GH) > input room
                if i in self.pending_assignments:
                    prog_name = "\u2605 " + self.pending_assignments[i]['program_name'][:13]
                elif i in self.applied_programs:
                    prog_name = "\u2713 " + self.applied_programs[i][:13]
                else:
                    prog_name = "None"
                    if hasattr(room, 'properties') and hasattr(room.properties, 'energy'):
                        prog = getattr(room.properties.energy, 'program_type', None)
                        if prog:
                            prog_name = getattr(prog, 'identifier', str(prog))[:15]
                
                items.append([name[:20], "{:.1f}".format(area), prog_name])
            except:
                items.append(["Room_{}".format(i), "?", "Error"])
        
        self.grid_rooms.DataStore = items
    
    def _send_modified_rooms_to_gh(self, s, e):
        """Output all rooms and all corresponding programs 1:1"""
        if not self.hb_rooms:
            self.txt_program_summary.Text = "No rooms to send. Load rooms first."
            return
        
        if not self.pending_assignments:
            self.txt_program_summary.Text = "No pending assignments. Use 'Assign to Selected Rooms' first."
            return
        
        def expire_with_group(comp):
            """Expire component and any group it belongs to"""
            comp.ExpireSolution(True)
            # Also expire any group containing this component
            try:
                for obj in DOC.Objects:
                    if hasattr(obj, 'Objects'):  # It's a group
                        if comp in obj.Objects():
                            obj.ExpireSolution(True)
            except:
                pass
        
        try:
            from Grasshopper.Kernel.Types import GH_ObjectWrapper
            
            # Build program list for ALL rooms 1:1
            program_jsons = []
            assigned_count = 0
            
            for i, room in enumerate(self.hb_rooms):
                if i in self.pending_assignments:
                    # Room has pending assignment - use new program
                    program_dict = self.pending_assignments[i]['program_dict']
                    program_dict = dict(program_dict)  # copy
                    base_id = program_dict.get('identifier', 'GDS_Program')
                    program_dict['identifier'] = "{}_R{}".format(base_id, i)
                    program_jsons.append(json.dumps(program_dict))
                    assigned_count += 1
                else:
                    # No pending assignment - use existing program from room
                    existing_prog = None
                    try:
                        if hasattr(room, 'properties') and hasattr(room.properties, 'energy'):
                            existing_prog = getattr(room.properties.energy, 'program_type', None)
                    except:
                        pass
                    
                    if existing_prog:
                        # Serialize existing program
                        try:
                            prog_dict = existing_prog.to_dict()
                            program_jsons.append(json.dumps(prog_dict))
                        except:
                            program_jsons.append("")
                    else:
                        program_jsons.append("")
            
            # Output ALL program JSONs 1:1 matching rooms
            program_targets = []
            for obj in DOC.Objects:
                if obj.NickName == NAME_PROGRAM_OUTPUT:
                    program_targets.append(obj)
            
            if program_targets:
                def do_program_output():
                    for comp in program_targets:
                        comp.PersistentData.Clear()
                        for prog_json in program_jsons:
                            comp.PersistentData.Append(GH_ObjectWrapper(prog_json))
                        expire_with_group(comp)
                schedule(do_program_output)
            else:
                self.txt_program_summary.Text = "Error: '{}' not found on canvas.".format(NAME_PROGRAM_OUTPUT)
                return
            
            # Build SHW system config and store in sc.sticky for Refiner
            shw_equip_type = str(self.dd_shw_equipment.SelectedValue) if hasattr(self, 'dd_shw_equipment') and self.dd_shw_equipment.SelectedValue else "Gas_WaterHeater"
            shw_system_config = {
                "equipment_type": shw_equip_type,
                "efficiency": float(self.num_shw_efficiency.Value) if hasattr(self, 'num_shw_efficiency') else SHW_EQUIPMENT_DEFAULTS.get(shw_equip_type, {}).get("efficiency", 1.0),
                "tank_ua": float(self.num_shw_tank_ua.Value) if hasattr(self, 'num_shw_tank_ua') else 6.0,
                "ambient": float(self.num_shw_ambient.Value) if hasattr(self, 'num_shw_ambient') else 22.0,
            }
            sc.sticky[SHW_STICKY_KEY] = shw_system_config
            
            # Also output to GDS_SHW_System panel (backward compatible)
            shw_targets = []
            for obj in DOC.Objects:
                if obj.NickName == NAME_SHW_SYSTEM:
                    shw_targets.append(obj)
            if shw_targets:
                def do_shw_output():
                    for comp in shw_targets:
                        comp.PersistentData.Clear()
                        comp.PersistentData.Append(GH_ObjectWrapper(shw_equip_type))
                        expire_with_group(comp)
                schedule(do_shw_output)
            
            # Transfer pending → applied (so grid still shows what was assigned)
            for k, v in self.pending_assignments.items():
                self.applied_programs[k] = v['program_name']
            
            # Clear pending (they've been sent to GH)
            self.pending_assignments.clear()
            self._refresh_room_grid()
            
            # Save service module state for persistence (after clearing pending)
            self._save_service_state()
            
            # Publish occupancy data for CONTAM pipeline (wireless bridge)
            self._publish_contam_occupancy()
            selected = list(self.grid_rooms.SelectedRows)
            if selected:
                self._update_room_exam_panel(selected)
            
            self.txt_program_summary.Text = (
                "Output {} room(s), {} with new programs.\n"
                "SHW: {} (eff={}, UA={} W/K, amb={}C)\n\n"
                "GH Setup:\n"
                "[{}] -> [HB Str to Obj] -> programs\n"
                "[HB_Rooms] + programs -> [HB Apply ProgramType]\n"
                "SHW: auto-injected by Refiner into hbjson\n\n"
                "Both lists are 1:1 matched."
            ).format(len(self.hb_rooms), assigned_count, shw_equip_type,
                     shw_system_config["efficiency"], shw_system_config["tank_ua"],
                     shw_system_config["ambient"], NAME_PROGRAM_OUTPUT)
            
            # Update initialization status
            self.lbl_init_status.Text = "✓ Initialization complete"
            self.lbl_init_status.TextColor = Drawing.Color.FromArgb(0, 128, 0)  # Green
            
        except Exception as ex:
            import traceback
            self.txt_program_summary.Text = "Error: {}\n{}".format(ex, traceback.format_exc()[:300])
            self.lbl_init_status.Text = "✗ Apply failed"
            self.lbl_init_status.TextColor = Drawing.Color.FromArgb(200, 0, 0)  # Red
    
    def _create_program_from_dict(self, program_dict):
        """Create ProgramType using HB API directly"""
        error_details = []
        
        try:
            from honeybee_energy.programtype import ProgramType
            from honeybee_energy.schedule.ruleset import ScheduleRuleset
            from honeybee_energy.schedule.day import ScheduleDay
            from honeybee_energy.load.people import People
            from honeybee_energy.load.lighting import Lighting
            from honeybee_energy.load.equipment import ElectricEquipment
            from honeybee_energy.load.infiltration import Infiltration
            from honeybee_energy.load.ventilation import Ventilation
            from honeybee_energy.load.setpoint import Setpoint
            from ladybug.dt import Time
            
            prog_id = program_dict.get('identifier', 'GDS_Program')
            error_details.append("prog_id: {}".format(prog_id))
            
            # Create times list for 24-hour schedules
            times_24 = [Time(i, 0) for i in range(24)]
            
            def make_schedule(sched_dict, sched_name):
                """Create simple ScheduleRuleset from values"""
                if not sched_dict:
                    return None
                
                # Get values from first day schedule
                day_scheds = sched_dict.get('day_schedules', [])
                if not day_scheds:
                    return None
                
                values = day_scheds[0].get('values', [0]*24)
                sched_id = sched_dict.get('identifier', sched_name)
                
                # Create ScheduleDay with values AND times
                day_sched = ScheduleDay(sched_id + '_Day', values, times_24)
                schedule = ScheduleRuleset(sched_id, day_sched)
                return schedule
            
            # Create schedules
            people_dict = program_dict.get('people', {})
            occ_sched = make_schedule(people_dict.get('occupancy_schedule'), prog_id + '_Occ')
            error_details.append("occ_sched: {}".format(occ_sched))
            
            act_sched = make_schedule(people_dict.get('activity_schedule'), prog_id + '_Act')
            error_details.append("act_sched: {}".format(act_sched))
            
            light_dict = program_dict.get('lighting', {})
            light_sched = make_schedule(light_dict.get('schedule'), prog_id + '_Light')
            
            equip_dict = program_dict.get('electric_equipment', {})
            equip_sched = make_schedule(equip_dict.get('schedule'), prog_id + '_Equip')
            
            infil_dict = program_dict.get('infiltration', {})
            infil_sched = make_schedule(infil_dict.get('schedule'), prog_id + '_Infil')
            
            setp_dict = program_dict.get('setpoint', {})
            heat_sched = make_schedule(setp_dict.get('heating_schedule'), prog_id + '_Heat')
            cool_sched = make_schedule(setp_dict.get('cooling_schedule'), prog_id + '_Cool')
            
            # Create loads
            people = None
            if people_dict and occ_sched:
                people = People(
                    prog_id + '_People',
                    people_dict.get('people_per_area', 0.0565),
                    occ_sched,
                    activity_schedule=act_sched
                )
                error_details.append("people created")
            
            lighting = None
            if light_dict and light_sched:
                lighting = Lighting(
                    prog_id + '_Lighting',
                    light_dict.get('watts_per_area', 10.76),
                    light_sched
                )
                error_details.append("lighting created")
            
            electric_equipment = None
            if equip_dict and equip_sched:
                electric_equipment = ElectricEquipment(
                    prog_id + '_ElecEquip',
                    equip_dict.get('watts_per_area', 10.76),
                    equip_sched
                )
            
            infiltration = None
            if infil_dict and infil_sched:
                infiltration = Infiltration(
                    prog_id + '_Infiltration',
                    infil_dict.get('flow_per_exterior_area', 0.0003),
                    infil_sched
                )
            
            vent_dict = program_dict.get('ventilation', {})
            ventilation = None
            if vent_dict:
                ventilation = Ventilation(
                    prog_id + '_Ventilation',
                    vent_dict.get('outdoor_air_per_person', 0.006),
                    vent_dict.get('outdoor_air_per_area', 0.0003)
                )
            
            setpoint = None
            if heat_sched and cool_sched:
                setpoint = Setpoint(
                    prog_id + '_Setpoint',
                    heat_sched,
                    cool_sched
                )
            
            # Create ProgramType
            program = ProgramType(
                prog_id,
                people=people,
                lighting=lighting,
                electric_equipment=electric_equipment,
                infiltration=infiltration,
                ventilation=ventilation,
                setpoint=setpoint
            )
            
            error_details.append("program created successfully")
            return program
            
        except Exception as ex:
            import traceback
            tb = traceback.format_exc()
            error_details.append("EXCEPTION: {}".format(ex))
            error_details.append(tb)
            # Store for display
            self._last_program_error = "\n".join(error_details)
            return None
    
    def _export_program_json(self, s, e):
        self._collect_program_data()
        
        dialog = Forms.SaveFileDialog()
        dialog.Title = "Export Program JSON"
        dialog.Filters.Add(Forms.FileFilter("JSON Files", ".json"))
        dialog.FileName = "{}.json".format(self.program_data.identifier)
        
        if dialog.ShowDialog(self) == Forms.DialogResult.Ok:
            program_dict = self.program_data.to_program_dict(self.gds_parser)
            
            try:
                with open(dialog.FileName, 'w') as f:
                    json.dump(program_dict, f, indent=2)
                self.txt_program_summary.Text = "Exported to: {}".format(dialog.FileName)
            except Exception as ex:
                self.txt_program_summary.Text = "Export error: {}".format(ex)
    
    # Site Module handlers
    def _apply_site_settings(self, s, e):
        set_panel_text(NAME_SITE_CONTEXT, self.txt_site_context.Text)
        set_panel_text(NAME_SITE_NAME, self.txt_site_name.Text)
        set_slider_value(NAME_SITE_INDEX, self.num_site_index.Value)
    
    def _set_site_index(self, s, e):
        set_slider_value(NAME_SITE_INDEX, self.num_site_index.Value)
    
    def _press_site_overwrite(self, s, e):
        press_button(NAME_SITE_BUTTON)
    
    def _apply_weather_path(self, s, e):
        set_panel_text(NAME_WEATHER_PATH, self.txt_weather_path.Text)
    
    def _set_inc_context(self, s, e):
        """Set the Include Context toggle on the canvas"""
        targets = find_objs("GH_BooleanToggle", NAME_INC_CONTEXT)
        if not targets:
            return
        state = self.chk_inc_context.Checked
        if state is None:
            return
        def do():
            for tog in targets:
                try:
                    tog.Value = bool(state)
                    tog.ExpireSolution(True)
                except:
                    pass
        schedule(do)
    
    def _resync_site(self, s=None, e=None):
        try:
            self.txt_site_context.Text = get_first_input_panel_text(NAME_SITE_CONTEXT)
            self.txt_site_name.Text = get_first_input_panel_text(NAME_SITE_NAME)
            self.txt_weather_path.Text = get_first_input_panel_text(NAME_WEATHER_PATH)
            
            site_idx_info = get_slider_info(NAME_SITE_INDEX, 0)
            self.num_site_index.MinValue = site_idx_info[0]
            self.num_site_index.MaxValue = site_idx_info[1]
            self.num_site_index.Value = site_idx_info[2]
            
            self.chk_inc_context.Checked = get_toggles_aggregate(NAME_INC_CONTEXT)
        except Exception as ex:
            print("Site resync error: {}".format(ex))
    
    # --- RENEWABLE ENERGY HANDLERS ---
    
    def _on_pv_preset_changed(self, s, e):
        """Update parameters when preset changes"""
        try:
            preset_name = str(self.dd_pv_preset.SelectedValue)
            if preset_name in PV_PRESETS:
                p = PV_PRESETS[preset_name]
                self.num_pv_efficiency.Value = p["efficiency"]
                self.num_pv_loss.Value = p["loss_fraction"]
                self.num_pv_gcr.Value = p.get("tracking_gcr", 0.4)
                
                # Set module type dropdown
                module_type = p.get("module_type", "Standard")
                for i in range(self.dd_pv_module_type.Items.Count):
                    if str(self.dd_pv_module_type.Items[i]) == module_type:
                        self.dd_pv_module_type.SelectedIndex = i
                        break
                
                # Set mounting dropdown
                mounting = p["mounting"]
                for i in range(self.dd_pv_mounting.Items.Count):
                    if str(self.dd_pv_mounting.Items[i]) == mounting:
                        self.dd_pv_mounting.SelectedIndex = i
                        break
                
                # Enable/disable GCR based on mounting
                self._update_gcr_enabled()
        except Exception as ex:
            print("PV preset change error: {}".format(ex))
    
    def _on_pv_mounting_changed(self, s, e):
        """Enable/disable GCR input based on mounting type"""
        self._update_gcr_enabled()
    
    def _update_gcr_enabled(self):
        """Update GCR input enabled state based on mounting type"""
        try:
            mounting = str(self.dd_pv_mounting.SelectedValue)
            is_tracking = mounting in ['OneAxis', 'OneAxisBacktracking']
            self.num_pv_gcr.Enabled = is_tracking
            if is_tracking:
                self.lbl_gcr_note.Text = "(tracking ratio)"
            else:
                self.lbl_gcr_note.Text = "(OneAxis only)"
        except:
            pass
    
    def _load_pv_shades_from_model(self, s, e):
        """Load HB Shade objects from connected model"""
        try:
            # Try to get shades from a GH parameter named "HB_Shades"
            shades = get_hb_shades_from_param("HB_Shades")
            if shades:
                self.pv_shades = shades
                total_area = sum(sh.geometry.area for sh in shades if hasattr(sh, 'geometry'))
                self.lbl_pv_shade_status.Text = "{} shades ({:.1f} m²)".format(
                    len(shades), total_area)
            else:
                self.lbl_pv_shade_status.Text = "No shades found"
        except Exception as ex:
            self.lbl_pv_shade_status.Text = "Error: {}".format(str(ex)[:20])
    
    def _pick_pv_shades_in_rhino(self, s, e):
        """Pick surfaces in Rhino to use as PV shades"""
        self.Visible = False
        try:
            old_ctx = sc.doc
            if Rhino.RhinoDoc.ActiveDoc:
                sc.doc = Rhino.RhinoDoc.ActiveDoc
            
            go = ri.Custom.GetObject()
            go.SetCommandPrompt("Select surfaces for PV panels")
            go.GeometryFilter = rdo.ObjectType.Surface | rdo.ObjectType.Brep
            go.SubObjectSelect = False
            go.EnablePreSelect(False, True)
            
            res = go.GetMultiple(0, 0)
            if res == ri.GetResult.Object:
                self.pv_shade_breps = []
                total_area = 0
                
                for obj_ref in go.Objects():
                    geom = obj_ref.Geometry()
                    if geom:
                        brep = None
                        if geom.ObjectType == rdo.ObjectType.Brep:
                            brep = geom.DuplicateBrep()
                        elif geom.ObjectType == rdo.ObjectType.Surface:
                            brep = geom.ToBrep()
                        
                        if brep:
                            self.pv_shade_breps.append(brep)
                            amp = rg.AreaMassProperties.Compute(brep)
                            if amp:
                                total_area += amp.Area
                
                count = len(self.pv_shade_breps)
                self.lbl_pv_shade_status.Text = "{} surfaces ({:.1f} m²)".format(
                    count, total_area)
            else:
                self.lbl_pv_shade_status.Text = "Cancelled"
                
        except Exception as ex:
            self.lbl_pv_shade_status.Text = "Error: {}".format(str(ex)[:20])
        finally:
            try:
                sc.doc = old_ctx
            except:
                pass
            self.Visible = True
            self.BringToFront()
    
    def _apply_pv_properties(self, s, e):
        """Apply PV properties to selected shades"""
        try:
            # Collect parameters
            efficiency = float(self.num_pv_efficiency.Value)
            active_area = float(self.num_pv_active.Value)
            module_type = str(self.dd_pv_module_type.SelectedValue)
            mounting = str(self.dd_pv_mounting.SelectedValue)
            loss_fraction = float(self.num_pv_loss.Value)
            tracking_gcr = float(self.num_pv_gcr.Value)
            
            # Get shade count and area
            shade_count = 0
            total_area = 0
            
            if hasattr(self, 'pv_shades') and self.pv_shades:
                shade_count = len(self.pv_shades)
                total_area = sum(sh.geometry.area for sh in self.pv_shades 
                                if hasattr(sh, 'geometry'))
            elif hasattr(self, 'pv_shade_breps') and self.pv_shade_breps:
                shade_count = len(self.pv_shade_breps)
                for brep in self.pv_shade_breps:
                    amp = rg.AreaMassProperties.Compute(brep)
                    if amp:
                        total_area += amp.Area
            
            if shade_count == 0:
                self.txt_pv_summary.Text = "Error: No shades selected.\n\nPlease select surfaces first."
                return
            
            # Calculate stats
            active_area_total = total_area * active_area
            # Capacity at STC: 1000 W/m² × efficiency × area
            capacity_kw = (active_area_total * efficiency * 1000) / 1000
            
            # Rough annual generation estimate
            # Assumes ~1700 kWh/m²/year solar resource, 80% performance ratio
            annual_kwh = capacity_kw * 1700 * 0.80
            
            # Adjust for mounting type
            mounting_boost = {
                "FixedOpenRack": 1.0,
                "FixedRoofMounted": 0.95,
                "OneAxis": 1.20,
                "OneAxisBacktracking": 1.18,
                "TwoAxis": 1.35,
            }
            annual_kwh *= mounting_boost.get(mounting, 1.0)
            
            # Build summary with GCR if applicable
            is_tracking = mounting in ['OneAxis', 'OneAxisBacktracking']
            
            summary_lines = [
                "=" * 35,
                "PV SYSTEM SUMMARY",
                "=" * 35,
                "",
                "Configuration:",
                "  Module Type: {}".format(module_type),
                "  Efficiency: {:.1%}".format(efficiency),
                "  Mounting: {}".format(mounting),
            ]
            
            if is_tracking:
                summary_lines.append("  Tracking GCR: {:.2f}".format(tracking_gcr))
            
            summary_lines.extend([
                "  System Losses: {:.1%}".format(loss_fraction),
                "",
                "Surfaces:",
                "  Count: {} shades".format(shade_count),
                "  Total Area: {:.1f} m²".format(total_area),
                "  Active Area: {:.1f} m² ({:.0%})".format(active_area_total, active_area),
                "",
                "Estimated Output:",
                "  DC Capacity: {:.2f} kW".format(capacity_kw),
                "  Annual Gen: {:,.0f} kWh/year".format(annual_kwh),
                "",
                "=" * 35,
                "Status: Ready for simulation",
                "",
                "Use HB Photovoltaic Properties component",
                "to apply these settings to HB Shades.",
            ])
            self.txt_pv_summary.Text = "\n".join(summary_lines)
            
            # Store config in sticky for other components
            pv_config = {
                "efficiency": efficiency,
                "active_area_fraction": active_area,
                "module_type": module_type,
                "mounting_type": mounting,
                "loss_fraction": loss_fraction,
                "tracking_gcr": tracking_gcr,
                "shade_count": shade_count,
                "total_area_m2": total_area,
                "capacity_kw": capacity_kw,
            }
            sc.sticky["GDS_PV_CONFIG"] = pv_config
            
        except Exception as ex:
            import traceback
            self.txt_pv_summary.Text = "Error applying PV:\n{}\n\n{}".format(ex, traceback.format_exc())
    
    def _clear_pv_properties(self, s, e):
        """Clear PV configuration"""
        self.pv_shades = []
        self.pv_shade_breps = []
        self.lbl_pv_shade_status.Text = "0 shades (0 m²)"
        self.txt_pv_summary.Text = "No renewable systems configured.\n\nPV: Select shades, Apply PV\nSolar HW: Enable, Apply Config\n\nFor Battery & Wind (IDF),\nsee Module 6: Advanced."
        
        if "GDS_PV_CONFIG" in sc.sticky:
            del sc.sticky["GDS_PV_CONFIG"]
    
    # --- MODULE 6: RENEWABLES HANDLERS ---
    
    def _on_batt_preset_changed(self, s, e):
        """Update battery parameters from preset"""
        try:
            preset_name = str(self.dd_batt_preset.SelectedValue)
            if preset_name in BATTERY_PRESETS:
                p = BATTERY_PRESETS[preset_name]
                self.num_batt_capacity.Value = p["capacity_kwh"]
                self.num_batt_power.Value = p["power_kw"]
                self.num_batt_efficiency.Value = p["efficiency"]
        except Exception as ex:
            print("Battery preset error: {}".format(ex))
    
    def _on_wind_preset_changed(self, s, e):
        """Update wind parameters from preset"""
        try:
            preset_name = str(self.dd_wind_preset.SelectedValue)
            if preset_name in WIND_PRESETS:
                p = WIND_PRESETS[preset_name]
                self.num_wind_power.Value = p["rated_power_kw"]
                self.num_wind_hub.Value = p["hub_height_m"]
                self.num_wind_rotor.Value = p["rotor_diameter_m"]
        except Exception as ex:
            print("Wind preset error: {}".format(ex))
    
    def _on_solhw_preset_changed(self, s, e):
        """Update Solar HW parameters from preset (Module 5)"""
        try:
            preset_name = str(self.dd_solhw_preset.SelectedValue)
            if preset_name in SOLHW_PRESETS:
                p = SOLHW_PRESETS[preset_name]
                self.num_solhw_efficiency.Value = p["efficiency"]
        except Exception as ex:
            print("Solar HW preset error: {}".format(ex))
    
    def _apply_solhw_config(self, s, e):
        """Apply Solar HW configuration and store for HB SHW System component"""
        try:
            if not self.chk_solhw_enable.Checked:
                # Update summary
                self._update_renewables_summary()
                return
            
            equipment = str(self.dd_solhw_equipment.SelectedValue)
            collector_type = str(self.dd_solhw_preset.SelectedValue)
            area = float(self.num_solhw_area.Value)
            efficiency = float(self.num_solhw_efficiency.Value)
            
            # Store config for HB SHW System
            solhw_config = {
                "enabled": True,
                "equipment_type": equipment,
                "collector_type": collector_type,
                "collector_area": area,
                "efficiency": efficiency,
            }
            sc.sticky["GDS_SOLHW_CONFIG"] = solhw_config
            
            # Update summary
            self._update_renewables_summary()
            
        except Exception as ex:
            print("Solar HW config error: {}".format(ex))
    
    def _update_renewables_summary(self):
        """Update the combined PV + SHW summary in Module 5"""
        try:
            lines = ["=" * 35, "RENEWABLE SYSTEMS SUMMARY", "=" * 35, ""]
            
            # PV Status
            if "GDS_PV_CONFIG" in sc.sticky:
                pv = sc.sticky["GDS_PV_CONFIG"]
                lines.extend([
                    "PHOTOVOLTAIC:",
                    "  Capacity: {:.2f} kW".format(pv.get("capacity_kw", 0)),
                    "  Shades: {}".format(pv.get("shade_count", 0)),
                    "  Module: {}".format(pv.get("module_type", "-")),
                    ""
                ])
            else:
                lines.extend(["PHOTOVOLTAIC: Not configured", ""])
            
            # Solar HW Status
            if "GDS_SOLHW_CONFIG" in sc.sticky and sc.sticky["GDS_SOLHW_CONFIG"].get("enabled"):
                solhw = sc.sticky["GDS_SOLHW_CONFIG"]
                lines.extend([
                    "SOLAR HOT WATER:",
                    "  Equipment: {}".format(solhw.get("equipment_type", "-")),
                    "  Area: {} m²".format(solhw.get("collector_area", 0)),
                    "  Efficiency: {:.0%}".format(solhw.get("efficiency", 0)),
                    ""
                ])
            else:
                lines.extend(["SOLAR HOT WATER: Not enabled", ""])
            
            lines.extend([
                "=" * 35,
                "Use HB components to apply:",
                "  PV: HB Photovoltaic Properties",
                "  SHW: HB SHW System",
            ])
            
            self.txt_pv_summary.Text = "\n".join(lines)
        except:
            pass
    
    def _generate_all_idf(self, s, e):
        """Generate IDF strings for Battery and Wind (Module 6 only)"""
        import math
        idf_parts = []
        
        # Battery IDF
        if self.chk_battery.Checked:
            capacity_j = float(self.num_batt_capacity.Value) * 3.6e6
            power_w = float(self.num_batt_power.Value) * 1000
            eff = float(self.num_batt_efficiency.Value)
            single_eff = math.sqrt(eff)
            
            battery_idf = """! GDS Battery Storage System
ElectricLoadCenter:Storage:Simple,
    GDS_Battery,             !- Name
    Always On Discrete,      !- Availability Schedule Name
    ,                        !- Zone Name
    0,                       !- Radiative Fraction
    {:.3f},                  !- Nominal Energetic Efficiency for Charging
    {:.3f},                  !- Nominal Discharging Energetic Efficiency
    {:.0f},                  !- Maximum Storage Capacity {{J}}
    {:.0f},                  !- Maximum Power for Discharging {{W}}
    {:.0f},                  !- Maximum Power for Charging {{W}}
    {:.0f};                  !- Initial State of Charge {{J}}
""".format(single_eff, single_eff, capacity_j, power_w, power_w, capacity_j * 0.5)
            idf_parts.append(battery_idf)
        
        # Wind IDF
        if self.chk_wind.Checked:
            power_w = float(self.num_wind_power.Value) * 1000
            hub = float(self.num_wind_hub.Value)
            rotor = float(self.num_wind_rotor.Value)
            
            wind_idf = """! GDS Wind Turbine Generator
Generator:WindTurbine,
    GDS_WindTurbine,         !- Name
    Always On Discrete,      !- Availability Schedule Name
    HorizontalAxisWindTurbine, !- Rotor Type
    VariableSpeedVariablePitch, !- Power Control
    150,                     !- Rated Rotor Speed {{rpm}}
    {:.1f},                  !- Rotor Diameter {{m}}
    {:.1f},                  !- Overall Height {{m}}
    3,                       !- Number of Blades
    {:.0f},                  !- Rated Power {{W}}
    10.0,                    !- Rated Wind Speed {{m/s}}
    3.0,                     !- Cut In Wind Speed {{m/s}}
    25.0,                    !- Cut Out Wind Speed {{m/s}}
    0.835,                   !- Fraction System Efficiency
    7.0,                     !- Maximum Tip Speed Ratio
    0.40,                    !- Maximum Power Coefficient
    ,                        !- Annual Local Average Wind Speed
    {:.1f};                  !- Height for Local Average Wind Speed {{m}}
""".format(rotor, hub + rotor/2, power_w, hub)
            idf_parts.append(wind_idf)
        
        if idf_parts:
            self.txt_idf_preview.Text = "\n".join(idf_parts)
            
            # Store in sticky for downstream components
            sc.sticky["GDS_RENEWABLES_IDF"] = "\n".join(idf_parts)
        else:
            self.txt_idf_preview.Text = "! No IDF systems enabled.\n! Enable Battery or Wind and click Generate.\n!\n! Note: PV and SHW use native HB components\n! (configured in Module 5)"
    
    def _send_idf_to_gh(self, s, e):
        """Send IDF string to GH Panel for injection into HB Model"""
        try:
            idf_text = self.txt_idf_preview.Text.strip()
            
            # Check if there's actual IDF content (not just comments)
            has_content = False
            for line in idf_text.split('\n'):
                line = line.strip()
                if line and not line.startswith('!'):
                    has_content = True
                    break
            
            if not has_content:
                Forms.MessageBox.Show(
                    self,
                    "No IDF objects to send.\n\nEnable Battery or Wind, configure settings,\nthen click 'Generate IDF' first.",
                    "No IDF Content",
                    Forms.MessageBoxButtons.OK,
                    Forms.MessageBoxType.Warning
                )
                return
            
            # Send to named panel
            set_panel_text(NAME_IDF_INJECTION, idf_text)
            
            Forms.MessageBox.Show(
                self,
                "IDF sent to Panel: '{}'\n\nConnect this panel to HB Model's\nadditional_str_ input for injection.".format(NAME_IDF_INJECTION),
                "IDF Sent to GH",
                Forms.MessageBoxButtons.OK,
                Forms.MessageBoxType.Information
            )
            
        except Exception as ex:
            Forms.MessageBox.Show(
                self,
                "Error sending IDF: {}\n\nMake sure a Panel named '{}' exists on the canvas.".format(ex, NAME_IDF_INJECTION),
                "Send Failed",
                Forms.MessageBoxButtons.OK,
                Forms.MessageBoxType.Error
            )
    
    def _copy_idf_to_clipboard(self, s, e):
        """Copy IDF text to clipboard"""
        try:
            text = self.txt_idf_preview.Text
            if text:
                Forms.Clipboard.SetString(text)
                Forms.MessageBox.Show(self, "IDF copied to clipboard!", "Success",
                                     Forms.MessageBoxButtons.OK, Forms.MessageBoxType.Information)
        except Exception as ex:
            Forms.MessageBox.Show(self, "Error: {}".format(ex), "Copy Failed",
                                 Forms.MessageBoxButtons.OK, Forms.MessageBoxType.Error)
    
    def _toggle_idf_customize(self, s, e):
        """Toggle IDF preview between read-only and editable mode"""
        self._idf_customizing = not self._idf_customizing
        self.txt_idf_preview.ReadOnly = not self._idf_customizing
        
        if self._idf_customizing:
            # Entering edit mode
            self.btn_customize_idf.Text = "Lock (Exit Edit Mode)"
            self.txt_idf_preview.BackgroundColor = Drawing.Color.FromArgb(255, 255, 240)  # Light yellow
        else:
            # Exiting edit mode
            self.btn_customize_idf.Text = "Customize from Here"
            self.txt_idf_preview.BackgroundColor = Drawing.Colors.White
    
    # --- HVAC MODULE HANDLERS (Simplified) ---
    
    def _update_hvac_details(self):
        """Update details text based on selected preset"""
        try:
            name = str(self.dd_hvac_preset.SelectedValue)
            if name in HVAC_BUILDING_PRESETS:
                p = HVAC_BUILDING_PRESETS[name]
                txt = "Building Type: {}\n".format(name)
                txt += "Description: {}\n\n".format(p.get('description', ''))
                txt += "System Class: {}\n".format(p.get('class', ''))
                txt += "Equipment: {}\n".format(p.get('equipment_type', ''))
                txt += "Vintage: {}\n\n".format(p.get('vintage', ''))
                txt += "Economizer: {}\n".format(p.get('economizer_type', ''))
                txt += "Sensible HR: {:.0%}\n".format(p.get('sensible_heat_recovery', 0))
                txt += "Latent HR: {:.0%}\n".format(p.get('latent_heat_recovery', 0))
                txt += "DCV: {}".format("Yes" if p.get('demand_controlled_ventilation') else "No")
                self.txt_hvac_details.Text = txt
        except:
            pass
    
    def _on_hvac_preset_changed(self, s, e):
        """Handle preset dropdown change"""
        self._update_hvac_details()
    
    def _hvac_set_default(self, s, e):
        """Set selected preset as default HVAC"""
        try:
            name = str(self.dd_hvac_preset.SelectedValue)
            if name in HVAC_BUILDING_PRESETS:
                p = HVAC_BUILDING_PRESETS[name]
                config = {
                    'preset_name': name,
                    'class': p.get('class', 'IdealAirSystem'),
                    'equipment_type': p.get('equipment_type', ''),
                    'vintage': p.get('vintage', 'ASHRAE_2019'),
                    'economizer_type': p.get('economizer_type', 'NoEconomizer'),
                    'sensible_heat_recovery': p.get('sensible_heat_recovery', 0),
                    'latent_heat_recovery': p.get('latent_heat_recovery', 0),
                    'demand_controlled_ventilation': p.get('demand_controlled_ventilation', False),
                }
                sc.sticky[HVAC_DEFAULT_KEY] = config
                self.lbl_hvac_status.Text = "Default set: {} \u2014 Refiner will auto-apply to all rooms".format(name)
        except Exception as ex:
            self.lbl_hvac_status.Text = "Error: {}".format(str(ex))

# --------------------------- run function ------------------------------------
def _run(button_input):
    if not button_input:
        return False
    
    try:
        if hasattr(sc.sticky, '__getitem__'):
            ui = sc.sticky.get(KEY, None)
            if ui and hasattr(ui, 'Visible') and ui.Visible:
                ui.BringToFront()
                ui.Focus()
                return True
    except:
        pass
    
    try:
        ui = GDSHubPanel()
        try:
            if Rhino.UI.RhinoEtoApp.MainWindow:
                ui.Owner = Rhino.UI.RhinoEtoApp.MainWindow
        except:
            pass
        
        def _cleanup(sender, e):
            try:
                if DOC and hasattr(ui, '_on_solution_end') and ui._on_solution_end:
                    DOC.SolutionEnd -= ui._on_solution_end
            except:
                pass
            try:
                if hasattr(sc.sticky, '__delitem__') and KEY in sc.sticky:
                    sc.sticky.pop(KEY, None)
            except:
                pass
        
        ui.Closed += _cleanup
        
        try:
            ui._restore_applied_from_gh()
        except Exception:
            pass
        
        try:
            if hasattr(sc.sticky, '__setitem__'):
                sc.sticky[KEY] = ui
        except:
            pass
        
        ui.Show()
        return True
    except Exception as e:
        print("Error creating window: {}".format(e))
        return False

# Main execution
try:
    if RUN:
        _run(True)
except NameError:
    print("Connect a Button component to 'RUN' input")
# ---------- end gds_mod_hub ----------

crv = Curve(<curve referenced from the Rhino model>)

# ----
# Weather
weather_path = Panel("https://energyplus-weather.s3.amazonaws.com/north_and_central_america_wmo_region_4/USA/NY/USA_NY_Syracuse-Hancock.Intl.AP.725190_TMY3/USA_NY_Syracuse-Hancock.Intl.AP.725190_TMY3.zip")
downloadepw = LBDownloadWeather(weather_URL=weather_path)  # -> epw_file, stat_file, ddy_file; plug-in component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

cv = CV(C=crv)

# ----
# Enclosure
door_sync = Button()
ap_sync = Button()
aperture_surfaces = Brep([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])
door_surfaces = Brep([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])
gds_ref = GDSRef_2(brep_geo=aperture_surfaces, overwrite=ap_sync)
gds_ref_2 = GDSRef(brep_geo=door_surfaces, overwrite=door_sync)
gds_preview = Brep([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])

# ----
# Zone
layer_to_bake_refer = Panel("GDS_Space/Zone")
selected_geo = Brep([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])
dup = Slider(3, range=0..10)
geo_overwrite = Button()
run_sim = BooleanToggle(True)
not = GateNot(A=run_sim)
onoff = EnableDisableObject(Enabled=run_sim)
gds_ops_dup = GDS_OperationsDuplicate(geo=selected_geo, count=dup, vec=cv, gap=0, include_src=Toggle(True))  # -> msg, Geo_Dup, Xfroms; inputs geo: list, count: Int32, vec: Vector3d, gap: Double, include_src: Boolean
#   port geo: Brep/Geometry or GUID(s).
#   port count: Number of copies to make (Item, int)
#   port vec: Direction vector.
#   port gap: Optional gap distance, m.
#   port include_src: Whether to include originals as first set.
#   port pack_list: Whether to pack incoming list in order.
#   port Xfroms: Transforms applied.
# ---------- gds_ops_dup: Python ----------
"""Duplicate/pack Breps along a vector so they touch without overlap.
IronPython 2.7 (GHPython)

Inputs
    geo          : Brep/Geometry or GUID(s) (List Access)
    count        : number of copies to make (Item, int)
    vec          : direction vector (Item, Vector)
    gap          : optional gap distance (Item, float)
    include_src  : include originals as first set (Item, bool)
    pack_list    : pack incoming list in order (Item, bool)

Outputs
    Geo_Dup     : resulting geometry
    X           : transforms applied (Identity first if include_src=True)
    msg         : diagnostics
"""

ghenv.Component.Name = "GDS_Operations.Duplicate"
ghenv.Component.NickName = 'GDS_Ops.Dup'
ghenv.Component.Message = '0.2'
ghenv.Component.Category = 'GDS'
ghenv.Component.SubCategory = '2 :: Operations'

import System
import Rhino
from   Rhino.Geometry import Transform, Vector3d, Plane, Point3d

# ---------- helpers -------------------------------------------------
def _to_list(o):
    try:
        return list(o) if hasattr(o, '__iter__') and not isinstance(o, basestring) else [o]
    except:
        return [o]

def coerce_geom(o):
    """Return Rhino.Geometry.GeometryBase or None from geometry / GH-wrapped / GUID."""
    if isinstance(o, Rhino.Geometry.GeometryBase):
        return o
    v = getattr(o, 'Value', None)
    if isinstance(v, Rhino.Geometry.GeometryBase):
        return v
    if isinstance(o, System.Guid):
        rhobj = Rhino.RhinoDoc.ActiveDoc.Objects.FindId(o)
        if rhobj:
            return rhobj.Geometry.Duplicate()
    return None

def dup(g):
    if hasattr(g, 'DuplicateBrep'): return g.DuplicateBrep()
    if hasattr(g, 'Duplicate'):     return g.Duplicate()
    return g

def _v_aligned_plane(v):
    """Plane at origin whose X axis is v (so bbox.Max.X - bbox.Min.X = span along v)."""
    vv = Vector3d(v); vv.Unitize()
    helper = Vector3d.ZAxis
    if abs(vv * helper) > 0.99:
        helper = Vector3d.YAxis
    y = Vector3d.CrossProduct(helper, vv); y.Unitize()
    return Plane(Point3d.Origin, vv, y)  # plane.XAxis == vv

def extent_along_v(g, v):
    """True span of geometry along v, using an oriented bounding box."""
    plane = _v_aligned_plane(v)
    xform = Transform.ChangeBasis(Plane.WorldXY, plane)
    bb = g.GetBoundingBox(xform)
    if not bb.IsValid:
        # fallback to world AABB projection
        bb = g.GetBoundingBox(True)
        if not bb.IsValid: bb = g.GetBoundingBox(False)
        dots = [v.X*c.X + v.Y*c.Y + v.Z*c.Z for c in bb.GetCorners()]
        return max(dots) - min(dots)
    return bb.Max.X - bb.Min.X

def oriented_bounds_along_v(g, v):
    """Return (lo, hi) of g projected onto v, in the v-aligned frame."""
    plane = _v_aligned_plane(v)
    xform = Transform.ChangeBasis(Plane.WorldXY, plane)
    bb = g.GetBoundingBox(xform)
    return bb.Min.X, bb.Max.X

# ---------- inputs --------------------------------------------------
gap   = 0.0 if gap is None else float(gap)
count = max(0, int(count))
v     = vec if (vec and not vec.IsZero) else Vector3d.XAxis
v.Unitize()

raw = _to_list(geo)
geos = []
for g in raw:
    cg = coerce_geom(g)
    if cg is not None:
        geos.append(cg)

G, X = [], []
tol = Rhino.RhinoDoc.ActiveDoc.ModelAbsoluteTolerance if Rhino.RhinoDoc.ActiveDoc else 1e-6

# ---------- main ----------------------------------------------------
if pack_list:
    # Pack once in the given order; ignore count/include_src by design.
    acc = 0.0
    for g in geos:
        step = extent_along_v(g, v)
        if step <= tol: step = 0.0
        x = Transform.Translation(v * acc)
        d = dup(g); d.Transform(x)
        G.append(d); X.append(x)
        acc += step + gap
    msg = "Packed {0} item(s) along {1}; gap={2:g}".format(len(G), v, gap)

else:
    if not geos:
        msg = "No valid geometry on input (got {0} item[s]).".format(len(raw))
    else:
        # span of the whole input set along v, using oriented bounds per geometry
        los, his = [], []
        for g in geos:
            lo, hi = oriented_bounds_along_v(g, v)
            los.append(lo); his.append(hi)
        step = (max(his) - min(los)) + gap

        # Option A semantics:
        # - include_src=True → emit originals at identity (index 0)
        # - then always make exactly `count` copies at offsets 1..count
        if include_src:
            for g in geos:
                G.append(dup(g))
            X.append(Transform.Identity)

        # copies at +step, +2*step, ..., +count*step
        for i in range(1, count + 1):
            x = Transform.Translation(v * (i * step))
            for g in geos:
                d = dup(g); d.Transform(x); G.append(d)
            X.append(x)

        Geo_Dup = G
        Xfroms = X
        msg = "Tiled {0} copy(ies), step={1:g} along {2}; gap={3:g}".format(
            count, step - gap, v, gap)

# Ensure outputs are always assigned
Geo_Dup = G
Xfroms = X
# ---------- end gds_ops_dup ----------
building_name = Panel("GDSTEST")
hideshow = HideShowObjectPreview(Visible=not)
gds_bake_refer = GDS_BakeRefer(layer=layer_to_bake_refer, brep=gds_ops_dup.Geo_Dup, bld_name=building_name, bool=geo_overwrite)  # -> G, bld_name_3
gds_cond_status = Data([True, True, True, True, True, True, True, True, True, True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])
defset = DefSet()  # -> mod_sets, constr_set, room_prog
blds = Brep(gds_bake_refer.G)
gds_rawroom = GDS_RawRoom(
    geo=blds,
    name=gds_bake_refer.bld_name_3,
    mod_set=defset.mod_sets,
    constr_set=defset.constr_set,
    program=defset.room_prog,
    conditioned=gds_cond_status,
    geo_3=gds_ref,
    geo_4=gds_ref_2)

# ----
# Bld Context (GIS)
site_context = Panel("C:\Users\cdu113\OneDrive - Syracuse University\Desktop\GDS_Chengbo\GDS1.0\GIS_SouthCampus\SouthCampus.shp")
site_index = Slider(7, range=0..10)
site_name = Panel("GDS_S-Campus")
site_overwrite = Button()

# ----
# Site
inccont = BooleanToggle(False)
gds_context = GDS_Context(filepath=site_context, i=site_index, txt=site_name, bool=site_overwrite)  # -> fields, G
onoff_2 = EnableDisableObject(Enabled=inccont)
context = Brep(gds_context.G)  # disabled

# ----
# Service
gds_program = Data(["Grasshopper.Kernel.Types.GH_ObjectWrapper", "Grasshopper.Kernel.Types.GH_ObjectWrapper", "Grasshopper.Kernel.Types.GH_ObjectWrapper", "Grasshopper.Kernel.Types.GH_ObjectWrapper", "Grasshopper.Kernel.Types.GH_ObjectWrapper", "Grasshopper.Kernel.Types.GH_ObjectWrapper", "Grasshopper.Kernel.Types.GH_ObjectWrapper", "Grasshopper.Kernel.Types.GH_ObjectWrapper", "Grasshopper.Kernel.Types.GH_ObjectWrapper", "Grasshopper.Kernel.Types.GH_ObjectWrapper", "Grasshopper.Kernel.Types.GH_ObjectWrapper", "Grasshopper.Kernel.Types.GH_ObjectWrapper", "Grasshopper.Kernel.Types.GH_ObjectWrapper", "Grasshopper.Kernel.Types.GH_ObjectWrapper", "Grasshopper.Kernel.Types.GH_ObjectWrapper", "Grasshopper.Kernel.Types.GH_ObjectWrapper", "Grasshopper.Kernel.Types.GH_ObjectWrapper", "Grasshopper.Kernel.Types.GH_ObjectWrapper", "Grasshopper.Kernel.Types.GH_ObjectWrapper", "Grasshopper.Kernel.Types.GH_ObjectWrapper", "Grasshopper.Kernel.Types.GH_ObjectWrapper", "Grasshopper.Kernel.Types.GH_ObjectWrapper", "Grasshopper.Kernel.Types.GH_ObjectWrapper", "Grasshopper.Kernel.Types.GH_ObjectWrapper", "Grasshopper.Kernel.Types.GH_ObjectWrapper", "Grasshopper.Kernel.Types.GH_ObjectWrapper", "Grasshopper.Kernel.Types.GH_ObjectWrapper", "Grasshopper.Kernel.Types.GH_ObjectWrapper", "Grasshopper.Kernel.Types.GH_ObjectWrapper", "Grasshopper.Kernel.Types.GH_ObjectWrapper", "Grasshopper.Kernel.Types.GH_ObjectWrapper", "Grasshopper.Kernel.Types.GH_ObjectWrapper"])

# ----
# Modified:
# Enclosure
hb_rooms = Data(gds_rawroom)

epw = Data(downloadepw.epw_file)

# ----
# Assembly
run = Boolean(refiner_run)
gds_database_path = Panel("C:\Users\cdu113\OneDrive - Syracuse University\Desktop\GDS_Chengbo\TEST Sandbox\GDSDBTEST03202026.json")
gds_comfort_settings = Panel("clothing=0.7;air_vel=0.1")
gds_envelope_preview = Brep()
sim_start = Panel("1-16")
sim_end = Panel("11-22")
run_opening = BooleanToggle(True)
run_viewer = BooleanToggle(True)
run_solver = BooleanToggle(False)
panel_2 = Panel(gds_envelope_preview)
null = NullItem(Item=gds_envelope_preview)  # -> NullFlags, InvalidFlags, Description
hideshow_2 = HideShowObjectPreview(Visible=null.NullFlags, AllObjects_Object=gds_preview)
gds_contam = GDS_CONTAM(
    blds=blds,
    aperture=gds_ref,
    door=gds_ref_2,
    D="tilted",
    program_data=gds_program,
    sim_start=sim_start,
    sim_end=sim_end,
    epw_path=epw,
    auto_open=run_viewer,
    run_3=run_viewer,
    run_2=run_solver,
    run=run_opening)
toggle_2 = BooleanToggle(True)

# ----
# Modified:
# Enclosure + Service
# (RUN REF MODEL)
gds_refcase = GDS_RefCase(rooms=hb_rooms, _0=defset.room_prog, hb_str=gds_program, settings=gds_comfort_settings, epw_file=epw, geo=context)  # -> model_2, sql, rooms_2

initroom = Data(gds_refcase.rooms_2)
panel_3 = Panel(gds_contam)

gds_gbe_refiner = IronPython2Script(model=gds_refcase.model_2, gds_library=gds_database_path, run=run)  # -> report, hbjson_path, sim_folder; inputs model: list, preview_name: Boolean, gds_library: String
# ---------- gds_gbe_refiner: IronPython ----------
"""
GDS Refiner
===========

SPDX-License-Identifier: BSD-3-Clause
Copyright (c) 2026 SyracuseCoE, Syracuse University. All rights reserved.

Redistribution and use in source and binary forms, with or without
modification, are permitted provided that the conditions stated in the
LICENSE file distributed with this project are met.

Author: Chengbo Du <cdu113@syr.edu>

Edit a Honeybee Model. Provides room- and surface-level overrides and
applies the HVAC, PV, SHW, DHW, and battery/wind IDF configurations
published by GDS Hub. Output is written to .hbjson.

INPUTS:
    _model         : Honeybee Model
    _run           : Trigger UI
    _gds_library   : Path to GDS module database JSON (optional)
    _output_path_  : Output .hbjson path (default: temp file)
    _preview_name_ : Brep parameter nickname for preview
                     (default "GDS envelope preview")
    _case_suffix_  : Suffix for model name and simulation folder
                     (default "designcase")

OUTPUTS:
    hbjson_path : Path to the saved .hbjson
    sim_folder  : Simulation folder path
    report      : Status messages
"""

import Rhino
import Rhino.Geometry as rg
import System
import Eto.Forms as forms
import Eto.Drawing as drawing
import scriptcontext as sc
import json
import os
import re
import tempfile
import time
import hashlib

from Grasshopper import DataTree
from Grasshopper.Kernel.Data import GH_Path
import Grasshopper

STORAGE_KEY = "HB_SURFACE_PROP_EDITOR_V5"
DIALOG_KEY = "HB_SURFACE_PROP_EDITOR_V5_DIALOG"
COMPONENT_KEY = "HB_SURFACE_PROP_EDITOR_V5_COMPONENT"
RUN_STATE_KEY = "HB_SURFACE_PROP_EDITOR_V5_RUN_STATE"
OUTPUT_PATH_KEY = "HB_SURFACE_PROP_EDITOR_V5_OUTPUT_PATH"
MODEL_HASH_KEY = "HB_SURFACE_PROP_EDITOR_V5_MODEL_HASH"
LAST_MODIFICATIONS_KEY = "HB_SURFACE_PROP_EDITOR_V5_LAST_MODS"
RELEASE_OUTPUT_KEY = "HB_SURFACE_PROP_EDITOR_V5_RELEASE"
HVAC_CONFIG_KEY = "GDS_HVAC_CONFIG"  # HVAC config from GDS Hub
HVAC_DEFAULT_KEY = "GDS_HVAC_DEFAULT"  # Default HVAC config from GDS Hub
PV_CONFIG_KEY = "GDS_PV_CONFIG"  # PV properties from GDS Hub (v7)
SOLHW_CONFIG_KEY = "GDS_SOLHW_CONFIG"  # Solar Hot Water config from GDS Hub (v7)
SHW_CONFIG_KEY = "GDS_SHW_SYSTEM"  # DHW heater config from Hub Service Module
IDF_CONFIG_KEY = "GDS_RENEWABLES_IDF"  # IDF injection string from GDS Hub (v7)

# HVAC system categories and options (same as GDS Hub)
HVAC_CATEGORIES = {
    "Ideal Air (Loads Only)": {
        "class": "IdealAirSystem",
        "description": "Perfect HVAC for load calculations",
        "equipment_types": ["IdealAirSystem"]
    },
    "All-Air: VAV": {
        "class": "VAV",
        "description": "Variable Air Volume systems",
        "equipment_types": ["VAV_Chiller_Boiler", "VAV_Chiller_ASHP", "VAV_Chiller_DHW", 
                           "VAV_Chiller_PFP", "VAV_Chiller_GasCoil", "VAV_ACChiller_Boiler",
                           "VAV_ACChiller_ASHP", "VAV_ACChiller_DHW", "VAV_ACChiller_PFP",
                           "VAV_ACChiller_GasCoil", "VAV_DCW_Boiler", "VAV_DCW_ASHP",
                           "VAV_DCW_DHW", "VAV_DCW_PFP", "VAV_DCW_GasCoil"]
    },
    "All-Air: PVAV": {
        "class": "PVAV",
        "description": "Packaged VAV rooftop units",
        "equipment_types": ["PVAV_Boiler", "PVAV_ASHP", "PVAV_DHW", "PVAV_PFP", "PVAV_BoilerElectricReheat"]
    },
    "All-Air: PSZ": {
        "class": "PSZ",
        "description": "Packaged Single Zone units",
        "equipment_types": ["PSZAC", "PSZAC_GasCoil", "PSZAC_DHW", "PSZHP"]
    },
    "DOAS + FCU": {
        "class": "FCUwithDOAS",
        "description": "DOAS with Fan Coil Units",
        "equipment_types": ["DOAS_FCU_Chiller_Boiler", "DOAS_FCU_Chiller_ASHP", 
                           "DOAS_FCU_Chiller_DHW", "DOAS_FCU_Chiller_ElectricBaseboard",
                           "DOAS_FCU_Chiller", "DOAS_FCU_ACChiller_Boiler",
                           "DOAS_FCU_ACChiller_ASHP", "DOAS_FCU_ACChiller_DHW",
                           "DOAS_FCU_ACChiller_ElectricBaseboard", "DOAS_FCU_ACChiller",
                           "DOAS_FCU_DCW_Boiler", "DOAS_FCU_DCW_ASHP", "DOAS_FCU_DCW_DHW",
                           "DOAS_FCU_DCW_ElectricBaseboard", "DOAS_FCU_DCW"]
    },
    "DOAS + VRF": {
        "class": "VRFwithDOAS",
        "description": "DOAS with VRF system",
        "equipment_types": ["DOAS_VRF"]
    },
    "DOAS + WSHP": {
        "class": "WSHPwithDOAS",
        "description": "DOAS with Water Source Heat Pumps",
        "equipment_types": ["DOAS_WSHP_FluidCooler_Boiler", "DOAS_WSHP_CoolingTower_Boiler",
                           "DOAS_WSHP_GSHP", "DOAS_WSHP_DCW_DHW"]
    },
    "DOAS + Radiant": {
        "class": "RadiantwithDOAS",
        "description": "DOAS with radiant heating/cooling",
        "equipment_types": ["DOAS_Radiant_Chiller_Boiler", "DOAS_Radiant_Chiller_ASHP",
                           "DOAS_Radiant_Chiller_DHW", "DOAS_Radiant_ACChiller_Boiler",
                           "DOAS_Radiant_ACChiller_ASHP", "DOAS_Radiant_ACChiller_DHW",
                           "DOAS_Radiant_DCW_Boiler", "DOAS_Radiant_DCW_ASHP",
                           "DOAS_Radiant_DCW_DHW"]
    },
    "HeatCool: Baseboard": {
        "class": "Baseboard",
        "description": "Baseboard heating systems",
        "equipment_types": ["ElectricBaseboard", "BoilerBaseboard", "ASHPBaseboard", "DHWBaseboard"]
    },
    "HeatCool: Residential": {
        "class": "Residential",
        "description": "Residential split systems",
        "equipment_types": ["ResidentialAC_ElectricBaseboard", "ResidentialAC_BoilerBaseboard",
                           "ResidentialAC_ASHPBaseboard", "ResidentialAC_DHWBaseboard",
                           "ResidentialAC_ResidentialFurnace", "ResidentialHP",
                           "ResidentialHPNoCool", "ResidentialFurnace"]
    },
    "Radiant Only": {
        "class": "Radiant",
        "description": "Radiant heating/cooling only",
        "equipment_types": ["Radiant_Chiller_Boiler", "Radiant_Chiller_ASHP", "Radiant_Chiller_DHW",
                           "Radiant_ACChiller_Boiler", "Radiant_ACChiller_ASHP", "Radiant_ACChiller_DHW",
                           "Radiant_DCW_Boiler", "Radiant_DCW_ASHP", "Radiant_DCW_DHW"]
    },
}

HVAC_VINTAGES = ["ASHRAE_2019", "ASHRAE_2016", "ASHRAE_2013", "ASHRAE_2010", "ASHRAE_2007", "ASHRAE_2004"]
HVAC_ECONOMIZER_TYPES = ["NoEconomizer", "DifferentialDryBulb", "DifferentialEnthalpy"]
HVAC_RADIANT_TYPES = ["Floor", "Ceiling", "FloorWithCarpet", "CeilingMetalPanel"]

# --- HUB INTEGRATION FUNCTIONS ---

def load_hub_hvac_default():
    """Load HVAC default configuration from GDS Hub."""
    hub_default = sc.sticky.get(HVAC_DEFAULT_KEY, None)
    if hub_default and isinstance(hub_default, dict):
        print("GDS Hub: Loaded HVAC default - {}".format(hub_default.get('preset_name', 'Unknown')))
        return hub_default
    return None

def load_hub_pv_config():
    """Load PV configuration from GDS Hub."""
    pv_config = sc.sticky.get(PV_CONFIG_KEY, None)
    if pv_config and isinstance(pv_config, dict):
        print("GDS Hub: Loaded PV config - {:.1f}% efficiency".format(
            pv_config.get('efficiency', 0) * 100))
        return pv_config
    return None

def load_hub_shw_config():
    """Load SHW configuration from GDS Hub.
    
    Checks two sources in priority order:
    1. GDS_SHW_SYSTEM (Service Module — DHW heater type + tank params)
    2. GDS_SOLHW_CONFIG (Module 5 — solar thermal, requires enabled=True)
    """
    # Source 1: Service Module DHW heater (always applies if present)
    shw_config = sc.sticky.get(SHW_CONFIG_KEY, None)
    if shw_config and isinstance(shw_config, dict) and shw_config.get('equipment_type'):
        print("GDS Hub: Loaded SHW config - {}".format(
            shw_config.get('equipment_type', 'Unknown')))
        # Merge solar collector info if also configured
        solhw = sc.sticky.get(SOLHW_CONFIG_KEY, None)
        if solhw and isinstance(solhw, dict) and solhw.get('enabled', False):
            shw_config['collector_area'] = solhw.get('collector_area', 0)
            shw_config['collector_type'] = solhw.get('collector_type', '')
        return shw_config
    
    # Source 2: Solar HW only (legacy path)
    solhw = sc.sticky.get(SOLHW_CONFIG_KEY, None)
    if solhw and isinstance(solhw, dict) and solhw.get('enabled', False):
        print("GDS Hub: Loaded SHW config (solar only) - {} m2 collector".format(
            solhw.get('collector_area', 0)))
        return solhw
    
    return None

def load_hub_idf_injection():
    """Load IDF injection string from GDS Hub (Battery, Wind)."""
    idf_string = sc.sticky.get(IDF_CONFIG_KEY, None)
    if idf_string and isinstance(idf_string, str):
        has_content = any(line.strip() and not line.strip().startswith('!') 
                         for line in idf_string.split('\n'))
        if has_content:
            print("GDS Hub: Loaded IDF injection string")
            return idf_string
    return None

def apply_pv_to_model_dict(model_dict, pv_config):
    """
    Apply PV properties to orphaned/context shades in model dict.
    Returns: (count, list of shade names)
    """
    if not pv_config:
        return 0, []
    
    pv_count = 0
    pv_shade_names = []
    
    # Get all shades from model
    all_shades = model_dict.get('orphaned_shades', []) + model_dict.get('context_shades', [])
    
    if not all_shades:
        print("PV: No orphaned or context shades found in model")
        return 0, []
    
    # Build PV properties dict in HB schema
    pv_properties = {
        'type': 'PVProperties',
        'identifier': 'GDS_PV_System',
        'rated_efficiency': pv_config.get('efficiency', 0.15),
        'active_area_fraction': pv_config.get('active_area_fraction', 0.9),
        'module_type': pv_config.get('module_type', 'Standard'),
        'mounting_type': pv_config.get('mounting_type', 'FixedOpenRack'),
        'system_loss_fraction': pv_config.get('loss_fraction', 0.14),
    }
    
    for shade in all_shades:
        shade_id = shade.get('identifier', '')
        
        if 'properties' not in shade:
            shade['properties'] = {}
        if 'energy' not in shade['properties']:
            shade['properties']['energy'] = {}
        
        shade['properties']['energy']['pv_properties'] = pv_properties.copy()
        pv_count += 1
        pv_shade_names.append(shade.get('display_name', shade_id)[:25])
        print("PV applied to shade: {}".format(shade_id[:40]))
    
    return pv_count, pv_shade_names

def apply_shw_to_model_dict(model_dict, shw_config):
    """
    Apply SHW system to model dict.
    Uses config values for equipment type, efficiency, tank UA, ambient.
    Only assigns to rooms whose program has ServiceHotWater demand.
    Returns: (success, report_message)
    """
    if not shw_config:
        return False, ""
    
    # Build SHW system dict from config
    shw_dict = {
        'type': 'SHWSystem',
        'identifier': 'GDS_SHW_System',
        'equipment_type': shw_config.get('equipment_type', 'Gas_WaterHeater'),
        'heater_efficiency': shw_config.get('efficiency', 0.8),
        'ambient_condition': shw_config.get('ambient', 22.0),
        'ambient_loss_coefficient': shw_config.get('tank_ua', 6.0),
    }
    
    # Ensure energy properties exist
    if 'properties' not in model_dict:
        model_dict['properties'] = {}
    if 'energy' not in model_dict['properties']:
        model_dict['properties']['energy'] = {}
    if 'shws' not in model_dict['properties']['energy']:
        model_dict['properties']['energy']['shws'] = []
    
    # Add or replace SHW system
    shws = model_dict['properties']['energy']['shws']
    shws[:] = [s for s in shws if s.get('identifier') != shw_dict['identifier']]
    shws.append(shw_dict)
    
    # Build lookup: which programs have SHW demand?
    progs_with_shw = set()
    for prog in model_dict['properties']['energy'].get('program_types', []):
        if prog.get('service_hot_water') is not None:
            progs_with_shw.add(prog.get('identifier', ''))
    
    # Assign SHW system only to rooms with SHW demand
    assigned = 0
    for room_dict in model_dict.get('rooms', []):
        if 'properties' not in room_dict:
            room_dict['properties'] = {}
        if 'energy' not in room_dict['properties']:
            room_dict['properties']['energy'] = {}
        
        pid = room_dict['properties']['energy'].get('program_type', '')
        if pid in progs_with_shw:
            room_dict['properties']['energy']['shw'] = shw_dict['identifier']
            assigned += 1
        else:
            room_dict['properties']['energy'].pop('shw', None)
    
    report = "SHW: {} (eff={}, UA={} W/K, amb={}C) -> {} rooms".format(
        shw_dict['equipment_type'],
        shw_dict['heater_efficiency'],
        shw_dict['ambient_loss_coefficient'],
        shw_dict['ambient_condition'],
        assigned
    )
    
    collector_area = shw_config.get('collector_area', 0)
    if collector_area > 0:
        report += " + {} m2 solar".format(collector_area)
    
    return True, report

def inject_idf_to_model_dict(model_dict, idf_string):
    """
    Inject IDF string into model dict.
    Returns: (success, report_message)
    """
    if not idf_string:
        return False, ""
    
    # Ensure energy properties exist
    if 'properties' not in model_dict:
        model_dict['properties'] = {}
    if 'energy' not in model_dict['properties']:
        model_dict['properties']['energy'] = {}
    
    # Append to additional_idf
    existing_idf = model_dict['properties']['energy'].get('additional_idf', '')
    if existing_idf:
        combined = existing_idf + '\n\n! === GDS Hub Renewables ===\n' + idf_string
    else:
        combined = '! === GDS Hub Renewables ===\n' + idf_string
    
    model_dict['properties']['energy']['additional_idf'] = combined
    
    # Count objects
    obj_count = sum(1 for line in idf_string.split('\n') 
                   if line.strip() and not line.strip().startswith('!') and ';' in line)
    
    return True, "IDF: {} objects injected".format(obj_count)

# --- END HUB INTEGRATION FUNCTIONS ---

def get_model_hash(model):
    """
    Generate a hash of the model to detect changes.
    Uses model's dict representation for comparison.
    """
    try:
        model_dict = model.to_dict()
        model_str = json.dumps(model_dict, sort_keys=True)
        return hashlib.md5(model_str.encode()).hexdigest()
    except:
        return None

def get_modifications_hash(modified_faces, modified_apertures, modified_doors):
    """
    Generate a hash of the modifications to detect changes.
    Now includes doors.
    """
    try:
        mods_dict = {
            'faces': modified_faces,
            'apertures': modified_apertures,
            'doors': modified_doors
        }
        mods_str = json.dumps(mods_dict, sort_keys=True)
        return hashlib.md5(mods_str.encode()).hexdigest()
    except:
        return None

def get_unique_filepath(filepath):
    """
    Get a unique filepath by adding suffix if file exists.
    """
    if not os.path.exists(filepath):
        return filepath
    
    base, ext = os.path.splitext(filepath)
    counter = 1
    
    while True:
        new_path = "{}_{}{}".format(base, counter, ext)
        if not os.path.exists(new_path):
            return new_path
        counter += 1
        if counter > 1000:
            timestamp = int(time.time())
            return "{}_{}{}".format(base, timestamp, ext)

def get_output_filepath(user_path=None):
    """
    Get the output filepath.
    """
    if user_path:
        if not user_path.lower().endswith('.hbjson'):
            user_path = user_path + '.hbjson'
        return get_unique_filepath(user_path)
    else:
        temp_dir = tempfile.gettempdir()
        timestamp = int(time.time())
        filename = "hb_modified_model_{}.hbjson".format(timestamp)
        return os.path.join(temp_dir, filename)

def create_brep_from_vertices(vertices):
    """Create Brep from ladybug Point3D vertices"""
    if vertices is None or len(vertices) < 3:
        return None
    try:
        pts = [rg.Point3d(v.x, v.y, v.z) for v in vertices]
        pts.append(pts[0])
        polyline = rg.Polyline(pts)
        curve = polyline.ToNurbsCurve()
        if curve is None:
            return None
        tol = Rhino.RhinoDoc.ActiveDoc.ModelAbsoluteTolerance
        breps = rg.Brep.CreatePlanarBreps(curve, tol)
        if breps and len(breps) > 0:
            return breps[0]
        breps = rg.Brep.CreatePlanarBreps(curve, 0.01)
        if breps and len(breps) > 0:
            return breps[0]
        n = len(pts) - 1
        if n == 4:
            srf = rg.NurbsSurface.CreateFromCorners(pts[0], pts[1], pts[2], pts[3])
            if srf:
                return srf.ToBrep()
        elif n == 3:
            srf = rg.NurbsSurface.CreateFromCorners(pts[0], pts[1], pts[2])
            if srf:
                return srf.ToBrep()
        return None
    except:
        return None

def find_preview_component(nickname):
    """Find a GH component by nickname"""
    try:
        doc = Grasshopper.Instances.ActiveCanvas.Document
        for obj in doc.Objects:
            if obj.NickName == nickname:
                return obj
    except:
        pass
    return None

def update_preview_component(nickname, breps):
    """Update preview component with breps - thread safe"""
    def do_update():
        comp = find_preview_component(nickname)
        if comp is None:
            return
        try:
            if hasattr(comp, 'PersistentData'):
                comp.PersistentData.Clear()
                if breps:
                    from Grasshopper.Kernel.Types import GH_Brep
                    for brep in breps:
                        if brep:
                            gh_brep = GH_Brep(brep)
                            comp.PersistentData.Append(gh_brep)
                comp.ExpireSolution(True)
        except Exception as e:
            print("Preview update error: {}".format(e))
    
    try:
        Rhino.RhinoApp.InvokeOnUiThread(System.Action(do_update))
    except:
        do_update()

def clear_preview_component(nickname):
    """Clear preview component"""
    update_preview_component(nickname, [])

def expire_gh_component():
    """Expire the main GH component to trigger recalculation"""
    try:
        if COMPONENT_KEY in sc.sticky:
            comp = sc.sticky[COMPONENT_KEY]
            if comp:
                def do_expire():
                    comp.ExpireSolution(True)
                Rhino.RhinoApp.InvokeOnUiThread(System.Action(do_expire))
    except:
        pass

class GDSLibraryParser:
    """Parse GDS module database"""
    
    def __init__(self, json_path):
        self.json_path = json_path
        self.constructions = {}
        self.modifiers = {}
        if json_path:
            self._load_and_parse()
    
    def _load_and_parse(self):
        try:
            with open(self.json_path, 'r') as f:
                data = json.load(f)
            modules = data.get('modules', {})
            for module_key, module_data in modules.items():
                if not module_key.startswith('enclosure.'):
                    continue
                short_key = module_key.replace('enclosure.', '')
                if '_exterior' in short_key:
                    boundary = 'Outdoors'
                elif '_ground' in short_key:
                    boundary = 'Ground'
                elif '_interior' in short_key:
                    boundary = 'Surface'
                else:
                    boundary = 'Outdoors'
                meta = module_data.get('meta', {})
                display_name = meta.get('display_name', short_key)
                design = module_data.get('design', {})
                thermal = design.get('thermal', {})
                layers = thermal.get('layers', [])
                if layers:
                    is_window = any(l.get('type', '').startswith('EnergyWindow') for l in layers)
                    constr_dict = self._build_construction(short_key, layers, is_window)
                    if constr_dict:
                        self.constructions[display_name] = {
                            'hb_dict': constr_dict,
                            'boundary': boundary,
                            'is_window': is_window
                        }
                lighting = design.get('lighting', {})
                modifier = lighting.get('modifier', {})
                if modifier:
                    mod_dict = self._build_modifier(modifier)
                    if mod_dict:
                        mod_name = modifier.get('name', short_key + '_mod')
                        self.modifiers[mod_name] = {
                            'hb_dict': mod_dict,
                            'boundary': boundary,
                            'is_glass': modifier.get('type') in ['glass', 'trans'],
                            'display_name': display_name
                        }
        except:
            pass
    
    def _build_construction(self, module_key, layers, is_window):
        constr_id = "gds__{}".format(module_key.replace('.', '_').replace('-', '_'))
        material_ids = []
        materials = []
        for i, layer in enumerate(layers):
            mat_id = "gds__{}_{}".format(constr_id, i)
            mat_dict = self._build_material(mat_id, layer)
            if mat_dict:
                material_ids.append(mat_id)
                materials.append(mat_dict)
        if not materials:
            return None
        return {
            'type': 'WindowConstruction' if is_window else 'OpaqueConstruction',
            'identifier': constr_id,
            'layers': material_ids,
            'materials': materials
        }
    
    def _build_material(self, mat_id, layer):
        layer_type = layer.get('type', 'EnergyMaterial')
        if layer_type == 'EnergyMaterial':
            return {
                'type': 'EnergyMaterial',
                'identifier': mat_id,
                'thickness': layer.get('thickness', 0.1),
                'conductivity': layer.get('conductivity', 1.0),
                'density': layer.get('density', 1000),
                'specific_heat': layer.get('specific_heat', 1000),
                'roughness': layer.get('roughness', 'MediumRough'),
                'thermal_absorptance': layer.get('thermal_absorptance', 0.9),
                'solar_absorptance': layer.get('solar_absorptance', 0.7),
                'visible_absorptance': layer.get('visible_absorptance', 0.7)
            }
        elif layer_type == 'EnergyWindowMaterialSimpleGlazSys':
            return {
                'type': 'EnergyWindowMaterialSimpleGlazSys',
                'identifier': mat_id,
                'u_factor': layer.get('u_factor', 2.7),
                'shgc': layer.get('shgc', 0.6),
                'vt': layer.get('visible_transmittance', 0.6)
            }
        return None
    
    def _build_modifier(self, modifier):
        mod_type = modifier.get('type', 'plastic')
        mod_name = modifier.get('name', 'unnamed')
        if mod_type == 'plastic':
            rgb = modifier.get('rgb_reflectance', [0.5, 0.5, 0.5])
            return {
                'type': 'Plastic',
                'identifier': mod_name,
                'modifier': None,
                'r_reflectance': rgb[0],
                'g_reflectance': rgb[1],
                'b_reflectance': rgb[2],
                'specularity': modifier.get('specularity', 0.0),
                'roughness': modifier.get('roughness', 0.0)
            }
        elif mod_type == 'glass':
            rgb = modifier.get('rgb_transmissivity', [0.6, 0.6, 0.6])
            return {
                'type': 'Glass',
                'identifier': mod_name,
                'modifier': None,
                'r_transmissivity': rgb[0],
                'g_transmissivity': rgb[1],
                'b_transmissivity': rgb[2]
            }
        return None
    
    def get_constructions_for_boundary(self, boundary, is_window=False):
        result = {}
        for name, data in self.constructions.items():
            if data['boundary'] == boundary and data['is_window'] == is_window:
                result[name] = data
        return result
    
    def get_modifiers_for_boundary(self, boundary, is_glass=False):
        result = {}
        for name, data in self.modifiers.items():
            if data['boundary'] == boundary and data['is_glass'] == is_glass:
                result[name] = data
        return result

class SurfacePropertyEditor(forms.Form):
    """Main editor dialog - MODELESS with preview support"""
    
    def __init__(self):
        forms.Form.__init__(self)
    
    def initialize(self, hb_model, gds_parser, preview_nickname):
        self.hb_model = hb_model
        self.gds_parser = gds_parser
        self.preview_nickname = preview_nickname
        self.face_list = []
        self.aperture_list = []
        self.door_list = []
        self.filtered_faces = []
        self.filtered_apertures = []
        self.filtered_doors = []
        self.modified_faces = {}
        self.modified_apertures = {}
        self.modified_doors = {}  # NEW: Track door modifications
        self.shading_config = {}
        # HVAC: New data structures for system grouping
        self.hvac_systems = {}  # system_name -> config (defines the HVAC systems)
        self.room_hvac_assignments = {}  # room_id -> system_name (assigns rooms to systems)
        self.room_hvac_names = {}  # room_id -> display_name (for ID migration when model rebuilds)
        self.room_list = []
        self.room_breps = {}  # NEW: Store room geometry for preview (room_id -> list of breps)
        self.program_assignments = {}  # v9
        self.available_programs = []  # v9
        self.room_exhaust_assignments = {}  # room_id -> list of exhaust spec dicts
        
        if STORAGE_KEY in sc.sticky:
            stored = sc.sticky[STORAGE_KEY]
            self.modified_faces = dict(stored.get('faces', {}))
            self.modified_apertures = dict(stored.get('apertures', {}))
            self.modified_doors = dict(stored.get('doors', {}))  # NEW
            self.shading_config = dict(stored.get('shading', {}))
            # Load new HVAC data structures
            self.hvac_systems = dict(stored.get('hvac_systems', {}))
            self.room_hvac_assignments = dict(stored.get('room_hvac_assignments', {}))
            self.room_hvac_names = dict(stored.get('room_hvac_names', {}))
            self.program_assignments = dict(stored.get('program_assignments', {}))
            stored_exh = stored.get('room_exhaust_assignments', {})
            self.room_exhaust_assignments = {rid: list(v) for rid, v in stored_exh.items()}
        
        # Always sync Hub HVAC default (replaces v7 first-load-only logic)
        hub_hvac = load_hub_hvac_default()
        if hub_hvac:
            system_name = "Hub_{}".format(hub_hvac.get('preset_name', 'Default'))
            new_cfg = {
                'class': hub_hvac.get('class', 'IdealAirSystem'),
                'equipment_type': hub_hvac.get('equipment_type', 'IdealAirSystem'),
                'vintage': hub_hvac.get('vintage', 'ASHRAE_2019'),
                'economizer_type': hub_hvac.get('economizer_type', 'NoEconomizer'),
                'sensible_heat_recovery': hub_hvac.get('sensible_heat_recovery', 0),
                'latent_heat_recovery': hub_hvac.get('latent_heat_recovery', 0),
                'demand_controlled_ventilation': hub_hvac.get('demand_controlled_ventilation', False),
                'radiant_type': hub_hvac.get('radiant_type', 'Floor'),
            }
            # Remove any stale Hub_ systems and replace with current
            stale = [k for k in self.hvac_systems if k.startswith('Hub_')]
            for k in stale:
                del self.hvac_systems[k]
            self.hvac_systems[system_name] = new_cfg
            # Re-assign rooms that were on stale Hub_ systems to the new one
            for rid, sname in list(self.room_hvac_assignments.items()):
                if sname in stale or sname.startswith('Hub_'):
                    self.room_hvac_assignments[rid] = system_name
            print("Hub HVAC synced: {}".format(system_name))
        
        self._extract_model_data()
        
        # Auto-assign all rooms to Hub HVAC if no prior assignments exist
        if self.hvac_systems and not self.room_hvac_assignments:
            hub_names = [n for n in self.hvac_systems if n.startswith('Hub_')]
            if hub_names:
                default_sys = hub_names[0]
                for r in self.room_list:
                    self.room_hvac_assignments[r['id']] = default_sys
                print("Auto-assigned {} rooms to Hub HVAC: {}".format(
                    len(self.room_list), default_sys))
        
        seen_p = set()
        for r in self.room_list:
            p = r.get('program', '')
            if p and not p.startswith('<') and not p.startswith('*'):
                if p not in seen_p:
                    seen_p.add(p)
                    self.available_programs.append(p)
        # Also load HB library program identifiers (strings only)
        self.hb_lib_programs = []
        try:
            from honeybee_energy.lib.programtypes import PROGRAM_TYPES
            self.hb_lib_programs = sorted(list(PROGRAM_TYPES))
        except:
            pass
        self._setup_form()
        self.Closed += self._on_form_closed
        return self
    
    def _extract_model_data(self):
        for room in self.hb_model.rooms:
            room_name = room.display_name or room.identifier
            room_id = room.identifier
            
            try:
                room_area = round(room.floor_area, 2)
            except:
                room_area = 0
            
            hvac_status = "<default>"
            if room_id in self.room_hvac_assignments:
                system_name = self.room_hvac_assignments[room_id]
                hvac_status = system_name[:15]
            elif hasattr(room.properties, 'energy') and hasattr(room.properties.energy, 'hvac'):
                if room.properties.energy.hvac is not None:
                    hvac_status = str(type(room.properties.energy.hvac).__name__)[:15]
            
            prog_id = '<none>'
            if room_id in self.program_assignments:
                prog_id = '* ' + self.program_assignments[room_id][:15]
            elif hasattr(room.properties, 'energy'):
                p = getattr(room.properties.energy, 'program_type', None)
                if p is not None:
                    prog_id = getattr(p, 'identifier', str(p))[:17]
            self.room_list.append({
                'id': room_id,
                'name': room_name,
                'area': room_area,
                'hvac': hvac_status,
                'program': prog_id
            })
            
            # NEW: Collect all breps for this room for preview
            room_brep_list = []
            
            for face in room.faces:
                face_id = face.identifier
                bc = "Outdoors"
                bc_str = str(face.boundary_condition)
                if 'Ground' in bc_str:
                    bc = "Ground"
                elif 'Surface' in bc_str or 'Adiabatic' in bc_str:
                    bc = "Surface"
                brep = create_brep_from_vertices(face.geometry.boundary)
                # Add to room breps for room preview
                if brep:
                    room_brep_list.append(brep)
                stored_constr = self.modified_faces.get(face_id, {}).get('construction', '<Unchanged>')
                stored_mod = self.modified_faces.get(face_id, {}).get('modifier', '<Unchanged>')
                self.face_list.append({
                    'id': face_id,
                    'room': room_name,
                    'type': str(face.type),
                    'bc': bc,
                    'area': round(face.area, 2),
                    'brep': brep,
                    'construction': stored_constr,
                    'modifier': stored_mod
                })
                for ap in face.apertures:
                    ap_id = ap.identifier
                    ap_brep = create_brep_from_vertices(ap.geometry.boundary)
                    stored_ap_constr = self.modified_apertures.get(ap_id, {}).get('construction', '<Unchanged>')
                    stored_ap_mod = self.modified_apertures.get(ap_id, {}).get('modifier', '<Unchanged>')
                    self.aperture_list.append({
                        'id': ap_id,
                        'room': room_name,
                        'parent': face_id,
                        'bc': bc,
                        'area': round(ap.area, 2),
                        'brep': ap_brep,
                        'construction': stored_ap_constr,
                        'modifier': stored_ap_mod
                    })
                # NEW: Extract doors with stored modifications
                for door in face.doors:
                    door_id = door.identifier
                    door_brep = create_brep_from_vertices(door.geometry.boundary)
                    # Check if door is glass
                    is_glass = False
                    try:
                        is_glass = door.is_glass
                    except:
                        pass
                    stored_door_constr = self.modified_doors.get(door_id, {}).get('construction', '<Unchanged>')
                    stored_door_mod = self.modified_doors.get(door_id, {}).get('modifier', '<Unchanged>')
                    self.door_list.append({
                        'id': door_id,
                        'room': room_name,
                        'parent': face_id,
                        'bc': bc,
                        'area': round(door.area, 2),
                        'brep': door_brep,
                        'is_glass': is_glass,
                        'construction': stored_door_constr,
                        'modifier': stored_door_mod
                    })
            
            # NEW: Store all breps for this room
            if room_brep_list:
                self.room_breps[room_id] = room_brep_list
        
        # Migrate HVAC assignments when room IDs have changed (model rebuilt upstream)
        self._migrate_hvac_assignments()
        
        self.filtered_faces = list(self.face_list)
        self.filtered_apertures = list(self.aperture_list)
        self.filtered_doors = list(self.door_list)
    
    def _migrate_hvac_assignments(self):
        """Migrate HVAC assignments when room identifiers have changed.
        
        Honeybee regenerates room.identifier (with hash suffixes) whenever
        the model is rebuilt upstream. This breaks room_hvac_assignments which
        maps room_id -> system_name. We recover by matching on display_name,
        which is user-controlled and stable across rebuilds.
        """
        if not self.room_hvac_assignments:
            return
        
        current_ids = {r['id'] for r in self.room_list}
        stale_ids = [rid for rid in self.room_hvac_assignments if rid not in current_ids]
        
        if not stale_ids:
            return  # All IDs still valid, no migration needed
        
        # Build name -> new_id map from current model (first match wins)
        name_to_new_id = {}
        for r in self.room_list:
            if r['name'] not in name_to_new_id:
                name_to_new_id[r['name']] = r['id']
        
        migrated = {}
        lost = []
        for old_id in stale_ids:
            system_name = self.room_hvac_assignments[old_id]
            old_name = self.room_hvac_names.get(old_id)
            
            if old_name and old_name in name_to_new_id:
                new_id = name_to_new_id[old_name]
                # Only migrate if the new_id isn't already assigned
                if new_id not in self.room_hvac_assignments and new_id not in migrated:
                    migrated[new_id] = system_name
                else:
                    lost.append(old_id)
            else:
                lost.append(old_id)
        
        # Apply migration: remove stale, add migrated
        for old_id in stale_ids:
            del self.room_hvac_assignments[old_id]
            if old_id in self.room_hvac_names:
                del self.room_hvac_names[old_id]
        
        for new_id, sys_name in migrated.items():
            self.room_hvac_assignments[new_id] = sys_name
            # Update name map with new ID
            for r in self.room_list:
                if r['id'] == new_id:
                    self.room_hvac_names[new_id] = r['name']
                    break
        
        if migrated or lost:
            msg = "HVAC migration: {} remapped".format(len(migrated))
            if lost:
                msg += ", {} lost (room removed/renamed)".format(len(lost))
            print(msg)
    
    def _setup_form(self):
        self.Title = "GDS - GBE Refiner"
        self.Resizable = True
        self.Size = drawing.Size(950, 800)
        self.Padding = drawing.Padding(10)
        
        main_layout = forms.DynamicLayout()
        main_layout.Spacing = drawing.Size(5, 5)
        
        face_geo_count = sum(1 for f in self.face_list if f['brep'])
        ap_geo_count = sum(1 for a in self.aperture_list if a['brep'])
        door_geo_count = sum(1 for d in self.door_list if d['brep'])
        info_text = "Faces: {} ({} geo) | Apertures: {} ({} geo) | Doors: {} ({} geo) | GDS: {} constr, {} mod".format(
            len(self.face_list), face_geo_count, len(self.aperture_list), ap_geo_count,
            len(self.door_list), door_geo_count,
            len(self.gds_parser.constructions), len(self.gds_parser.modifiers))
        main_layout.Add(forms.Label(Text=info_text))
        
        preview_comp = find_preview_component(self.preview_nickname)
        if preview_comp:
            self.preview_status = forms.Label(Text="Preview: Connected to '{}'".format(self.preview_nickname))
        else:
            self.preview_status = forms.Label(Text="Preview: Component '{}' not found".format(self.preview_nickname))
        main_layout.Add(self.preview_status)
        
        self.tabs = forms.TabControl()
        face_tab = forms.TabPage(Text="Opaque Faces ({})".format(len(self.face_list)))
        face_tab.Content = self._create_face_panel()
        self.tabs.Pages.Add(face_tab)
        ap_tab = forms.TabPage(Text="Apertures ({})".format(len(self.aperture_list)))
        ap_tab.Content = self._create_aperture_panel()
        self.tabs.Pages.Add(ap_tab)
        # NEW: Doors tab
        door_tab = forms.TabPage(Text="Doors ({})".format(len(self.door_list)))
        door_tab.Content = self._create_door_panel()
        self.tabs.Pages.Add(door_tab)
        shading_tab = forms.TabPage(Text="Shading")
        shading_tab.Content = self._create_shading_panel()
        self.tabs.Pages.Add(shading_tab)
        hvac_tab = forms.TabPage(Text="HVAC Systems ({})".format(len(self.room_list)))
        hvac_tab.Content = self._create_hvac_panel()
        self.tabs.Pages.Add(hvac_tab)
        try:
            prog_tab = forms.TabPage(Text="Room Service ({})".format(len(self.room_list)))
            prog_tab.Content = self._create_program_panel()
            self.tabs.Pages.Add(prog_tab)
        except Exception as ex:
            import traceback
            print("Program tab error: " + traceback.format_exc())
        main_layout.Add(self.tabs, yscale=True)
        
        self.status_label = forms.Label()
        self._update_status()
        main_layout.Add(self.status_label)
        
        preview_layout = forms.DynamicLayout()
        preview_layout.BeginHorizontal()
        self.chk_preview_selected = forms.CheckBox(Text="Preview Selected")
        self.chk_preview_selected.Checked = True
        self.chk_preview_selected.CheckedChanged += self._on_preview_toggle
        preview_layout.Add(self.chk_preview_selected)
        self.chk_preview_modified = forms.CheckBox(Text="Preview All Modified")
        self.chk_preview_modified.CheckedChanged += self._on_preview_toggle
        preview_layout.Add(self.chk_preview_modified)
        btn_clear_preview = forms.Button(Text="Clear Preview")
        btn_clear_preview.Click += self._on_clear_preview
        preview_layout.Add(btn_clear_preview)
        preview_layout.Add(None, xscale=True)
        preview_layout.EndHorizontal()
        main_layout.Add(preview_layout)
        
        btn_layout = forms.DynamicLayout()
        btn_layout.BeginHorizontal()
        # Left column: Save Settings | Clear All
        btn_save = forms.Button(Text="Save Settings")
        btn_save.Click += self._on_save
        btn_layout.Add(btn_save)
        btn_clear = forms.Button(Text="Clear All")
        btn_clear.Click += self._on_clear
        btn_layout.Add(btn_clear)
        btn_layout.Add(None, xscale=True)
        # Center column: Save & Run (green)
        btn_save_run = forms.Button(Text="Save && Run")
        btn_save_run.BackgroundColor = drawing.Color.FromArgb(200, 255, 200)
        btn_save_run.Click += self._on_save_and_run
        btn_layout.Add(btn_save_run)
        btn_layout.Add(None, xscale=True)
        # Right column: Save & Close | Cancel
        btn_save_close = forms.Button(Text="Save && Close")
        btn_save_close.Click += self._on_apply
        btn_layout.Add(btn_save_close)
        btn_cancel = forms.Button(Text="Cancel")
        btn_cancel.Click += self._on_cancel
        btn_layout.Add(btn_cancel)
        btn_layout.EndHorizontal()
        main_layout.Add(btn_layout)
        
        self.Content = main_layout
    
    def _update_status(self):
        mod_face_count = len([f for f in self.face_list if f['id'] in self.modified_faces])
        mod_ap_count = len([a for a in self.aperture_list if a['id'] in self.modified_apertures])
        mod_door_count = len([d for d in self.door_list if d['id'] in self.modified_doors])
        pc = len(self.program_assignments)
        self.status_label.Text = "Modified: {} faces, {} aps, {} doors | Programs: {}".format(
            mod_face_count, mod_ap_count, mod_door_count, pc)
    
    def _update_preview(self):
        """Update preview - includes faces, apertures, doors, rooms, and shading selections"""
        breps = []
        if self.chk_preview_selected.Checked:
            # Faces
            selected_indices = list(self.face_grid.SelectedRows)
            for idx in selected_indices:
                if idx < len(self.filtered_faces):
                    brep = self.filtered_faces[idx].get('brep')
                    if brep:
                        breps.append(brep)
            # Apertures
            selected_ap_indices = list(self.ap_grid.SelectedRows)
            for idx in selected_ap_indices:
                if idx < len(self.filtered_apertures):
                    brep = self.filtered_apertures[idx].get('brep')
                    if brep:
                        breps.append(brep)
            # Doors
            selected_door_indices = list(self.door_grid.SelectedRows)
            for idx in selected_door_indices:
                if idx < len(self.filtered_doors):
                    brep = self.filtered_doors[idx].get('brep')
                    if brep:
                        breps.append(brep)
            # Rooms (from HVAC tab)
            try:
                selected_room_indices = list(self.hvac_room_grid.SelectedRows)
                for idx in selected_room_indices:
                    if idx < len(self.filtered_hvac_rooms):
                        room_id = self.filtered_hvac_rooms[idx]['id']
                        room_brep_list = self.room_breps.get(room_id, [])
                        for brep in room_brep_list:
                            if brep and brep not in breps:
                                breps.append(brep)
            except:
                pass  # HVAC grid might not exist yet during initialization
            
            # Shading tab selections (walls, apertures, doors)
            try:
                # Shading walls
                selected_shade_wall_indices = list(self.shade_wall_grid.SelectedRows)
                for idx in selected_shade_wall_indices:
                    if idx < len(self.filtered_shade_walls):
                        brep = self.filtered_shade_walls[idx].get('brep')
                        if brep and brep not in breps:
                            breps.append(brep)
                # Shading apertures
                selected_shade_ap_indices = list(self.shade_ap_grid.SelectedRows)
                for idx in selected_shade_ap_indices:
                    if idx < len(self.filtered_shade_apertures):
                        brep = self.filtered_shade_apertures[idx].get('brep')
                        if brep and brep not in breps:
                            breps.append(brep)
                # Shading doors
                selected_shade_door_indices = list(self.shade_door_grid.SelectedRows)
                for idx in selected_shade_door_indices:
                    if idx < len(self.filtered_shade_doors):
                        brep = self.filtered_shade_doors[idx].get('brep')
                        if brep and brep not in breps:
                            breps.append(brep)
            except:
                pass  # Shading grids might not exist yet during initialization
        
        if self.chk_preview_modified.Checked:
            for f in self.face_list:
                if f['id'] in self.modified_faces and f.get('brep'):
                    if f['brep'] not in breps:
                        breps.append(f['brep'])
            for a in self.aperture_list:
                if a['id'] in self.modified_apertures and a.get('brep'):
                    if a['brep'] not in breps:
                        breps.append(a['brep'])
            # Modified doors
            for d in self.door_list:
                if d['id'] in self.modified_doors and d.get('brep'):
                    if d['brep'] not in breps:
                        breps.append(d['brep'])
            # Rooms with HVAC assignments
            for room_id in self.room_hvac_assignments.keys():
                room_brep_list = self.room_breps.get(room_id, [])
                for brep in room_brep_list:
                    if brep and brep not in breps:
                        breps.append(brep)
            
            # Surfaces with shading configured
            for surface_id in self.shading_config.keys():
                # Check faces
                for f in self.face_list:
                    if f['id'] == surface_id and f.get('brep'):
                        if f['brep'] not in breps:
                            breps.append(f['brep'])
                # Check apertures
                for a in self.aperture_list:
                    if a['id'] == surface_id and a.get('brep'):
                        if a['brep'] not in breps:
                            breps.append(a['brep'])
                # Check doors
                for d in self.door_list:
                    if d['id'] == surface_id and d.get('brep'):
                        if d['brep'] not in breps:
                            breps.append(d['brep'])
        
        update_preview_component(self.preview_nickname, breps)
    
    def _on_preview_toggle(self, sender, e):
        self._update_preview()
    
    def _on_clear_preview(self, sender, e):
        clear_preview_component(self.preview_nickname)
    
    def _create_face_panel(self):
        layout = forms.DynamicLayout()
        layout.Spacing = drawing.Size(5, 5)
        layout.Padding = drawing.Padding(5)
        
        filter_layout = forms.DynamicLayout()
        filter_layout.BeginHorizontal()
        filter_layout.Add(forms.Label(Text="Room:"))
        self.room_filter = forms.DropDown()
        rooms = ["<All>"] + sorted(set(f['room'] for f in self.face_list))
        for r in rooms:
            self.room_filter.Items.Add(r)
        self.room_filter.SelectedIndex = 0
        filter_layout.Add(self.room_filter)
        filter_layout.Add(forms.Label(Text="  Type:"))
        self.type_filter = forms.DropDown()
        for t in ["<All>", "Wall", "Floor", "RoofCeiling"]:
            self.type_filter.Items.Add(t)
        self.type_filter.SelectedIndex = 0
        filter_layout.Add(self.type_filter)
        filter_layout.Add(forms.Label(Text="  BC:"))
        self.bc_filter = forms.DropDown()
        for bc in ["<All>", "Outdoors", "Ground", "Surface"]:
            self.bc_filter.Items.Add(bc)
        self.bc_filter.SelectedIndex = 0
        filter_layout.Add(self.bc_filter)
        btn_filter = forms.Button(Text="Filter")
        btn_filter.Click += self._on_filter_faces
        filter_layout.Add(btn_filter)
        filter_layout.Add(None, xscale=True)
        filter_layout.EndHorizontal()
        layout.Add(filter_layout)
        
        self.face_grid = forms.GridView()
        self.face_grid.Height = 200
        self.face_grid.AllowMultipleSelection = True
        
        # Column: Modified marker
        col_mod = forms.GridColumn()
        col_mod.HeaderText = "M"
        col_mod.DataCell = forms.TextBoxCell(0)
        col_mod.Width = 25
        self.face_grid.Columns.Add(col_mod)
        
        # Column: Geometry marker
        col_geo = forms.GridColumn()
        col_geo.HeaderText = "G"
        col_geo.DataCell = forms.TextBoxCell(1)
        col_geo.Width = 25
        self.face_grid.Columns.Add(col_geo)
        
        # Column: Type
        col_type = forms.GridColumn()
        col_type.HeaderText = "Type"
        col_type.DataCell = forms.TextBoxCell(2)
        col_type.Width = 80
        self.face_grid.Columns.Add(col_type)
        
        # Column: Room
        col_room = forms.GridColumn()
        col_room.HeaderText = "Room"
        col_room.DataCell = forms.TextBoxCell(3)
        col_room.Width = 150
        self.face_grid.Columns.Add(col_room)
        
        # Column: BC
        col_bc = forms.GridColumn()
        col_bc.HeaderText = "BC"
        col_bc.DataCell = forms.TextBoxCell(4)
        col_bc.Width = 60
        self.face_grid.Columns.Add(col_bc)
        
        # Column: Area
        col_area = forms.GridColumn()
        col_area.HeaderText = "Area"
        col_area.DataCell = forms.TextBoxCell(5)
        col_area.Width = 60
        self.face_grid.Columns.Add(col_area)
        
        # Column: Construction
        col_constr = forms.GridColumn()
        col_constr.HeaderText = "Construction"
        col_constr.DataCell = forms.TextBoxCell(6)
        col_constr.Width = 150
        self.face_grid.Columns.Add(col_constr)
        
        self._refresh_face_grid()
        self.face_grid.SelectionChanged += self._on_face_selection_changed
        layout.Add(self.face_grid, yscale=True)
        
        assign_group = forms.GroupBox(Text="Assign Properties")
        assign_layout = forms.DynamicLayout()
        assign_layout.Spacing = drawing.Size(5, 5)
        assign_layout.Padding = drawing.Padding(5)
        self.face_selection_info = forms.Label(Text="No selection")
        assign_layout.Add(self.face_selection_info)
        assign_layout.BeginHorizontal()
        assign_layout.Add(forms.Label(Text="Construction:"))
        self.face_constr_dropdown = forms.DropDown()
        self.face_constr_dropdown.Items.Add("<Unchanged>")
        self.face_constr_dropdown.SelectedIndex = 0
        assign_layout.Add(self.face_constr_dropdown, xscale=True)
        assign_layout.EndHorizontal()
        assign_layout.BeginHorizontal()
        assign_layout.Add(forms.Label(Text="Modifier:"))
        self.face_mod_dropdown = forms.DropDown()
        self.face_mod_dropdown.Items.Add("<Unchanged>")
        self.face_mod_dropdown.SelectedIndex = 0
        assign_layout.Add(self.face_mod_dropdown, xscale=True)
        assign_layout.EndHorizontal()
        btn_row = forms.DynamicLayout()
        btn_row.BeginHorizontal()
        btn_set_selected = forms.Button(Text="Set for Selected")
        btn_set_selected.Click += self._on_set_selected_faces
        btn_row.Add(btn_set_selected)
        self.btn_set_all_faces = forms.Button(Text="Set for All Filtered ({})".format(len(self.filtered_faces)))
        self.btn_set_all_faces.Click += self._on_set_all_faces
        btn_row.Add(self.btn_set_all_faces)
        btn_row.Add(None, xscale=True)
        btn_row.EndHorizontal()
        assign_layout.Add(btn_row)
        assign_group.Content = assign_layout
        layout.Add(assign_group)
        return layout
    
    def _create_aperture_panel(self):
        layout = forms.DynamicLayout()
        layout.Spacing = drawing.Size(5, 5)
        layout.Padding = drawing.Padding(5)
        
        filter_layout = forms.DynamicLayout()
        filter_layout.BeginHorizontal()
        filter_layout.Add(forms.Label(Text="Room:"))
        self.ap_room_filter = forms.DropDown()
        rooms = ["<All>"] + sorted(set(a['room'] for a in self.aperture_list))
        for r in rooms:
            self.ap_room_filter.Items.Add(r)
        self.ap_room_filter.SelectedIndex = 0
        filter_layout.Add(self.ap_room_filter)
        filter_layout.Add(forms.Label(Text="  BC:"))
        self.ap_bc_filter = forms.DropDown()
        for bc in ["<All>", "Outdoors", "Surface"]:
            self.ap_bc_filter.Items.Add(bc)
        self.ap_bc_filter.SelectedIndex = 0
        filter_layout.Add(self.ap_bc_filter)
        btn_filter = forms.Button(Text="Filter")
        btn_filter.Click += self._on_filter_apertures
        filter_layout.Add(btn_filter)
        filter_layout.Add(None, xscale=True)
        filter_layout.EndHorizontal()
        layout.Add(filter_layout)
        
        self.ap_grid = forms.GridView()
        self.ap_grid.Height = 200
        self.ap_grid.AllowMultipleSelection = True
        
        # Column: Modified marker
        col_mod = forms.GridColumn()
        col_mod.HeaderText = "M"
        col_mod.DataCell = forms.TextBoxCell(0)
        col_mod.Width = 25
        self.ap_grid.Columns.Add(col_mod)
        
        # Column: Geometry marker
        col_geo = forms.GridColumn()
        col_geo.HeaderText = "G"
        col_geo.DataCell = forms.TextBoxCell(1)
        col_geo.Width = 25
        self.ap_grid.Columns.Add(col_geo)
        
        # Column: Room
        col_room = forms.GridColumn()
        col_room.HeaderText = "Room"
        col_room.DataCell = forms.TextBoxCell(2)
        col_room.Width = 150
        self.ap_grid.Columns.Add(col_room)
        
        # Column: Parent Face
        col_parent = forms.GridColumn()
        col_parent.HeaderText = "Parent"
        col_parent.DataCell = forms.TextBoxCell(3)
        col_parent.Width = 100
        self.ap_grid.Columns.Add(col_parent)
        
        # Column: BC
        col_bc = forms.GridColumn()
        col_bc.HeaderText = "BC"
        col_bc.DataCell = forms.TextBoxCell(4)
        col_bc.Width = 60
        self.ap_grid.Columns.Add(col_bc)
        
        # Column: Area
        col_area = forms.GridColumn()
        col_area.HeaderText = "Area"
        col_area.DataCell = forms.TextBoxCell(5)
        col_area.Width = 60
        self.ap_grid.Columns.Add(col_area)
        
        # Column: Construction
        col_constr = forms.GridColumn()
        col_constr.HeaderText = "Construction"
        col_constr.DataCell = forms.TextBoxCell(6)
        col_constr.Width = 150
        self.ap_grid.Columns.Add(col_constr)
        
        self._refresh_ap_grid()
        self.ap_grid.SelectionChanged += self._on_ap_selection_changed
        layout.Add(self.ap_grid, yscale=True)
        
        assign_group = forms.GroupBox(Text="Assign Properties")
        assign_layout = forms.DynamicLayout()
        assign_layout.Spacing = drawing.Size(5, 5)
        assign_layout.Padding = drawing.Padding(5)
        self.ap_selection_info = forms.Label(Text="No selection")
        assign_layout.Add(self.ap_selection_info)
        assign_layout.BeginHorizontal()
        assign_layout.Add(forms.Label(Text="Construction:"))
        self.ap_constr_dropdown = forms.DropDown()
        self.ap_constr_dropdown.Items.Add("<Unchanged>")
        self.ap_constr_dropdown.SelectedIndex = 0
        assign_layout.Add(self.ap_constr_dropdown, xscale=True)
        assign_layout.EndHorizontal()
        assign_layout.BeginHorizontal()
        assign_layout.Add(forms.Label(Text="Modifier:"))
        self.ap_mod_dropdown = forms.DropDown()
        self.ap_mod_dropdown.Items.Add("<Unchanged>")
        self.ap_mod_dropdown.SelectedIndex = 0
        assign_layout.Add(self.ap_mod_dropdown, xscale=True)
        assign_layout.EndHorizontal()
        btn_row = forms.DynamicLayout()
        btn_row.BeginHorizontal()
        btn_set_selected = forms.Button(Text="Set for Selected")
        btn_set_selected.Click += self._on_set_selected_apertures
        btn_row.Add(btn_set_selected)
        self.btn_set_all_ap = forms.Button(Text="Set for All Filtered ({})".format(len(self.filtered_apertures)))
        self.btn_set_all_ap.Click += self._on_set_all_apertures
        btn_row.Add(self.btn_set_all_ap)
        btn_row.Add(None, xscale=True)
        btn_row.EndHorizontal()
        assign_layout.Add(btn_row)
        assign_group.Content = assign_layout
        layout.Add(assign_group)
        return layout
    
    def _create_door_panel(self):
        """NEW: Create the Doors tab panel for door selection and modification"""
        layout = forms.DynamicLayout()
        layout.Spacing = drawing.Size(5, 5)
        layout.Padding = drawing.Padding(5)
        
        # Info about doors
        glass_doors = len([d for d in self.door_list if d.get('is_glass', False)])
        opaque_doors = len(self.door_list) - glass_doors
        layout.Add(forms.Label(Text="Total: {} doors ({} opaque, {} glass)".format(
            len(self.door_list), opaque_doors, glass_doors)))
        
        # Filter controls
        filter_layout = forms.DynamicLayout()
        filter_layout.BeginHorizontal()
        filter_layout.Add(forms.Label(Text="Room:"))
        self.door_room_filter = forms.DropDown()
        rooms = ["<All>"] + sorted(set(d['room'] for d in self.door_list))
        for r in rooms:
            self.door_room_filter.Items.Add(r)
        self.door_room_filter.SelectedIndex = 0
        filter_layout.Add(self.door_room_filter)
        filter_layout.Add(forms.Label(Text="  BC:"))
        self.door_bc_filter = forms.DropDown()
        for bc in ["<All>", "Outdoors", "Surface"]:
            self.door_bc_filter.Items.Add(bc)
        self.door_bc_filter.SelectedIndex = 0
        filter_layout.Add(self.door_bc_filter)
        filter_layout.Add(forms.Label(Text="  Type:"))
        self.door_type_filter = forms.DropDown()
        for dt in ["<All>", "Opaque", "Glass"]:
            self.door_type_filter.Items.Add(dt)
        self.door_type_filter.SelectedIndex = 0
        filter_layout.Add(self.door_type_filter)
        btn_filter = forms.Button(Text="Filter")
        btn_filter.Click += self._on_filter_doors
        filter_layout.Add(btn_filter)
        filter_layout.Add(None, xscale=True)
        filter_layout.EndHorizontal()
        layout.Add(filter_layout)
        
        # Door grid
        self.door_grid = forms.GridView()
        self.door_grid.Height = 200
        self.door_grid.AllowMultipleSelection = True
        
        # Column: Modified marker
        col_mod = forms.GridColumn()
        col_mod.HeaderText = "M"
        col_mod.DataCell = forms.TextBoxCell(0)
        col_mod.Width = 25
        self.door_grid.Columns.Add(col_mod)
        
        # Column: Geometry marker
        col_geo = forms.GridColumn()
        col_geo.HeaderText = "G"
        col_geo.DataCell = forms.TextBoxCell(1)
        col_geo.Width = 25
        self.door_grid.Columns.Add(col_geo)
        
        # Column: Type (Opaque/Glass)
        col_type = forms.GridColumn()
        col_type.HeaderText = "Type"
        col_type.DataCell = forms.TextBoxCell(2)
        col_type.Width = 55
        self.door_grid.Columns.Add(col_type)
        
        # Column: Room
        col_room = forms.GridColumn()
        col_room.HeaderText = "Room"
        col_room.DataCell = forms.TextBoxCell(3)
        col_room.Width = 150
        self.door_grid.Columns.Add(col_room)
        
        # Column: BC
        col_bc = forms.GridColumn()
        col_bc.HeaderText = "BC"
        col_bc.DataCell = forms.TextBoxCell(4)
        col_bc.Width = 60
        self.door_grid.Columns.Add(col_bc)
        
        # Column: Area
        col_area = forms.GridColumn()
        col_area.HeaderText = "Area"
        col_area.DataCell = forms.TextBoxCell(5)
        col_area.Width = 60
        self.door_grid.Columns.Add(col_area)
        
        # Column: Construction
        col_constr = forms.GridColumn()
        col_constr.HeaderText = "Construction"
        col_constr.DataCell = forms.TextBoxCell(6)
        col_constr.Width = 150
        self.door_grid.Columns.Add(col_constr)
        
        self._refresh_door_grid()
        self.door_grid.SelectionChanged += self._on_door_selection_changed
        layout.Add(self.door_grid, yscale=True)
        
        # Assign properties group
        assign_group = forms.GroupBox(Text="Assign Properties")
        assign_layout = forms.DynamicLayout()
        assign_layout.Spacing = drawing.Size(5, 5)
        assign_layout.Padding = drawing.Padding(5)
        self.door_selection_info = forms.Label(Text="No selection")
        assign_layout.Add(self.door_selection_info)
        
        # Construction dropdown
        assign_layout.BeginHorizontal()
        assign_layout.Add(forms.Label(Text="Construction:"))
        self.door_constr_dropdown = forms.DropDown()
        self.door_constr_dropdown.Items.Add("<Unchanged>")
        self.door_constr_dropdown.SelectedIndex = 0
        assign_layout.Add(self.door_constr_dropdown, xscale=True)
        assign_layout.EndHorizontal()
        
        # Modifier dropdown
        assign_layout.BeginHorizontal()
        assign_layout.Add(forms.Label(Text="Modifier:"))
        self.door_mod_dropdown = forms.DropDown()
        self.door_mod_dropdown.Items.Add("<Unchanged>")
        self.door_mod_dropdown.SelectedIndex = 0
        assign_layout.Add(self.door_mod_dropdown, xscale=True)
        assign_layout.EndHorizontal()
        
        # Action buttons
        btn_row = forms.DynamicLayout()
        btn_row.BeginHorizontal()
        btn_set_selected = forms.Button(Text="Set for Selected")
        btn_set_selected.Click += self._on_set_selected_doors
        btn_row.Add(btn_set_selected)
        self.btn_set_all_doors = forms.Button(Text="Set for All Filtered ({})".format(len(self.filtered_doors)))
        self.btn_set_all_doors.Click += self._on_set_all_doors
        btn_row.Add(self.btn_set_all_doors)
        btn_row.Add(None, xscale=True)
        btn_row.EndHorizontal()
        assign_layout.Add(btn_row)
        
        assign_group.Content = assign_layout
        layout.Add(assign_group)
        
        return layout
    
    def _create_shading_panel(self):
        """Create the Shading tab panel with scrolling support"""
        # Inner layout for all shading content
        inner_layout = forms.DynamicLayout()
        inner_layout.Spacing = drawing.Size(5, 5)
        inner_layout.Padding = drawing.Padding(5)
        
        # Count exterior elements
        ext_walls = [f for f in self.face_list if f['bc'] == 'Outdoors' and 'Wall' in f['type']]
        ext_apertures = [a for a in self.aperture_list if a['bc'] == 'Outdoors']
        ext_doors = [d for d in self.door_list if d['bc'] == 'Outdoors']
        
        info_text = "Exterior: {} walls, {} apertures, {} doors".format(
            len(ext_walls), len(ext_apertures), len(ext_doors))
        inner_layout.Add(forms.Label(Text=info_text))
        
        # --- Wall Shading Section ---
        wall_group = forms.GroupBox(Text="Wall Shading ({} exterior walls)".format(len(ext_walls)))
        wall_layout = forms.DynamicLayout()
        wall_layout.Spacing = drawing.Size(5, 5)
        wall_layout.Padding = drawing.Padding(5)
        
        wall_filter_layout = forms.DynamicLayout()
        wall_filter_layout.BeginHorizontal()
        wall_filter_layout.Add(forms.Label(Text="Room:"))
        self.shade_wall_room_filter = forms.DropDown()
        rooms = ["<All>"] + sorted(set(f['room'] for f in ext_walls))
        for r in rooms:
            self.shade_wall_room_filter.Items.Add(r)
        self.shade_wall_room_filter.SelectedIndex = 0
        wall_filter_layout.Add(self.shade_wall_room_filter)
        btn_filter_walls = forms.Button(Text="Filter")
        btn_filter_walls.Click += self._on_filter_shade_walls
        wall_filter_layout.Add(btn_filter_walls)
        wall_filter_layout.Add(None, xscale=True)
        wall_filter_layout.EndHorizontal()
        wall_layout.Add(wall_filter_layout)
        
        self.shade_wall_grid = forms.GridView()
        self.shade_wall_grid.Height = 100
        self.shade_wall_grid.AllowMultipleSelection = True
        
        # Column: Shaded marker
        col_shaded = forms.GridColumn()
        col_shaded.HeaderText = "S"
        col_shaded.DataCell = forms.TextBoxCell(0)
        col_shaded.Width = 25
        self.shade_wall_grid.Columns.Add(col_shaded)
        
        # Column: Type
        col_type = forms.GridColumn()
        col_type.HeaderText = "Type"
        col_type.DataCell = forms.TextBoxCell(1)
        col_type.Width = 60
        self.shade_wall_grid.Columns.Add(col_type)
        
        # Column: Room
        col_room = forms.GridColumn()
        col_room.HeaderText = "Room"
        col_room.DataCell = forms.TextBoxCell(2)
        col_room.Width = 150
        self.shade_wall_grid.Columns.Add(col_room)
        
        # Column: Area
        col_area = forms.GridColumn()
        col_area.HeaderText = "Area"
        col_area.DataCell = forms.TextBoxCell(3)
        col_area.Width = 60
        self.shade_wall_grid.Columns.Add(col_area)
        
        self.filtered_shade_walls = list(ext_walls)
        self.shade_wall_grid.SelectionChanged += self._on_shade_selection_changed  # Preview support
        self._refresh_shade_wall_grid()
        wall_layout.Add(self.shade_wall_grid)
        
        wall_param_layout = forms.DynamicLayout()
        wall_param_layout.BeginHorizontal()
        self.chk_wall_overhang = forms.CheckBox(Text="Overhang")
        wall_param_layout.Add(self.chk_wall_overhang)
        wall_param_layout.Add(forms.Label(Text="Depth:"))
        self.num_wall_oh_depth = forms.NumericUpDown()
        self.num_wall_oh_depth.MinValue = 0.1
        self.num_wall_oh_depth.MaxValue = 5.0
        self.num_wall_oh_depth.DecimalPlaces = 2
        self.num_wall_oh_depth.Value = 0.5
        self.num_wall_oh_depth.Width = 60
        wall_param_layout.Add(self.num_wall_oh_depth)
        wall_param_layout.Add(forms.Label(Text="Angle:"))
        self.num_wall_oh_angle = forms.NumericUpDown()
        self.num_wall_oh_angle.MinValue = 0
        self.num_wall_oh_angle.MaxValue = 90
        self.num_wall_oh_angle.Value = 0
        self.num_wall_oh_angle.Width = 50
        wall_param_layout.Add(self.num_wall_oh_angle)
        wall_param_layout.EndHorizontal()
        wall_layout.Add(wall_param_layout)
        
        btn_apply_wall = forms.Button(Text="Set for Selected Walls")
        btn_apply_wall.Click += self._on_apply_wall_shading
        wall_layout.Add(btn_apply_wall)
        
        wall_group.Content = wall_layout
        inner_layout.Add(wall_group)
        
        # --- Aperture Shading Section ---
        ap_group = forms.GroupBox(Text="Aperture Shading ({} exterior)".format(len(ext_apertures)))
        ap_layout = forms.DynamicLayout()
        ap_layout.Spacing = drawing.Size(5, 5)
        ap_layout.Padding = drawing.Padding(5)
        
        ap_filter_layout = forms.DynamicLayout()
        ap_filter_layout.BeginHorizontal()
        ap_filter_layout.Add(forms.Label(Text="Room:"))
        self.shade_ap_room_filter = forms.DropDown()
        ap_rooms = ["<All>"] + sorted(set(a['room'] for a in ext_apertures))
        for r in ap_rooms:
            self.shade_ap_room_filter.Items.Add(r)
        self.shade_ap_room_filter.SelectedIndex = 0
        ap_filter_layout.Add(self.shade_ap_room_filter)
        btn_filter_ap = forms.Button(Text="Filter")
        btn_filter_ap.Click += self._on_filter_shade_apertures
        ap_filter_layout.Add(btn_filter_ap)
        ap_filter_layout.Add(None, xscale=True)
        ap_filter_layout.EndHorizontal()
        ap_layout.Add(ap_filter_layout)
        
        self.shade_ap_grid = forms.GridView()
        self.shade_ap_grid.Height = 100
        self.shade_ap_grid.AllowMultipleSelection = True
        
        # Column: Shaded marker
        col_shaded = forms.GridColumn()
        col_shaded.HeaderText = "S"
        col_shaded.DataCell = forms.TextBoxCell(0)
        col_shaded.Width = 25
        self.shade_ap_grid.Columns.Add(col_shaded)
        
        # Column: Room
        col_room = forms.GridColumn()
        col_room.HeaderText = "Room"
        col_room.DataCell = forms.TextBoxCell(1)
        col_room.Width = 150
        self.shade_ap_grid.Columns.Add(col_room)
        
        # Column: Parent
        col_parent = forms.GridColumn()
        col_parent.HeaderText = "Parent Face"
        col_parent.DataCell = forms.TextBoxCell(2)
        col_parent.Width = 100
        self.shade_ap_grid.Columns.Add(col_parent)
        
        # Column: Area
        col_area = forms.GridColumn()
        col_area.HeaderText = "Area"
        col_area.DataCell = forms.TextBoxCell(3)
        col_area.Width = 60
        self.shade_ap_grid.Columns.Add(col_area)
        
        self.filtered_shade_apertures = list(ext_apertures)
        self.shade_ap_grid.SelectionChanged += self._on_shade_selection_changed  # Preview support
        self._refresh_shade_ap_grid()
        ap_layout.Add(self.shade_ap_grid)
        
        ap_opt_layout = forms.DynamicLayout()
        ap_opt_layout.BeginHorizontal()
        self.chk_ap_overhang = forms.CheckBox(Text="Overhang")
        ap_opt_layout.Add(self.chk_ap_overhang)
        ap_opt_layout.Add(forms.Label(Text="Dp:"))
        self.num_ap_oh_depth = forms.NumericUpDown()
        self.num_ap_oh_depth.MinValue = 0.1
        self.num_ap_oh_depth.MaxValue = 5.0
        self.num_ap_oh_depth.DecimalPlaces = 2
        self.num_ap_oh_depth.Value = 0.5
        self.num_ap_oh_depth.Width = 50
        ap_opt_layout.Add(self.num_ap_oh_depth)
        ap_opt_layout.Add(forms.Label(Text="Ang:"))
        self.num_ap_oh_angle = forms.NumericUpDown()
        self.num_ap_oh_angle.MinValue = 0
        self.num_ap_oh_angle.MaxValue = 90
        self.num_ap_oh_angle.Value = 0
        self.num_ap_oh_angle.Width = 40
        ap_opt_layout.Add(self.num_ap_oh_angle)
        ap_opt_layout.EndHorizontal()
        ap_layout.Add(ap_opt_layout)
        
        ap_opt2_layout = forms.DynamicLayout()
        ap_opt2_layout.BeginHorizontal()
        self.chk_ap_fins = forms.CheckBox(Text="Fins")
        ap_opt2_layout.Add(self.chk_ap_fins)
        ap_opt2_layout.Add(forms.Label(Text="Dp:"))
        self.num_ap_fin_depth = forms.NumericUpDown()
        self.num_ap_fin_depth.MinValue = 0.1
        self.num_ap_fin_depth.MaxValue = 3.0
        self.num_ap_fin_depth.DecimalPlaces = 2
        self.num_ap_fin_depth.Value = 0.3
        self.num_ap_fin_depth.Width = 50
        ap_opt2_layout.Add(self.num_ap_fin_depth)
        ap_opt2_layout.Add(forms.Label(Text="Ang:"))
        self.num_ap_fin_angle = forms.NumericUpDown()
        self.num_ap_fin_angle.MinValue = 0
        self.num_ap_fin_angle.MaxValue = 90
        self.num_ap_fin_angle.Value = 0
        self.num_ap_fin_angle.Width = 40
        ap_opt2_layout.Add(self.num_ap_fin_angle)
        ap_opt2_layout.EndHorizontal()
        ap_layout.Add(ap_opt2_layout)
        
        ap_opt3_layout = forms.DynamicLayout()
        ap_opt3_layout.BeginHorizontal()
        self.chk_ap_louvers = forms.CheckBox(Text="Louvers")
        ap_opt3_layout.Add(self.chk_ap_louvers)
        ap_opt3_layout.Add(forms.Label(Text="Cnt:"))
        self.num_ap_louver_count = forms.NumericUpDown()
        self.num_ap_louver_count.MinValue = 1
        self.num_ap_louver_count.MaxValue = 20
        self.num_ap_louver_count.Value = 5
        self.num_ap_louver_count.Width = 40
        ap_opt3_layout.Add(self.num_ap_louver_count)
        ap_opt3_layout.Add(forms.Label(Text="Dp:"))
        self.num_ap_louver_depth = forms.NumericUpDown()
        self.num_ap_louver_depth.MinValue = 0.05
        self.num_ap_louver_depth.MaxValue = 1.0
        self.num_ap_louver_depth.DecimalPlaces = 2
        self.num_ap_louver_depth.Value = 0.1
        self.num_ap_louver_depth.Width = 45
        ap_opt3_layout.Add(self.num_ap_louver_depth)
        ap_opt3_layout.Add(forms.Label(Text="Off:"))
        self.num_ap_louver_offset = forms.NumericUpDown()
        self.num_ap_louver_offset.MinValue = 0.0
        self.num_ap_louver_offset.MaxValue = 1.0
        self.num_ap_louver_offset.DecimalPlaces = 2
        self.num_ap_louver_offset.Value = 0.05
        self.num_ap_louver_offset.Width = 45
        ap_opt3_layout.Add(self.num_ap_louver_offset)
        ap_opt3_layout.Add(forms.Label(Text="Ang:"))
        self.num_ap_louver_angle = forms.NumericUpDown()
        self.num_ap_louver_angle.MinValue = 0
        self.num_ap_louver_angle.MaxValue = 89
        self.num_ap_louver_angle.Value = 45
        self.num_ap_louver_angle.Width = 40
        ap_opt3_layout.Add(self.num_ap_louver_angle)
        ap_opt3_layout.EndHorizontal()
        ap_layout.Add(ap_opt3_layout)
        
        btn_apply_ap = forms.Button(Text="Set for Selected Apertures")
        btn_apply_ap.Click += self._on_apply_aperture_shading
        ap_layout.Add(btn_apply_ap)
        
        ap_group.Content = ap_layout
        inner_layout.Add(ap_group)
        
        # --- Door Shading Section ---
        door_group = forms.GroupBox(Text="Door Shading ({} exterior)".format(len(ext_doors)))
        door_layout = forms.DynamicLayout()
        door_layout.Spacing = drawing.Size(5, 5)
        door_layout.Padding = drawing.Padding(5)
        
        self.shade_door_grid = forms.GridView()
        self.shade_door_grid.Height = 80
        self.shade_door_grid.AllowMultipleSelection = True
        
        # Column: Shaded marker
        col_shaded = forms.GridColumn()
        col_shaded.HeaderText = "S"
        col_shaded.DataCell = forms.TextBoxCell(0)
        col_shaded.Width = 25
        self.shade_door_grid.Columns.Add(col_shaded)
        
        # Column: Type
        col_type = forms.GridColumn()
        col_type.HeaderText = "Type"
        col_type.DataCell = forms.TextBoxCell(1)
        col_type.Width = 55
        self.shade_door_grid.Columns.Add(col_type)
        
        # Column: Room
        col_room = forms.GridColumn()
        col_room.HeaderText = "Room"
        col_room.DataCell = forms.TextBoxCell(2)
        col_room.Width = 150
        self.shade_door_grid.Columns.Add(col_room)
        
        # Column: Area
        col_area = forms.GridColumn()
        col_area.HeaderText = "Area"
        col_area.DataCell = forms.TextBoxCell(3)
        col_area.Width = 60
        self.shade_door_grid.Columns.Add(col_area)
        
        self.filtered_shade_doors = list(ext_doors)
        self.shade_door_grid.SelectionChanged += self._on_shade_selection_changed  # Preview support
        self._refresh_shade_door_grid()
        door_layout.Add(self.shade_door_grid)
        
        door_param_layout = forms.DynamicLayout()
        door_param_layout.BeginHorizontal()
        self.chk_door_canopy = forms.CheckBox(Text="Canopy")
        self.chk_door_canopy.Checked = True
        door_param_layout.Add(self.chk_door_canopy)
        door_param_layout.Add(forms.Label(Text="Depth:"))
        self.num_door_canopy_depth = forms.NumericUpDown()
        self.num_door_canopy_depth.MinValue = 0.3
        self.num_door_canopy_depth.MaxValue = 5.0
        self.num_door_canopy_depth.DecimalPlaces = 2
        self.num_door_canopy_depth.Value = 1.0
        self.num_door_canopy_depth.Width = 60
        door_param_layout.Add(self.num_door_canopy_depth)
        door_param_layout.EndHorizontal()
        door_layout.Add(door_param_layout)
        
        btn_apply_door = forms.Button(Text="Set for Selected Doors")
        btn_apply_door.Click += self._on_apply_door_shading
        door_layout.Add(btn_apply_door)
        
        door_group.Content = door_layout
        inner_layout.Add(door_group)
        
        self.shade_status = forms.Label(Text="")
        inner_layout.Add(self.shade_status)
        
        # Wrap in scrollable container
        scrollable = forms.Scrollable()
        scrollable.Content = inner_layout
        scrollable.ExpandContentWidth = True
        scrollable.ExpandContentHeight = False
        
        return scrollable
    
    def _create_hvac_panel(self):
        """Create the HVAC Systems panel with system grouping support"""
        layout = forms.DynamicLayout()
        layout.Spacing = drawing.Size(8, 8)
        layout.Padding = drawing.Padding(5)
        
        # Info section
        info_group = forms.GroupBox(Text="HVAC System Grouping")
        info_layout = forms.DynamicLayout()
        info_layout.Padding = drawing.Padding(8)
        info_layout.AddRow(forms.Label(Text="Central systems (VAV, DOAS, VRF) should be shared by multiple rooms."))
        info_layout.AddRow(forms.Label(Text="Zone-level systems (PSZ, Baseboard) can be per-room or shared."))
        info_group.Content = info_layout
        layout.Add(info_group)
        
        # Main 3-column layout
        columns = forms.DynamicLayout()
        columns.BeginHorizontal()
        
        # LEFT: Room Selection
        room_group = forms.GroupBox(Text="Room Selection ({} rooms)".format(len(self.room_list)))
        room_layout = forms.DynamicLayout()
        room_layout.Spacing = drawing.Size(5, 5)
        room_layout.Padding = drawing.Padding(5)
        
        filter_row = forms.DynamicLayout()
        filter_row.BeginHorizontal()
        filter_row.Add(forms.Label(Text="Show:"))
        self.dd_hvac_filter = forms.DropDown()
        self.dd_hvac_filter.Items.Add("All Rooms")
        self.dd_hvac_filter.Items.Add("Unassigned Only")
        self.dd_hvac_filter.Items.Add("Assigned Only")
        self.dd_hvac_filter.SelectedIndex = 0
        self.dd_hvac_filter.SelectedIndexChanged += self._on_hvac_filter_changed
        filter_row.Add(self.dd_hvac_filter)
        filter_row.EndHorizontal()
        room_layout.Add(filter_row)
        
        self.hvac_room_grid = forms.GridView()
        self.hvac_room_grid.Height = 250
        self.hvac_room_grid.AllowMultipleSelection = True
        
        col = forms.GridColumn()
        col.HeaderText = "Room"
        col.DataCell = forms.TextBoxCell(0)
        col.Width = 140
        self.hvac_room_grid.Columns.Add(col)
        
        col2 = forms.GridColumn()
        col2.HeaderText = "Area"
        col2.DataCell = forms.TextBoxCell(1)
        col2.Width = 50
        self.hvac_room_grid.Columns.Add(col2)
        
        col3 = forms.GridColumn()
        col3.HeaderText = "System"
        col3.DataCell = forms.TextBoxCell(2)
        col3.Width = 100
        self.hvac_room_grid.Columns.Add(col3)
        
        self.filtered_hvac_rooms = list(self.room_list)
        self.hvac_room_grid.SelectionChanged += self._on_hvac_room_selection_changed
        room_layout.Add(self.hvac_room_grid, yscale=True)
        
        self.lbl_hvac_room_selection = forms.Label(Text="Select rooms to assign")
        room_layout.Add(self.lbl_hvac_room_selection)
        
        room_group.Content = room_layout
        columns.Add(room_group, xscale=True)
        
        # CENTER: Existing Systems List
        systems_group = forms.GroupBox(Text="Defined Systems")
        systems_layout = forms.DynamicLayout()
        systems_layout.Spacing = drawing.Size(5, 5)
        systems_layout.Padding = drawing.Padding(5)
        
        self.hvac_systems_grid = forms.GridView()
        self.hvac_systems_grid.Height = 180
        self.hvac_systems_grid.AllowMultipleSelection = False
        
        sys_col1 = forms.GridColumn()
        sys_col1.HeaderText = "System Name"
        sys_col1.DataCell = forms.TextBoxCell(0)
        sys_col1.Width = 120
        self.hvac_systems_grid.Columns.Add(sys_col1)
        
        sys_col2 = forms.GridColumn()
        sys_col2.HeaderText = "Type"
        sys_col2.DataCell = forms.TextBoxCell(1)
        sys_col2.Width = 80
        self.hvac_systems_grid.Columns.Add(sys_col2)
        
        sys_col3 = forms.GridColumn()
        sys_col3.HeaderText = "Rooms"
        sys_col3.DataCell = forms.TextBoxCell(2)
        sys_col3.Width = 50
        self.hvac_systems_grid.Columns.Add(sys_col3)
        
        self.hvac_systems_grid.SelectionChanged += self._on_hvac_system_selected
        systems_layout.Add(self.hvac_systems_grid, yscale=True)
        
        # Buttons for system management
        sys_btn_row = forms.DynamicLayout()
        sys_btn_row.BeginHorizontal()
        btn_load_system = forms.Button(Text="Load Selected")
        btn_load_system.Click += self._on_hvac_load_system
        sys_btn_row.Add(btn_load_system)
        btn_delete_system = forms.Button(Text="Delete")
        btn_delete_system.Click += self._on_hvac_delete_system
        sys_btn_row.Add(btn_delete_system)
        sys_btn_row.EndHorizontal()
        systems_layout.Add(sys_btn_row)
        
        systems_group.Content = systems_layout
        columns.Add(systems_group, xscale=True)
        
        # RIGHT: HVAC Configuration
        config_group = forms.GroupBox(Text="System Configuration")
        config_layout = forms.DynamicLayout()
        config_layout.Spacing = drawing.Size(5, 5)
        config_layout.Padding = drawing.Padding(8)
        
        # System Name (key field!)
        config_layout.AddRow(forms.Label(Text="System Name:"))
        self.txt_hvac_system_name = forms.TextBox()
        self.txt_hvac_system_name.Text = "System_1"
        config_layout.AddRow(self.txt_hvac_system_name)
        
        config_layout.AddSpace()
        
        config_layout.AddRow(forms.Label(Text="System Category:"))
        self.dd_hvac_category = forms.DropDown()
        for cat in HVAC_CATEGORIES.keys():
            self.dd_hvac_category.Items.Add(cat)
        self.dd_hvac_category.SelectedIndex = 0
        self.dd_hvac_category.SelectedIndexChanged += self._on_hvac_category_changed
        config_layout.AddRow(self.dd_hvac_category)
        
        self.lbl_hvac_cat_desc = forms.Label(Text="")
        self.lbl_hvac_cat_desc.TextColor = drawing.Color.FromArgb(100, 100, 100)
        config_layout.AddRow(self.lbl_hvac_cat_desc)
        
        config_layout.AddRow(forms.Label(Text="Equipment Type:"))
        self.dd_hvac_equipment = forms.DropDown()
        config_layout.AddRow(self.dd_hvac_equipment)
        
        config_layout.AddRow(forms.Label(Text="Vintage:"))
        self.dd_hvac_vintage = forms.DropDown()
        for v in HVAC_VINTAGES:
            self.dd_hvac_vintage.Items.Add(v)
        self.dd_hvac_vintage.SelectedIndex = 0
        config_layout.AddRow(self.dd_hvac_vintage)
        
        config_layout.AddRow(forms.Label(Text="Economizer:"))
        self.dd_hvac_economizer = forms.DropDown()
        for e in HVAC_ECONOMIZER_TYPES:
            self.dd_hvac_economizer.Items.Add(e)
        self.dd_hvac_economizer.SelectedIndex = 0
        config_layout.AddRow(self.dd_hvac_economizer)
        
        hr_row = forms.DynamicLayout()
        hr_row.BeginHorizontal()
        hr_row.Add(forms.Label(Text="Sensible HR:"))
        self.num_hvac_sensible = forms.NumericStepper()
        self.num_hvac_sensible.MinValue = 0.0
        self.num_hvac_sensible.MaxValue = 0.95
        self.num_hvac_sensible.DecimalPlaces = 2
        self.num_hvac_sensible.Increment = 0.05
        self.num_hvac_sensible.Value = 0.0
        self.num_hvac_sensible.Width = 60
        hr_row.Add(self.num_hvac_sensible)
        hr_row.EndHorizontal()
        config_layout.Add(hr_row)
        
        hr_row2 = forms.DynamicLayout()
        hr_row2.BeginHorizontal()
        hr_row2.Add(forms.Label(Text="Latent HR:"))
        self.num_hvac_latent = forms.NumericStepper()
        self.num_hvac_latent.MinValue = 0.0
        self.num_hvac_latent.MaxValue = 0.95
        self.num_hvac_latent.DecimalPlaces = 2
        self.num_hvac_latent.Increment = 0.05
        self.num_hvac_latent.Value = 0.0
        self.num_hvac_latent.Width = 60
        hr_row2.Add(self.num_hvac_latent)
        hr_row2.EndHorizontal()
        config_layout.Add(hr_row2)
        
        self.chk_hvac_dcv = forms.CheckBox(Text="Demand Controlled Vent.")
        config_layout.AddRow(self.chk_hvac_dcv)
        
        config_layout.AddSpace()
        
        # Action buttons
        btn_assign = forms.Button(Text="Assign Rooms to System")
        btn_assign.Click += self._on_hvac_assign_rooms
        config_layout.AddRow(btn_assign)
        
        btn_unassign = forms.Button(Text="Unassign Selected Rooms")
        btn_unassign.Click += self._on_hvac_unassign_rooms
        config_layout.AddRow(btn_unassign)
        
        config_group.Content = config_layout
        columns.Add(config_group, xscale=True)
        
        columns.EndHorizontal()
        layout.Add(columns, yscale=True)
        
        # Status
        self.hvac_status = forms.Label(Text="")
        layout.Add(self.hvac_status)
        
        # Initialize
        self._update_hvac_equipment_dropdown()
        self._refresh_hvac_room_grid()
        self._refresh_hvac_systems_grid()
        self._suggest_system_name()
        
        return layout
    
    # --- PROGRAM TAB ---
    
    def _create_program_panel(self):
        layout = forms.DynamicLayout()
        layout.Spacing = drawing.Size(8, 8)
        layout.Padding = drawing.Padding(5)
        info = forms.GroupBox(Text="Room Service: Program + Exhaust")
        il = forms.DynamicLayout()
        il.Padding = drawing.Padding(8)
        il.AddRow(forms.Label(Text="Override per-room programs for the design case."))
        n_model = len(self.available_programs)
        n_hblib = len(self.hb_lib_programs)
        info_parts = []
        if n_model:
            info_parts.append("{} from model: {}".format(n_model, ", ".join(self.available_programs[:3])))
        if n_hblib:
            info_parts.append("{} from HB library".format(n_hblib))
        il.AddRow(forms.Label(Text=", ".join(info_parts) if info_parts else "No programs available."))
        info.Content = il
        layout.Add(info)
        cols = forms.DynamicLayout()
        cols.BeginHorizontal()
        rg = forms.GroupBox(Text="Rooms ({})".format(len(self.room_list)))
        rl = forms.DynamicLayout()
        rl.Spacing = drawing.Size(5, 5)
        rl.Padding = drawing.Padding(5)
        self.prog_grid = forms.GridView()
        self.prog_grid.Height = 300
        self.prog_grid.AllowMultipleSelection = True
        gc1 = forms.GridColumn()
        gc1.HeaderText = "Room"
        gc1.DataCell = forms.TextBoxCell(0)
        gc1.Width = 150
        self.prog_grid.Columns.Add(gc1)
        gc2 = forms.GridColumn()
        gc2.HeaderText = "Area"
        gc2.DataCell = forms.TextBoxCell(1)
        gc2.Width = 55
        self.prog_grid.Columns.Add(gc2)
        gc3 = forms.GridColumn()
        gc3.HeaderText = "Program"
        gc3.DataCell = forms.TextBoxCell(2)
        gc3.Width = 150
        self.prog_grid.Columns.Add(gc3)
        gc4 = forms.GridColumn()
        gc4.HeaderText = "Exhaust"
        gc4.DataCell = forms.TextBoxCell(3)
        gc4.Width = 90
        self.prog_grid.Columns.Add(gc4)
        rl.Add(self.prog_grid, yscale=True)
        rg.Content = rl
        cols.Add(rg, xscale=True)
        ag = forms.GroupBox(Text="Assign Program")
        al = forms.DynamicLayout()
        al.Spacing = drawing.Size(5, 5)
        al.Padding = drawing.Padding(8)
        al.AddRow(forms.Label(Text="Select program:"))
        self.dd_prog = forms.DropDown()
        for pid in self.available_programs:
            self.dd_prog.Items.Add(pid)
        for hid in self.hb_lib_programs:
            if hid not in self.available_programs:
                self.dd_prog.Items.Add("[HB] " + hid)
        if self.dd_prog.Items.Count == 0:
            self.dd_prog.Items.Add("(none)")
        self.dd_prog.SelectedIndex = 0
        al.AddRow(self.dd_prog)
        row1 = forms.DynamicLayout()
        row1.BeginHorizontal()
        ba = forms.Button(Text="Assign to Selected")
        ba.Click += self._on_prog_assign
        row1.Add(ba, xscale=True)
        baa = forms.Button(Text="Assign to All Rooms")
        baa.Click += self._on_prog_assign_all
        row1.Add(baa, xscale=True)
        row1.EndHorizontal()
        al.Add(row1)
        row2 = forms.DynamicLayout()
        row2.BeginHorizontal()
        bu = forms.Button(Text="Remove Override")
        bu.Click += self._on_prog_unassign
        row2.Add(bu, xscale=True)
        bc = forms.Button(Text="Clear All Overrides")
        bc.Click += self._on_prog_clear
        row2.Add(bc, xscale=True)
        row2.EndHorizontal()
        al.Add(row2)
        self.lbl_pstat = forms.Label(Text="")
        al.AddRow(self.lbl_pstat)
        ag.Content = al
        # Build right-side vertical stack (Assign Program above Exhaust Fans)
        right_stack = forms.DynamicLayout()
        right_stack.Spacing = drawing.Size(5, 8)
        right_stack.Add(ag)
        # --- Exhaust Fan Section (Room Service) ---
        eg = forms.GroupBox(Text="Exhaust Fans")
        el = forms.DynamicLayout()
        el.Spacing = drawing.Size(5, 5)
        el.Padding = drawing.Padding(8)
        
        el.AddRow(forms.Label(Text="Preview (selected room):"))
        self.lbl_exh_preview = forms.Label(Text="(no room selected)")
        el.AddRow(self.lbl_exh_preview)
        
        el.AddRow(forms.Label(Text="-- Add new exhaust fan to selected room(s) --"))
        
        rx1 = forms.DynamicLayout()
        rx1.BeginHorizontal()
        lf = forms.Label(Text="Flow (m3/s):"); lf.Width = 90
        rx1.Add(lf)
        self.num_exh_flow = forms.NumericStepper()
        self.num_exh_flow.DecimalPlaces = 4
        self.num_exh_flow.MinValue = 0.0001
        self.num_exh_flow.MaxValue = 10.0
        self.num_exh_flow.Value = 0.012
        self.num_exh_flow.Increment = 0.001
        self.num_exh_flow.Width = 85
        rx1.Add(self.num_exh_flow)
        lp = forms.Label(Text="Press (Pa):"); lp.Width = 75
        rx1.Add(lp)
        self.num_exh_press = forms.NumericStepper()
        self.num_exh_press.DecimalPlaces = 1
        self.num_exh_press.MinValue = 0.0
        self.num_exh_press.MaxValue = 2000.0
        self.num_exh_press.Value = 100.0
        self.num_exh_press.Increment = 5.0
        self.num_exh_press.Width = 75
        rx1.Add(self.num_exh_press)
        rx1.EndHorizontal()
        el.Add(rx1)
        
        rx2 = forms.DynamicLayout()
        rx2.BeginHorizontal()
        le = forms.Label(Text="Efficiency:"); le.Width = 90
        rx2.Add(le)
        self.num_exh_eff = forms.NumericStepper()
        self.num_exh_eff.DecimalPlaces = 2
        self.num_exh_eff.MinValue = 0.1
        self.num_exh_eff.MaxValue = 1.0
        self.num_exh_eff.Value = 0.5
        self.num_exh_eff.Increment = 0.05
        self.num_exh_eff.Width = 85
        rx2.Add(self.num_exh_eff)
        lv = forms.Label(Text="Vent type:"); lv.Width = 75
        rx2.Add(lv)
        self.dd_exh_type = forms.DropDown()
        for vt in ["Exhaust", "Intake", "Balanced"]:
            self.dd_exh_type.Items.Add(vt)
        self.dd_exh_type.SelectedIndex = 0
        self.dd_exh_type.Width = 90
        rx2.Add(self.dd_exh_type)
        rx2.EndHorizontal()
        el.Add(rx2)
        
        rx3 = forms.DynamicLayout()
        rx3.BeginHorizontal()
        b_add_exh = forms.Button(Text="Add Exhaust to Selected")
        b_add_exh.Click += self._on_exh_add
        rx3.Add(b_add_exh, xscale=True)
        b_clr_exh = forms.Button(Text="Clear Exhausts on Selected")
        b_clr_exh.Click += self._on_exh_clear
        rx3.Add(b_clr_exh, xscale=True)
        rx3.EndHorizontal()
        el.Add(rx3)
        
        self.lbl_exhstat = forms.Label(Text="")
        el.AddRow(self.lbl_exhstat)
        
        eg.Content = el
        right_stack.Add(eg)
        cols.Add(right_stack, xscale=True)
        cols.EndHorizontal()
        layout.Add(cols, yscale=True)
        
        try:
            self.prog_grid.SelectionChanged += self._on_prog_grid_selection_changed
        except Exception:
            pass
        
        self._refresh_prog_grid()
        return layout
    
    def _refresh_prog_grid(self):
        rows = []
        for r in self.room_list:
            p = r.get('program', '<none>')
            if r['id'] in self.program_assignments:
                p = "* " + self.program_assignments[r['id']][:17]
            exh_list = self.room_exhaust_assignments.get(r['id'], [])
            n_exh = len(exh_list)
            if n_exh == 0:
                exh_txt = "-"
            elif n_exh == 1:
                spec = exh_list[0]
                exh_txt = "{} @{:.3f}".format(spec.get('vent_type', 'Exh')[:4], spec.get('flow', 0))
            else:
                exh_txt = "{} fans".format(n_exh)
            rows.append([r['name'][:22], "{:.0f}".format(r['area']), p, exh_txt])
        self.prog_grid.DataStore = rows
    
    def _on_prog_assign(self, s, e):
        pid = str(self.dd_prog.SelectedValue)
        if not pid or pid == "(none)":
            return
        if pid.startswith("[HB] "):
            pid = pid[5:]
        sel = list(self.prog_grid.SelectedRows)
        if not sel:
            self.lbl_pstat.Text = "Select rooms first."
            return
        ct = 0
        for i in sel:
            if i < len(self.room_list):
                self.program_assignments[self.room_list[i]['id']] = pid
                ct += 1
        self._refresh_prog_grid()
        self.lbl_pstat.Text = "'{}' -> {} room(s)".format(pid[:20], ct)
    
    def _on_prog_assign_all(self, s, e):
        pid = str(self.dd_prog.SelectedValue)
        if not pid or pid == "(none)":
            return
        if pid.startswith("[HB] "):
            pid = pid[5:]
        for r in self.room_list:
            self.program_assignments[r['id']] = pid
        self._refresh_prog_grid()
        self.lbl_pstat.Text = "'{}' -> all {} rooms".format(pid[:20], len(self.room_list))
    
    def _on_prog_unassign(self, s, e):
        ct = 0
        for i in list(self.prog_grid.SelectedRows):
            if i < len(self.room_list):
                rid = self.room_list[i]['id']
                if rid in self.program_assignments:
                    del self.program_assignments[rid]
                    ct += 1
        self._refresh_prog_grid()
        self.lbl_pstat.Text = "Removed {} override(s)".format(ct)
    
    def _on_prog_clear(self, s, e):
        self.program_assignments.clear()
        self._refresh_prog_grid()
        self.lbl_pstat.Text = "Cleared."
    
    # ---------- Exhaust Fan handlers (Room Service) ----------
    def _on_prog_grid_selection_changed(self, s, e):
        try:
            sel = list(self.prog_grid.SelectedRows)
            if len(sel) == 1 and sel[0] < len(self.room_list):
                room = self.room_list[sel[0]]
                rid = room['id']
                exh_list = self.room_exhaust_assignments.get(rid, [])
                if not exh_list:
                    self.lbl_exh_preview.Text = "{}: no exhaust fans".format(room['name'][:30])
                else:
                    parts = ["{}: {} fan(s):".format(room['name'][:30], len(exh_list))]
                    for i, spec in enumerate(exh_list):
                        parts.append("  {}. {} @{:.4f} m3/s  P={:.0f}Pa  eff={:.2f}".format(
                            i+1, spec.get('vent_type', 'Exhaust'),
                            spec.get('flow', 0),
                            spec.get('pressure_rise', 0),
                            spec.get('fan_efficiency', 0)))
                    self.lbl_exh_preview.Text = "\n".join(parts)
                if rid in self.room_hvac_assignments:
                    sysname = self.room_hvac_assignments[rid]
                    if sysname in self.hvac_systems:
                        hvac_cls = self.hvac_systems[sysname].get('class', '')
                        vt = self._default_vent_type_for_hvac(hvac_cls)
                        idx_map = {"Exhaust": 0, "Intake": 1, "Balanced": 2}
                        self.dd_exh_type.SelectedIndex = idx_map.get(vt, 0)
            elif len(sel) > 1:
                self.lbl_exh_preview.Text = "{} rooms selected".format(len(sel))
            else:
                self.lbl_exh_preview.Text = "(no room selected)"
        except Exception as ex:
            print("exh preview update error: {}".format(ex))
    
    def _default_vent_type_for_hvac(self, hvac_class):
        # Always default to Exhaust. The 'Balanced' option pairs an intake fan with
        # an exhaust fan and conditions the supply air, which can substantially
        # increase energy use in cold climates if the fan runs continuously.
        # Most bathroom/kitchen exhaust use cases want Exhaust.
        return "Exhaust"
    
    def _on_exh_add(self, s, e):
        sel = list(self.prog_grid.SelectedRows)
        if not sel:
            self.lbl_exhstat.Text = "Select rooms first."
            return
        spec = {
            'flow': float(self.num_exh_flow.Value),
            'pressure_rise': float(self.num_exh_press.Value),
            'fan_efficiency': float(self.num_exh_eff.Value),
            'vent_type': str(self.dd_exh_type.SelectedValue),
        }
        ct = 0
        for i in sel:
            if i < len(self.room_list):
                rid = self.room_list[i]['id']
                if rid not in self.room_exhaust_assignments:
                    self.room_exhaust_assignments[rid] = []
                self.room_exhaust_assignments[rid].append(dict(spec))
                ct += 1
        self._refresh_prog_grid()
        self.lbl_exhstat.Text = "Added {} fan(s) to {} room(s)".format(spec['vent_type'], ct)
        self._on_prog_grid_selection_changed(None, None)
    
    def _on_exh_clear(self, s, e):
        sel = list(self.prog_grid.SelectedRows)
        if not sel:
            self.lbl_exhstat.Text = "Select rooms first."
            return
        ct = 0
        for i in sel:
            if i < len(self.room_list):
                rid = self.room_list[i]['id']
                if rid in self.room_exhaust_assignments:
                    del self.room_exhaust_assignments[rid]
                    ct += 1
        self._refresh_prog_grid()
        self.lbl_exhstat.Text = "Cleared exhausts on {} room(s)".format(ct)
        self._on_prog_grid_selection_changed(None, None)
    
    def _refresh_hvac_room_grid(self):
        """Refresh the HVAC room grid based on filter"""
        filter_idx = self.dd_hvac_filter.SelectedIndex
        
        rows = []
        for r in self.filtered_hvac_rooms:
            system_name = self.room_hvac_assignments.get(r['id'], '<none>')
            rows.append([r['name'][:20], "{:.0f}".format(r['area']), system_name[:12]])
        self.hvac_room_grid.DataStore = rows
    
    def _refresh_hvac_systems_grid(self):
        """Refresh the systems list grid"""
        rows = []
        for sys_name, config in self.hvac_systems.items():
            # Count rooms assigned to this system
            room_count = sum(1 for r_id, s_name in self.room_hvac_assignments.items() if s_name == sys_name)
            sys_type = config.get('class', 'Unknown')[:10]
            rows.append([sys_name[:15], sys_type, str(room_count)])
        self.hvac_systems_grid.DataStore = rows
    
    def _suggest_system_name(self):
        """Suggest a unique system name"""
        base = "System"
        counter = 1
        while True:
            name = "{}_{}".format(base, counter)
            if name not in self.hvac_systems:
                self.txt_hvac_system_name.Text = name
                return
            counter += 1
            if counter > 100:
                self.txt_hvac_system_name.Text = "System_New"
                return
    
    def _update_hvac_equipment_dropdown(self):
        """Update equipment dropdown based on selected category"""
        try:
            cat_name = str(self.dd_hvac_category.SelectedValue)
            cat_info = HVAC_CATEGORIES.get(cat_name, {})
            
            self.lbl_hvac_cat_desc.Text = cat_info.get("description", "")
            
            self.dd_hvac_equipment.Items.Clear()
            for eq in cat_info.get("equipment_types", []):
                self.dd_hvac_equipment.Items.Add(eq)
            if self.dd_hvac_equipment.Items.Count > 0:
                self.dd_hvac_equipment.SelectedIndex = 0
        except:
            pass
    
    def _on_hvac_filter_changed(self, sender, e):
        """Handle HVAC room filter change"""
        filter_idx = self.dd_hvac_filter.SelectedIndex
        if filter_idx == 0:  # All
            self.filtered_hvac_rooms = list(self.room_list)
        elif filter_idx == 1:  # Unassigned Only
            self.filtered_hvac_rooms = [r for r in self.room_list if r['id'] not in self.room_hvac_assignments]
        else:  # Assigned Only
            self.filtered_hvac_rooms = [r for r in self.room_list if r['id'] in self.room_hvac_assignments]
        self._refresh_hvac_room_grid()
    
    def _on_hvac_category_changed(self, sender, e):
        """Handle HVAC category change"""
        self._update_hvac_equipment_dropdown()
    
    def _on_hvac_room_selection_changed(self, sender, e):
        """Handle HVAC room selection change - update preview and selection label"""
        selected_indices = list(self.hvac_room_grid.SelectedRows)
        if not selected_indices:
            self.lbl_hvac_room_selection.Text = "Select rooms to assign"
        else:
            total_area = 0
            for idx in selected_indices:
                if idx < len(self.filtered_hvac_rooms):
                    total_area += self.filtered_hvac_rooms[idx].get('area', 0)
            self.lbl_hvac_room_selection.Text = "Selected: {} room(s), {:.0f} m2 total".format(
                len(selected_indices), total_area)
        self._update_preview()
    
    def _on_hvac_system_selected(self, sender, e):
        """Handle system selection in the systems grid"""
        selected = list(self.hvac_systems_grid.SelectedRows)
        if selected:
            idx = selected[0]
            system_names = list(self.hvac_systems.keys())
            if idx < len(system_names):
                sys_name = system_names[idx]
                self.txt_hvac_system_name.Text = sys_name
    
    def _on_hvac_load_system(self, sender, e):
        """Load selected system configuration into the form"""
        selected = list(self.hvac_systems_grid.SelectedRows)
        if not selected:
            self.hvac_status.Text = "Select a system to load"
            return
        
        idx = selected[0]
        system_names = list(self.hvac_systems.keys())
        if idx >= len(system_names):
            return
        
        sys_name = system_names[idx]
        config = self.hvac_systems[sys_name]
        
        # Load into form
        self.txt_hvac_system_name.Text = sys_name
        
        # Find and set category (reverse-lookup from class name)
        hvac_class = config.get('class', 'IdealAirSystem')
        cat_name = config.get('category', '')
        if not cat_name:
            # Reverse-lookup: find category whose class matches
            for cname, cdata in HVAC_CATEGORIES.items():
                if cdata.get('class') == hvac_class:
                    cat_name = cname
                    break
            if not cat_name:
                cat_name = 'Ideal Air (Loads Only)'
        for i in range(self.dd_hvac_category.Items.Count):
            if str(self.dd_hvac_category.Items[i]) == cat_name:
                self.dd_hvac_category.SelectedIndex = i
                break
        
        self._update_hvac_equipment_dropdown()
        
        # Find and set equipment type
        eq_type = config.get('equipment_type', '')
        for i in range(self.dd_hvac_equipment.Items.Count):
            if str(self.dd_hvac_equipment.Items[i]) == eq_type:
                self.dd_hvac_equipment.SelectedIndex = i
                break
        
        # Set vintage
        vintage = config.get('vintage', 'ASHRAE_2019')
        for i in range(self.dd_hvac_vintage.Items.Count):
            if str(self.dd_hvac_vintage.Items[i]) == vintage:
                self.dd_hvac_vintage.SelectedIndex = i
                break
        
        # Set economizer
        econ = config.get('economizer_type', 'NoEconomizer')
        for i in range(self.dd_hvac_economizer.Items.Count):
            if str(self.dd_hvac_economizer.Items[i]) == econ:
                self.dd_hvac_economizer.SelectedIndex = i
                break
        
        self.num_hvac_sensible.Value = config.get('sensible_heat_recovery', 0)
        self.num_hvac_latent.Value = config.get('latent_heat_recovery', 0)
        self.chk_hvac_dcv.Checked = config.get('demand_controlled_ventilation', False)
        
        self.hvac_status.Text = "Loaded system: {}".format(sys_name)
    
    def _on_hvac_delete_system(self, sender, e):
        """Delete selected system and unassign all rooms from it"""
        selected = list(self.hvac_systems_grid.SelectedRows)
        if not selected:
            self.hvac_status.Text = "Select a system to delete"
            return
        
        idx = selected[0]
        system_names = list(self.hvac_systems.keys())
        if idx >= len(system_names):
            return
        
        sys_name = system_names[idx]
        
        # Unassign all rooms from this system
        rooms_to_unassign = [r_id for r_id, s_name in self.room_hvac_assignments.items() if s_name == sys_name]
        for r_id in rooms_to_unassign:
            del self.room_hvac_assignments[r_id]
            self.room_hvac_names.pop(r_id, None)
        
        # Delete the system
        del self.hvac_systems[sys_name]
        
        self._refresh_hvac_systems_grid()
        self._refresh_hvac_room_grid()
        self._suggest_system_name()
        self.hvac_status.Text = "Deleted system '{}', unassigned {} rooms".format(sys_name, len(rooms_to_unassign))
    
    def _on_hvac_assign_rooms(self, sender, e):
        """Assign selected rooms to the named system (create/update system)"""
        system_name = self.txt_hvac_system_name.Text.strip()
        if not system_name:
            self.hvac_status.Text = "Enter a system name"
            return
        
        # Validate system name (no spaces, special chars)
        system_name = system_name.replace(' ', '_')
        
        selected = list(self.hvac_room_grid.SelectedRows)
        if not selected:
            self.hvac_status.Text = "Select rooms to assign"
            return
        
        cat_name = str(self.dd_hvac_category.SelectedValue)
        cat_info = HVAC_CATEGORIES.get(cat_name, {})
        
        # Build system config
        config = {
            'class': cat_info.get('class', 'IdealAirSystem'),
            'category': cat_name,
            'equipment_type': str(self.dd_hvac_equipment.SelectedValue) if self.dd_hvac_equipment.SelectedIndex >= 0 else '',
            'vintage': str(self.dd_hvac_vintage.SelectedValue) if self.dd_hvac_vintage.SelectedIndex >= 0 else 'ASHRAE_2019',
            'economizer_type': str(self.dd_hvac_economizer.SelectedValue) if self.dd_hvac_economizer.SelectedIndex >= 0 else 'NoEconomizer',
            'sensible_heat_recovery': float(self.num_hvac_sensible.Value),
            'latent_heat_recovery': float(self.num_hvac_latent.Value),
            'demand_controlled_ventilation': self.chk_hvac_dcv.Checked,
        }
        
        # Create or update the system
        is_new = system_name not in self.hvac_systems
        self.hvac_systems[system_name] = config
        
        # Assign selected rooms to this system
        count = 0
        for idx in selected:
            if idx < len(self.filtered_hvac_rooms):
                room_id = self.filtered_hvac_rooms[idx]['id']
                self.room_hvac_assignments[room_id] = system_name
                # Store display_name for ID migration on model rebuild
                self.room_hvac_names[room_id] = self.filtered_hvac_rooms[idx]['name']
                count += 1
        
        self._refresh_hvac_room_grid()
        self._refresh_hvac_systems_grid()
        
        action = "Created" if is_new else "Updated"
        self.hvac_status.Text = "{} '{}' ({}) - assigned {} rooms".format(
            action, system_name, cat_info.get('class', '')[:10], count)
    
    def _on_hvac_unassign_rooms(self, sender, e):
        """Unassign selected rooms from their HVAC systems"""
        selected = list(self.hvac_room_grid.SelectedRows)
        if not selected:
            self.hvac_status.Text = "Select rooms to unassign"
            return
        
        count = 0
        for idx in selected:
            if idx < len(self.filtered_hvac_rooms):
                room_id = self.filtered_hvac_rooms[idx]['id']
                if room_id in self.room_hvac_assignments:
                    del self.room_hvac_assignments[room_id]
                    self.room_hvac_names.pop(room_id, None)
                    count += 1
        
        self._refresh_hvac_room_grid()
        self._refresh_hvac_systems_grid()  # Update room counts
        self.hvac_status.Text = "Unassigned {} rooms".format(count)
    
    def _refresh_shade_wall_grid(self):
        """Refresh wall shading grid: [S, Type, Room, Area]"""
        rows = []
        for f in self.filtered_shade_walls:
            shaded = "S" if f['id'] in self.shading_config else ""
            rows.append([
                shaded,
                f['type'][:10],
                f['room'][:20],
                "{:.1f}".format(f['area'])
            ])
        self.shade_wall_grid.DataStore = rows
    
    def _refresh_shade_ap_grid(self):
        """Refresh aperture shading grid: [S, Room, Parent, Area]"""
        rows = []
        for a in self.filtered_shade_apertures:
            shaded = "S" if a['id'] in self.shading_config else ""
            parent_short = a.get('parent', '')[-12:] if a.get('parent') else ""
            rows.append([
                shaded,
                a['room'][:20],
                parent_short,
                "{:.1f}".format(a['area'])
            ])
        self.shade_ap_grid.DataStore = rows
    
    def _refresh_shade_door_grid(self):
        """Refresh door shading grid: [S, Type, Room, Area]"""
        rows = []
        for d in self.filtered_shade_doors:
            shaded = "S" if d['id'] in self.shading_config else ""
            type_marker = "Glass" if d.get('is_glass', False) else "Opaque"
            rows.append([
                shaded,
                type_marker,
                d['room'][:20],
                "{:.1f}".format(d['area'])
            ])
        self.shade_door_grid.DataStore = rows
    
    def _on_shade_selection_changed(self, sender, e):
        """Handle shading surface selection change - update preview"""
        self._update_preview()
    
    def _on_filter_shade_walls(self, sender, e):
        room_f = str(self.shade_wall_room_filter.Items[self.shade_wall_room_filter.SelectedIndex])
        ext_walls = [f for f in self.face_list if f['bc'] == 'Outdoors' and 'Wall' in f['type']]
        if room_f == "<All>":
            self.filtered_shade_walls = list(ext_walls)
        else:
            self.filtered_shade_walls = [f for f in ext_walls if f['room'] == room_f]
        self._refresh_shade_wall_grid()
    
    def _on_filter_shade_apertures(self, sender, e):
        room_f = str(self.shade_ap_room_filter.Items[self.shade_ap_room_filter.SelectedIndex])
        ext_ap = [a for a in self.aperture_list if a['bc'] == 'Outdoors']
        if room_f == "<All>":
            self.filtered_shade_apertures = list(ext_ap)
        else:
            self.filtered_shade_apertures = [a for a in ext_ap if a['room'] == room_f]
        self._refresh_shade_ap_grid()
    
    def _on_apply_wall_shading(self, sender, e):
        if not self.chk_wall_overhang.Checked:
            self.shade_status.Text = "Check 'Overhang' to apply"
            return
        selected = list(self.shade_wall_grid.SelectedRows)
        if not selected:
            self.shade_status.Text = "Select walls first"
            return
        depth = float(self.num_wall_oh_depth.Value)
        angle = float(self.num_wall_oh_angle.Value)
        count = 0
        for idx in selected:
            if idx < len(self.filtered_shade_walls):
                face_data = self.filtered_shade_walls[idx]
                self.shading_config[face_data['id']] = {
                    'type': 'wall_overhang',
                    'depth': depth,
                    'angle': angle
                }
                count += 1
        self._refresh_shade_wall_grid()
        self.shade_status.Text = "Applied overhang to {} walls".format(count)
    
    def _on_apply_aperture_shading(self, sender, e):
        has_overhang = self.chk_ap_overhang.Checked
        has_fins = self.chk_ap_fins.Checked
        has_louvers = self.chk_ap_louvers.Checked
        if not (has_overhang or has_fins or has_louvers):
            self.shade_status.Text = "Select at least one shading type"
            return
        selected = list(self.shade_ap_grid.SelectedRows)
        if not selected:
            self.shade_status.Text = "Select apertures first"
            return
        config = {'type': 'aperture_shading'}
        if has_overhang:
            config['overhang'] = {
                'depth': float(self.num_ap_oh_depth.Value),
                'angle': float(self.num_ap_oh_angle.Value)
            }
        if has_fins:
            config['fins'] = {
                'depth': float(self.num_ap_fin_depth.Value),
                'angle': float(self.num_ap_fin_angle.Value)
            }
        if has_louvers:
            config['louvers'] = {
                'count': int(self.num_ap_louver_count.Value),
                'depth': float(self.num_ap_louver_depth.Value),
                'offset': float(self.num_ap_louver_offset.Value),
                'angle': float(self.num_ap_louver_angle.Value)
            }
        count = 0
        for idx in selected:
            if idx < len(self.filtered_shade_apertures):
                ap_data = self.filtered_shade_apertures[idx]
                self.shading_config[ap_data['id']] = config.copy()
                count += 1
        self._refresh_shade_ap_grid()
        types = []
        if has_overhang: types.append("OH")
        if has_fins: types.append("Fins")
        if has_louvers: types.append("Louvers")
        self.shade_status.Text = "Applied {} to {} apertures".format("+".join(types), count)
    
    def _on_apply_door_shading(self, sender, e):
        if not self.chk_door_canopy.Checked:
            self.shade_status.Text = "Check 'Canopy' to apply"
            return
        selected = list(self.shade_door_grid.SelectedRows)
        if not selected:
            self.shade_status.Text = "Select doors first"
            return
        depth = float(self.num_door_canopy_depth.Value)
        count = 0
        for idx in selected:
            if idx < len(self.filtered_shade_doors):
                door_data = self.filtered_shade_doors[idx]
                self.shading_config[door_data['id']] = {
                    'type': 'door_canopy',
                    'depth': depth
                }
                count += 1
        self._refresh_shade_door_grid()
        self.shade_status.Text = "Applied canopy to {} doors".format(count)

    def _format_face_row(self, f):
        """Format face row for multi-column grid: [M, G, Type, Room, BC, Area, Construction]"""
        mod_marker = "*" if f['id'] in self.modified_faces else ""
        geo_marker = "G" if f['brep'] else "-"
        constr_display = f['construction'][:20] if f['construction'] != '<Unchanged>' else ""
        return [
            mod_marker,
            geo_marker,
            f['type'][:10],
            f['room'][:20],
            f['bc'][:7],
            "{:.1f}".format(f['area']),
            constr_display
        ]
    
    def _format_ap_row(self, a):
        """Format aperture row for multi-column grid: [M, G, Room, Parent, BC, Area, Construction]"""
        mod_marker = "*" if a['id'] in self.modified_apertures else ""
        geo_marker = "G" if a['brep'] else "-"
        constr_display = a['construction'][:20] if a['construction'] != '<Unchanged>' else ""
        parent_short = a.get('parent', '')[-15:] if a.get('parent') else ""
        return [
            mod_marker,
            geo_marker,
            a['room'][:20],
            parent_short,
            a['bc'][:7],
            "{:.1f}".format(a['area']),
            constr_display
        ]
    
    def _format_door_row(self, d):
        """Format door row for multi-column grid: [M, G, Type, Room, BC, Area, Construction]"""
        mod_marker = "*" if d['id'] in self.modified_doors else ""
        geo_marker = "G" if d['brep'] else "-"
        type_marker = "Glass" if d.get('is_glass', False) else "Opaque"
        constr_display = d['construction'][:20] if d['construction'] != '<Unchanged>' else ""
        return [
            mod_marker,
            geo_marker,
            type_marker,
            d['room'][:20],
            d['bc'][:7],
            "{:.1f}".format(d['area']),
            constr_display
        ]
    
    def _refresh_face_grid(self):
        self.filtered_faces = []
        room_f = str(self.room_filter.Items[self.room_filter.SelectedIndex]) if self.room_filter.SelectedIndex >= 0 else "<All>"
        type_f = str(self.type_filter.Items[self.type_filter.SelectedIndex]) if self.type_filter.SelectedIndex >= 0 else "<All>"
        bc_f = str(self.bc_filter.Items[self.bc_filter.SelectedIndex]) if self.bc_filter.SelectedIndex >= 0 else "<All>"
        for f in self.face_list:
            if room_f != "<All>" and f['room'] != room_f:
                continue
            if type_f != "<All>" and type_f.lower() not in f['type'].lower():
                continue
            if bc_f != "<All>" and f['bc'] != bc_f:
                continue
            self.filtered_faces.append(f)
        rows = [self._format_face_row(f) for f in self.filtered_faces]
        self.face_grid.DataStore = rows
        if hasattr(self, 'btn_set_all_faces'):
            self.btn_set_all_faces.Text = "Set for All Filtered ({})".format(len(self.filtered_faces))
    
    def _refresh_ap_grid(self):
        self.filtered_apertures = []
        room_f = str(self.ap_room_filter.Items[self.ap_room_filter.SelectedIndex]) if self.ap_room_filter.SelectedIndex >= 0 else "<All>"
        bc_f = str(self.ap_bc_filter.Items[self.ap_bc_filter.SelectedIndex]) if self.ap_bc_filter.SelectedIndex >= 0 else "<All>"
        for a in self.aperture_list:
            if room_f != "<All>" and a['room'] != room_f:
                continue
            if bc_f != "<All>" and a['bc'] != bc_f:
                continue
            self.filtered_apertures.append(a)
        rows = [self._format_ap_row(a) for a in self.filtered_apertures]
        self.ap_grid.DataStore = rows
        if hasattr(self, 'btn_set_all_ap'):
            self.btn_set_all_ap.Text = "Set for All Filtered ({})".format(len(self.filtered_apertures))
    
    def _refresh_door_grid(self):
        """NEW: Refresh the door grid based on filters"""
        self.filtered_doors = []
        room_f = str(self.door_room_filter.Items[self.door_room_filter.SelectedIndex]) if self.door_room_filter.SelectedIndex >= 0 else "<All>"
        bc_f = str(self.door_bc_filter.Items[self.door_bc_filter.SelectedIndex]) if self.door_bc_filter.SelectedIndex >= 0 else "<All>"
        type_f = str(self.door_type_filter.Items[self.door_type_filter.SelectedIndex]) if self.door_type_filter.SelectedIndex >= 0 else "<All>"
        for d in self.door_list:
            if room_f != "<All>" and d['room'] != room_f:
                continue
            if bc_f != "<All>" and d['bc'] != bc_f:
                continue
            if type_f == "Opaque" and d.get('is_glass', False):
                continue
            if type_f == "Glass" and not d.get('is_glass', False):
                continue
            self.filtered_doors.append(d)
        rows = [self._format_door_row(d) for d in self.filtered_doors]
        self.door_grid.DataStore = rows
        if hasattr(self, 'btn_set_all_doors'):
            self.btn_set_all_doors.Text = "Set for All Filtered ({})".format(len(self.filtered_doors))
    
    def _update_face_dropdowns(self, bc):
        self.face_constr_dropdown.Items.Clear()
        self.face_constr_dropdown.Items.Add("<Unchanged>")
        gds_c = self.gds_parser.get_constructions_for_boundary(bc, is_window=False)
        for name in sorted(gds_c.keys()):
            self.face_constr_dropdown.Items.Add("[GDS] " + name)
        try:
            from honeybee_energy.lib.constructions import OPAQUE_CONSTRUCTIONS
            for c in sorted(OPAQUE_CONSTRUCTIONS):
                self.face_constr_dropdown.Items.Add("[HB] " + c)
        except:
            pass
        self.face_constr_dropdown.SelectedIndex = 0
        self.face_mod_dropdown.Items.Clear()
        self.face_mod_dropdown.Items.Add("<Unchanged>")
        gds_m = self.gds_parser.get_modifiers_for_boundary(bc, is_glass=False)
        for name in sorted(gds_m.keys()):
            self.face_mod_dropdown.Items.Add("[GDS] " + name)
        try:
            from honeybee_radiance.lib.modifiers import MODIFIERS
            for m in sorted(MODIFIERS):
                self.face_mod_dropdown.Items.Add("[HB] " + m)
        except:
            pass
        self.face_mod_dropdown.SelectedIndex = 0
    
    def _update_ap_dropdowns(self, bc):
        self.ap_constr_dropdown.Items.Clear()
        self.ap_constr_dropdown.Items.Add("<Unchanged>")
        gds_c = self.gds_parser.get_constructions_for_boundary(bc, is_window=True)
        for name in sorted(gds_c.keys()):
            self.ap_constr_dropdown.Items.Add("[GDS] " + name)
        try:
            from honeybee_energy.lib.constructions import WINDOW_CONSTRUCTIONS
            for c in sorted(WINDOW_CONSTRUCTIONS):
                self.ap_constr_dropdown.Items.Add("[HB] " + c)
        except:
            pass
        self.ap_constr_dropdown.SelectedIndex = 0
        self.ap_mod_dropdown.Items.Clear()
        self.ap_mod_dropdown.Items.Add("<Unchanged>")
        gds_m = self.gds_parser.get_modifiers_for_boundary(bc, is_glass=True)
        for name in sorted(gds_m.keys()):
            self.ap_mod_dropdown.Items.Add("[GDS] " + name)
        try:
            from honeybee_radiance.lib.modifiers import MODIFIERS
            for m in sorted(MODIFIERS):
                self.ap_mod_dropdown.Items.Add("[HB] " + m)
        except:
            pass
        self.ap_mod_dropdown.SelectedIndex = 0
    
    def _update_door_dropdowns(self, bc, is_glass):
        """NEW: Update door dropdowns based on boundary condition and door type"""
        self.door_constr_dropdown.Items.Clear()
        self.door_constr_dropdown.Items.Add("<Unchanged>")
        
        # For glass doors, use window constructions; for opaque doors, use opaque constructions
        gds_c = self.gds_parser.get_constructions_for_boundary(bc, is_window=is_glass)
        for name in sorted(gds_c.keys()):
            self.door_constr_dropdown.Items.Add("[GDS] " + name)
        
        try:
            if is_glass:
                from honeybee_energy.lib.constructions import WINDOW_CONSTRUCTIONS
                for c in sorted(WINDOW_CONSTRUCTIONS):
                    self.door_constr_dropdown.Items.Add("[HB] " + c)
            else:
                from honeybee_energy.lib.constructions import OPAQUE_CONSTRUCTIONS
                for c in sorted(OPAQUE_CONSTRUCTIONS):
                    self.door_constr_dropdown.Items.Add("[HB] " + c)
        except:
            pass
        self.door_constr_dropdown.SelectedIndex = 0
        
        # Modifiers
        self.door_mod_dropdown.Items.Clear()
        self.door_mod_dropdown.Items.Add("<Unchanged>")
        gds_m = self.gds_parser.get_modifiers_for_boundary(bc, is_glass=is_glass)
        for name in sorted(gds_m.keys()):
            self.door_mod_dropdown.Items.Add("[GDS] " + name)
        try:
            from honeybee_radiance.lib.modifiers import MODIFIERS
            for m in sorted(MODIFIERS):
                self.door_mod_dropdown.Items.Add("[HB] " + m)
        except:
            pass
        self.door_mod_dropdown.SelectedIndex = 0
    
    def _on_filter_faces(self, sender, e):
        self._refresh_face_grid()
    
    def _on_filter_apertures(self, sender, e):
        self._refresh_ap_grid()
    
    def _on_filter_doors(self, sender, e):
        """NEW: Handle door filter button click"""
        self._refresh_door_grid()
    
    def _on_face_selection_changed(self, sender, e):
        selected_indices = list(self.face_grid.SelectedRows)
        if not selected_indices:
            self.face_selection_info.Text = "No selection"
        else:
            self.face_selection_info.Text = "Selected: {} face(s)".format(len(selected_indices))
            first_idx = selected_indices[0]
            if first_idx < len(self.filtered_faces):
                bc = self.filtered_faces[first_idx]['bc']
                self._update_face_dropdowns(bc)
        self._update_preview()
    
    def _on_ap_selection_changed(self, sender, e):
        selected_indices = list(self.ap_grid.SelectedRows)
        if not selected_indices:
            self.ap_selection_info.Text = "No selection"
        else:
            self.ap_selection_info.Text = "Selected: {} aperture(s)".format(len(selected_indices))
            first_idx = selected_indices[0]
            if first_idx < len(self.filtered_apertures):
                bc = self.filtered_apertures[first_idx]['bc']
                self._update_ap_dropdowns(bc)
        self._update_preview()
    
    def _on_door_selection_changed(self, sender, e):
        """NEW: Handle door selection change"""
        selected_indices = list(self.door_grid.SelectedRows)
        if not selected_indices:
            self.door_selection_info.Text = "No selection"
        else:
            self.door_selection_info.Text = "Selected: {} door(s)".format(len(selected_indices))
            first_idx = selected_indices[0]
            if first_idx < len(self.filtered_doors):
                door = self.filtered_doors[first_idx]
                bc = door['bc']
                is_glass = door.get('is_glass', False)
                self._update_door_dropdowns(bc, is_glass)
        self._update_preview()
    
    def _apply_to_faces(self, faces_to_modify):
        constr = str(self.face_constr_dropdown.Items[self.face_constr_dropdown.SelectedIndex])
        mod = str(self.face_mod_dropdown.Items[self.face_mod_dropdown.SelectedIndex])
        for f in faces_to_modify:
            fid = f['id']
            if constr != "<Unchanged>" or mod != "<Unchanged>":
                if fid not in self.modified_faces:
                    self.modified_faces[fid] = {}
                if constr != "<Unchanged>":
                    self.modified_faces[fid]['construction'] = constr
                    f['construction'] = constr
                if mod != "<Unchanged>":
                    self.modified_faces[fid]['modifier'] = mod
                    f['modifier'] = mod
        self._refresh_face_grid()
        self._update_status()
        self._update_preview()
    
    def _apply_to_apertures(self, apertures_to_modify):
        constr = str(self.ap_constr_dropdown.Items[self.ap_constr_dropdown.SelectedIndex])
        mod = str(self.ap_mod_dropdown.Items[self.ap_mod_dropdown.SelectedIndex])
        for a in apertures_to_modify:
            aid = a['id']
            if constr != "<Unchanged>" or mod != "<Unchanged>":
                if aid not in self.modified_apertures:
                    self.modified_apertures[aid] = {}
                if constr != "<Unchanged>":
                    self.modified_apertures[aid]['construction'] = constr
                    a['construction'] = constr
                if mod != "<Unchanged>":
                    self.modified_apertures[aid]['modifier'] = mod
                    a['modifier'] = mod
        self._refresh_ap_grid()
        self._update_status()
        self._update_preview()
    
    def _apply_to_doors(self, doors_to_modify):
        """NEW: Apply construction and modifier to doors"""
        constr = str(self.door_constr_dropdown.Items[self.door_constr_dropdown.SelectedIndex])
        mod = str(self.door_mod_dropdown.Items[self.door_mod_dropdown.SelectedIndex])
        for d in doors_to_modify:
            did = d['id']
            if constr != "<Unchanged>" or mod != "<Unchanged>":
                if did not in self.modified_doors:
                    self.modified_doors[did] = {}
                if constr != "<Unchanged>":
                    self.modified_doors[did]['construction'] = constr
                    self.modified_doors[did]['is_glass'] = d.get('is_glass', False)
                    d['construction'] = constr
                if mod != "<Unchanged>":
                    self.modified_doors[did]['modifier'] = mod
                    self.modified_doors[did]['is_glass'] = d.get('is_glass', False)
                    d['modifier'] = mod
        self._refresh_door_grid()
        self._update_status()
        self._update_preview()
    
    def _on_set_selected_faces(self, sender, e):
        selected_indices = list(self.face_grid.SelectedRows)
        if not selected_indices:
            self.face_selection_info.Text = "No faces selected"
            return
        faces_to_modify = [self.filtered_faces[i] for i in selected_indices if i < len(self.filtered_faces)]
        self._apply_to_faces(faces_to_modify)
        self.face_selection_info.Text = "Set {} face(s)".format(len(faces_to_modify))
    
    def _on_set_all_faces(self, sender, e):
        self._apply_to_faces(self.filtered_faces)
        self.face_selection_info.Text = "Set all {} filtered faces".format(len(self.filtered_faces))
    
    def _on_set_selected_apertures(self, sender, e):
        selected_indices = list(self.ap_grid.SelectedRows)
        if not selected_indices:
            self.ap_selection_info.Text = "No apertures selected"
            return
        apertures_to_modify = [self.filtered_apertures[i] for i in selected_indices if i < len(self.filtered_apertures)]
        self._apply_to_apertures(apertures_to_modify)
        self.ap_selection_info.Text = "Set {} aperture(s)".format(len(apertures_to_modify))
    
    def _on_set_all_apertures(self, sender, e):
        self._apply_to_apertures(self.filtered_apertures)
        self.ap_selection_info.Text = "Set all {} filtered apertures".format(len(self.filtered_apertures))
    
    def _on_set_selected_doors(self, sender, e):
        """NEW: Set properties for selected doors"""
        selected_indices = list(self.door_grid.SelectedRows)
        if not selected_indices:
            self.door_selection_info.Text = "No doors selected"
            return
        doors_to_modify = [self.filtered_doors[i] for i in selected_indices if i < len(self.filtered_doors)]
        self._apply_to_doors(doors_to_modify)
        self.door_selection_info.Text = "Set {} door(s)".format(len(doors_to_modify))
    
    def _on_set_all_doors(self, sender, e):
        """NEW: Set properties for all filtered doors"""
        self._apply_to_doors(self.filtered_doors)
        self.door_selection_info.Text = "Set all {} filtered doors".format(len(self.filtered_doors))
    
    def _on_clear(self, sender, e):
        self.modified_faces = {}
        self.modified_apertures = {}
        self.modified_doors = {}
        self.shading_config = {}
        self.hvac_systems = {}
        self.room_hvac_assignments = {}
        self.room_hvac_names = {}
        self.program_assignments = {}
        for f in self.face_list:
            f['construction'] = '<Unchanged>'
            f['modifier'] = '<Unchanged>'
        for a in self.aperture_list:
            a['construction'] = '<Unchanged>'
            a['modifier'] = '<Unchanged>'
        for d in self.door_list:
            d['construction'] = '<Unchanged>'
            d['modifier'] = '<Unchanged>'
        if STORAGE_KEY in sc.sticky:
            del sc.sticky[STORAGE_KEY]
        self._refresh_face_grid()
        self._refresh_ap_grid()
        self._refresh_door_grid()
        self._refresh_shade_wall_grid()
        self._refresh_shade_ap_grid()
        self._refresh_shade_door_grid()
        self._refresh_hvac_room_grid()
        self._refresh_hvac_systems_grid()
        self._suggest_system_name()
        self._update_status()
        clear_preview_component(self.preview_nickname)
    
    def _on_cancel(self, sender, e):
        clear_preview_component(self.preview_nickname)
        if DIALOG_KEY in sc.sticky:
            del sc.sticky[DIALOG_KEY]
        self.Close()
    
    def _on_save(self, sender, e):
        """Save settings without closing UI or triggering downstream"""
        sc.sticky[STORAGE_KEY] = {
            'faces': dict(self.modified_faces),
            'apertures': dict(self.modified_apertures),
            'doors': dict(self.modified_doors),
            'shading': dict(self.shading_config),
            'hvac_systems': dict(self.hvac_systems),
            'room_hvac_assignments': dict(self.room_hvac_assignments),
            'room_hvac_names': dict(self.room_hvac_names),
            'program_assignments': dict(self.program_assignments),
            'room_exhaust_assignments': {rid: list(v) for rid, v in self.room_exhaust_assignments.items()},
            'force_update': False
        }
        shade_count = len(self.shading_config)
        hvac_count = len(self.room_hvac_assignments)
        self.status_label.Text = "Saved: {} faces, {} aps, {} doors, {} shades, {} HVAC rooms".format(
            len(self.modified_faces), len(self.modified_apertures), len(self.modified_doors), shade_count, hvac_count)
    
    def _on_apply(self, sender, e):
        """Save and close, but DON'T trigger downstream simulation"""
        sc.sticky[STORAGE_KEY] = {
            'faces': dict(self.modified_faces),
            'apertures': dict(self.modified_apertures),
            'doors': dict(self.modified_doors),
            'shading': dict(self.shading_config),
            'hvac_systems': dict(self.hvac_systems),
            'room_hvac_assignments': dict(self.room_hvac_assignments),
            'room_hvac_names': dict(self.room_hvac_names),
            'program_assignments': dict(self.program_assignments),
            'room_exhaust_assignments': {rid: list(v) for rid, v in self.room_exhaust_assignments.items()},
            'force_update': True
        }
        sc.sticky[RELEASE_OUTPUT_KEY] = False
        clear_preview_component(self.preview_nickname)
        if DIALOG_KEY in sc.sticky:
            del sc.sticky[DIALOG_KEY]
        expire_gh_component()
        self.Close()
    
    def _on_save_and_run(self, sender, e):
        """Save and trigger downstream simulation, but keep UI open"""
        sc.sticky[STORAGE_KEY] = {
            'faces': dict(self.modified_faces),
            'apertures': dict(self.modified_apertures),
            'doors': dict(self.modified_doors),
            'shading': dict(self.shading_config),
            'hvac_systems': dict(self.hvac_systems),
            'room_hvac_assignments': dict(self.room_hvac_assignments),
            'room_hvac_names': dict(self.room_hvac_names),
            'program_assignments': dict(self.program_assignments),
            'room_exhaust_assignments': {rid: list(v) for rid, v in self.room_exhaust_assignments.items()},
            'force_update': True
        }
        sc.sticky[RELEASE_OUTPUT_KEY] = True
        expire_gh_component()
        shade_count = len(self.shading_config)
        hvac_count = len(self.room_hvac_assignments)
        self.status_label.Text = "Running: {} faces, {} aps, {} doors, {} shades, {} HVAC rooms".format(
            len(self.modified_faces), len(self.modified_apertures), len(self.modified_doors), shade_count, hvac_count)
    
    def _on_form_closed(self, sender, e):
        clear_preview_component(self.preview_nickname)
        if DIALOG_KEY in sc.sticky:
            del sc.sticky[DIALOG_KEY]

def get_construction_dict(identifier, gds_constructions, is_window=False):
    """Get construction as dictionary for embedding in model JSON"""
    if not identifier or identifier == '<Unchanged>':
        return None
    
    if identifier.startswith("[GDS] "):
        name = identifier[6:]
        if name in gds_constructions:
            return gds_constructions[name]['hb_dict']
    
    elif identifier.startswith("[HB] "):
        hb_id = identifier[5:]
        try:
            if is_window:
                from honeybee_energy.lib.constructions import window_construction_by_identifier
                return window_construction_by_identifier(hb_id).to_dict()
            else:
                from honeybee_energy.lib.constructions import opaque_construction_by_identifier
                return opaque_construction_by_identifier(hb_id).to_dict()
        except:
            try:
                if is_window:
                    from honeybee_energy.lib.constructions import opaque_construction_by_identifier
                    return opaque_construction_by_identifier(hb_id).to_dict()
                else:
                    from honeybee_energy.lib.constructions import window_construction_by_identifier
                    return window_construction_by_identifier(hb_id).to_dict()
            except:
                pass
    return None

def get_modifier_dict(identifier, gds_modifiers):
    """Get modifier as dictionary for embedding in model JSON"""
    if not identifier or identifier == '<Unchanged>':
        return None
    
    if identifier.startswith("[GDS] "):
        name = identifier[6:]
        if name in gds_modifiers:
            return gds_modifiers[name]['hb_dict']
    
    elif identifier.startswith("[HB] "):
        hb_id = identifier[5:]
        try:
            from honeybee_radiance.lib.modifiers import modifier_by_identifier
            return modifier_by_identifier(hb_id).to_dict()
        except:
            pass
    return None

def apply_shading_to_model(hb_model, shading_config):
    """
    Apply shading configurations to HB model using native HB methods.
    Must be called BEFORE to_dict() since it modifies live objects.
    
    Returns count of shades applied.
    """
    shade_count = 0
    error_count = 0
    
    for room in hb_model.rooms:
        for face in room.faces:
            face_id = face.identifier
            
            if face_id in shading_config:
                config = shading_config[face_id]
                if config.get('type') == 'wall_overhang':
                    try:
                        depth = config.get('depth', 0.5)
                        angle = config.get('angle', 0)
                        face.overhang(depth, angle=angle, indoor=False)
                        shade_count += 1
                    except Exception as ex:
                        print("Wall overhang error on {}: {}".format(face_id, ex))
                        error_count += 1
            
            for aperture in face.apertures:
                ap_id = aperture.identifier
                if ap_id in shading_config:
                    config = shading_config[ap_id]
                    if config.get('type') == 'aperture_shading':
                        try:
                            if 'overhang' in config:
                                oh = config['overhang']
                                aperture.overhang(oh['depth'], angle=oh['angle'], indoor=False)
                                shade_count += 1
                            if 'fins' in config:
                                fin = config['fins']
                                aperture.right_fin(fin['depth'], angle=fin['angle'], indoor=False)
                                aperture.left_fin(fin['depth'], angle=fin['angle'], indoor=False)
                                shade_count += 2
                            if 'louvers' in config:
                                louv = config['louvers']
                                aperture.louvers_by_count(
                                    louv['count'], louv['depth'],
                                    offset=louv['offset'], angle=louv['angle'],
                                    indoor=False
                                )
                                shade_count += louv['count']
                        except Exception as ex:
                            print("Aperture shading error on {}: {}".format(ap_id, ex))
                            error_count += 1
            
            for door in face.doors:
                door_id = door.identifier
                if door_id in shading_config:
                    config = shading_config[door_id]
                    if config.get('type') == 'door_canopy':
                        try:
                            depth = config.get('depth', 1.0)
                            door.overhang(depth, angle=0, indoor=False)
                            shade_count += 1
                        except Exception as ex:
                            print("Door canopy error on {}: {}".format(door_id, ex))
                            error_count += 1
    
    return shade_count, error_count

def build_hvac_dict(system_name, hvac_config):
    """
    Build HVAC dict in HB schema format.
    system_name: The shared identifier for this HVAC system
    hvac_config: Configuration dict with class, equipment_type, vintage, etc.
    """
    class_name = hvac_config.get('class', 'IdealAirSystem')
    
    hvac_dict = {
        'identifier': system_name
    }
    
    if class_name == 'IdealAirSystem':
        hvac_dict['type'] = 'IdealAirSystemAbridged'
        hvac_dict['economizer_type'] = hvac_config.get('economizer_type', 'NoEconomizer')
        hvac_dict['sensible_heat_recovery'] = hvac_config.get('sensible_heat_recovery', 0)
        hvac_dict['latent_heat_recovery'] = hvac_config.get('latent_heat_recovery', 0)
        hvac_dict['demand_controlled_ventilation'] = hvac_config.get('demand_controlled_ventilation', False)
    
    elif class_name == 'VAV':
        hvac_dict['type'] = 'VAV'
        hvac_dict['vintage'] = hvac_config.get('vintage', 'ASHRAE_2019')
        hvac_dict['equipment_type'] = hvac_config.get('equipment_type', 'VAV_Chiller_Boiler')
        hvac_dict['economizer_type'] = hvac_config.get('economizer_type', 'NoEconomizer')
        hvac_dict['sensible_heat_recovery'] = hvac_config.get('sensible_heat_recovery', 0)
        hvac_dict['latent_heat_recovery'] = hvac_config.get('latent_heat_recovery', 0)
        hvac_dict['demand_controlled_ventilation'] = hvac_config.get('demand_controlled_ventilation', False)
    
    elif class_name == 'PVAV':
        hvac_dict['type'] = 'PVAV'
        hvac_dict['vintage'] = hvac_config.get('vintage', 'ASHRAE_2019')
        hvac_dict['equipment_type'] = hvac_config.get('equipment_type', 'PVAV_Boiler')
        hvac_dict['economizer_type'] = hvac_config.get('economizer_type', 'NoEconomizer')
        hvac_dict['sensible_heat_recovery'] = hvac_config.get('sensible_heat_recovery', 0)
        hvac_dict['latent_heat_recovery'] = hvac_config.get('latent_heat_recovery', 0)
        hvac_dict['demand_controlled_ventilation'] = hvac_config.get('demand_controlled_ventilation', False)
    
    elif class_name == 'PSZ':
        hvac_dict['type'] = 'PSZ'
        hvac_dict['vintage'] = hvac_config.get('vintage', 'ASHRAE_2019')
        hvac_dict['equipment_type'] = hvac_config.get('equipment_type', 'PSZAC')
        hvac_dict['economizer_type'] = hvac_config.get('economizer_type', 'NoEconomizer')
        hvac_dict['sensible_heat_recovery'] = hvac_config.get('sensible_heat_recovery', 0)
        hvac_dict['latent_heat_recovery'] = hvac_config.get('latent_heat_recovery', 0)
        hvac_dict['demand_controlled_ventilation'] = hvac_config.get('demand_controlled_ventilation', False)
    
    elif class_name == 'FCUwithDOAS':
        hvac_dict['type'] = 'FCUwithDOAS'
        hvac_dict['vintage'] = hvac_config.get('vintage', 'ASHRAE_2019')
        hvac_dict['equipment_type'] = hvac_config.get('equipment_type', 'DOAS_FCU_Chiller_Boiler')
        hvac_dict['sensible_heat_recovery'] = hvac_config.get('sensible_heat_recovery', 0)
        hvac_dict['latent_heat_recovery'] = hvac_config.get('latent_heat_recovery', 0)
        hvac_dict['demand_controlled_ventilation'] = hvac_config.get('demand_controlled_ventilation', False)
    
    elif class_name == 'VRFwithDOAS':
        hvac_dict['type'] = 'VRFwithDOAS'
        hvac_dict['vintage'] = hvac_config.get('vintage', 'ASHRAE_2019')
        hvac_dict['equipment_type'] = hvac_config.get('equipment_type', 'DOAS_VRF')
        hvac_dict['sensible_heat_recovery'] = hvac_config.get('sensible_heat_recovery', 0)
        hvac_dict['latent_heat_recovery'] = hvac_config.get('latent_heat_recovery', 0)
        hvac_dict['demand_controlled_ventilation'] = hvac_config.get('demand_controlled_ventilation', False)
    
    elif class_name == 'RadiantwithDOAS':
        hvac_dict['type'] = 'RadiantwithDOAS'
        hvac_dict['vintage'] = hvac_config.get('vintage', 'ASHRAE_2019')
        hvac_dict['equipment_type'] = hvac_config.get('equipment_type', 'DOAS_Radiant_Chiller_Boiler')
        hvac_dict['sensible_heat_recovery'] = hvac_config.get('sensible_heat_recovery', 0)
        hvac_dict['latent_heat_recovery'] = hvac_config.get('latent_heat_recovery', 0)
        hvac_dict['demand_controlled_ventilation'] = hvac_config.get('demand_controlled_ventilation', False)
        hvac_dict['radiant_type'] = hvac_config.get('radiant_type', 'Floor')
    
    elif class_name == 'WSHPwithDOAS':
        hvac_dict['type'] = 'WSHPwithDOAS'
        hvac_dict['vintage'] = hvac_config.get('vintage', 'ASHRAE_2019')
        hvac_dict['equipment_type'] = hvac_config.get('equipment_type', 'DOAS_WSHP_FluidCooler_Boiler')
        hvac_dict['sensible_heat_recovery'] = hvac_config.get('sensible_heat_recovery', 0)
        hvac_dict['latent_heat_recovery'] = hvac_config.get('latent_heat_recovery', 0)
        hvac_dict['demand_controlled_ventilation'] = hvac_config.get('demand_controlled_ventilation', False)
    
    elif class_name == 'Residential':
        hvac_dict['type'] = 'Residential'
        hvac_dict['vintage'] = hvac_config.get('vintage', 'ASHRAE_2019')
        hvac_dict['equipment_type'] = hvac_config.get('equipment_type', 'ResidentialAC_ResidentialFurnace')
    
    elif class_name == 'Baseboard':
        hvac_dict['type'] = 'Baseboard'
        hvac_dict['vintage'] = hvac_config.get('vintage', 'ASHRAE_2019')
        hvac_dict['equipment_type'] = hvac_config.get('equipment_type', 'ElectricBaseboard')
    
    elif class_name == 'Radiant':
        hvac_dict['type'] = 'Radiant'
        hvac_dict['vintage'] = hvac_config.get('vintage', 'ASHRAE_2019')
        hvac_dict['equipment_type'] = hvac_config.get('equipment_type', 'Radiant_Chiller_Boiler')
        hvac_dict['radiant_type'] = hvac_config.get('radiant_type', 'Floor')
    
    else:
        hvac_dict['type'] = 'IdealAirSystemAbridged'
        hvac_dict['economizer_type'] = 'NoEconomizer'
        hvac_dict['sensible_heat_recovery'] = 0
        hvac_dict['latent_heat_recovery'] = 0
        hvac_dict['demand_controlled_ventilation'] = False
    
    return hvac_dict

def build_modified_model_file(hb_model, modified_faces, modified_apertures, modified_doors, shading_config, hvac_systems, room_hvac_assignments, program_assignments, gds_parser, output_path, case_suffix="designcase", room_exhaust_assignments=None):
    """
    Build complete modified model and save to .hbjson file.
    
    v8: Added case_suffix parameter for model naming and sim_folder output.
    v6: HVAC system grouping - multiple rooms can share the same HVAC system.
    hvac_systems: dict of system_name -> config
    room_hvac_assignments: dict of room_id -> system_name
    
    Returns: (hbjson_path, sim_folder, report)
    """
    report_lines = ["Model Modification Report", "=" * 40]
    
    # Step 0: Apply shading to live model BEFORE converting to dict
    shade_count = 0
    shade_errors = 0
    if shading_config:
        shade_count, shade_errors = apply_shading_to_model(hb_model, shading_config)
        if shade_count > 0:
            report_lines.append("Shading: {} shades applied".format(shade_count))
            if shade_errors > 0:
                report_lines.append("  ({} shading errors)".format(shade_errors))
    
    # Step 0.5: Build VentilationFan dicts for later injection into model_dict.
    # We build them HERE while we have direct access to hb_model.rooms (for ID matching),
    # but inject AFTER to_dict() to avoid isinstance issues with HB's property setters.
    exh_count = 0
    fan_dicts_by_room_id = {}  # room.identifier -> [fan_dict, ...]
    exh_diag_lines = []
    exh_diag_lines.append("=== Exhaust Fan Diagnostic ===")
    exh_diag_lines.append("room_exhaust_assignments keys ({}): {}".format(
        len(room_exhaust_assignments) if room_exhaust_assignments else 0,
        list(room_exhaust_assignments.keys())[:5] if room_exhaust_assignments else []))
    exh_diag_lines.append("Model has {} rooms".format(len(list(hb_model.rooms))))
    if hb_model.rooms:
        sample_ids = [r.identifier for r in list(hb_model.rooms)[:3]]
        exh_diag_lines.append("Sample room.identifier: {}".format(sample_ids))
    
    if room_exhaust_assignments:
        try:
            from honeybee_energy.ventcool.fan import VentilationFan
            exh_diag_lines.append("VentilationFan imported OK")
        except ImportError as imp_ex:
            exh_diag_lines.append("VentilationFan IMPORT FAILED: {}".format(imp_ex))
            VentilationFan = None
            report_lines.append("Exhaust: VentilationFan import failed ({})".format(imp_ex))
        
        if VentilationFan is not None:
            # Build name->room and id->room maps
            name_to_room = {}
            id_to_room = {}
            for room in hb_model.rooms:
                id_to_room[room.identifier] = room
                if room.display_name:
                    name_to_room[room.display_name] = room
            
            for stored_key, specs in room_exhaust_assignments.items():
                room = id_to_room.get(stored_key)
                match_mode = "identifier"
                if room is None:
                    room = name_to_room.get(stored_key)
                    match_mode = "display_name"
                if room is None:
                    exh_diag_lines.append("NO MATCH for stored key '{}'".format(stored_key[:40]))
                    continue
                exh_diag_lines.append("Match for '{}' (via {}): {} spec(s)".format(
                    stored_key[:40], match_mode, len(specs)))
                
                room_fan_dicts = []
                for i, spec in enumerate(specs):
                    fan_id = "{}_Exh_{}".format(room.identifier[:40], i)
                    flow_rate = float(spec.get('flow', 0.012))
                    vent_type = str(spec.get('vent_type', 'Exhaust'))
                    pressure_rise = float(spec.get('pressure_rise', 100.0))
                    efficiency = float(spec.get('fan_efficiency', 0.5))
                    
                    fan_dict = None
                    # Try: construct positionally, setattr the rest, call to_dict()
                    try:
                        fan = VentilationFan(fan_id, flow_rate)
                        # Set optional props via setattr (works regardless of constructor signature)
                        for attr_name, attr_val in [('vent_type', vent_type),
                                                     ('pressure_rise', pressure_rise),
                                                     ('efficiency', efficiency)]:
                            try:
                                setattr(fan, attr_name, attr_val)
                            except Exception as sa_ex:
                                exh_diag_lines.append("  setattr {}={}: {}".format(attr_name, attr_val, sa_ex))
                        # Get HB's official dict representation
                        try:
                            fan_dict = fan.to_dict()
                            exh_diag_lines.append("  fan.to_dict() OK for {}: keys={}".format(
                                fan_id[:40], list(fan_dict.keys())))
                        except Exception as td_ex:
                            exh_diag_lines.append("  fan.to_dict() FAILED for {}: {}".format(
                                fan_id[:40], td_ex))
                        
                        # Force user's UI choices into the dict regardless of HB version's
                        # property name conventions. Write BOTH naming variants so HB Load
                        # Objects accepts the dict whichever it expects.
                        if fan_dict is not None:
                            fan_dict['ventilation_type'] = vent_type
                            fan_dict['vent_type'] = vent_type
                            fan_dict['flow_rate'] = flow_rate
                            fan_dict['pressure_rise'] = pressure_rise
                            fan_dict['efficiency'] = efficiency
                            exh_diag_lines.append("  Forced ventilation_type={} into dict".format(vent_type))
                    except Exception as ctor_ex:
                        exh_diag_lines.append("  VentilationFan ctor FAILED for {}: {}".format(
                            fan_id[:40], ctor_ex))
                    
                    # Fallback: manual dict matching HB schema
                    if fan_dict is None:
                        fan_dict = {
                            'type': 'VentilationFan',
                            'identifier': fan_id,
                            'flow_rate': flow_rate,
                            'vent_type': vent_type,
                            'pressure_rise': pressure_rise,
                            'efficiency': efficiency,
                        }
                        exh_diag_lines.append("  Using fallback manual dict for {}".format(fan_id[:40]))
                    
                    room_fan_dicts.append(fan_dict)
                    exh_count += 1
                
                if room_fan_dicts:
                    fan_dicts_by_room_id[room.identifier] = room_fan_dicts
        
        if exh_count > 0:
            report_lines.append("Exhaust: {} fan dict(s) prepared".format(exh_count))
        else:
            report_lines.append("Exhaust: 0 fan dicts prepared (see diagnostic log)")
    else:
        exh_diag_lines.append("room_exhaust_assignments is empty/None")
        # Now convert to dict
    model_dict = hb_model.to_dict()
    
    # Step 0.5b: Inject exhaust fan dicts into model_dict (bypasses isinstance issues)
    if fan_dicts_by_room_id:
        attached_count = 0
        for room_dict in model_dict.get('rooms', []):
            rid = room_dict.get('identifier', '')
            if rid not in fan_dicts_by_room_id:
                continue
            if 'properties' not in room_dict:
                room_dict['properties'] = {}
            if 'energy' not in room_dict['properties']:
                room_dict['properties']['energy'] = {}
            existing_fans = room_dict['properties']['energy'].get('fans', [])
            if not isinstance(existing_fans, list):
                existing_fans = []
            new_fans_for_room = fan_dicts_by_room_id[rid]
            room_dict['properties']['energy']['fans'] = existing_fans + new_fans_for_room
            attached_count += len(new_fans_for_room)
            exh_diag_lines.append("Injected {} fan(s) into model_dict for '{}'".format(
                len(new_fans_for_room), rid[:40]))
        report_lines.append("Exhaust: {} fan(s) injected into model_dict".format(attached_count))
    
    # Write diagnostic log next to output file
    try:
        import os as _os
        _diag_path = _os.path.join(_os.path.dirname(output_path), "exhaust_diagnostic.log")
        with open(_diag_path, "w") as _df:
            _df.write("\n".join(exh_diag_lines))
        report_lines.append("Exhaust diagnostic written: {}".format(_diag_path))
    except Exception as _diag_ex:
        report_lines.append("Failed to write exhaust diagnostic: {}".format(_diag_ex))
    
    # Set model name with case suffix
    model_name = "GDS_{}".format(case_suffix.lstrip('_').replace(' ', '_'))
    model_dict['identifier'] = model_name
    model_dict['display_name'] = model_name
    
    # Step 1: Collect all unique constructions and modifiers
    construction_library = {}
    modifier_library = {}
    hvac_library = {}  # system_name -> hvac_dict (only one entry per system)
    
    # From faces
    for face_id, props in modified_faces.items():
        constr_id = props.get('construction', '')
        if constr_id and constr_id != '<Unchanged>':
            constr_dict = get_construction_dict(constr_id, gds_parser.constructions, is_window=False)
            if constr_dict:
                construction_library[constr_dict['identifier']] = constr_dict
        
        mod_id = props.get('modifier', '')
        if mod_id and mod_id != '<Unchanged>':
            mod_dict = get_modifier_dict(mod_id, gds_parser.modifiers)
            if mod_dict:
                modifier_library[mod_dict['identifier']] = mod_dict
    
    # From apertures
    for ap_id, props in modified_apertures.items():
        constr_id = props.get('construction', '')
        if constr_id and constr_id != '<Unchanged>':
            constr_dict = get_construction_dict(constr_id, gds_parser.constructions, is_window=True)
            if constr_dict:
                construction_library[constr_dict['identifier']] = constr_dict
        
        mod_id = props.get('modifier', '')
        if mod_id and mod_id != '<Unchanged>':
            mod_dict = get_modifier_dict(mod_id, gds_parser.modifiers)
            if mod_dict:
                modifier_library[mod_dict['identifier']] = mod_dict
    
    # NEW: From doors
    for door_id, props in modified_doors.items():
        is_glass = props.get('is_glass', False)
        constr_id = props.get('construction', '')
        if constr_id and constr_id != '<Unchanged>':
            constr_dict = get_construction_dict(constr_id, gds_parser.constructions, is_window=is_glass)
            if constr_dict:
                construction_library[constr_dict['identifier']] = constr_dict
        
        mod_id = props.get('modifier', '')
        if mod_id and mod_id != '<Unchanged>':
            mod_dict = get_modifier_dict(mod_id, gds_parser.modifiers)
            if mod_dict:
                modifier_library[mod_dict['identifier']] = mod_dict
    
    # Step 2: Add constructions to model's energy properties library
    if construction_library:
        if 'properties' not in model_dict:
            model_dict['properties'] = {}
        if 'energy' not in model_dict['properties']:
            model_dict['properties']['energy'] = {}
        if 'constructions' not in model_dict['properties']['energy']:
            model_dict['properties']['energy']['constructions'] = []
        
        existing_constr_ids = {c['identifier'] for c in model_dict['properties']['energy']['constructions']}
        
        for constr_id, constr_data in construction_library.items():
            if constr_id not in existing_constr_ids:
                model_dict['properties']['energy']['constructions'].append(constr_data)
    
    # Step 3: Add modifiers to model's radiance properties library
    if modifier_library:
        if 'properties' not in model_dict:
            model_dict['properties'] = {}
        if 'radiance' not in model_dict['properties']:
            model_dict['properties']['radiance'] = {}
        if 'modifiers' not in model_dict['properties']['radiance']:
            model_dict['properties']['radiance']['modifiers'] = []
        
        existing_mod_ids = {m['identifier'] for m in model_dict['properties']['radiance']['modifiers']}
        
        for mod_id, mod_data in modifier_library.items():
            if mod_id not in existing_mod_ids:
                model_dict['properties']['radiance']['modifiers'].append(mod_data)
    
    # Step 4: Apply assignments to faces, apertures, and doors
    total_faces_modified = 0
    total_apertures_modified = 0
    total_doors_modified = 0
    total_hvac_modified = 0
    
    for room_dict in model_dict.get('rooms', []):
        room_id = room_dict.get('identifier', '')
        room_name = room_dict.get('display_name', room_id)
        
        room_faces_mod = 0
        room_aps_mod = 0
        room_doors_mod = 0
        
        for face_dict in room_dict.get('faces', []):
            face_id = face_dict.get('identifier', '')
            
            # Face modifications
            if face_id in modified_faces:
                props = modified_faces[face_id]
                
                if 'properties' not in face_dict:
                    face_dict['properties'] = {}
                
                constr_id = props.get('construction', '')
                if constr_id and constr_id != '<Unchanged>':
                    constr_dict = get_construction_dict(constr_id, gds_parser.constructions, is_window=False)
                    if constr_dict:
                        if 'energy' not in face_dict['properties']:
                            face_dict['properties']['energy'] = {}
                        face_dict['properties']['energy']['construction'] = constr_dict['identifier']
                        room_faces_mod += 1
                
                mod_id = props.get('modifier', '')
                if mod_id and mod_id != '<Unchanged>':
                    mod_dict = get_modifier_dict(mod_id, gds_parser.modifiers)
                    if mod_dict:
                        if 'radiance' not in face_dict['properties']:
                            face_dict['properties']['radiance'] = {}
                        face_dict['properties']['radiance']['modifier'] = mod_dict['identifier']
            
            # Aperture modifications
            for ap_dict in face_dict.get('apertures', []):
                ap_id = ap_dict.get('identifier', '')
                
                if ap_id in modified_apertures:
                    ap_props = modified_apertures[ap_id]
                    
                    if 'properties' not in ap_dict:
                        ap_dict['properties'] = {}
                    
                    ap_constr_id = ap_props.get('construction', '')
                    if ap_constr_id and ap_constr_id != '<Unchanged>':
                        ap_constr_dict = get_construction_dict(ap_constr_id, gds_parser.constructions, is_window=True)
                        if ap_constr_dict:
                            if 'energy' not in ap_dict['properties']:
                                ap_dict['properties']['energy'] = {}
                            ap_dict['properties']['energy']['construction'] = ap_constr_dict['identifier']
                            room_aps_mod += 1
                    
                    ap_mod_id = ap_props.get('modifier', '')
                    if ap_mod_id and ap_mod_id != '<Unchanged>':
                        ap_mod_dict = get_modifier_dict(ap_mod_id, gds_parser.modifiers)
                        if ap_mod_dict:
                            if 'radiance' not in ap_dict['properties']:
                                ap_dict['properties']['radiance'] = {}
                            ap_dict['properties']['radiance']['modifier'] = ap_mod_dict['identifier']
            
            # NEW: Door modifications
            for door_dict in face_dict.get('doors', []):
                door_id = door_dict.get('identifier', '')
                
                if door_id in modified_doors:
                    door_props = modified_doors[door_id]
                    is_glass = door_props.get('is_glass', False)
                    
                    if 'properties' not in door_dict:
                        door_dict['properties'] = {}
                    
                    door_constr_id = door_props.get('construction', '')
                    if door_constr_id and door_constr_id != '<Unchanged>':
                        door_constr_dict = get_construction_dict(door_constr_id, gds_parser.constructions, is_window=is_glass)
                        if door_constr_dict:
                            if 'energy' not in door_dict['properties']:
                                door_dict['properties']['energy'] = {}
                            door_dict['properties']['energy']['construction'] = door_constr_dict['identifier']
                            room_doors_mod += 1
                    
                    door_mod_id = door_props.get('modifier', '')
                    if door_mod_id and door_mod_id != '<Unchanged>':
                        door_mod_dict = get_modifier_dict(door_mod_id, gds_parser.modifiers)
                        if door_mod_dict:
                            if 'radiance' not in door_dict['properties']:
                                door_dict['properties']['radiance'] = {}
                            door_dict['properties']['radiance']['modifier'] = door_mod_dict['identifier']
        
        # HVAC application - NEW: Use system grouping
        if room_hvac_assignments and room_id in room_hvac_assignments:
            system_name = room_hvac_assignments[room_id]
            
            if system_name in hvac_systems:
                hvac_cfg = hvac_systems[system_name]
                
                # Build HVAC dict using system_name as identifier (so rooms share the system)
                if system_name not in hvac_library:
                    # First room using this system - create the HVAC dict
                    hvac_dict = build_hvac_dict(system_name, hvac_cfg)
                    hvac_library[system_name] = hvac_dict
                
                # Assign this room to the shared HVAC system
                if 'properties' not in room_dict:
                    room_dict['properties'] = {}
                if 'energy' not in room_dict['properties']:
                    room_dict['properties']['energy'] = {}
                
                room_dict['properties']['energy']['hvac'] = system_name
                total_hvac_modified += 1
                print("HVAC assigned: room='{}' -> system='{}'".format(room_id[:25], system_name[:30]))
        
        # Program override
        if program_assignments and room_id in program_assignments:
            target_pid = program_assignments[room_id]
            donor_prog = None
            for dr in model_dict.get('rooms', []):
                drp = dr.get('properties', {}).get('energy', {}).get('program_type', None)
                if drp and isinstance(drp, dict):
                    drpid = drp.get('identifier', '')
                    if drpid == target_pid or re.sub(r'_R\d+$', '', drpid) == target_pid:
                        donor_prog = dict(drp)
                        break
            if not donor_prog:
                # Fallback: load from HB library
                try:
                    from honeybee_energy.lib.programtypes import program_type_by_identifier
                    hb_prog = program_type_by_identifier(target_pid)
                    if hb_prog:
                        donor_prog = hb_prog.to_dict()
                except:
                    pass
            if donor_prog:
                donor_prog['identifier'] = target_pid + '_' + room_id[:20]
                if 'properties' not in room_dict:
                    room_dict['properties'] = {}
                if 'energy' not in room_dict['properties']:
                    room_dict['properties']['energy'] = {}
                room_dict['properties']['energy']['program_type'] = donor_prog
                print("Program: room='{}' -> '{}'".format(room_id[:25], target_pid[:30]))
        
        if room_faces_mod > 0 or room_aps_mod > 0 or room_doors_mod > 0:
            report_lines.append("'{}': {} faces, {} apertures, {} doors".format(
                room_name, room_faces_mod, room_aps_mod, room_doors_mod))
        
        total_faces_modified += room_faces_mod
        total_apertures_modified += room_aps_mod
        total_doors_modified += room_doors_mod
    
    # Step 5: Add HVAC systems to model's energy properties library
    if hvac_library:
        if 'properties' not in model_dict:
            model_dict['properties'] = {}
        if 'energy' not in model_dict['properties']:
            model_dict['properties']['energy'] = {}
        if 'hvacs' not in model_dict['properties']['energy']:
            model_dict['properties']['energy']['hvacs'] = []
        
        existing_hvac_ids = set()
        for h in model_dict['properties']['energy']['hvacs']:
            if isinstance(h, dict) and 'identifier' in h:
                existing_hvac_ids.add(h['identifier'])
        
        for hvac_id, hvac_data in hvac_library.items():
            if hvac_id not in existing_hvac_ids:
                model_dict['properties']['energy']['hvacs'].append(hvac_data)
                print("Added HVAC to model library: {}".format(hvac_id[:40]))
    
    # --- Step 6: GDS Hub Integration - Apply PV, SHW, IDF ---
    report_lines.append("")
    report_lines.append("--- GDS Hub Integration ---")
    
    # 6a: Apply PV properties from Hub
    pv_config = load_hub_pv_config()
    pv_count = 0
    pv_shade_names = []
    if pv_config:
        pv_count, pv_shade_names = apply_pv_to_model_dict(model_dict, pv_config)
        if pv_count > 0:
            report_lines.append("PV: Applied to {} shades ({:.1f}% eff)".format(
                pv_count, pv_config.get('efficiency', 0) * 100))
        else:
            report_lines.append("PV: Config found but no shades available")
    else:
        report_lines.append("PV: Not configured in Hub")
    
    # 6b: Apply SHW system from Hub
    shw_config = load_hub_shw_config()
    shw_applied = False
    shw_report = ""
    if shw_config:
        shw_applied, shw_report = apply_shw_to_model_dict(model_dict, shw_config)
        report_lines.append(shw_report if shw_applied else "SHW: Failed to apply")
    else:
        report_lines.append("SHW: Not configured in Hub")
    
    # 6c: Inject IDF from Hub (Battery, Wind)
    idf_string = load_hub_idf_injection()
    idf_injected = False
    idf_report = ""
    if idf_string:
        idf_injected, idf_report = inject_idf_to_model_dict(model_dict, idf_string)
        report_lines.append(idf_report if idf_injected else "IDF: Failed to inject")
    else:
        report_lines.append("IDF: No Battery/Wind in Hub")
    
    report_lines.append("---------------------------")
    
    # Step 7: Write to file
    try:
        with open(output_path, 'w') as f:
            json.dump(model_dict, f, indent=2)
        
        report_lines.append("")
        report_lines.append("=" * 40)
        report_lines.append("SUMMARY")
        report_lines.append("=" * 40)
        report_lines.append("Envelope: {} faces, {} apertures, {} doors".format(
            total_faces_modified, total_apertures_modified, total_doors_modified))
        report_lines.append("HVAC: {} rooms assigned".format(total_hvac_modified))
        report_lines.append("Shading: {} devices".format(shade_count))
        report_lines.append("PV: {} shades".format(pv_count))
        report_lines.append("SHW: {}".format("Applied" if shw_applied else "Not applied"))
        report_lines.append("IDF: {}".format("Injected" if idf_injected else "Not injected"))
        
        if construction_library:
            report_lines.append("")
            report_lines.append("Added {} constructions to model library:".format(len(construction_library)))
            for constr_id in construction_library.keys():
                report_lines.append("  - {}".format(constr_id))
        
        if modifier_library:
            report_lines.append("")
            report_lines.append("Added {} modifiers to model library:".format(len(modifier_library)))
            for mod_id in modifier_library.keys():
                report_lines.append("  - {}".format(mod_id))
        
        if total_hvac_modified > 0:
            report_lines.append("")
            report_lines.append("HVAC Systems ({} systems, {} rooms):".format(len(hvac_library), total_hvac_modified))
            for sys_name, sys_dict in hvac_library.items():
                room_count = sum(1 for r_id, s_name in room_hvac_assignments.items() if s_name == sys_name)
                report_lines.append("  - {} ({}) -> {} rooms".format(sys_name, sys_dict.get('type', 'Unknown'), room_count))
        
        report_lines.append("")
        report_lines.append("Saved to: {}".format(output_path))
        report_lines.append("")
        report_lines.append("Connect hbjson_path to HB Load Objects")
        report_lines.append("Connect sim_folder to HB Model to OSM _folder input")
        
        # Build simulation folder path based on model name
        base_folder = os.path.dirname(output_path)
        sim_folder = os.path.join(base_folder, model_name)
        
        return output_path, sim_folder, "\n".join(report_lines)
    
    except Exception as e:
        report_lines.append("=" * 40)
        report_lines.append("ERROR saving file: {}".format(str(e)))
        return "", None, "\n".join(report_lines)

# --- MAIN EXECUTION ---

gds_path = None
try:
    if _gds_library:
        gds_path = _gds_library
except:
    pass

preview_name = "GDS envelope preview"
try:
    if _preview_name_:
        preview_name = _preview_name_
except:
    pass

# Handle optional case suffix
case_suffix = "designcase"
try:
    if _case_suffix_:
        case_suffix = str(_case_suffix_).strip()
except:
    pass

try:
    sc.sticky[COMPONENT_KEY] = ghenv.Component
except:
    pass

# Handle _model input
model = None
try:
    if _model is not None:
        if hasattr(_model, 'rooms'):
            model = _model
        elif hasattr(_model, '__iter__'):
            for item in _model:
                if hasattr(item, 'rooms'):
                    model = item
                    break
except:
    pass

# Handle optional output path
user_output_path = None
try:
    if _output_path_:
        user_output_path = _output_path_
except:
    pass

# Initialize outputs
hbjson_path = None
sim_folder = None
out_report = ""

if model is None:
    out_report = "Connect HB Model to _model"
else:
    gds_parser = GDSLibraryParser(gds_path)
    
    prev_run = sc.sticky.get(RUN_STATE_KEY, False)
    curr_run = bool(_run)
    sc.sticky[RUN_STATE_KEY] = curr_run
    rising_edge = curr_run and not prev_run
    
    # --- Get modifications and flags ---
    if STORAGE_KEY in sc.sticky:
        stored = sc.sticky[STORAGE_KEY]
        modified_faces = stored.get('faces', {})
        modified_apertures = stored.get('apertures', {})
        modified_doors = stored.get('doors', {})
        shading_config = stored.get('shading', {})
        hvac_systems = stored.get('hvac_systems', {})
        room_hvac_assignments = stored.get('room_hvac_assignments', {})
        program_assignments = stored.get('program_assignments', {})
        room_exhaust_assignments = stored.get('room_exhaust_assignments', {})
        force_update = stored.get('force_update', False)
        
        if force_update:
            stored['force_update'] = False
            sc.sticky[STORAGE_KEY] = stored
    else:
        modified_faces = {}
        modified_apertures = {}
        modified_doors = {}
        shading_config = {}
        hvac_systems = {}
        room_hvac_assignments = {}
        program_assignments = {}
        room_exhaust_assignments = {}
        force_update = False
    
    release_output = sc.sticky.get(RELEASE_OUTPUT_KEY, False)
    if release_output:
        sc.sticky[RELEASE_OUTPUT_KEY] = False
    
    # --- CASE 1: Rising edge - ONLY open UI, never generate file ---
    if rising_edge:
        if DIALOG_KEY in sc.sticky and sc.sticky[DIALOG_KEY] is not None:
            try:
                existing = sc.sticky[DIALOG_KEY]
                if existing.Visible:
                    existing.BringToFront()
                    out_report = "Editor already open - brought to front"
                else:
                    editor = SurfacePropertyEditor()
                    editor.initialize(model, gds_parser, preview_name)
                    editor.Owner = Rhino.UI.RhinoEtoApp.MainWindow
                    sc.sticky[DIALOG_KEY] = editor
                    editor.Show()
                    out_report = "Editor opened"
            except:
                editor = SurfacePropertyEditor()
                editor.initialize(model, gds_parser, preview_name)
                editor.Owner = Rhino.UI.RhinoEtoApp.MainWindow
                sc.sticky[DIALOG_KEY] = editor
                editor.Show()
                out_report = "Editor opened"
        else:
            editor = SurfacePropertyEditor()
            editor.initialize(model, gds_parser, preview_name)
            editor.Owner = Rhino.UI.RhinoEtoApp.MainWindow
            sc.sticky[DIALOG_KEY] = editor
            editor.Show()
            out_report = "Editor opened"
        
        hbjson_path = None
    
    # CASE 2: force_update=True - User clicked Apply button, generate file
    elif force_update:
        output_file = get_output_filepath(user_output_path)
        generated_path = None
        generated_sim_folder = None
        
        if modified_faces or modified_apertures or modified_doors or shading_config or room_hvac_assignments or program_assignments or room_exhaust_assignments:
            # Build and save modified model
            generated_path, generated_sim_folder, detail_report = build_modified_model_file(
                model, modified_faces, modified_apertures, modified_doors, shading_config, hvac_systems, room_hvac_assignments, program_assignments, gds_parser, output_file, case_suffix, room_exhaust_assignments=room_exhaust_assignments)
            
            if generated_path:
                sc.sticky[MODEL_HASH_KEY] = get_model_hash(model)
                sc.sticky[LAST_MODIFICATIONS_KEY] = get_modifications_hash(modified_faces, modified_apertures, modified_doors)
                sc.sticky[OUTPUT_PATH_KEY] = generated_path
                out_report = detail_report
        else:
            # No modifications - save model with case suffix applied
            model_dict = model.to_dict()
            
            # Set model name with case suffix
            model_name = "GDS_{}".format(case_suffix.lstrip('_').replace(' ', '_'))
            model_dict['identifier'] = model_name
            model_dict['display_name'] = model_name
            
            try:
                with open(output_file, 'w') as f:
                    json.dump(model_dict, f, indent=2)
                
                generated_path = output_file
                generated_sim_folder = os.path.join(os.path.dirname(output_file), model_name)
                sc.sticky[MODEL_HASH_KEY] = get_model_hash(model)
                sc.sticky[LAST_MODIFICATIONS_KEY] = get_modifications_hash(modified_faces, modified_apertures, modified_doors)
                sc.sticky[OUTPUT_PATH_KEY] = generated_path
                
                face_count = sum(len(room_dict.get('faces', [])) 
                               for room_dict in model_dict.get('rooms', []))
                ap_count = sum(len(face_dict.get('apertures', [])) 
                             for room_dict in model_dict.get('rooms', [])
                             for face_dict in room_dict.get('faces', []))
                door_count = sum(len(face_dict.get('doors', [])) 
                               for room_dict in model_dict.get('rooms', [])
                               for face_dict in room_dict.get('faces', []))
                
                report_lines = [
                    "Original Model Saved (No Modifications)",
                    "Model Name: {}".format(model_name),
                    "=" * 40,
                    "Rooms: {}".format(len(model_dict.get('rooms', []))),
                    "Faces: {}".format(face_count),
                    "Apertures: {}".format(ap_count),
                    "Doors: {}".format(door_count),
                    "",
                    "Saved to: {}".format(output_file),
                    "Sim folder: {}".format(generated_sim_folder)
                ]
                out_report = "\n".join(report_lines)
            
            except Exception as e:
                generated_path = None
                generated_sim_folder = None
                out_report = "ERROR saving model: {}".format(str(e))
        
        if release_output and generated_path:
            hbjson_path = generated_path
            sim_folder = generated_sim_folder
            out_report += "\n\n>>> RUNNING: Output sent to downstream components <<<"
        else:
            hbjson_path = None
            sim_folder = generated_sim_folder  # Still provide sim_folder even without triggering
            if generated_path:
                out_report += "\n\nFile saved. Click 'Save & Run' to trigger simulation."
    
    # --- CASE 3: No action - return None, file ready for manual trigger ---
    else:
        cached_path = sc.sticky.get(OUTPUT_PATH_KEY, None)
        
        if cached_path and os.path.exists(cached_path):
            current_model_hash = get_model_hash(model)
            stored_model_hash = sc.sticky.get(MODEL_HASH_KEY, None)
            
            if current_model_hash != stored_model_hash:
                out_report = "Input model changed. Click _run to open the refiner and re-apply."
                hbjson_path = None
            else:
                out_report = "File ready: {}\n\nClick _run to modify, or 'Save & Run' to re-trigger.".format(cached_path)
                hbjson_path = None
        else:
            out_report = "Set _run=True to open editor"
            hbjson_path = None

# Outputs
report = out_report
# hbjson_path is set above (None or path)
# sim_folder is set above (None or path)
# ---------- end gds_gbe_refiner ----------
panel_4 = Panel(gds_gbe_refiner.report)
null_2 = NullItem(Item=gds_gbe_refiner.hbjson_path)  # -> NullFlags, InvalidFlags, Description
hideshow_3 = HideShowObjectPreview(Visible=null_2.NullFlags)

# ----
# Final Version
# (RUN DES MODEL)
gds_designcase = GDS_DesignCase(path=gds_gbe_refiner.hbjson_path, epw_file=epw, settings=gds_comfort_settings)  # -> report, hb_objs, sql

gds_html_results = Python3Script(design_sql=gds_designcase.sql, ref_sql=gds_refcase.sql, auto_open=toggle_2, run=toggle_2)  # -> report, monthly_design_total, monthly_design_elec, monthly_design_gas, html_path; inputs design_sql: String, ref_sql: String, project_name: String, elec_carbon: Double, gas_carbon: Double, elec_rate: Double, gas_rate: Double, auto_open: Boolean, run: Boolean
# ---------- gds_html_results: Python ----------
"""
GDS Results Comparison Dashboard
================================

SPDX-License-Identifier: BSD-3-Clause
Copyright (c) 2026 SyracuseCoE, Syracuse University. All rights reserved.

Redistribution and use in source and binary forms, with or without
modification, are permitted provided that the conditions stated in the
LICENSE file distributed with this project are met.

Author: Chengbo Du <cdu113@syr.edu>

Compare two EnergyPlus SQL outputs (design vs reference) and produce an
HTML dashboard covering energy, carbon, cost, HVAC, and comfort metrics.

INPUTS:
    _design_sql   : str   - Design case eplusout.sql (required)
    _ref_sql      : str   - Reference case eplusout.sql (required)
    _project_name : str   - Dashboard title (default "GDS Project")
    _elec_carbon  : float - Electricity carbon [kg CO2/kWh] (default 0.125)
    _gas_carbon   : float - Gas carbon [kg CO2/kWh] (default 0.181)
    _elec_rate    : float - Electricity rate [$/kWh] (default 0.166)
    _gas_rate     : float - Gas rate [$/kWh] (default 0.04)
    _auto_open    : bool  - Open HTML in browser (default True)
    _run          : bool  - Set True to execute (required)

OUTPUTS:
    html_path : str - Path to generated HTML dashboard
    report    : str - Text summary of comparison results
    monthly_design_total    : list[float] - Design monthly total energy [kWh], 12 values
    monthly_design_elec     : list[float] - Design monthly electricity [kWh], 12 values
    monthly_design_gas      : list[float] - Design monthly gas [kWh], 12 values
    monthly_design_district : list[float] - Design monthly district energy [kWh], 12 values
    monthly_ref_total       : list[float] - Reference monthly total energy [kWh], 12 values
    monthly_ref_elec        : list[float] - Reference monthly electricity [kWh], 12 values
    monthly_ref_gas         : list[float] - Reference monthly gas [kWh], 12 values
    monthly_ref_district    : list[float] - Reference monthly district energy [kWh], 12 values

Default emission and cost factors (Syracuse, NY):
[1] Electricity carbon, 0.125 kg CO2/kWh.
    U.S. EPA, eGRID2022 (17th edition, Jan 2024). Subregion NYUP (NPCC
    Upstate NY), annual output emission rate 274.6 lb CO2/MWh.
    https://www.epa.gov/egrid
[2] Natural gas carbon, 0.181 kg CO2/kWh.
    U.S. EPA, 40 CFR Part 98 Subpart C, Table C-1. Default factor for
    natural gas 53.06 kg CO2/MMBtu = 0.181 kg CO2/kWh.
    https://www.epa.gov/climateleadership/ghg-emission-factors-hub
[3] Electricity rate, $0.166/kWh.
    U.S. EIA, Form EIA-861. Average residential price, Syracuse, NY
    (NYSEG service territory), 2024.
    https://www.eia.gov/electricity/monthly/
[4] Natural gas rate, $0.04/kWh (~$1.17/therm).
    U.S. EIA, Natural Gas Prices by sector and state. New York
    residential average, 2024.
    https://www.eia.gov/dnav/ng/ng_pri_sum_dcu_SNY_a.htm

For other locations, override with EPA eGRID (electricity carbon),
EPA 40 CFR 98 Table C-1 (gas carbon), and EIA state-level rate data.
"""

import os
import json
import sqlite3
import webbrowser
from datetime import datetime

# --- SQL PARSER (inlined from gds_compare_parser.py) ---

class SQLParser:
    """Parse EnergyPlus SQL file with comprehensive metrics and VDS scoring."""

    def __init__(self, sql_path, elec_carbon=0.125, gas_carbon=0.181,
                 elec_rate=0.166, gas_rate=0.04):
        self.sql_path = sql_path
        self.elec_carbon = elec_carbon
        self.gas_carbon = gas_carbon
        self.elec_rate = elec_rate
        self.gas_rate = gas_rate
        self.data = {'energy': {}, 'comfort': {}, 'performance': {},

                     }

    def parse(self):
        if not os.path.exists(self.sql_path):
            raise FileNotFoundError("SQL not found: {}".format(self.sql_path))
        conn = sqlite3.connect(self.sql_path)
        cur = conn.cursor()
        
        # Check for tabular data — TabularDataWithStrings is a VIEW (not table) in E+
        cur.execute("SELECT name FROM sqlite_master WHERE name='TabularDataWithStrings'")
        has_tdws = cur.fetchone() is not None
        
        if not has_tdws:
            # View missing — check if underlying tables exist and recreate it
            cur.execute("SELECT name FROM sqlite_master WHERE type='table' AND name='TabularData'")
            has_td = cur.fetchone() is not None
            cur.execute("SELECT name FROM sqlite_master WHERE type='table' AND name='Strings'")
            has_str = cur.fetchone() is not None
            
            if has_td and has_str:
                # Recreate the view that E+ should have created
                cur.execute("""
                    CREATE TEMP VIEW TabularDataWithStrings AS
                    SELECT
                        td.TabularDataIndex,
                        TRIM(s1.Value) AS ReportName,
                        TRIM(s2.Value) AS ReportForString,
                        TRIM(s3.Value) AS TableName,
                        TRIM(s4.Value) AS RowName,
                        TRIM(s5.Value) AS ColumnName,
                        TRIM(s6.Value) AS Units,
                        TRIM(td.Value) AS Value
                    FROM TabularData td
                    LEFT JOIN Strings s1 ON s1.StringIndex = td.ReportNameIndex
                    LEFT JOIN Strings s2 ON s2.StringIndex = td.ReportForStringIndex
                    LEFT JOIN Strings s3 ON s3.StringIndex = td.TableNameIndex
                    LEFT JOIN Strings s4 ON s4.StringIndex = td.RowNameIndex
                    LEFT JOIN Strings s5 ON s5.StringIndex = td.ColumnNameIndex
                    LEFT JOIN Strings s6 ON s6.StringIndex = td.UnitsIndex
                """)
                print("TabularDataWithStrings view recreated from TabularData + Strings")
            else:
                diag = self._build_diagnostics(cur)
                conn.close()
                raise RuntimeError("\n".join(diag))
        else:
            print("TabularDataWithStrings view found")
        
        # Performance: materialize into temp table for faster repeated queries
        cur.execute("SELECT name FROM sqlite_master WHERE type='table' AND name='TabularDataWithStrings'")
        if not cur.fetchone():
            # It's a view — materialize with TRIM on all text columns
            print("Materializing view into temp table...")
            cur.execute("""CREATE TEMP TABLE _TDWSMat AS 
                SELECT TabularDataIndex, 
                       TRIM(ReportName) AS ReportName,
                       TRIM(ReportForString) AS ReportForString,
                       TRIM(TableName) AS TableName,
                       TRIM(RowName) AS RowName,
                       TRIM(ColumnName) AS ColumnName,
                       TRIM(Units) AS Units,
                       TRIM(Value) AS Value
                FROM TabularDataWithStrings""")
            cur.execute("DROP VIEW IF EXISTS TabularDataWithStrings")
            cur.execute("ALTER TABLE _TDWSMat RENAME TO TabularDataWithStrings")
            cur.execute("CREATE INDEX IF NOT EXISTS idx_tdws_table ON TabularDataWithStrings(TableName)")
            cur.execute("CREATE INDEX IF NOT EXISTS idx_tdws_row ON TabularDataWithStrings(RowName)")
            cur.execute("CREATE INDEX IF NOT EXISTS idx_tdws_col ON TabularDataWithStrings(ColumnName)")
            print("Materialized + indexed")
        
        self._parse_energy(cur)
        # Diagnostic: check energy parsing results
        e = self.data['energy']
        print("  siteEUI={}, totalElec={}, totalGas={}, totalDistrict={}".format(
            e['siteEUI'], e['totalElectricity'], e['totalGas'], e['totalDistrict']))
        print("  endUses: {}".format(e['endUses']))
        print("  peakHeating={} kW, peakCooling={} kW".format(e['peakHeating'], e['peakCooling']))
        if e['totalElectricity'] == 0 and e['siteEUI'] > 0:
            # End uses failed but site energy exists — dump available data
            cur.execute("SELECT DISTINCT TableName FROM TabularDataWithStrings LIMIT 20")
            print("  Available TableNames: {}".format([r[0] for r in cur.fetchall()]))
            cur.execute("SELECT DISTINCT ColumnName FROM TabularDataWithStrings "
                       "WHERE TableName='End Uses' LIMIT 20")
            print("  End Uses columns: {}".format([r[0] for r in cur.fetchall()]))
        self._parse_monthly(cur)
        print("  monthlyElec sum={:.0f}".format(sum(self.data['energy']['monthlyElec'])))
        self._parse_monthly_by_category(cur)
        self._parse_fuel_breakdown()
        self._parse_unmet_hours(cur)
        self._parse_hvac_sizing(cur)
        hvac = self.data['energy'].get('hvacSizing', {})
        print("  HVAC: heatCap={}, coolCap={}, hRatio={}, cRatio={}".format(
            hvac.get('totalHeatingCapacity'), hvac.get('totalCoolingCapacity'),
            hvac.get('heatingRatio'), hvac.get('coolingRatio')))
        self._parse_comfort(cur)
        self._calc_carbon_cost()
        carbon = self.data['energy'].get('carbon', {})
        cost = self.data['energy'].get('cost', {})
        print("  Carbon: total={}, elec={}, gas={}, district={}".format(
            carbon.get('total'), carbon.get('electricity'), carbon.get('gas'), carbon.get('district')))
        print("  Cost: total={}, elec={}, gas={}, district={}".format(
            cost.get('total'), cost.get('electricity'), cost.get('gas'), cost.get('district')))
        self._calc_monthly_cost()
        self._calc_standards_compliance()

        conn.close()
        return self.data
    
    @staticmethod
    def _count_rows(cur, table):
        cur.execute("SELECT COUNT(*) FROM \"{}\"".format(table))
        return cur.fetchone()[0]
    
    def _build_diagnostics(self, cur):
        """Build diagnostic info when no tabular data is found."""
        diag = []
        diag.append("=" * 60)
        diag.append("GDS DIAGNOSTIC: No tabular data found")
        diag.append("=" * 60)
        diag.append("SQL path: {}".format(self.sql_path))
        sql_size = os.path.getsize(self.sql_path)
        diag.append("SQL size: {} bytes ({:.1f} MB)".format(sql_size, sql_size/1e6))
        import time
        sql_mtime = os.path.getmtime(self.sql_path)
        diag.append("SQL modified: {}".format(
            time.strftime('%Y-%m-%d %H:%M:%S', time.localtime(sql_mtime))))
        cur.execute("SELECT name FROM sqlite_master WHERE type='table' ORDER BY name")
        tables = [r[0] for r in cur.fetchall()]
        diag.append("Tables in SQL ({} total):".format(len(tables)))
        for t in tables:
            cnt = self._count_rows(cur, t)
            diag.append("  - {} ({} rows)".format(t, cnt))
        cur.execute("SELECT name FROM sqlite_master WHERE type='view' ORDER BY name")
        views = [r[0] for r in cur.fetchall()]
        diag.append("Views in SQL ({} total): {}".format(len(views), views))
        # Check sibling IDF
        sql_dir = os.path.dirname(self.sql_path)
        for fname in os.listdir(sql_dir):
            if fname.lower().endswith('.idf'):
                idf_check = os.path.join(sql_dir, fname)
                diag.append("\nIDF found: {}".format(fname))
                with open(idf_check, 'r') as fcheck:
                    idf_text = fcheck.read()
                import re as re_diag
                m = re_diag.search(r'(Output:SQLite[^;]*;)', idf_text)
                diag.append("Output:SQLite in IDF: {}".format(
                    m.group(1).strip() if m else "*** NOT FOUND ***"))
                m2 = re_diag.search(r'(Output:Table:SummaryReports[^;]*;)', idf_text)
                diag.append("SummaryReports in IDF: {}".format(
                    m2.group(1).strip() if m2 else "*** NOT FOUND ***"))
                break
        else:
            diag.append("\nNo IDF found in: {}".format(sql_dir))
        diag.append("=" * 60)
        return diag

    # ----------------------------------------------------------
    # Energy parsing
    # ----------------------------------------------------------
    def _parse_energy(self, cur):
        """Site/source energy, end uses, peaks."""
        def get_val(table, row, col, units=None):
            q = ("SELECT Value FROM TabularDataWithStrings WHERE "
                 "TableName='{}' AND RowName='{}' AND ColumnName='{}'".format(table, row, col))
            if units:
                q += " AND Units='{}'".format(units)
            cur.execute(q)
            r = cur.fetchone()
            if r and r[0] and r[0].strip():
                try:
                    return float(r[0])
                except ValueError:
                    return 0
            return 0

        site_gj = get_val('Site and Source Energy', 'Total Site Energy', 'Total Energy', 'GJ')
        source_gj = get_val('Site and Source Energy', 'Total Source Energy', 'Total Energy', 'GJ')
        floor_area = get_val('Building Area', 'Total Building Area', 'Area') or 1
        cond_area = get_val('Building Area', 'Net Conditioned Building Area', 'Area') or floor_area

        site_kwh = site_gj * 277.78
        source_kwh = source_gj * 277.78

        # End uses (detailed)
        end_uses, end_uses_elec, end_uses_gas, end_uses_district = {}, {}, {}, {}
        mapping = [
            ('Heating', 'heating'), ('Cooling', 'cooling'),
            ('Interior Lighting', 'lighting'), ('Exterior Lighting', 'ext_lighting'),
            ('Interior Equipment', 'equipment'), ('Exterior Equipment', 'ext_equipment'),
            ('Fans', 'fans'), ('Pumps', 'pumps'),
            ('Heat Rejection', 'heat_rejection'), ('Humidification', 'humidification'),
            ('Heat Recovery', 'heat_recovery'), ('Water Systems', 'dhw'),
            ('Refrigeration', 'refrigeration'), ('Generators', 'generators')
        ]

        for ep, key in mapping:
            e = get_val('End Uses', ep, 'Electricity', 'GJ') * 277.78
            g = get_val('End Uses', ep, 'Natural Gas', 'GJ') * 277.78
            dc = get_val('End Uses', ep, 'District Cooling', 'GJ') * 277.78
            dhw = get_val('End Uses', ep, 'District Heating Water', 'GJ') * 277.78
            dhs = get_val('End Uses', ep, 'District Heating Steam', 'GJ') * 277.78
            dist = dc + dhw + dhs
            total = e + g + dist
            if total > 0:
                end_uses[key] = round(total)
                end_uses_elec[key] = round(e)
                end_uses_gas[key] = round(g)
                end_uses_district[key] = round(dist)

        # Peak loads — try system-level first, fall back to zone sizing sums
        peak_heat, peak_cool = 0, 0
        # Method 1: System-level peak from equipment summary tables
        cur.execute("SELECT Value FROM TabularDataWithStrings WHERE "
                    "TableName LIKE '%Heating%' AND ColumnName LIKE '%Peak%' "
                    "AND Units='W' LIMIT 1")
        r = cur.fetchone()
        peak_heat = float(r[0]) / 1000 if r and r[0] else 0
        cur.execute("SELECT Value FROM TabularDataWithStrings WHERE "
                    "TableName LIKE '%Cooling%' AND ColumnName LIKE '%Peak%' "
                    "AND Units='W' LIMIT 1")
        r = cur.fetchone()
        peak_cool = float(r[0]) / 1000 if r and r[0] else 0
        # Method 2: Sum zone-level design loads (for zone equipment like baseboard)
        if peak_heat == 0:
            cur.execute("SELECT SUM(CAST(Value AS REAL)) FROM TabularDataWithStrings WHERE "
                        "TableName='Zone Sensible Heating' AND ColumnName='User Design Load' "
                        "AND Units='W'")
            r = cur.fetchone()
            if r and r[0]:
                peak_heat = float(r[0]) / 1000
        if peak_cool == 0:
            cur.execute("SELECT SUM(CAST(Value AS REAL)) FROM TabularDataWithStrings WHERE "
                        "TableName='Zone Sensible Cooling' AND ColumnName='User Design Load' "
                        "AND Units='W'")
            r = cur.fetchone()
            if r and r[0]:
                peak_cool = float(r[0]) / 1000

        self.data['energy'] = {
            'siteEUI': round(site_kwh / floor_area, 1),
            'sourceEUI': round(source_kwh / floor_area, 1),
            'totalSiteEnergy': round(site_kwh),
            'totalSourceEnergy': round(source_kwh),
            'floorArea': round(floor_area, 1),
            'conditionedArea': round(cond_area, 1),
            'peakHeating': round(peak_heat, 1),
            'peakCooling': round(peak_cool, 1),
            'endUses': end_uses,
            'endUsesElec': end_uses_elec,
            'endUsesGas': end_uses_gas,
            'endUsesDistrict': end_uses_district,
            'totalElectricity': sum(end_uses_elec.values()),
            'totalGas': sum(end_uses_gas.values()),
            'totalDistrict': sum(end_uses_district.values()),
            'monthlyElec': [0]*12,
            'monthlyGas': [0]*12,
            'monthlyByCategory': {},
            'monthly': {'heating': [0]*12, 'cooling': [0]*12}
        }

    # ----------------------------------------------------------
    # Monthly energy
    # ----------------------------------------------------------
    def _parse_monthly(self, cur):
        """Monthly energy by fuel type from meter data."""
        monthly_elec, monthly_gas, monthly_district = [0]*12, [0]*12, [0]*12

        try:
            cur.execute("SELECT ReportDataDictionaryIndex FROM ReportDataDictionary "
                       "WHERE Name='Electricity:Facility' AND ReportingFrequency='Monthly'")
            elec_idx = cur.fetchone()
            if elec_idx:
                cur.execute("SELECT t.Month, SUM(rd.Value) "
                           "FROM ReportData rd JOIN Time t ON rd.TimeIndex=t.TimeIndex "
                           "WHERE rd.ReportDataDictionaryIndex=? "
                           "AND t.Month BETWEEN 1 AND 12 AND t.Year > 0 "
                           "GROUP BY t.Month ORDER BY t.Month", (elec_idx[0],))
                for row in cur.fetchall():
                    m = int(row[0]) - 1
                    if 0 <= m < 12:
                        monthly_elec[m] = row[1] / 3600000

            cur.execute("SELECT ReportDataDictionaryIndex FROM ReportDataDictionary "
                       "WHERE Name LIKE '%Gas:Facility' AND ReportingFrequency='Monthly'")
            gas_idx = cur.fetchone()
            if gas_idx:
                cur.execute("SELECT t.Month, SUM(rd.Value) "
                           "FROM ReportData rd JOIN Time t ON rd.TimeIndex=t.TimeIndex "
                           "WHERE rd.ReportDataDictionaryIndex=? "
                           "AND t.Month BETWEEN 1 AND 12 AND t.Year > 0 "
                           "GROUP BY t.Month ORDER BY t.Month", (gas_idx[0],))
                for row in cur.fetchall():
                    m = int(row[0]) - 1
                    if 0 <= m < 12:
                        monthly_gas[m] = row[1] / 3600000

            for meter_name in ['DistrictCooling:Facility', 'DistrictHeatingWater:Facility',
                               'DistrictHeatingSteam:Facility']:
                cur.execute("SELECT ReportDataDictionaryIndex FROM ReportDataDictionary "
                           "WHERE Name=? AND ReportingFrequency='Monthly'", (meter_name,))
                d_idx = cur.fetchone()
                if d_idx:
                    cur.execute("SELECT t.Month, SUM(rd.Value) "
                               "FROM ReportData rd JOIN Time t ON rd.TimeIndex=t.TimeIndex "
                               "WHERE rd.ReportDataDictionaryIndex=? "
                               "AND t.Month BETWEEN 1 AND 12 AND t.Year > 0 "
                               "GROUP BY t.Month ORDER BY t.Month", (d_idx[0],))
                    for row in cur.fetchall():
                        m_idx = int(row[0]) - 1
                        if 0 <= m_idx < 12:
                            monthly_district[m_idx] += row[1] / 3600000
        except Exception:
            pass

        # Fallback: try hourly/timestep and aggregate
        if sum(monthly_elec) == 0:
            try:
                cur.execute("SELECT ReportDataDictionaryIndex FROM ReportDataDictionary "
                           "WHERE Name='Electricity:Facility' LIMIT 1")
                elec_idx = cur.fetchone()
                if elec_idx:
                    cur.execute("SELECT t.Month, SUM(rd.Value) "
                               "FROM ReportData rd JOIN Time t ON rd.TimeIndex=t.TimeIndex "
                               "WHERE rd.ReportDataDictionaryIndex=? "
                               "AND t.Month BETWEEN 1 AND 12 AND t.Year > 0 "
                               "GROUP BY t.Month ORDER BY t.Month", (elec_idx[0],))
                    for row in cur.fetchall():
                        m = int(row[0]) - 1
                        if 0 <= m < 12:
                            monthly_elec[m] = row[1] / 3600000
            except Exception:
                pass

        if sum(monthly_gas) == 0:
            try:
                cur.execute("SELECT ReportDataDictionaryIndex FROM ReportDataDictionary "
                           "WHERE Name LIKE '%Gas:Facility' LIMIT 1")
                gas_idx = cur.fetchone()
                if gas_idx:
                    cur.execute("SELECT t.Month, SUM(rd.Value) "
                               "FROM ReportData rd JOIN Time t ON rd.TimeIndex=t.TimeIndex "
                               "WHERE rd.ReportDataDictionaryIndex=? "
                               "AND t.Month BETWEEN 1 AND 12 AND t.Year > 0 "
                               "GROUP BY t.Month ORDER BY t.Month", (gas_idx[0],))
                    for row in cur.fetchall():
                        m = int(row[0]) - 1
                        if 0 <= m < 12:
                            monthly_gas[m] = row[1] / 3600000
            except Exception:
                pass

        # Final fallback: distribute annual evenly
        if sum(monthly_elec) == 0:
            monthly_elec = [self.data['energy']['totalElectricity'] / 12] * 12
        if sum(monthly_gas) == 0 and self.data['energy']['totalGas'] > 0:
            pattern = [0.18, 0.15, 0.12, 0.05, 0.01, 0, 0, 0, 0.01, 0.06, 0.12, 0.16]
            total = sum(pattern)
            monthly_gas = [self.data['energy']['totalGas'] * p / total for p in pattern]
        if sum(monthly_district) == 0 and self.data['energy']['totalDistrict'] > 0:
            monthly_district = [self.data['energy']['totalDistrict'] / 12] * 12

        self.data['energy']['monthlyElec'] = monthly_elec
        self.data['energy']['monthlyGas'] = monthly_gas
        self.data['energy']['monthlyDistrict'] = monthly_district
        self.data['energy']['monthlyTotal'] = [e + g + d for e, g, d in
            zip(monthly_elec, monthly_gas, monthly_district)]

    def _parse_monthly_by_category(self, cur):
        """Monthly energy by end-use category (estimated from annual patterns)."""
        cats = {
            'heating': [0.18, 0.15, 0.12, 0.05, 0.01, 0, 0, 0, 0.01, 0.06, 0.12, 0.16],
            'cooling': [0, 0, 0.02, 0.06, 0.12, 0.18, 0.22, 0.20, 0.12, 0.06, 0.02, 0]
        }
        monthly_cat = {}
        for cat, pattern in cats.items():
            if cat in self.data['energy']['endUses']:
                total_p = sum(pattern)
                annual = self.data['energy']['endUses'][cat]
                monthly_cat[cat] = [round(annual * p / total_p) for p in pattern]
        for cat in ['lighting', 'equipment', 'fans', 'dhw']:
            if cat in self.data['energy']['endUses']:
                monthly_cat[cat] = [round(self.data['energy']['endUses'][cat] / 12)] * 12

        self.data['energy']['monthlyByCategory'] = monthly_cat
        self.data['energy']['monthly']['heating'] = monthly_cat.get('heating', [0]*12)
        self.data['energy']['monthly']['cooling'] = monthly_cat.get('cooling', [0]*12)

    def _parse_fuel_breakdown(self):
        """Fuel percentage breakdown."""
        total_elec = self.data['energy']['totalElectricity']
        total_gas = self.data['energy']['totalGas']
        total_district = self.data['energy']['totalDistrict']
        total = total_elec + total_gas + total_district
        self.data['energy']['fuelBreakdown'] = {
            'electricity': {
                'total': total_elec,
                'percentage': round(total_elec / total * 100, 1) if total > 0 else 0
            },
            'naturalGas': {
                'total': total_gas,
                'percentage': round(total_gas / total * 100, 1) if total > 0 else 0
            },
            'district': {
                'total': total_district,
                'percentage': round(total_district / total * 100, 1) if total > 0 else 0
            }
        }

    # ----------------------------------------------------------
    # Unmet hours
    # ----------------------------------------------------------
    def _parse_unmet_hours(self, cur):
        """Unmet setpoint hours (facility + zone-level)."""
        cur.execute("SELECT Value FROM TabularDataWithStrings WHERE "
                    "TableName LIKE '%Setpoint Not Met%' AND RowName='Facility' "
                    "AND ColumnName LIKE '%Heating%'")
        r = cur.fetchone()
        heat = float(r[0]) if r and r[0] and r[0].strip() else 0
        cur.execute("SELECT Value FROM TabularDataWithStrings WHERE "
                    "TableName LIKE '%Setpoint Not Met%' AND RowName='Facility' "
                    "AND ColumnName LIKE '%Cooling%'")
        r = cur.fetchone()
        cool = float(r[0]) if r and r[0] and r[0].strip() else 0
        total = heat + cool

        zone_unmet = []
        cur.execute("SELECT RowName, Value FROM TabularDataWithStrings WHERE "
                    "TableName LIKE '%Setpoint Not Met%' "
                    "AND ColumnName LIKE '%Heating%' AND RowName != 'Facility'")
        heating_by_zone = {r[0]: float(r[1]) if r[1] and r[1].strip() else 0 for r in cur.fetchall()}
        cur.execute("SELECT RowName, Value FROM TabularDataWithStrings WHERE "
                    "TableName LIKE '%Setpoint Not Met%' "
                    "AND ColumnName LIKE '%Cooling%' AND RowName != 'Facility'")
        cooling_by_zone = {r[0]: float(r[1]) if r[1] and r[1].strip() else 0 for r in cur.fetchall()}

        all_zones = set(heating_by_zone.keys()) | set(cooling_by_zone.keys())
        for zone in list(all_zones):
            h = heating_by_zone.get(zone, 0)
            c = cooling_by_zone.get(zone, 0)
            if h > 0 or c > 0:
                zone_unmet.append({
                    'name': zone, 'heating': round(h, 1),
                    'cooling': round(c, 1), 'total': round(h + c, 1)
                })
        zone_unmet.sort(key=lambda x: x['total'], reverse=True)

        self.data['energy']['unmetHours'] = {
            'heating': round(heat, 1), 'cooling': round(cool, 1),
            'total': round(total, 1), 'limit': 300,
            'compliant': total <= 300,
            'byZone': zone_unmet
        }

    # ----------------------------------------------------------
    # HVAC sizing
    # ----------------------------------------------------------
    def _parse_hvac_sizing(self, cur):
        """HVAC equipment capacity and sizing ratios."""
        heating_equip, cooling_equip = [], []
        heat_cap, cool_cap = 0, 0

        # Heating coils — TableName is 'Heating Coils' or 'DX Heating Coils'
        cur.execute("SELECT RowName, Value FROM TabularDataWithStrings WHERE "
                    "(TableName='Heating Coils' OR TableName='DX Heating Coils') "
                    "AND ColumnName LIKE '%Capacity%' AND Units='W'")
        for r in cur.fetchall():
            if r[1]:
                try:
                    cap = float(r[1]) / 1000
                    if cap > 0:
                        heat_cap += cap
                        heating_equip.append({'name': r[0][:30], 'capacity': round(cap, 1)})
                except:
                    pass

        # Cooling coils — TableName is 'Cooling Coils' or 'DX Cooling Coils'
        cur.execute("SELECT RowName, Value FROM TabularDataWithStrings WHERE "
                    "(TableName='Cooling Coils' OR TableName='DX Cooling Coils') "
                    "AND ColumnName LIKE '%Capacity%' AND Units='W'")
        for r in cur.fetchall():
            if r[1]:
                try:
                    cap = float(r[1]) / 1000
                    if cap > 0:
                        cool_cap += cap
                        cooling_equip.append({'name': r[0][:30], 'capacity': round(cap, 1)})
                except:
                    pass

        peak_h = self.data['energy']['peakHeating']
        peak_c = self.data['energy']['peakCooling']
        h_ratio = round(heat_cap / peak_h, 2) if peak_h > 0 else 0
        c_ratio = round(cool_cap / peak_c, 2) if peak_c > 0 else 0

        self.data['energy']['hvacSizing'] = {
            'heatingEquipment': heating_equip[:5],
            'coolingEquipment': cooling_equip[:5],
            'totalHeatingCapacity': round(heat_cap, 1),
            'totalCoolingCapacity': round(cool_cap, 1),
            'heatingRatio': h_ratio,
            'coolingRatio': c_ratio,
            'heatingOversized': h_ratio > 1.3,
            'coolingOversized': c_ratio > 1.3
        }

    # ----------------------------------------------------------
    # Comfort
    # ----------------------------------------------------------
    def _parse_comfort(self, cur):
        """Thermal comfort (PMV/PPD by zone)."""
        cur.execute("SELECT DISTINCT KeyValue FROM ReportDataDictionary "
                    "WHERE Name LIKE '%Fanger Model PPD%'")
        zones = [r[0] for r in cur.fetchall()]
        if not zones:
            self.data['comfort'] = {'avgPMV': 0, 'avgPPD': 0, 'comfortHours': 0,
                                    'totalOccupiedHours': 8760, 'zones': []}
            return

        zone_data = []
        for zone in zones:
            cur.execute("SELECT ReportDataDictionaryIndex FROM "
                       "ReportDataDictionary WHERE Name LIKE '%PMV%' "
                       "AND KeyValue='{}'".format(zone))
            pmv_idx = cur.fetchone()
            cur.execute("SELECT ReportDataDictionaryIndex FROM "
                       "ReportDataDictionary WHERE Name LIKE '%PPD%' "
                       "AND KeyValue='{}'".format(zone))
            ppd_idx = cur.fetchone()
            pmv, ppd = 0, 0
            if pmv_idx:
                cur.execute("SELECT AVG(Value) FROM ReportData "
                           "WHERE ReportDataDictionaryIndex={}".format(pmv_idx[0]))
                r = cur.fetchone()
                pmv = float(r[0]) if r and r[0] else 0
            if ppd_idx:
                cur.execute("SELECT AVG(Value) FROM ReportData "
                           "WHERE ReportDataDictionaryIndex={}".format(ppd_idx[0]))
                r = cur.fetchone()
                ppd = float(r[0]) if r and r[0] else 0
            if ppd > 0:
                zone_data.append({
                    'name': zone, 'pmv': round(pmv, 2), 'ppd': round(ppd, 1),
                    'comfortPct': max(0, min(100, round(100 - ppd)))
                })

        avg_ppd = sum(z['ppd'] for z in zone_data) / len(zone_data) if zone_data else 0
        avg_pmv = sum(z['pmv'] for z in zone_data) / len(zone_data) if zone_data else 0

        self.data['comfort'] = {
            'avgPMV': round(avg_pmv, 2), 'avgPPD': round(avg_ppd, 1),
            'comfortHours': round(8760 * (100 - avg_ppd) / 100) if avg_ppd > 0 else 0,
            'totalOccupiedHours': 8760,
            'zones': zone_data if zone_data else [{'name': 'No data', 'pmv': 0, 'ppd': 0, 'comfortPct': 0}]
        }

    # ----------------------------------------------------------
    # Carbon, cost, monthly cost
    # ----------------------------------------------------------
    def _calc_carbon_cost(self):
        """Carbon emissions and annual cost."""
        elec = self.data['energy']['totalElectricity']
        gas = self.data['energy']['totalGas']
        district = self.data['energy']['totalDistrict']
        area = self.data['energy']['floorArea']

        c_elec = elec * self.elec_carbon
        c_gas = gas * self.gas_carbon
        c_district = district * self.gas_carbon  # Conservative estimate; district source varies
        self.data['energy']['carbon'] = {
            'electricity': round(c_elec), 'gas': round(c_gas),
            'district': round(c_district),
            'total': round(c_elec + c_gas + c_district),
            'intensity': round((c_elec + c_gas + c_district) / area, 1) if area > 0 else 0
        }

        cost_elec = elec * self.elec_rate
        cost_gas = gas * self.gas_rate
        cost_district = district * self.gas_rate  # Use gas rate as proxy for district
        self.data['energy']['cost'] = {
            'electricity': round(cost_elec), 'gas': round(cost_gas),
            'district': round(cost_district),
            'total': round(cost_elec + cost_gas + cost_district),
            'perArea': round((cost_elec + cost_gas + cost_district) / area, 2) if area > 0 else 0
        }

    def _calc_monthly_cost(self):
        """Monthly cost breakdown."""
        m_elec = self.data['energy']['monthlyElec']
        m_gas = self.data['energy']['monthlyGas']
        m_district = self.data['energy'].get('monthlyDistrict', [0]*12)
        m_elec_cost = [round(e * self.elec_rate) for e in m_elec]
        m_gas_cost = [round(g * self.gas_rate) for g in m_gas]
        m_dist_cost = [round(d * self.gas_rate) for d in m_district]
        m_total = [e + g + d for e, g, d in zip(m_elec_cost, m_gas_cost, m_dist_cost)]
        self.data['energy']['monthlyCost'] = {
            'electricity': m_elec_cost, 'gas': m_gas_cost,
            'district': m_dist_cost, 'total': m_total
        }

    # ----------------------------------------------------------
    # Standards compliance
    # ----------------------------------------------------------
    def _calc_standards_compliance(self):
        """Summarize performance metrics for comparative analysis."""
        e = self.data['energy']
        c = self.data['comfort']

        energy_cost = e.get('cost', {}).get('total', 0)
        self.data['performance'] = {
            'energyCost': {
                'label': 'Energy Cost',
                'metric': 'Energy Cost',
                'value': energy_cost,
                'unit': '$',
                'connected': energy_cost > 0,
                'note': 'Design vs reference comparison'
            },
            'siteEUI': {
                'label': 'Site EUI',
                'metric': 'Site EUI',
                'value': e.get('siteEUI', 0),
                'unit': 'kWh/m2/yr',
                'connected': e.get('siteEUI', 0) > 0,
                'note': 'Relative to reference case'
            },
            'unmetHours': {
                'label': 'Unmet Setpoint Hours',
                'metric': 'Unmet Setpoint Hours',
                'value': e.get('unmetHours', {}).get('total', 0),
                'limit': 300,
                'unit': 'hours',
                'compliant': e.get('unmetHours', {}).get('compliant', False),
                'connected': True,
                'note': '300 hrs is a common modeling threshold (verify applicability for your project)'
            },
            'thermalComfort': {
                'label': 'Thermal Comfort (PPD)',
                'metric': 'Thermal Comfort (PPD)',
                'value': c.get('avgPPD', 0),
                'limit': 20,
                'unit': '%',
                'compliant': 0 < c.get('avgPPD', 0) <= 20,
                'connected': c.get('avgPPD', 0) > 0,
                'zoneCount': len(c.get('zones', [])),
                'zonesCompliant': sum(1 for z in c.get('zones', [])
                                      if 0 < z.get('ppd', 99) <= 20),
                'note': 'PPD < 10% corresponds to PMV within +/-0.5'
            },
            'hvacSizing': {
                'label': 'HVAC Sizing',
                'metric': 'HVAC Sizing Adequacy',
                'heatingRatio': e.get('hvacSizing', {}).get('heatingRatio', 0),
                'coolingRatio': e.get('hvacSizing', {}).get('coolingRatio', 0),
                'unit': 'capacity/peak',
                'connected': (e.get('hvacSizing', {}).get('heatingRatio', 0) > 0 or
                              e.get('hvacSizing', {}).get('coolingRatio', 0) > 0),
                'note': 'Ratio of installed capacity to design peak load'
            },
            'carbonIntensity': {
                'label': 'Carbon Intensity',
                'metric': 'Carbon Intensity',
                'value': e.get('carbon', {}).get('intensity', 0),
                'total': e.get('carbon', {}).get('total', 0),
                'unit': 'kg CO2/m2',
                'connected': e.get('carbon', {}).get('total', 0) > 0,
                'note': 'Based on user-provided emission factors'
            },

        }

# --- COMPARISON ENGINE ---

def calc_comparison(design, reference):
    """Calculate comparison metrics between design and reference cases."""
    de = design.get('energy', {})
    re = reference.get('energy', {})
    dc = design.get('comfort', {})
    rc = reference.get('comfort', {})

    def calc_diff(d, r, lower_is_better=True):
        if r == 0:
            return {'design': d, 'reference': r, 'diff': 0, 'pct': 0, 'improved': False}
        diff = d - r
        pct = (diff / r) * 100
        improved = diff < 0 if lower_is_better else diff > 0
        return {'design': d, 'reference': r, 'diff': round(diff, 1),
                'pct': round(pct, 1), 'improved': improved}

    c = {
        'siteEUI': calc_diff(de.get('siteEUI', 0), re.get('siteEUI', 0)),
        'sourceEUI': calc_diff(de.get('sourceEUI', 0), re.get('sourceEUI', 0)),
        'totalSiteEnergy': calc_diff(de.get('totalSiteEnergy', 0), re.get('totalSiteEnergy', 0)),
        'totalElectricity': calc_diff(de.get('totalElectricity', 0), re.get('totalElectricity', 0)),
        'totalGas': calc_diff(de.get('totalGas', 0), re.get('totalGas', 0)),
        'totalDistrict': calc_diff(de.get('totalDistrict', 0), re.get('totalDistrict', 0)),
        'heating': calc_diff(de.get('endUses', {}).get('heating', 0), re.get('endUses', {}).get('heating', 0)),
        'cooling': calc_diff(de.get('endUses', {}).get('cooling', 0), re.get('endUses', {}).get('cooling', 0)),
        'lighting': calc_diff(de.get('endUses', {}).get('lighting', 0), re.get('endUses', {}).get('lighting', 0)),
        'equipment': calc_diff(de.get('endUses', {}).get('equipment', 0), re.get('endUses', {}).get('equipment', 0)),
        'fans': calc_diff(de.get('endUses', {}).get('fans', 0), re.get('endUses', {}).get('fans', 0)),
        'dhw': calc_diff(de.get('endUses', {}).get('dhw', 0), re.get('endUses', {}).get('dhw', 0)),
        'carbon': calc_diff(de.get('carbon', {}).get('total', 0), re.get('carbon', {}).get('total', 0)),
        'carbonIntensity': calc_diff(de.get('carbon', {}).get('intensity', 0), re.get('carbon', {}).get('intensity', 0)),
        'cost': calc_diff(de.get('cost', {}).get('total', 0), re.get('cost', {}).get('total', 0)),
        'ppd': calc_diff(dc.get('avgPPD', 0), rc.get('avgPPD', 0)),
        'unmetHours': calc_diff(de.get('unmetHours', {}).get('total', 0), re.get('unmetHours', {}).get('total', 0)),
        'peakHeating': calc_diff(de.get('peakHeating', 0), re.get('peakHeating', 0)),
        'peakCooling': calc_diff(de.get('peakCooling', 0), re.get('peakCooling', 0)),
    }

    dmc = de.get('monthlyCost', {}).get('total', [0]*12)
    rmc = re.get('monthlyCost', {}).get('total', [0]*12)
    c['monthlyCostDiff'] = [round(d - r) for d, r in zip(dmc, rmc)]
    c['annualSavings'] = round(re.get('cost', {}).get('total', 0) - de.get('cost', {}).get('total', 0))

    ref_cost = re.get('cost', {}).get('total', 0)
    des_cost = de.get('cost', {}).get('total', 0)
    c['costSavingsPct'] = round((1 - des_cost / ref_cost) * 100, 1) if ref_cost > 0 else 0

    ref_carbon = re.get('carbon', {}).get('total', 0)
    des_carbon = de.get('carbon', {}).get('total', 0)
    c['carbonReductionPct'] = round((1 - des_carbon / ref_carbon) * 100, 1) if ref_carbon > 0 else 0

    ref_eui = re.get('siteEUI', 0)
    des_eui = de.get('siteEUI', 0)
    c['euiReductionPct'] = round((1 - des_eui / ref_eui) * 100, 1) if ref_eui > 0 else 0

    return c

def build_report(design, reference, comparison):
    """Build a text summary report."""
    c = comparison
    de = design.get('energy', {})
    re = reference.get('energy', {})
    lines = []
    lines.append("=" * 65)
    lines.append("GDS RESULTS — DESIGN vs REFERENCE COMPARISON")
    lines.append("=" * 65)

    def fmt(m):
        arrow = 'v' if m['improved'] else '^'
        return "{} {:+.1f}%".format(arrow, m['pct'])

    lines.append("")
    lines.append("{:<25} {:>12} {:>12} {:>12}".format("Metric", "Design", "Reference", "Change"))
    lines.append("-" * 65)
    lines.append("{:<25} {:>12.1f} {:>12.1f} {:>12}".format(
        "Site EUI (kWh/m2/yr)", c['siteEUI']['design'], c['siteEUI']['reference'], fmt(c['siteEUI'])))
    lines.append("{:<25} {:>12,} {:>12,} {:>12}".format(
        "Total Energy (kWh)", c['totalSiteEnergy']['design'], c['totalSiteEnergy']['reference'], fmt(c['totalSiteEnergy'])))
    lines.append("{:<25} {:>12,} {:>12,} {:>12}".format(
        "Heating (kWh)", c['heating']['design'], c['heating']['reference'], fmt(c['heating'])))
    lines.append("{:<25} {:>12,} {:>12,} {:>12}".format(
        "Cooling (kWh)", c['cooling']['design'], c['cooling']['reference'], fmt(c['cooling'])))
    lines.append("{:<25} {:>12,} {:>12,} {:>12}".format(
        "Carbon (kg CO2)", c['carbon']['design'], c['carbon']['reference'], fmt(c['carbon'])))
    lines.append("{:<25} {:>12,} {:>12,} {:>12}".format(
        "Annual Cost ($)", c['cost']['design'], c['cost']['reference'], fmt(c['cost'])))
    lines.append("-" * 65)

    if c['annualSavings'] > 0:
        lines.append("\nAnnual Savings: ${:,}".format(c['annualSavings']))
    elif c['annualSavings'] < 0:
        lines.append("\nAnnual Extra Cost: ${:,}".format(-c['annualSavings']))

    lines.append("\nEUI Reduction: {:.1f}%".format(c['euiReductionPct']))
    lines.append("Carbon Reduction: {:.1f}%".format(c['carbonReductionPct']))
    lines.append("Cost Savings: {:.1f}%".format(c['costSavingsPct']))

    # Unmet hours
    du = de.get('unmetHours', {})
    ru = re.get('unmetHours', {})
    lines.append("\nUnmet Hours:  Design={:.0f}h ({})  Reference={:.0f}h ({})".format(
        du.get('total', 0), "Within threshold" if du.get('compliant') else "EXCEEDS threshold",
        ru.get('total', 0), "Within threshold" if ru.get('compliant') else "EXCEEDS threshold"))

    return "\n".join(lines)

# --- HTML TEMPLATE ---

def get_html_template():
    return '''<!DOCTYPE html>
<html lang="en">
<head>
<meta charset="UTF-8"><meta name="viewport" content="width=device-width, initial-scale=1.0">
<title>GDS Results Comparison</title>
<link href="https://fonts.googleapis.com/css2?family=DM+Sans:wght@400;500;600;700&family=JetBrains+Mono:wght@400;500&display=swap" rel="stylesheet">
<style>
*{margin:0;padding:0;box-sizing:border-box}
:root{
  --bg:#0c1220;--bg2:#141e33;--card:rgba(255,255,255,0.025);--card2:rgba(255,255,255,0.04);
  --border:rgba(255,255,255,0.07);--border2:rgba(255,255,255,0.12);
  --t1:#e8ecf4;--t2:#8b95a8;--t3:#5a6478;
  --green:#4ade80;--green-bg:rgba(74,222,128,0.08);
  --blue:#60a5fa;--blue-bg:rgba(96,165,250,0.08);
  --orange:#fbbf24;--orange-bg:rgba(251,191,36,0.08);
  --red:#f87171;--red-bg:rgba(248,113,113,0.08);
  --purple:#a78bfa;--purple-bg:rgba(167,139,250,0.08);
  --cyan:#22d3ee;--cyan-bg:rgba(34,211,238,0.08);
  --design:#4ade80;--reference:#60a5fa;
}
body{font-family:'DM Sans',system-ui,sans-serif;background:var(--bg);color:var(--t1);min-height:100vh}
.header{background:var(--bg2);border-bottom:1px solid var(--border);padding:14px 28px;display:flex;justify-content:space-between;align-items:center}
.header h1{font-size:18px;font-weight:700;letter-spacing:-0.3px}
.header h1 span{color:var(--green)}
.meta{text-align:right;font-size:12px;color:var(--t3)}
.meta .name{color:var(--t2);font-weight:500}
.case-legend{display:flex;gap:16px;align-items:center;font-size:11px;color:var(--t2);margin-top:4px}
.case-dot{width:8px;height:8px;border-radius:2px;display:inline-block;margin-right:4px}
.tabs{display:flex;gap:2px;padding:0 28px;background:var(--bg2);border-bottom:1px solid var(--border);overflow-x:auto}
.tab{padding:12px 18px;font-size:12px;font-weight:500;color:var(--t3);cursor:pointer;border-bottom:2px solid transparent;transition:all 0.2s;white-space:nowrap}
.tab:hover{color:var(--t2)}
.tab.active{color:var(--green);border-bottom-color:var(--green)}
.main{padding:24px 28px;max-width:1440px;margin:0 auto}
.section{display:none}.section.active{display:block}
.grid{display:grid;grid-template-columns:repeat(auto-fit,minmax(280px,1fr));gap:14px;margin-bottom:20px}
.grid-2{display:grid;grid-template-columns:repeat(2,1fr);gap:14px;margin-bottom:20px}
.grid-3{display:grid;grid-template-columns:repeat(3,1fr);gap:14px}
.grid-5{display:grid;grid-template-columns:repeat(5,1fr);gap:14px;margin-bottom:20px}
@media(max-width:900px){.grid-2,.grid-3,.grid-5{grid-template-columns:1fr}}
.card{background:var(--card);border:1px solid var(--border);border-radius:10px;padding:18px}
.card.span-2{grid-column:span 2}@media(max-width:900px){.card.span-2{grid-column:span 1}}
.card-head{display:flex;justify-content:space-between;align-items:center;margin-bottom:14px}
.card-title{font-size:12px;font-weight:600;color:var(--t3);text-transform:uppercase;letter-spacing:0.8px}
.badge{font-size:10px;padding:3px 10px;border-radius:10px;font-weight:500}
.badge.green{background:var(--green-bg);color:var(--green)}
.badge.red{background:var(--red-bg);color:var(--red)}
.badge.blue{background:var(--blue-bg);color:var(--blue)}
.badge.orange{background:var(--orange-bg);color:var(--orange)}
.badge.neutral{background:rgba(255,255,255,0.05);color:var(--t2)}
.metric{display:flex;align-items:baseline;gap:6px}
.metric .val{font-size:28px;font-weight:700;font-family:'JetBrains Mono','DM Sans',monospace}
.metric .unit{font-size:12px;color:var(--t3)}
.metric-sm .val{font-size:22px}
.label{font-size:11px;color:var(--t3);margin-top:2px}
.cmp{display:inline-flex;align-items:center;gap:4px;font-size:11px;font-weight:500;margin-top:6px;padding:2px 8px;border-radius:4px}
.cmp.pos{color:var(--green);background:var(--green-bg)}
.cmp.neg{color:var(--red);background:var(--red-bg)}
.kpi{text-align:center;padding:16px 10px}
.kpi .val{font-size:32px;font-weight:700;font-family:'JetBrains Mono',monospace}
.kpi .lbl{font-size:11px;color:var(--t3);margin-top:4px}
.kpi .change{font-size:13px;font-weight:600;margin-top:6px}
.kpi .change.pos{color:var(--green)}.kpi .change.neg{color:var(--red)}
.cmp-row{display:flex;align-items:center;padding:10px 0;border-bottom:1px solid var(--border);gap:12px}
.cmp-row:last-child{border-bottom:none}
.cmp-label{width:100px;font-size:12px;color:var(--t2);flex-shrink:0}
.cmp-bars{flex:1;display:flex;flex-direction:column;gap:3px}
.cmp-bar{height:14px;border-radius:3px;position:relative;min-width:2px;transition:width 0.6s}
.cmp-bar-val{position:absolute;right:6px;top:50%;transform:translateY(-50%);font-size:9px;font-weight:600;color:rgba(0,0,0,0.7)}
.cmp-change{width:70px;text-align:right;font-size:11px;font-weight:600;flex-shrink:0}
.stat-row{display:flex;justify-content:space-between;padding:7px 0;border-bottom:1px solid var(--border)}
.stat-row:last-child{border-bottom:none}
.stat-label{font-size:12px;color:var(--t2)}
.stat-value{font-size:12px;font-weight:600;font-family:'JetBrains Mono',monospace}
.stat-value.good{color:var(--green)}.stat-value.warn{color:var(--orange)}.stat-value.bad{color:var(--red)}
.chart-wrap{position:relative;padding-left:52px;padding-bottom:4px}
.chart-wrap .y-axis{position:absolute;left:0;top:0;bottom:24px;display:flex;flex-direction:column;justify-content:space-between;align-items:flex-end;padding-right:6px;width:48px}
.chart-wrap .y-tick{font-size:11px;color:var(--t2);font-family:'JetBrains Mono',monospace;line-height:1}
.chart-wrap .y-label{position:absolute;left:0;top:50%;transform:rotate(-90deg) translateX(-50%);transform-origin:0 0;font-size:10px;color:var(--t2);font-family:'JetBrains Mono',monospace;white-space:nowrap;letter-spacing:0.3px}
.chart-wrap .chart-area{position:relative}
.chart-wrap .x-labels{display:flex}
.chart-wrap .gridlines{position:absolute;left:0;right:0;top:0;bottom:0;pointer-events:none;z-index:0}
.chart-wrap .gridline{position:absolute;left:0;right:0;height:1px;background:rgba(255,255,255,0.06)}
.mbar{flex:1;border-radius:2px 2px 0 0;min-height:1px;transition:height 0.4s}
.month-lbl{font-size:11px;color:var(--t2);text-align:center;height:24px;line-height:24px;flex-shrink:0;font-family:'JetBrains Mono',monospace}
.monthly-stacked{display:flex;align-items:flex-end;gap:3px;height:220px;padding:0;position:relative;z-index:1}
.month-col{flex:1;display:flex;flex-direction:column;align-items:center;gap:0}
.month-stack{width:100%;display:flex;flex-direction:column-reverse}
.month-seg{width:100%;transition:height 0.3s}
.month-seg:first-child{border-radius:0 0 2px 2px}
.month-seg:last-child{border-radius:2px 2px 0 0}
.bar-chart{display:flex;align-items:flex-end;gap:3px;height:220px;padding:0;position:relative;z-index:1}
.bar-group{flex:1;display:flex;gap:1px;align-items:flex-end;height:100%}
.bar-group .mbar{min-width:3px}
.stacked-bar{display:flex;height:20px;border-radius:4px;overflow:hidden;margin:6px 0}
.stacked-bar .segment{height:100%}
.bar{height:5px;background:rgba(255,255,255,0.06);border-radius:3px;overflow:hidden;margin-top:6px}
.bar .fill{height:100%;border-radius:3px;transition:width 0.5s}
.bar-label{display:flex;justify-content:space-between;font-size:9px;color:var(--t3);margin-bottom:3px}
.legend-row{display:flex;flex-wrap:wrap;gap:14px;margin-top:10px}
.legend-item{display:flex;align-items:center;gap:5px;font-size:11px;color:var(--t2)}
.legend-dot{width:10px;height:10px;border-radius:2px;flex-shrink:0}
table{width:100%;border-collapse:collapse;font-size:12px}
th,td{padding:7px 10px;text-align:left;border-bottom:1px solid var(--border)}
th{font-weight:600;color:var(--t3);font-size:10px;text-transform:uppercase;letter-spacing:0.5px}
.dot{width:8px;height:8px;border-radius:50%;display:inline-block;margin-right:5px}
.dot.good{background:var(--green)}.dot.warn{background:var(--orange)}.dot.bad{background:var(--red)}
.radar-container{display:flex;gap:20px;flex-wrap:wrap;justify-content:center;align-items:flex-start}
.radar-panel{text-align:center}
.radar-panel h3{font-size:12px;font-weight:600;color:var(--t2);margin-bottom:8px}
.radar-legend{display:flex;flex-direction:column;gap:6px;min-width:180px}
.leg-item{display:flex;align-items:center;gap:8px;padding:5px 8px;border-radius:6px}
.leg-color{width:8px;height:8px;border-radius:2px;flex-shrink:0}
.leg-name{flex:1;font-size:11px;color:var(--t2)}
.leg-score{font-size:12px;font-weight:600;font-family:'JetBrains Mono',monospace}

.std-item{padding:16px;border:1px solid var(--border);border-radius:8px;margin-bottom:10px}
.std-item.pass{border-left:3px solid var(--green)}
.std-item.fail{border-left:3px solid var(--red)}

.std-header{display:flex;justify-content:space-between;align-items:center;margin-bottom:6px}
.std-metric{font-size:14px;font-weight:600}
.std-standard{font-size:10px;color:var(--t3);font-family:'JetBrains Mono',monospace}
.std-body{display:flex;align-items:center;gap:16px}
.std-value{font-size:24px;font-weight:700;font-family:'JetBrains Mono',monospace;min-width:80px}
.std-bar-wrap{flex:1;display:flex;flex-direction:column;gap:3px}
.std-bar-track{height:8px;background:rgba(255,255,255,0.06);border-radius:4px;overflow:hidden;position:relative}
.std-bar-fill{height:100%;border-radius:4px;transition:width 0.6s}
.std-bar-limit{position:absolute;top:-2px;height:12px;width:2px;background:var(--t1)}
.std-bar-labels{display:flex;justify-content:space-between;font-size:9px;color:var(--t3)}
.std-status{font-size:11px;font-weight:600;min-width:70px;text-align:right}

.std-compact{padding:10px 0;border-bottom:1px solid var(--border)}
.std-compact:last-child{border-bottom:none}
.print-btn{position:fixed;bottom:20px;right:20px;padding:8px 18px;background:var(--green);color:var(--bg);border:none;border-radius:6px;font-size:11px;font-weight:600;cursor:pointer;font-family:'DM Sans',sans-serif}
@media print{.tabs,.print-btn{display:none}.section{display:block!important;page-break-inside:avoid}}
</style>
</head>
<body>

<header class="header">
  <div>
    <h1><span>GDS</span> Results Comparison</h1>
    <div class="case-legend">
      <span><span class="case-dot" style="background:var(--design)"></span>Design Case</span>
      <span><span class="case-dot" style="background:var(--reference)"></span>Reference Case</span>
    </div>
  </div>
  <div class="meta">
    <div class="name" id="pName">--</div>
    <div id="pTime">--</div>
  </div>
</header>

<nav class="tabs">
  <div class="tab active" data-s="overview">Overview</div>
  <div class="tab" data-s="energy">Energy</div>
  <div class="tab" data-s="carbon">Carbon &amp; Cost</div>
  <div class="tab" data-s="hvac">HVAC</div>
  <div class="tab" data-s="comfort">Comfort</div>
</nav>

<main class="main">

<!-- ==================== OVERVIEW ==================== -->
<section id="overview" class="section active">
  <div class="card" style="margin-bottom:20px">
    <div class="card-head"><span class="card-title">Performance Polygon — Design vs Reference</span><span class="badge green" id="baselineLabel">Reference = Baseline</span></div>
    <p style="font-size:11px;color:var(--t2);margin-bottom:16px">Each axis shows a performance metric. The dashed polygon is the reference case (baseline). Outward = improvement relative to reference. Scale: baseline &plusmn;50%.</p>
    <div style="display:flex;gap:24px;flex-wrap:wrap;justify-content:center;align-items:flex-start">
      <svg id="polyChart" width="560" height="480"></svg>
      <div style="flex:1;min-width:280px" id="polyMetrics"></div>
    </div>
    <div class="legend-row" style="margin-top:16px;justify-content:center">
      <span class="legend-item"><span class="legend-dot" style="background:var(--design)"></span>Design Case</span>
      <span class="legend-item"><span class="legend-dot" style="border:2px dashed var(--reference);background:transparent;width:10px;height:10px"></span>Reference Case (Baseline)</span>
    </div>
  </div>
  <div class="grid-5" id="kpiRow"></div>
  <div class="card" style="margin-bottom:20px">
    <div class="card-head"><span class="card-title">Detailed Performance Metrics</span></div>
    <div id="fullTable"></div>
  </div>
  <div class="card" style="margin-bottom:20px">
    <div class="card-head"><span class="card-title">Performance Metrics Summary</span><span class="badge neutral">Design vs Reference</span></div>
    <div id="standardsGrid"></div>
  </div>

</section>

<!-- ==================== ENERGY ==================== -->
<section id="energy" class="section">
  <div class="grid-2">
    <div class="card">
      <div class="card-head"><span class="card-title">Annual End-Use Energy Comparison</span><span class="badge neutral">MWh by End Use</span></div>
      <div id="endUseCompare"></div>
      <div class="legend-row" style="margin-top:14px"><span class="legend-item"><span class="legend-dot" style="background:var(--design)"></span>Design Case</span><span class="legend-item"><span class="legend-dot" style="background:var(--reference)"></span>Reference Case</span></div>
    </div>
    <div class="card">
      <div class="card-head"><span class="card-title">Monthly Total Energy — Design vs Reference</span><span class="badge neutral">kWh/month</span></div>
      <div class="chart-wrap" id="monthCompareWrap">
        <div class="y-label">Energy (MWh)</div>
        <div class="y-axis" id="monthCompareY"></div>
        <div class="chart-area bar-chart" id="monthCompare"></div>
      </div>
      <div class="legend-row"><span class="legend-item"><span class="legend-dot" style="background:var(--design)"></span>Design Case</span><span class="legend-item"><span class="legend-dot" style="background:var(--reference)"></span>Reference Case</span></div>
    </div>
  </div>
  <div class="grid-2">
    <div class="card">
      <div class="card-head"><span class="card-title">Design Case — Annual End-Use Breakdown</span><span class="badge green">Design</span></div>
      <div style="display:flex;justify-content:center"><svg id="pieD" width="180" height="180"></svg></div>
      <div id="euListD" style="margin-top:12px"></div>
    </div>
    <div class="card">
      <div class="card-head"><span class="card-title">Reference Case — Annual End-Use Breakdown</span><span class="badge blue">Reference</span></div>
      <div style="display:flex;justify-content:center"><svg id="pieR" width="180" height="180"></svg></div>
      <div id="euListR" style="margin-top:12px"></div>
    </div>
  </div>
  <div class="grid-2">
    <div class="card">
      <div class="card-head"><span class="card-title">Design Case — Energy by Fuel Type</span></div>
      <div class="stacked-bar" id="fuelBarD"></div>
      <div class="legend-row" id="fuelLegD"></div>
      <div style="margin-top:12px">
        <div class="stat-row"><span class="stat-label">Electricity (MWh)</span><span class="stat-value" id="elecD">--</span></div>
        <div class="stat-row"><span class="stat-label">Natural Gas (MWh)</span><span class="stat-value" id="gasD">--</span></div>
        <div class="stat-row"><span class="stat-label">District (MWh)</span><span class="stat-value" id="distD">--</span></div>
        <div class="stat-row"><span class="stat-label">Total Site Energy (MWh)</span><span class="stat-value" id="totalD">--</span></div>
      </div>
    </div>
    <div class="card">
      <div class="card-head"><span class="card-title">Reference Case — Energy by Fuel Type</span></div>
      <div class="stacked-bar" id="fuelBarR"></div>
      <div class="legend-row" id="fuelLegR"></div>
      <div style="margin-top:12px">
        <div class="stat-row"><span class="stat-label">Electricity (MWh)</span><span class="stat-value" id="elecR">--</span></div>
        <div class="stat-row"><span class="stat-label">Natural Gas (MWh)</span><span class="stat-value" id="gasR">--</span></div>
        <div class="stat-row"><span class="stat-label">District (MWh)</span><span class="stat-value" id="distR">--</span></div>
        <div class="stat-row"><span class="stat-label">Total Site Energy (MWh)</span><span class="stat-value" id="totalR">--</span></div>
      </div>
    </div>
  </div>
  <div class="grid-2">
    <div class="card">
      <div class="card-head"><span class="card-title">Design Case — Monthly End-Use Breakdown</span><span class="badge green">kWh by Category</span></div>
      <div class="chart-wrap" id="stackedDWrap">
        <div class="y-label">Energy (MWh)</div>
        <div class="y-axis" id="stackedDY"></div>
        <div class="chart-area monthly-stacked" id="stackedD"></div>
      </div>
      <div class="legend-row" id="stackedLegD"></div>
    </div>
    <div class="card">
      <div class="card-head"><span class="card-title">Reference Case — Monthly End-Use Breakdown</span><span class="badge blue">kWh by Category</span></div>
      <div class="chart-wrap" id="stackedRWrap">
        <div class="y-label">Energy (MWh)</div>
        <div class="y-axis" id="stackedRY"></div>
        <div class="chart-area monthly-stacked" id="stackedR"></div>
      </div>
      <div class="legend-row" id="stackedLegR"></div>
    </div>
  </div>
  <div class="card">
    <div class="card-head"><span class="card-title">Monthly Heating &amp; Cooling Load Comparison</span><span class="badge neutral">Design vs Reference</span></div>
    <div class="chart-wrap" id="hcCompareWrap">
      <div class="y-label">Energy (MWh)</div>
      <div class="y-axis" id="hcCompareY"></div>
      <div class="chart-area bar-chart" id="hcCompare"></div>
    </div>
    <div class="legend-row">
      <span class="legend-item"><span class="legend-dot" style="background:var(--orange)"></span>Design Heating</span>
      <span class="legend-item"><span class="legend-dot" style="background:var(--blue)"></span>Design Cooling</span>
      <span class="legend-item"><span class="legend-dot" style="background:var(--orange);opacity:0.35"></span>Ref. Heating</span>
      <span class="legend-item"><span class="legend-dot" style="background:var(--blue);opacity:0.35"></span>Ref. Cooling</span>
    </div>
  </div>
</section>

<!-- ==================== CARBON & COST ==================== -->
<section id="carbon" class="section">
  <div class="grid-2">
    <div class="card">
      <div class="card-head"><span class="card-title">Annual Carbon Emissions — Design vs Reference</span></div>
      <div class="grid-2" style="margin:0;gap:20px">
        <div>
          <div class="label">Design</div>
          <div class="metric metric-sm"><span class="val" style="color:var(--design)" id="carbonD">--</span><span class="unit">kg CO2/yr</span></div>
        </div>
        <div>
          <div class="label">Reference</div>
          <div class="metric metric-sm"><span class="val" style="color:var(--reference)" id="carbonR">--</span><span class="unit">kg CO2/yr</span></div>
        </div>
      </div>
      <div id="carbonCmpBadge" style="margin-top:12px"></div>
      <div style="margin-top:16px">
        <div class="stat-row"><span class="stat-label">Design Intensity (kg CO2/m2)</span><span class="stat-value" id="ciD">--</span></div>
        <div class="stat-row"><span class="stat-label">Reference Intensity (kg CO2/m2)</span><span class="stat-value" id="ciR">--</span></div>
      </div>
    </div>
    <div class="card">
      <div class="card-head"><span class="card-title">Annual Energy Cost — Design vs Reference</span></div>
      <div class="grid-2" style="margin:0;gap:20px">
        <div>
          <div class="label">Design</div>
          <div class="metric metric-sm"><span class="val" style="color:var(--design)" id="costD">--</span><span class="unit">USD/yr</span></div>
        </div>
        <div>
          <div class="label">Reference</div>
          <div class="metric metric-sm"><span class="val" style="color:var(--reference)" id="costR">--</span><span class="unit">USD/yr</span></div>
        </div>
      </div>
      <div id="savingsBadge" style="margin-top:12px"></div>
      <div style="margin-top:16px">
        <div class="stat-row"><span class="stat-label">Design ($/m2)</span><span class="stat-value" id="cpaD">--</span></div>
        <div class="stat-row"><span class="stat-label">Reference ($/m2)</span><span class="stat-value" id="cpaR">--</span></div>
      </div>
    </div>
  </div>
  <div class="card">
    <div class="card-head"><span class="card-title">Monthly Energy Cost — Design vs Reference</span><span class="badge neutral">USD/month</span></div>
    <div class="chart-wrap" id="costCompareWrap">
      <div class="y-label">Cost (USD)</div>
      <div class="y-axis" id="costCompareY"></div>
      <div class="chart-area bar-chart" id="costCompare"></div>
    </div>
    <div class="legend-row"><span class="legend-item"><span class="legend-dot" style="background:var(--design)"></span>Design Case</span><span class="legend-item"><span class="legend-dot" style="background:var(--reference)"></span>Reference Case</span></div>
  </div>
</section>

<!-- ==================== HVAC ==================== -->
<section id="hvac" class="section">
  <div class="grid-2">
    <div class="card">
      <div class="card-head"><span class="card-title">Unmet Setpoint Hours — Design Case</span><span class="badge" id="unmetBadgeD">--</span></div>
      <div class="metric"><span class="val" id="unmetD">--</span><span class="unit">hours</span></div>
      <div class="bar-label"><span>0</span><span>Threshold: 300 hrs</span></div>
      <div class="bar"><div class="fill" id="unmetBarD"></div></div>
      <div style="margin-top:12px">
        <div class="stat-row"><span class="stat-label">Heating Unmet (hrs)</span><span class="stat-value" id="unmetHD">--</span></div>
        <div class="stat-row"><span class="stat-label">Cooling Unmet (hrs)</span><span class="stat-value" id="unmetCD">--</span></div>
      </div>
    </div>
    <div class="card">
      <div class="card-head"><span class="card-title">Unmet Setpoint Hours — Reference Case</span><span class="badge" id="unmetBadgeR">--</span></div>
      <div class="metric"><span class="val" id="unmetR">--</span><span class="unit">hours</span></div>
      <div class="bar-label"><span>0</span><span>Threshold: 300 hrs</span></div>
      <div class="bar"><div class="fill" id="unmetBarR"></div></div>
      <div style="margin-top:12px">
        <div class="stat-row"><span class="stat-label">Heating Unmet (hrs)</span><span class="stat-value" id="unmetHR">--</span></div>
        <div class="stat-row"><span class="stat-label">Cooling Unmet (hrs)</span><span class="stat-value" id="unmetCR">--</span></div>
      </div>
    </div>
  </div>
  <div class="grid-2">
    <div class="card">
      <div class="card-head"><span class="card-title">HVAC Sizing Adequacy — Design Case</span></div>
      <div class="stat-row"><span class="stat-label">Heating Capacity (kW)</span><span class="stat-value" id="hCapD">--</span></div>
      <div class="stat-row"><span class="stat-label">Heating Ratio (cap./peak)</span><span class="stat-value" id="hRatD">--</span></div>
      <div class="stat-row"><span class="stat-label">Cooling Capacity (kW)</span><span class="stat-value" id="cCapD">--</span></div>
      <div class="stat-row"><span class="stat-label">Cooling Ratio (cap./peak)</span><span class="stat-value" id="cRatD">--</span></div>
      <div class="label" style="margin-top:10px;font-size:9px">Ratio = Installed Capacity / Design Peak Load</div>
    </div>
    <div class="card">
      <div class="card-head"><span class="card-title">HVAC Sizing Adequacy — Reference Case</span></div>
      <div class="stat-row"><span class="stat-label">Heating Capacity (kW)</span><span class="stat-value" id="hCapR">--</span></div>
      <div class="stat-row"><span class="stat-label">Heating Ratio (cap./peak)</span><span class="stat-value" id="hRatR">--</span></div>
      <div class="stat-row"><span class="stat-label">Cooling Capacity (kW)</span><span class="stat-value" id="cCapR">--</span></div>
      <div class="stat-row"><span class="stat-label">Cooling Ratio (cap./peak)</span><span class="stat-value" id="cRatR">--</span></div>
      <div class="label" style="margin-top:10px;font-size:9px">Ratio = Installed Capacity / Design Peak Load</div>
    </div>
  </div>
</section>

<!-- ==================== COMFORT ==================== -->
<section id="comfort" class="section">
  <div class="grid-2">
    <div class="card">
      <div class="card-head"><span class="card-title">Zone Thermal Comfort (Fanger PMV/PPD) — Design Case</span><span class="badge green">Avg PPD: <span id="ppdD">--</span>%</span></div>
      <div style="max-height:400px;overflow-y:auto">
      <table><thead><tr><th>Zone</th><th>Avg PMV (-)</th><th>Avg PPD (%)</th><th>Comfort%</th><th>Status</th></tr></thead><tbody id="cTableD"></tbody></table>
      </div>
    </div>
    <div class="card">
      <div class="card-head"><span class="card-title">Zone Thermal Comfort (Fanger PMV/PPD) — Reference Case</span><span class="badge blue">Avg PPD: <span id="ppdR">--</span>%</span></div>
      <div style="max-height:400px;overflow-y:auto">
      <table><thead><tr><th>Zone</th><th>Avg PMV (-)</th><th>Avg PPD (%)</th><th>Comfort%</th><th>Status</th></tr></thead><tbody id="cTableR"></tbody></table>
      </div>
    </div>
  </div>
</section>

</main>
<button class="print-btn" onclick="window.print()">Export</button>

<script>
const R = RESULTS_PLACEHOLDER;
const D = R.design, Rf = R.reference, C = R.comparison;
const M = ['Jan','Feb','Mar','Apr','May','Jun','Jul','Aug','Sep','Oct','Nov','Dec'];
const MS = M.map(m => m[0]);
const EU_COLORS = {heating:'#f59e0b',cooling:'#3b82f6',lighting:'#fbbf24',equipment:'#a78bfa',fans:'#64748b',dhw:'#22d3ee',ext_lighting:'#fb923c',pumps:'#94a3b8',heat_rejection:'#f472b6',humidification:'#34d399',refrigeration:'#c084fc'};
const EU_LABELS = {heating:'Heating',cooling:'Cooling',lighting:'Lighting',equipment:'Equipment',fans:'Fans',dhw:'Hot Water',ext_lighting:'Ext Light',pumps:'Pumps',heat_rejection:'Heat Rej.',humidification:'Humid.',refrigeration:'Refrig.'};
const CATS = ['heating','cooling','lighting','equipment','fans','dhw'];
const CHART_H = 220;   // total CSS height of chart containers
const LABEL_H = 24;    // space for month labels at bottom
const BAR_H = CHART_H - LABEL_H;  // 196px — actual bar drawing area

document.addEventListener('DOMContentLoaded', () => {
    document.querySelectorAll('.tab').forEach(t => t.addEventListener('click', () => {
        document.querySelectorAll('.tab').forEach(x => x.classList.remove('active'));
        document.querySelectorAll('.section').forEach(x => x.classList.remove('active'));
        t.classList.add('active');
        document.getElementById(t.dataset.s).classList.add('active');
    }));
    document.getElementById('pName').textContent = R.projectName;
    document.getElementById('pTime').textContent = R.timestamp;
    [renderOverview, renderEnergy, renderCarbonCost, renderHVAC, renderComfort].forEach(fn => {
        try { fn(); } catch(e) { console.error(fn.name + ':', e); }
    });
});

function renderYAxis(elId, maxVal, unit, nTicks) {
    nTicks = nTicks || 5;
    const el = document.getElementById(elId);
    const step = niceStep(maxVal, nTicks);
    const niceMax = Math.ceil(maxVal / step) * step;
    if (!el) return niceMax;
    let html = '';
    for (let i = nTicks; i >= 0; i--) {
        const v = (niceMax / nTicks) * i;
        let label;
        if (unit === 'MWh') label = (v/1000).toFixed(v >= 10000 ? 0 : 1);
        else if (unit === 'USD') label = '$' + Math.round(v).toLocaleString();
        else label = v.toFixed(0);
        html += '<span class="y-tick">' + label + '</span>';
    }
    el.innerHTML = html;
    return niceMax;
}
function addGridlines(chartAreaId, nTicks) {
    nTicks = nTicks || 5;
    const ca = document.getElementById(chartAreaId);
    if (!ca) return;
    ca.style.position = 'relative';
    let gl = ca.querySelector('.gridlines');
    if (gl) gl.remove();
    gl = document.createElement('div');
    gl.className = 'gridlines';
    gl.style.cssText = 'position:absolute;left:0;right:0;top:0;bottom:'+LABEL_H+'px;pointer-events:none;z-index:0';
    let h = '';
    for (let i = 0; i <= nTicks; i++) h += '<div class="gridline" style="top:'+(i/nTicks*100)+'%"></div>';
    gl.innerHTML = h;
    ca.insertBefore(gl, ca.firstChild);
}
function niceStep(max, nTicks) {
    if (max <= 0) return 1;
    const rough = max / nTicks;
    const mag = Math.pow(10, Math.floor(Math.log10(rough)));
    const norm = rough / mag;
    let nice;
    if (norm <= 1.5) nice = 1;
    else if (norm <= 3) nice = 2;
    else if (norm <= 7) nice = 5;
    else nice = 10;
    return nice * mag || 1;
}
function getNiceMax(maxVal, nTicks) {
    nTicks = nTicks || 5;
    if (maxVal <= 0) return 1;
    const step = niceStep(maxVal, nTicks);
    return Math.ceil(maxVal / step) * step;
}

const CATS_STACKED = ['equipment','lighting','fans','dhw','cooling','heating'];

/* ============ OVERVIEW TAB ============ */
function renderOverview() {
    renderPolygon();
    const kpis = [
        {label:'Site EUI',val:C.siteEUI.design,unit:'kWh/m2',pct:C.siteEUI.pct,imp:C.siteEUI.improved},
        {label:'Annual Savings',val:C.annualSavings,unit:'',pct:null,imp:C.annualSavings>=0,fmt:v=>(v>=0?'+':'-')+'$'+Math.abs(v).toLocaleString()},
        {label:'Carbon',val:C.carbon.design,unit:'kg CO2',pct:C.carbon.pct,imp:C.carbon.improved,fmt:v=>v.toLocaleString()},
        {label:'Comfort (PPD)',val:C.ppd.design,unit:'%',pct:C.ppd.pct,imp:C.ppd.improved},
        {label:'Unmet Hours',val:C.unmetHours.design,unit:'hrs',pct:C.unmetHours.pct,imp:C.unmetHours.improved}
    ];
    document.getElementById('kpiRow').innerHTML = kpis.map(k => {
        const cls = k.imp ? 'pos' : 'neg';
        const arrow = k.imp ? '\\u2193' : '\\u2191';
        const valStr = k.fmt ? k.fmt(k.val) : k.val.toFixed(1);
        const chgStr = k.pct !== null ? (arrow + ' ' + Math.abs(k.pct).toFixed(1) + '%') : '';
        return '<div class="card kpi"><div class="val">' + valStr + '</div><div class="lbl">' + k.label + (k.unit ? ' (' + k.unit + ')' : '') + '</div>' + (chgStr ? '<div class="change ' + cls + '">' + chgStr + ' vs ref</div>' : '') + '</div>';
    }).join('');

    const metrics = [
        ['Site EUI (kWh/m2/yr)','siteEUI','f1'],['Source EUI (kWh/m2/yr)','sourceEUI','f1'],
        ['Total Energy (kWh)','totalSiteEnergy','comma'],['Electricity (kWh)','totalElectricity','comma'],
        ['Natural Gas (kWh)','totalGas','comma'],['District (kWh)','totalDistrict','comma'],['Heating (kWh)','heating','comma'],
        ['Cooling (kWh)','cooling','comma'],['Lighting (kWh)','lighting','comma'],
        ['Equipment (kWh)','equipment','comma'],['Carbon (kg CO2)','carbon','comma'],
        ['Carbon Intensity (kg/m2)','carbonIntensity','f1'],['Annual Cost ($)','cost','comma'],
        ['Comfort (PPD %)','ppd','f1'],['Unmet Hours','unmetHours','f1'],
        ['Peak Heating (kW)','peakHeating','f1'],['Peak Cooling (kW)','peakCooling','f1']
    ];
    function fmtVal(v,f){if(f==='comma')return Math.round(v).toLocaleString();if(f==='f1')return v.toFixed(1);return v}
    document.getElementById('fullTable').innerHTML = '<table><thead><tr><th>Metric</th><th>Design</th><th>Reference</th><th>Delta vs Baseline</th></tr></thead><tbody>' +
        metrics.map(([label,key,fmt]) => {
            const m = C[key]; if(!m) return '';
            const cls = m.improved ? 'good' : 'bad';
            const arrow = m.improved ? '\\u2193' : '\\u2191';
            return '<tr><td>'+label+'</td><td>'+fmtVal(m.design,fmt)+'</td><td>'+fmtVal(m.reference,fmt)+'</td><td class="stat-value '+cls+'">'+arrow+' '+Math.abs(m.pct).toFixed(1)+'%</td></tr>';
        }).join('') + '</tbody></table>';

    const dp = D.performance || {};
    const stdItems = [
        {metric:'Thermal Comfort (PPD)', note:'PPD < 10% ~ PMV within \u00b10.5', dVal:C.ppd.design, limit:20, unit:'%',
         type:'threshold', connected: dp.thermalComfort?.connected || false},
        {metric:'Unmet Setpoint Hours', note:'Common modeling threshold', dVal:C.unmetHours.design, rVal:C.unmetHours.reference, limit:300, unit:'hours',
         type:'threshold', connected: true},

    ];
    document.getElementById('standardsGrid').innerHTML = stdItems.map(item => {
        if (item.type === 'threshold') {
            const dOk = item.dVal <= item.limit;
            const dColor = dOk ? 'var(--green)' : 'var(--red)';
            const dBarW = Math.min(100, item.dVal / item.limit * 100);
            let detail = '';
            if (item.rVal !== undefined) {
                const rOk = item.rVal <= item.limit;
                const rBarW = Math.min(100, item.rVal / item.limit * 100);
                detail = '<div class="std-body" style="margin-top:6px"><span class="std-value" style="color:'+(rOk?'var(--blue)':'var(--red)')+';font-size:18px">'+item.rVal.toFixed(1)+'</span><div class="std-bar-wrap"><div class="std-bar-labels"><span>Reference</span><span></span></div><div class="std-bar-track"><div class="std-bar-fill" style="width:'+rBarW+'%;background:'+(rOk?'var(--reference)':'var(--red)')+'"></div></div></div><span class="std-status" style="color:'+(rOk?'var(--blue)':'var(--red)')+';font-size:11px">'+(rOk?'\\u2713 Within threshold':'\\u2717 Exceeds threshold')+'</span></div>';
            }
            return '<div class="std-item '+(dOk?'pass':'fail')+'"><div class="std-header"><span class="std-metric">'+item.metric+'</span><span class="std-standard" style="font-size:10px;color:var(--t3)">'+item.note+'</span></div><div class="std-body"><span class="std-value" style="color:'+dColor+'">'+item.dVal.toFixed(1)+'</span><div class="std-bar-wrap"><div class="std-bar-labels"><span>Design</span><span>Threshold: '+item.limit+' '+item.unit+'</span></div><div class="std-bar-track"><div class="std-bar-fill" style="width:'+dBarW+'%;background:'+dColor+'"></div></div></div><span class="std-status" style="color:'+dColor+'">'+(dOk?'\\u2713 Within threshold':'\\u2717 Exceeds threshold')+'</span></div>'+detail+'</div>';
        }
        return '';
    }).join('');

}

/* ============ POLYGON CHART ============ */
function renderPolygon() {
    const dp = D.performance || {};
    const axes = [
        {key:'eui', label:'Site EUI', unit:'kWh/m2/yr',
         dVal: C.siteEUI.design, rVal: C.siteEUI.reference, lowerBetter: true},
        {key:'sourceEui', label:'Source EUI', unit:'kWh/m2/yr',
         dVal: C.sourceEUI.design, rVal: C.sourceEUI.reference, lowerBetter: true},
        {key:'cost', label:'Energy Cost', unit:'$/yr',
         dVal: C.cost.design, rVal: C.cost.reference, lowerBetter: true},
        {key:'carbon', label:'Carbon', unit:'kg CO2/m2',
         dVal: C.carbonIntensity.design, rVal: C.carbonIntensity.reference, lowerBetter: true},
        {key:'comfort', label:'Comfort (PPD)', unit:'%',
         dVal: C.ppd.design, rVal: C.ppd.reference, lowerBetter: true,
         connected: dp.thermalComfort?.connected},
        {key:'unmet', label:'Unmet Hours', unit:'hrs',
         dVal: C.unmetHours.design, rVal: C.unmetHours.reference, lowerBetter: true},
        {key:'heating', label:'Heating Load', unit:'kWh',
         dVal: C.heating.design, rVal: C.heating.reference, lowerBetter: true},
        {key:'cooling', label:'Cooling Load', unit:'kWh',
         dVal: C.cooling.design, rVal: C.cooling.reference, lowerBetter: true},
        {key:'peakHeat', label:'Peak Heating', unit:'kW',
         dVal: C.peakHeating.design, rVal: C.peakHeating.reference, lowerBetter: true},
        {key:'peakCool', label:'Peak Cooling', unit:'kW',
         dVal: C.peakCooling.design, rVal: C.peakCooling.reference, lowerBetter: true}
    ].filter(a => a.connected !== false && a.rVal > 0);

    const n = axes.length;
    const svg = document.getElementById('polyChart');
    const cx = 280, cy = 240, maxR = 155, baseR = maxR * 0.55;
    const minR = maxR * 0.1;
    svg.innerHTML = '';

    axes.forEach(a => {
        if (a.rVal === 0) { a.normR = baseR; a.improvePct = 0; return; }
        const rawImprove = a.lowerBetter ? (a.rVal - a.dVal) / a.rVal : (a.dVal - a.rVal) / a.rVal;
        a.improvePct = rawImprove * 100;
        const clamped = Math.max(-0.5, Math.min(0.5, rawImprove));
        a.normR = baseR + (clamped / 0.5) * (maxR - baseR);
        if (a.normR < minR) a.normR = minR;
    });

    [{r:maxR*0.1,l:''},{r:maxR*0.325,l:'-25%'},{r:baseR,l:'Baseline'},{r:maxR*0.775,l:'+25%'},{r:maxR,l:'+50%'}].forEach(ring => {
        const c = document.createElementNS('http://www.w3.org/2000/svg','circle');
        c.setAttribute('cx',cx); c.setAttribute('cy',cy); c.setAttribute('r',ring.r);
        c.setAttribute('fill','none');
        c.setAttribute('stroke', ring.l==='Baseline' ? 'rgba(96,165,250,0.4)' : 'rgba(255,255,255,0.06)');
        c.setAttribute('stroke-width', ring.l==='Baseline' ? '2' : '1');
        if (ring.l==='Baseline') c.setAttribute('stroke-dasharray','6,4');
        svg.appendChild(c);
        if (ring.l && ring.l !== 'Baseline') {
            const t = document.createElementNS('http://www.w3.org/2000/svg','text');
            t.setAttribute('x', cx + ring.r + 2); t.setAttribute('y', cy - 2);
            t.setAttribute('font-size','8'); t.setAttribute('fill','rgba(255,255,255,0.2)');
            t.textContent = ring.l; svg.appendChild(t);
        }
    });

    axes.forEach((a, i) => {
        const angle = -Math.PI/2 + i * (2*Math.PI/n);
        const line = document.createElementNS('http://www.w3.org/2000/svg','line');
        line.setAttribute('x1',cx); line.setAttribute('y1',cy);
        line.setAttribute('x2', cx + maxR * Math.cos(angle));
        line.setAttribute('y2', cy + maxR * Math.sin(angle));
        line.setAttribute('stroke','rgba(255,255,255,0.1)'); svg.appendChild(line);
        const lx = cx + (maxR + 20) * Math.cos(angle);
        const ly = cy + (maxR + 20) * Math.sin(angle);
        const txt = document.createElementNS('http://www.w3.org/2000/svg','text');
        txt.setAttribute('x', lx); txt.setAttribute('y', ly + (Math.sin(angle) > 0.3 ? 12 : Math.sin(angle) < -0.3 ? -4 : 4));
        txt.setAttribute('text-anchor', Math.abs(Math.cos(angle)) < 0.3 ? 'middle' : Math.cos(angle) > 0 ? 'start' : 'end');
        txt.setAttribute('font-size','10'); txt.setAttribute('fill','#8b95a8');
        txt.setAttribute('font-family','DM Sans, sans-serif');
        txt.textContent = a.label; svg.appendChild(txt);
    });

    const refPts = axes.map((a,i) => {
        const angle = -Math.PI/2 + i*(2*Math.PI/n);
        return {x: cx+baseR*Math.cos(angle), y: cy+baseR*Math.sin(angle)};
    });
    const refPoly = document.createElementNS('http://www.w3.org/2000/svg','polygon');
    refPoly.setAttribute('points', refPts.map(p=>p.x+','+p.y).join(' '));
    refPoly.setAttribute('fill','rgba(96,165,250,0.06)');
    refPoly.setAttribute('stroke','#60a5fa'); refPoly.setAttribute('stroke-width','1.5');
    refPoly.setAttribute('stroke-dasharray','6,3'); svg.appendChild(refPoly);

    const desPts = axes.map((a,i) => {
        const angle = -Math.PI/2 + i*(2*Math.PI/n);
        return {x: cx+a.normR*Math.cos(angle), y: cy+a.normR*Math.sin(angle)};
    });
    const desPoly = document.createElementNS('http://www.w3.org/2000/svg','polygon');
    desPoly.setAttribute('points', desPts.map(p=>p.x+','+p.y).join(' '));
    desPoly.setAttribute('fill','rgba(74,222,128,0.12)');
    desPoly.setAttribute('stroke','#4ade80'); desPoly.setAttribute('stroke-width','2.5');
    svg.appendChild(desPoly);

    desPts.forEach((p, i) => {
        const dot = document.createElementNS('http://www.w3.org/2000/svg','circle');
        dot.setAttribute('cx',p.x); dot.setAttribute('cy',p.y); dot.setAttribute('r','4');
        dot.setAttribute('fill', axes[i].improvePct >= 0 ? '#4ade80' : '#f87171');
        dot.setAttribute('stroke','#fff'); dot.setAttribute('stroke-width','1.5');
        svg.appendChild(dot);
        const vt = document.createElementNS('http://www.w3.org/2000/svg','text');
        const angle = -Math.PI/2 + i*(2*Math.PI/n);
        const off = axes[i].normR > baseR ? 14 : -14;
        vt.setAttribute('x', p.x + off*Math.cos(angle)); vt.setAttribute('y', p.y + off*Math.sin(angle)+3);
        vt.setAttribute('text-anchor','middle'); vt.setAttribute('font-size','9'); vt.setAttribute('font-weight','600');
        vt.setAttribute('fill', axes[i].improvePct >= 0 ? '#4ade80' : '#f87171');
        vt.setAttribute('font-family','JetBrains Mono, monospace');
        vt.textContent = (axes[i].improvePct >= 0 ? '\\u2193':'\\u2191') + Math.abs(axes[i].improvePct).toFixed(1)+'%';
        svg.appendChild(vt);
    });

    document.getElementById('polyMetrics').innerHTML =
        '<table style="font-size:12px"><thead><tr><th>Metric</th><th>Design</th><th>Ref.</th><th>Delta</th><th>Standard</th></tr></thead><tbody>' +
        axes.map(a => {
            const imp = a.improvePct;
            const cls = imp >= 0 ? 'good' : 'bad';
            const arrow = imp >= 0 ? '\\u2193' : '\\u2191';
            const fmt = v => typeof v === 'number' ? (v >= 1000 ? Math.round(v).toLocaleString() : v.toFixed(1)) : '--';
            return '<tr><td>'+a.label+' <span style="color:var(--t3)">('+a.unit+')</span></td><td style="font-family:JetBrains Mono,monospace;font-weight:500">'+fmt(a.dVal)+'</td><td style="font-family:JetBrains Mono,monospace;color:var(--t3)">'+fmt(a.rVal)+'</td><td class="stat-value '+cls+'">'+arrow+' '+Math.abs(imp).toFixed(1)+'%</td><td style="color:var(--t3);font-size:10px">'+a.standard+'</td></tr>';
        }).join('') + '</tbody></table>';
}

/* ============ ENERGY TAB ============ */
function renderEnergy() {
    const endUses = ['heating','cooling','lighting','equipment','fans','dhw'];
    const de = D.energy.endUses || {}, re = Rf.energy.endUses || {};
    const maxEU = Math.max(...endUses.map(k => Math.max(de[k]||0, re[k]||0)), 1);
    document.getElementById('endUseCompare').innerHTML = endUses.map(k => {
        const dv = de[k]||0, rv = re[k]||0;
        const dp = dv/maxEU*100, rp = rv/maxEU*100;
        const diff = rv > 0 ? ((dv-rv)/rv*100) : 0;
        const cls = diff < 0 ? 'pos' : 'neg';
        return '<div class="cmp-row"><div class="cmp-label">'+(EU_LABELS[k]||k)+'</div><div class="cmp-bars"><div class="cmp-bar" style="width:'+dp+'%;background:var(--design)"><span class="cmp-bar-val">'+(dv/1000).toFixed(0)+'</span></div><div class="cmp-bar" style="width:'+rp+'%;background:var(--reference)"><span class="cmp-bar-val">'+(rv/1000).toFixed(0)+'</span></div></div><div class="cmp-change '+cls+'">'+(diff<0?'\\u2193':'\\u2191')+Math.abs(diff).toFixed(0)+'%</div></div>';
    }).join('');

    let dmt = D.energy.monthlyTotal || [];
    let rmt = Rf.energy.monthlyTotal || [];
    if (dmt.length === 0 || dmt.reduce((a,b)=>a+b,0) === 0) {
        const me = D.energy.monthlyElec || [], mg = D.energy.monthlyGas || [];
        if (me.length === 12) dmt = me.map((e,i) => e + (mg[i]||0));
    }
    if (rmt.length === 0 || rmt.reduce((a,b)=>a+b,0) === 0) {
        const me = Rf.energy.monthlyElec || [], mg = Rf.energy.monthlyGas || [];
        if (me.length === 12) rmt = me.map((e,i) => e + (mg[i]||0));
    }
    const mxM = Math.max(...dmt, ...rmt, 1);
    const mcCeil = renderYAxis('monthCompareY', mxM, 'MWh', 5);
    let mcHtml = '';
    for (let i = 0; i < 12; i++) {
        const dPx = Math.round((dmt[i]||0)/mcCeil*BAR_H);
        const rPx = Math.round((rmt[i]||0)/mcCeil*BAR_H);
        mcHtml += '<div class="month-col"><div class="bar-group">' +
            '<div class="mbar" style="height:'+dPx+'px;background:var(--design)"></div>' +
            '<div class="mbar" style="height:'+rPx+'px;background:var(--reference)"></div>' +
            '</div><span class="month-lbl">'+M[i]+'</span></div>';
    }
    document.getElementById('monthCompare').innerHTML = mcHtml;
    addGridlines('monthCompare');

    renderPieAndList(D.energy, 'pieD', 'euListD');
    renderPieAndList(Rf.energy, 'pieR', 'euListR');
    renderFuel(D.energy, 'fuelBarD', 'fuelLegD', 'elecD', 'gasD', 'distD', 'totalD');
    renderFuel(Rf.energy, 'fuelBarR', 'fuelLegR', 'elecR', 'gasR', 'distR', 'totalR');
    renderStacked(D.energy.monthlyByCategory||{}, 'stackedD', 'stackedLegD', 'stackedDY');
    renderStacked(Rf.energy.monthlyByCategory||{}, 'stackedR', 'stackedLegR', 'stackedRY');

    const dh = D.energy.monthly?.heating || D.energy.monthlyByCategory?.heating || [];
    const dc = D.energy.monthly?.cooling || D.energy.monthlyByCategory?.cooling || [];
    const rh = Rf.energy.monthly?.heating || Rf.energy.monthlyByCategory?.heating || [];
    const rc = Rf.energy.monthly?.cooling || Rf.energy.monthlyByCategory?.cooling || [];
    const hcMax = Math.max(...dh, ...dc, ...rh, ...rc, 1);
    const hcCeil = renderYAxis('hcCompareY', hcMax, 'MWh', 5);
    let hcHtml = '';
    for (let i = 0; i < 12; i++) {
        const dhPx = Math.round((dh[i]||0)/hcCeil*BAR_H);
        const dcPx = Math.round((dc[i]||0)/hcCeil*BAR_H);
        const rhPx = Math.round((rh[i]||0)/hcCeil*BAR_H);
        const rcPx = Math.round((rc[i]||0)/hcCeil*BAR_H);
        hcHtml += '<div class="month-col"><div class="bar-group">'+
            '<div class="mbar" style="height:'+dhPx+'px;background:var(--orange)"></div>'+
            '<div class="mbar" style="height:'+dcPx+'px;background:var(--blue)"></div>'+
            '<div class="mbar" style="height:'+rhPx+'px;background:var(--orange);opacity:0.35"></div>'+
            '<div class="mbar" style="height:'+rcPx+'px;background:var(--blue);opacity:0.35"></div>'+
            '</div><span class="month-lbl">'+M[i]+'</span></div>';
    }
    document.getElementById('hcCompare').innerHTML = hcHtml;
    addGridlines('hcCompare');
}

function renderPieAndList(e, pieId, listId) {
    if(!e.endUses) return;
    const total = Object.values(e.endUses).reduce((a,b)=>a+b,0);
    const svg = document.getElementById(pieId);
    svg.innerHTML = '';
    let angle = -Math.PI/2;
    Object.entries(e.endUses).forEach(([k,v])=>{
        if(v<=0) return;
        const pct=v/total;
        const end=angle+pct*2*Math.PI;
        const x1=90+70*Math.cos(angle),y1=90+70*Math.sin(angle);
        const x2=90+70*Math.cos(end),y2=90+70*Math.sin(end);
        const path=document.createElementNS('http://www.w3.org/2000/svg','path');
        path.setAttribute('d','M 90 90 L '+x1+' '+y1+' A 70 70 0 '+(pct>0.5?1:0)+' 1 '+x2+' '+y2+' Z');
        path.setAttribute('fill',EU_COLORS[k]||'#666');
        path.setAttribute('stroke','#0c1220');path.setAttribute('stroke-width','2');
        svg.appendChild(path);
        angle=end;
    });
    document.getElementById(listId).innerHTML = Object.entries(e.endUses)
        .filter(([k,v])=>v>0).sort((a,b)=>b[1]-a[1])
        .map(([k,v])=>'<div class="stat-row"><span class="stat-label"><span class="legend-dot" style="background:'+(EU_COLORS[k]||'#666')+';display:inline-block;margin-right:6px"></span>'+(EU_LABELS[k]||k)+'</span><span class="stat-value">'+(v/1000).toFixed(1)+' MWh ('+(v/total*100).toFixed(0)+'%)</span></div>').join('');
}

function renderFuel(e, barId, legId, elId, gasId, distId, totId) {
    const fb = e.fuelBreakdown||{};
    const ep = fb.electricity?.percentage||0, gp = fb.naturalGas?.percentage||0, dp = fb.district?.percentage||0;
    let barHtml = '<div class="segment" style="width:'+ep+'%;background:var(--orange)"></div>';
    if (gp > 0) barHtml += '<div class="segment" style="width:'+gp+'%;background:var(--purple)"></div>';
    if (dp > 0) barHtml += '<div class="segment" style="width:'+dp+'%;background:#22d3ee"></div>';
    document.getElementById(barId).innerHTML = barHtml;
    let legHtml = '<span class="legend-item"><span class="legend-dot" style="background:var(--orange)"></span>Elec '+ep+'%</span>';
    if (gp > 0) legHtml += '<span class="legend-item"><span class="legend-dot" style="background:var(--purple)"></span>Gas '+gp+'%</span>';
    if (dp > 0) legHtml += '<span class="legend-item"><span class="legend-dot" style="background:#22d3ee"></span>District '+dp+'%</span>';
    document.getElementById(legId).innerHTML = legHtml;
    document.getElementById(elId).textContent = (e.totalElectricity/1000).toFixed(1);
    document.getElementById(gasId).textContent = (e.totalGas/1000).toFixed(1);
    document.getElementById(distId).textContent = (e.totalDistrict/1000).toFixed(1);
    document.getElementById(totId).textContent = (e.totalSiteEnergy/1000).toFixed(1);
}

function renderStacked(mbc, chartId, legId, yAxisId) {
    const cats = CATS_STACKED;
    let maxT=0;
    for(let i=0;i<12;i++){let t=0;cats.forEach(c=>{t+=(mbc[c]?.[i]||0)});maxT=Math.max(maxT,t)}
    const ceil = yAxisId ? renderYAxis(yAxisId, maxT, 'MWh', 5) : (getNiceMax(maxT, 5));
    document.getElementById(chartId).innerHTML = M.map((m,i)=>{
        let segs='';
        cats.forEach(c=>{
            const v=mbc[c]?.[i]||0;
            const h=ceil>0?(v/ceil*BAR_H):0;
            if(h>0.5)segs+='<div class="month-seg" style="height:'+h.toFixed(1)+'px;background:'+(EU_COLORS[c]||'#666')+'"></div>';
        });
        return '<div class="month-col"><div class="month-stack">'+segs+'</div><span class="month-lbl">'+m+'</span></div>';
    }).join('');
    addGridlines(chartId);
    document.getElementById(legId).innerHTML = cats.slice().reverse().map(c=>'<span class="legend-item"><span class="legend-dot" style="background:'+(EU_COLORS[c]||'#666')+'"></span>'+(EU_LABELS[c]||c)+'</span>').join('');
}

/* ============ CARBON & COST TAB ============ */
function renderCarbonCost() {
    const dc=D.energy.carbon||{}, rc=Rf.energy.carbon||{};
    const dco=D.energy.cost||{}, rco=Rf.energy.cost||{};
    document.getElementById('carbonD').textContent = (dc.total||0).toLocaleString();
    document.getElementById('carbonR').textContent = (rc.total||0).toLocaleString();
    document.getElementById('ciD').textContent = (dc.intensity||0).toFixed(1);
    document.getElementById('ciR').textContent = (rc.intensity||0).toFixed(1);
    const cImp = C.carbon.improved;
    document.getElementById('carbonCmpBadge').innerHTML = '<span class="cmp '+(cImp?'pos':'neg')+'">'+(cImp?'\\u2193':'\\u2191')+' '+Math.abs(C.carbon.pct).toFixed(1)+'% vs reference</span>';
    document.getElementById('costD').textContent = '$'+(dco.total||0).toLocaleString();
    document.getElementById('costR').textContent = '$'+(rco.total||0).toLocaleString();
    document.getElementById('cpaD').textContent = (dco.perArea||0).toFixed(2);
    document.getElementById('cpaR').textContent = (rco.perArea||0).toFixed(2);
    const sav = C.annualSavings;
    document.getElementById('savingsBadge').innerHTML = '<span class="cmp '+(sav>=0?'pos':'neg')+'">'+(sav>=0?'Savings: +$':'Extra cost: -$')+Math.abs(sav).toLocaleString()+'/yr</span>';

    const dmc=D.energy.monthlyCost?.total||[], rmc=Rf.energy.monthlyCost?.total||[];
    const mxC=Math.max(...dmc,...rmc,1);
    const costCeil = renderYAxis('costCompareY', mxC, 'USD', 5);
    let costHtml = '';
    for (let i = 0; i < 12; i++) {
        const dPx = Math.round((dmc[i]||0)/costCeil*BAR_H);
        const rPx = Math.round((rmc[i]||0)/costCeil*BAR_H);
        costHtml += '<div class="month-col"><div class="bar-group">' +
            '<div class="mbar" style="height:'+dPx+'px;background:var(--design)"></div>' +
            '<div class="mbar" style="height:'+rPx+'px;background:var(--reference)"></div>' +
            '</div><span class="month-lbl">' + M[i] + '</span></div>';
    }
    document.getElementById('costCompare').innerHTML = costHtml;
    addGridlines('costCompare');
}

/* ============ HVAC TAB ============ */
function renderHVAC() {
    renderUnmet(D.energy, 'unmetD', 'unmetBarD', 'unmetBadgeD', 'unmetHD', 'unmetCD');
    renderUnmet(Rf.energy, 'unmetR', 'unmetBarR', 'unmetBadgeR', 'unmetHR', 'unmetCR');
    renderSizing(D.energy.hvacSizing||{}, 'hCapD', 'hRatD', 'cCapD', 'cRatD');
    renderSizing(Rf.energy.hvacSizing||{}, 'hCapR', 'hRatR', 'cCapR', 'cRatR');
}

function renderUnmet(e, totalId, barId, badgeId, hId, cId) {
    const u = e.unmetHours||{};
    document.getElementById(totalId).textContent = (u.total||0).toFixed(0);
    const pct = Math.min(100,(u.total||0)/300*100);
    const el = document.getElementById(barId);
    el.style.width = pct+'%';
    el.style.background = u.compliant ? 'var(--green)' : 'var(--red)';
    const bg = document.getElementById(badgeId);
    bg.textContent = u.compliant ? 'Within Threshold' : 'Exceeds Threshold';
    bg.className = 'badge '+(u.compliant?'green':'red');
    document.getElementById(hId).textContent = (u.heating||0).toFixed(0);
    document.getElementById(cId).textContent = (u.cooling||0).toFixed(0);
}

function renderSizing(h, hCapId, hRatId, cCapId, cRatId) {
    document.getElementById(hCapId).textContent = (h.totalHeatingCapacity||0).toFixed(1);
    document.getElementById(cCapId).textContent = (h.totalCoolingCapacity||0).toFixed(1);
    const hr=h.heatingRatio||0, cr=h.coolingRatio||0;
    const hEl=document.getElementById(hRatId), cEl=document.getElementById(cRatId);
    hEl.textContent = hr.toFixed(2);
    hEl.className = 'stat-value '+(hr>1.3?'warn':hr<1.0?'bad':'good');
    cEl.textContent = cr.toFixed(2);
    cEl.className = 'stat-value '+(cr>1.3?'warn':cr<1.0?'bad':'good');
}

/* ============ COMFORT TAB ============ */
function renderComfort() {
    renderComfortTable(D.comfort, 'cTableD', 'ppdD');
    renderComfortTable(Rf.comfort, 'cTableR', 'ppdR');
}

function renderComfortTable(c, tableId, ppdId) {
    document.getElementById(ppdId).textContent = (c?.avgPPD||0).toFixed(1);
    const tb = document.getElementById(tableId);
    if(c?.zones?.length){
        tb.innerHTML = c.zones.map(z=>{
            const st = z.ppd<=10?'good':z.ppd<=15?'warn':'bad';
            return '<tr><td>'+z.name+'</td><td>'+z.pmv.toFixed(2)+'</td><td>'+z.ppd.toFixed(1)+'%</td><td>'+(z.comfortPct||'--')+'%</td><td><span class="dot '+st+'"></span>'+(st==='good'?'OK':st==='warn'?'Marginal':'Poor')+'</td></tr>';
        }).join('');
    } else {
        tb.innerHTML = '<tr><td colspan="5" style="color:var(--t3)">No comfort data</td></tr>';
    }
}
</script>
</body>
</html>'''

# --- GRASSHOPPER COMPONENT ENTRY POINT ---

# --- Default input handling (Syracuse, NY — see docstring for citations) ---
if '_project_name' not in dir() or not _project_name:
    _project_name = "GDS Project"
if '_elec_carbon' not in dir() or not _elec_carbon:
    _elec_carbon = 0.125   # [1] EPA eGRID2022, NYUP subregion
if '_gas_carbon' not in dir() or not _gas_carbon:
    _gas_carbon = 0.181    # [2] EPA 40 CFR 98, Table C-1
if '_elec_rate' not in dir() or not _elec_rate:
    _elec_rate = 0.166     # [3] EIA, Syracuse NY avg residential
if '_gas_rate' not in dir() or not _gas_rate:
    _gas_rate = 0.04       # [4] EIA, NY residential natural gas
if '_auto_open' not in dir() or _auto_open is None:
    _auto_open = True
if '_run' not in dir():
    _run = False

# --- Outputs ---
html_path = None
report = None
monthly_design_total = None
monthly_design_elec = None
monthly_design_gas = None
monthly_design_district = None
monthly_ref_total = None
monthly_ref_elec = None
monthly_ref_gas = None
monthly_ref_district = None

if _run:
    # Validate inputs
    if not _design_sql or not os.path.exists(str(_design_sql)):
        raise ValueError("Design SQL not found: {}".format(_design_sql))
    if not _ref_sql or not os.path.exists(str(_ref_sql)):
        raise ValueError("Reference SQL not found: {}".format(_ref_sql))

    design_sql = str(_design_sql)
    ref_sql = str(_ref_sql)

    # Diagnostic: print paths and file info
    print("=" * 60)
    print("GDS EPHTML DIAGNOSTIC")
    print("=" * 60)
    print("Rates: elec_carbon={}, gas_carbon={}, elec_rate={}, gas_rate={}".format(
        _elec_carbon, _gas_carbon, _elec_rate, _gas_rate))
    for label, path in [("Design SQL", design_sql), ("Reference SQL", ref_sql)]:
        print("{}: {}".format(label, path))
        if os.path.exists(path):
            sz = os.path.getsize(path)
            import time as _t
            mt = os.path.getmtime(path)
            print("  Size: {} bytes ({:.1f} MB), Modified: {}".format(
                sz, sz/1e6, _t.strftime('%Y-%m-%d %H:%M:%S', _t.localtime(mt))))
        else:
            print("  *** FILE DOES NOT EXIST ***")
    print("=" * 60)

    # [1/4] Parse design case
    print("[1/4] Parsing Design Case...")
    design = SQLParser(design_sql, _elec_carbon, _gas_carbon,
                       _elec_rate, _gas_rate).parse()
    print("  Site EUI: {} kWh/m2/yr".format(design['energy']['siteEUI']))

    # [2/4] Parse reference case
    print("[2/4] Parsing Reference Case...")
    reference = SQLParser(ref_sql, _elec_carbon, _gas_carbon,
                          _elec_rate, _gas_rate).parse()
    print("  Site EUI: {} kWh/m2/yr".format(reference['energy']['siteEUI']))

    # [3/4] Calculate comparison
    print("[3/4] Calculating Comparison...")
    comparison = calc_comparison(design, reference)

    # [4/4] Generate dashboard
    print("[4/4] Generating Dashboard...")
    results = {
        'projectName': _project_name,
        'timestamp': datetime.now().strftime('%Y-%m-%d %H:%M:%S'),
        'design': design,
        'reference': reference,
        'comparison': comparison
    }

    output_dir = os.path.dirname(design_sql)
    safe_name = _project_name.replace(' ', '_')
    output_path = os.path.join(output_dir,
        "GDS_Comparison_{}.html".format(safe_name))

    html = get_html_template().replace('RESULTS_PLACEHOLDER', json.dumps(results))
    with open(output_path, 'w', encoding='utf-8') as f:
        f.write(html)

    html_path = output_path
    report = build_report(design, reference, comparison)

    # Expose monthly data as outputs (full precision, kWh)
    monthly_design_total = design['energy']['monthlyTotal']
    monthly_design_elec = design['energy']['monthlyElec']
    monthly_design_gas = design['energy']['monthlyGas']
    monthly_design_district = design['energy'].get('monthlyDistrict', [0]*12)
    monthly_ref_total = reference['energy']['monthlyTotal']
    monthly_ref_elec = reference['energy']['monthlyElec']
    monthly_ref_gas = reference['energy']['monthlyGas']
    monthly_ref_district = reference['energy'].get('monthlyDistrict', [0]*12)

    print("\nDashboard saved: {}".format(html_path))
    print(report)

    if _auto_open:
        webbrowser.open('file://' + os.path.abspath(output_path))

    print("\nDone!")
else:
    report = "Set _run to True to execute."
# ---------- end gds_html_results ----------

panel_5 = Panel(gds_html_results.monthly_design_total)
panel_6 = Panel(gds_designcase.report)
panel_7 = Panel(gds_html_results.report)
vizbytype = HBVisualizeByType(hb_objs=gds_designcase.hb_objs)  # -> walls, interior_walls, roofs, ceilings, exterior_floors, interior_floors, air_walls, apertures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; plug-in component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
preview = CustomPreview(
    Geometry=[vizbytype.wire_frame, vizbytype.walls, vizbytype.interior_walls, vizbytype.interior_doors, vizbytype.doors],
    Material={diffuse=RGB(221, 160, 221), emission=RGB(66, 48, 66), shine=0.5, specular=RGB(255, 255, 255), transparency=0})

# ==== cluster GDS_BakeRefer
brep = ClusterInput()
bld_name = ClusterInput()
bool = ClusterInput()
bool_2 = Boolean(bool)
layer = ClusterInput()

refbake = ReferenceByBakeName(BakeName=bld_name, Key="*", Val="*", lightweight=False, DisableAutoUpdate=False)
lng = ListLength(List=refbake)
brep_2 = Brep(brep)
bld_name_2 = Data(bld_name)
graft = GraftTree(Tree=brep_2, IncludeEmptyLists=True, IncludeNullItems=True)
list = ValueList({"AddSuffix", "Overwrite", "ThrowError", "UseExisting"}, selected="UseExisting")
ef_att = EleFrontAttributes(Layer=layer, maintainBakeName=False)
viewer = ParamViewer(graft)
tstat = TreeStatistics(Tree=viewer)  # -> Paths, Length, Count
dup = DuplicateData(Data=ef_att, Number=tstat.Length, Order=True)
bld_name_3 = ClusterOutput(bld_name_2)

bool_3 = Boolean(lng)
expression = Expression(x=bool_3, y=bool_2, Expression="If(y=false, If(x=true,false,true),true)")

bool_4 = Boolean(expression)
panel = Panel(bool_4)
bksettings = BakeSettings(
    AutoPushBlockDefinition=bool_4,
    AutoManifestGhostGeometry=bool_4,
    BlockNamesHandling=list,
    DimStyleNameHandling=list,
    MaterialNameHandling=list)
bake = BakeObjects(
    Geometry=brep_2,
    Attributes=dup,
    BakeName=bld_name_2,
    BakeSettings=bksettings,
    Bake=panel,
    createGroups=False,
    preset="Safest")  # -> Message, Ghosts

G = ClusterOutput(refbake)

# ==== cluster GDS_Context
filepath = ClusterInput()
iv = ImportVector(FilePath=filepath, ClipIt=False, PointsOnly=False)  # -> DataExtents, Fields, simplify(Values), simplify(FeatureGeometry)
i = ClusterInput()
fields = ClusterOutput(iv.Fields)

# ----
# Select Height Value
item = ListItem(List=iv.Values, Index=i, Wrap=True)

preview = CustomPreview(
    Geometry=iv.DataExtents,
    Material={diffuse=RGB(221, 160, 221), emission=RGB(66, 48, 66), shine=0.5, specular=RGB(255, 255, 255), transparency=0})

# ----
# Footprint Information
medges = MeshEdges(Mesh=iv.FeatureGeometry)  # -> NakedEdges, InteriorEdges, NonManifoldEdges
boundary = BoundarySurfaces(Edges=medges.NakedEdges)

# ----
# Used for handling unit conversion
panel = Panel("1")

multiplication = Multiplication(A=panel, B=item)
Z = UnitZ(Factor=multiplication)

# ----
# Relocate Geometry to Origin
bbox = BoundingBox(Content=flatten(boundary), Plane=PlaneXY(0, 0, 0), UnionBox=True)  # -> Box, Box_2
debox = DeconstructBox(Box=bbox.Box)  # -> Plane, X, Y, Z
dedomain = DeconstructDomain(Domain=debox.X)  # -> Start, End
dedomain_2 = DeconstructDomain(Domain=debox.Y)  # -> Start, End
pt = ConstructPoint(XCoordinate=dedomain.Start, YCoordinate=dedomain_2.Start, ZCoordinate="0")
vec2pt = Vector2Pt(PointA=pt, PointB="0,0", Unitize=False)  # -> Vector, Length
move = Move(Geometry=boundary, Motion=vec2pt.Vector)  # -> Geometry, Transform

txt = ClusterInput()
bool = ClusterInput()

# ----
# Bake to Rhino
txt_2 = Text(txt)
refbake = ReferenceByBakeName(BakeName=txt_2, Key="*", Val="*", lightweight=False, DisableAutoUpdate=False)
lng = ListLength(List=refbake)
bool_2 = Boolean(lng)
bool_3 = Boolean(bool)
extr = Extrude(Base=move.Geometry, Direction=Z)
expression = Expression(x=bool_2, y=bool_3, Expression="If(y=false, If(x=true,false,true),true)")
clean = CleanTree(RemoveNulls=True, RemoveInvalid=True, RemoveEmpty=True, Tree=extr)
viewer = ParamViewer(clean)
tstat = TreeStatistics(Tree=viewer)  # -> Paths, Length, Count
list = ValueList({"AddSuffix", "Overwrite", "ThrowError", "UseExisting"}, selected="AddSuffix")
bool_4 = Boolean(expression)
ef_att = EleFrontAttributes(Layer="GDS::Context", maintainBakeName=False)
dup = DuplicateData(Data=ef_att, Number=tstat.Length, Order=True)  # -> graft(Data)
panel_2 = Panel(bool_4)
bksettings = BakeSettings(
    AutoPushBlockDefinition=bool_4,
    AutoManifestGhostGeometry=bool_4,
    BlockNamesHandling=list,
    DimStyleNameHandling=list,
    MaterialNameHandling=list)
bake = BakeObjects(Geometry=clean, Attributes=dup, BakeName=txt_2, BakeSettings=bksettings, Bake=bool_4, createGroups=False)  # -> Message, Ghosts
man = ManifestGhostGeometry(GhostGeometry=bake.Ghosts, lightweight=True, DisableAutoUpdate=False, OnlyReferenced=False, ValueTable_lightweight=False)

G = ClusterOutput(refbake)

# ==== cluster GDS_DesignCase
path = ClusterInput()
show_faceattr = HBFaceEnergyAttributes({"Construction": "properties.energy.construction.display_name", "Materials": "properties.energy.construction.layers", "Thickness [m]": "properties.energy.construction.thickness", "Density [kg/m2]": "properties.energy.construction.mass_area_density", "Heat Capacity [J/K-m2]": "properties.energy.construction.area_heat_capacity", "Construction R-Value [m2-K/W]": "properties.energy.construction.r_value", "Construction U-Value [W/m2-K]": "properties.energy.construction.u_value", "Construction U-Factor [W/m2-K]": "properties.energy.construction.u_factor", "Construction SHGC [Unshaded]": "properties.energy.construction.shgc", "R-Factor [m2-K/W]": "properties.energy.r_factor", "U-Factor [W/m2-K]": "properties.energy.u_factor", "SHGC [Unshaded]": "properties.energy.shgc", "Solar Transmitance [Unshaded]": "properties.energy.construction.solar_transmittance", "Visible Transmitance [Unshaded]": "properties.energy.construction.visible_transmittance", "Solar Reflectance [Outside]": "properties.energy.construction.outside_solar_reflectance", "Solar Reflectance [Inside]": "properties.energy.construction.inside_solar_reflectance", "Fraction Area Operable": "properties.energy.vent_opening.fraction_area_operable", "Fraction Height Operable": "properties.energy.vent_opening.fraction_height_operable", "Discharge Coefficient": "properties.energy.vent_opening.discharge_coefficient"}, selected="Construction")
path_2 = FilePath(path)
null = NullItem(Item=path_2)  # -> NullFlags, InvalidFlags, Description
not = GateNot(A=null.InvalidFlags)
loadobjects = HBLoadObjects(hb_file=path_2, load=not)  # -> report, hb_objs; plug-in component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
data = Data(show_faceattr)
lablefaces = HBLabelFaces(hb_objs=flatten(loadobjects.hb_objs), attribute=data, sub_faces=Toggle(False), txt_height=0.1)  # -> label_text, base_pts, labels, wire_frame; plug-in component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
epw_file = ClusterInput()
settings = ClusterInput()
hb_objs = ClusterOutput(loadobjects.hb_objs)

# ----
# GDS Design Package
design_case = DesignCase(model=loadobjects.hb_objs, epw_file=epw_file, settings=settings)  # -> cooling, report, heating, sql

sql = ClusterOutput(design_case.sql)
lablefaces_2 = HBLabelFaces(hb_objs=flatten(loadobjects.hb_objs), attribute=data, sub_faces=Toggle(True), txt_height=0.08)  # -> label_text, base_pts, labels, wire_frame; plug-in component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
report = ClusterOutput(design_case.report)

# ==== cluster GDS_RawRoom
name = ClusterInput()
geo = ClusterInput()
name_2 = Data(name)
geo_2 = Data(geo)
conditioned = ClusterInput()
concat = Concatenate(FragmentA="GDS_", FragmentB=name_2)
mod_set = ClusterInput()
constr_set = ClusterInput()
program = ClusterInput()
geo_3 = ClusterInput()
geo_4 = ClusterInput()
roomsolid = HBRoomFromSolid(geo=flatten(geo_2), name=concat, mod_set=mod_set, constr_set=constr_set, program=program, conditioned=conditioned)  # -> report, rooms; plug-in component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
aperture = HBAperture(geo=geo_3, operable=Toggle(True))  # -> report, apertures; plug-in component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
door = HBDoor(geo=geo_4)  # -> report, doors; plug-in component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
addsubface = HBAddSubface(hb_obj=flatten(roomsolid.rooms), sub_faces=flatten([aperture.apertures, door.doors]))  # -> report, hb_obj, unmatched; plug-in component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
toggle = BooleanToggle(True)
intsolid = HBIntersectSolids(rooms=flatten(addsubface.hb_obj), run=toggle)  # -> int_rooms; plug-in component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
solveadj = HBSolveAdjacency(rooms=flatten(intsolid), run=toggle)  # -> report, adj_rooms; plug-in component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
adj_rooms = ClusterOutput(solveadj.adj_rooms)

# ==== cluster GDS_RefCase
rooms = ClusterInput()
hb_str = ClusterInput()
geo = ClusterInput()
strtoobj = HBStringToObject(hb_str=hb_str)  # -> hb_obj; plug-in component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

# ----
# All user-inputs valid?
null = NullItem(Item=strtoobj)  # -> NullFlags, InvalidFlags, Description
ma = MassAddition(Input=null.NullFlags)  # -> Result, PartialResults
equals = Equality(FirstNumber=ma.Result, SecondNumber=0)  # -> Equality, Inequality

shade = HBShade(geo=geo)  # -> report, shades; plug-in component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

# ----
# All user-inputs valid?
null_2 = NullItem(Item=geo)  # -> NullFlags, InvalidFlags, Description
ma_2 = MassAddition(Input=null_2.NullFlags)  # -> Result, PartialResults
equals_2 = Equality(FirstNumber=ma_2.Result, SecondNumber=0)  # -> Equality, Inequality

_0 = ClusterInput()
filter = StreamFilter(Gate=equals.Equality, Stream0=_0, Stream1=strtoobj)
applyprogram = HBApplyProgramType(rooms=flatten(rooms), program=filter)  # -> report, rooms; plug-in component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
filter_2 = StreamFilter(Gate=equals_2.Equality, Stream1=shade.shades)
rooms_2 = ClusterOutput(applyprogram.rooms)

# ----
# HB Model Setup
model = HBModel(rooms=flatten(applyprogram.rooms), shades=flatten(filter_2), name="ref_ASHRAE2019")  # -> report, model; plug-in component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

# ----
# Reference Package
model_2 = ClusterOutput(model.model)
settings = ClusterInput()
epw_file = ClusterInput()
gds_comfortparser = IronPython2Script(settings=settings)  # -> report, clothing, air_vel, work_eff, ankle_vel, comfort_model, ashrae_warnings; inputs settings: String
# ---------- gds_comfortparser: IronPython ----------
# -*- coding: utf-8 -*-
"""
GDS Comfort Parser
Parses comfort settings string from GDS Hub and outputs individual parameters.
-
Inputs:
    _settings: Settings string from GDS Hub (key=value format, semicolon-separated)
               Example: "clothing=0.7;air_vel=0.1;work_eff=0;comfort_model=Fanger"
Outputs:
    clothing: Clothing insulation (clo)
    air_vel: Air velocity (m/s)
    work_eff: Work efficiency (0-1)
    ankle_vel: Ankle air velocity (m/s)
    comfort_model: Comfort model type
    ashrae_warnings: Enable ASHRAE 55 warnings
    report: Parse status
-
GhPython component for Grasshopper
Wire the outputs to GDS_ComfortInjector inputs
"""

# Initialize outputs as None (empty wire)
clothing = None
air_vel = None
work_eff = None
ankle_vel = None
comfort_model = None
ashrae_warnings = None
report = "No settings string"

def parse_keyvalue(s):
    """Parse key=value format: clothing=0.7;air_vel=0.1"""
    result = {}
    try:
        pairs = s.split(';')
        for pair in pairs:
            if '=' in pair:
                key, val = pair.strip().split('=', 1)
                key = key.strip().lower()
                val = val.strip()
                
                # Convert to appropriate type
                if val.lower() == 'true':
                    result[key] = True
                elif val.lower() == 'false':
                    result[key] = False
                elif val.lower() in ['none', '']:
                    continue  # Skip empty values
                else:
                    try:
                        result[key] = float(val)
                    except:
                        result[key] = val  # Keep as string
        return result
    except:
        return None

if _settings and str(_settings).strip():
    settings_str = str(_settings).strip()
    parsed = parse_keyvalue(settings_str)
    
    if parsed:
        # Extract values (None if not present)
        clothing = parsed.get('clothing')
        air_vel = parsed.get('air_vel') or parsed.get('air_velocity')
        work_eff = parsed.get('work_eff') or parsed.get('work_efficiency')
        ankle_vel = parsed.get('ankle_vel') or parsed.get('ankle_velocity')
        comfort_model = parsed.get('comfort_model') or parsed.get('model')
        ashrae_warnings = parsed.get('ashrae_warnings') or parsed.get('warnings')
        
        # Count how many values were parsed
        count = sum(1 for v in [clothing, air_vel, work_eff, ankle_vel, comfort_model, ashrae_warnings] if v is not None)
        report = "Parsed {} value(s)".format(count)
    else:
        report = "Error: Could not parse settings string"
else:
    report = "No settings string provided"
# ---------- end gds_comfortparser ----------
modeltoosm = HBModelToOSM(model=model.model, epw_file=epw_file, write=Toggle(True), run=Toggle(False))  # -> report, jsons, osw, osm, idf, sql, zsz, rdd, html; plug-in component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
gds_comfortinjector = IronPython2Script(
    idf_path=modeltoosm.idf,
    clothing=gds_comfortparser.clothing,
    air_vel=gds_comfortparser.air_vel,
    work_eff=gds_comfortparser.work_eff,
    ankle_vel=gds_comfortparser.ankle_vel,
    comfort_model=gds_comfortparser.comfort_model,
    ashrae_warnings=gds_comfortparser.ashrae_warnings)  # -> report, idf_path; same code as gds_comfortinjector
panel = Panel(gds_comfortinjector.report)
runidf = HBRunIDF(idf=gds_comfortinjector.idf_path, epw_file=epw_file, cpu_count=Slider(4, range=1..8), run=Toggle(True))  # -> report, sql, zsz, rdd, html; plug-in component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
sql = ClusterOutput(runidf.sql)

# ==== cluster GDSRef
brep_geo = ClusterInput()
overwrite = ClusterInput()
gds_bake_refer_door = GDS_BakeRefer_door(layer="GDS_Doors", brep=brep_geo, bld_name="DefinedDoors", bool=overwrite)  # -> G, bld_name_3
brep_geo_2 = ClusterOutput(gds_bake_refer_door.G)

# ==== cluster GDSRef_2
brep_geo = ClusterInput()
overwrite = ClusterInput()
gds_bake_refer_aperture = GDS_BakeRefer_door(layer="GDS_Apertures", brep=brep_geo, bld_name="DefinedApertures", bool=overwrite)  # -> G, bld_name_3
brep_geo_2 = ClusterOutput(gds_bake_refer_aperture.G)

# ==== cluster DefSet

# ----
# Default ModSet
# Default ConstrSet
# Default Program
constructiontypes = HBConstructionTypes({"SteelFramed", "WoodFramed", "Mass", "Metal Building"}, selected="SteelFramed")
bldgprograms = HBBuildingPrograms({"LargeOffice", "MediumOffice", "SmallOffice", "MidriseApartment", "HighriseApartment", "Retail", "StripMall", "PrimarySchool", "SecondarySchool", "SmallHotel", "LargeHotel", "Hospital", "Outpatient", "Laboratory", "Warehouse", "SuperMarket", "FullServiceRestaurant", "QuickServiceRestaurant", "Courthouse", "College", "LargeDataCenterHighITE", "LargeDataCenterLowITE", "SmallDataCenterHighITE", "SmallDataCenterLowITE"}, selected="MidriseApartment")
climatezones = HBClimateZones({"1 - Very Hot": "1", "2 - Hot": "2", "3 - Warm": "3", "4 - Mixed": "4", "5 - Cool": "5", "6 - Cold": "6", "7 - Very Cold": "7", "8 - Subarctic": "8"}, selected="5 - Cool")
bldgvintages = HBBuildingVintages({"ASHRAE 90.1 2019  |  IECC 2021": "2019", "ASHRAE 90.1 2016  |  IECC 2018": "2016", "ASHRAE 90.1 2013  |  IECC 2015": "2013", "ASHRAE 90.1 2010  |  IECC 2012": "2010", "ASHRAE 90.1 2007  |  IECC 2009": "2007", "ASHRAE 90.1 2004  |  IECC 2006": "2004", "1980-2004 (CBECS)": "1980_2004", "Pre-1980 (CBECS)": "pre_1980"}, selected="ASHRAE 90.1 2019  |  IECC 2021")
bldgvintages_2 = HBBuildingVintages({"ASHRAE 90.1 2019  |  IECC 2021": "2019", "ASHRAE 90.1 2016  |  IECC 2018": "2016", "ASHRAE 90.1 2013  |  IECC 2015": "2013", "ASHRAE 90.1 2010  |  IECC 2012": "2010", "ASHRAE 90.1 2007  |  IECC 2009": "2007", "ASHRAE 90.1 2004  |  IECC 2006": "2004", "1980-2004 (CBECS)": "1980_2004", "Pre-1980 (CBECS)": "pre_1980"}, selected="ASHRAE 90.1 2019  |  IECC 2021")

searchmodsets = HBSearchModifierSets(keywords="Exterior_Solar")  # -> mod_sets; plug-in component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
constrsetclimate = HBConstructionSetByClimate(climate_zone=climatezones, vintage=bldgvintages, constr_type=constructiontypes)  # -> constr_set; plug-in component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
searchprog = HBSearchPrograms(bldg_prog=bldgprograms, vintage=bldgvintages_2, keywords="Apartment")  # -> room_prog; plug-in component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
mod_sets = ClusterOutput(searchmodsets)
room_prog = ClusterOutput(searchprog)
constr_set = ClusterOutput(constrsetclimate)

# ==== cluster CV
C = ClusterInput()
end = EndPoints(Curve=C)  # -> Start, End
vec2pt = Vector2Pt(PointA=end.End, PointB=end.Start, Unitize=True)  # -> Vector, Length
V = ClusterOutput(vec2pt.Vector)

# ==== cluster GDS_CONTAM
blds = ClusterInput()
door = ClusterInput()
aperture = ClusterInput()
door_2 = Data(door)
blds_2 = Data(blds)
aperture_2 = Data(aperture)
D = ClusterInput()
lng = ListLength(List=aperture_2)
repeat = RepeatData(Data=D, Length=lng)
run = ClusterInput()
gds_contam_openings = IronPython2Script(
    breps=blds_2,
    window_breps=aperture_2,
    window_states=repeat,
    door_breps=door_2,
    envelope_el="leaky",
    window_el="leaky",
    run=run)  # -> msg, openings_json; inputs breps: list of Brep, room_names: list of String, window_breps: list of Brep, window_states: list of String, door_breps: list of Brep, door_states: list of String, envelope_el: String, window_el: String, interior_el: String, vertical_el: String, run: Boolean
# ---------- gds_contam_openings: IronPython ----------
# -*- coding: utf-8 -*-
"""
GDS CONTAM Openings Interpreter
===============================

SPDX-License-Identifier: BSD-3-Clause
Copyright (c) 2026 SyracuseCoE, Syracuse University. All rights reserved.

Redistribution and use in source and binary forms, with or without
modification, are permitted provided that the conditions stated in the
LICENSE file distributed with this project are met.

Author: Chengbo Du <cdu113@syr.edu>

Translate Brep geometry and per-opening states to CONTAM airflow path
specifications. Output is consumed by GDS_CONTAM_RUN.

INPUTS:
  run            : bool        - Trigger run; results cached in sc.sticky
  breps          : list[Brep]  - Room geometry
  room_names     : list[str]   - Room names matching breps
  window_breps   : list[Brep]  - Window surfaces (optional)
  window_states  : list[str]   - Per-window: "open" / "closed" / "tilted" / "fixed"
  door_breps     : list[Brep]  - Door surfaces (optional)
  door_states    : list[str]   - Per-door: "open" / "closed" / "ajar"
  envelope_el    : str         - "tight" / "typical" / "leaky"
  window_el      : str         - "tight" / "typical" / "leaky"
                                 (frame seal for closed/fixed windows)
  interior_el    : str         - "door_open" / "door_undercut"
  vertical_el    : str         - "floor_leak" / "stairwell" / "shaft" / "open"
                                 (inter-floor connections)

OUTPUTS:
  openings_json : str  - JSON array of opening specs
  msg           : str  - Status / diagnostics
"""

import Rhino.Geometry as rg
import scriptcontext as sc
import json, math

# --- PRESET LIBRARIES ---

# Envelope presets: values verified against ASHRAE and CONTAM defaults.
# Flow in kg/s per m2 of wall area at reference dP.
ENVELOPE_PRESETS = {
    "tight":   {"dP": 50.0, "Flow": 0.0005, "expt": 0.65},  # ACH50 ~ 1
    "typical": {"dP": 50.0, "Flow": 0.0025, "expt": 0.65},  # ACH50 ~ 5
    "leaky":   {"dP": 50.0, "Flow": 0.0075, "expt": 0.65},  # ACH50 ~ 15
}

# Door state -> effective geometry.  All use dor_door (two-way flow).
# ht_factor: fraction of actual door height used as effective opening.
# cd: discharge coefficient.
DOOR_STATE_MAP = {
    "open":   {"ht_factor": 1.0,  "cd": 0.78},
    "closed": {"ht_factor": 0.0,  "cd": 0.65, "ht_override": 0.01},  # undercut
    "ajar":   {"ht_factor": 0.3,  "cd": 0.60},
}

# Door frame leakage (plr_test1).
# Added as a companion path for every door — models air leakage through the
# perimeter crack between door frame and wall, independent of door state.
# Flow is per metre of perimeter at reference dP; mult = perimeter length.
# Reference: ASHRAE Fundamentals Ch.16, typical residential frame crack.
DOOR_FRAME_LEAK = {
    "dP": 50.0, "Flow": 0.00035, "expt": 0.65,   # ~0.35 g/s per m @ 50 Pa
}

# Window state -> opening type + params.
# "open":   dor_door with full height (fully open casement/awning)
# "tilted": dor_door with 15% effective height (tilt-and-turn cracked)
# "closed": plr_test1 perimeter crack (frame leakage only)
# "fixed":  plr_test1 very tight (sealed/non-operable)
WINDOW_STATE_MAP = {
    "open":   {"type": "dor_door", "ht_factor": 1.0, "cd": 0.60},
    "tilted": {"type": "dor_door", "ht_factor": 0.15, "cd": 0.40},
    "closed": {"type": "plr_test1", "dP": 50.0, "Flow": 0.0015, "expt": 0.65},
    "fixed":  {"type": "plr_test1", "dP": 50.0, "Flow": 0.0005, "expt": 0.65},
}

# Window element presets (controls frame seal quality for closed/fixed windows).
# Overrides the Flow parameter in WINDOW_STATE_MAP for "closed" and "fixed" states.
# "tight"   = well-sealed modern frames
# "typical" = standard residential (default, matches WINDOW_STATE_MAP values)
# "leaky"   = old/deteriorated frames, single-pane
WINDOW_EL_PRESETS = {
    "tight":   {"dP": 50.0, "Flow": 0.0005, "expt": 0.65},
    "typical": {"dP": 50.0, "Flow": 0.0015, "expt": 0.65},
    "leaky":   {"dP": 50.0, "Flow": 0.005, "expt": 0.65},
}

# Interior adjacency presets (for auto-detected shared faces without door breps).
INTERIOR_PRESETS = {
    "door_open":     {"ht": 2.1, "wd": 0.9, "cd": 0.78},
    "door_undercut": {"ht": 0.01, "wd": 0.9, "cd": 0.65},
}

# Vertical connection presets.  Each maps to a dtype + params.
# Ht and Area are overridden by actual detected geometry.
VERTICAL_PRESETS = {
    "floor_leak":  {"dtype": "plr_test1",
                    "params": {"dP": 50.0, "Flow": 0.001, "expt": 0.65}},
    "stairwell":   {"dtype": "plr_stair",
                    "params": {"Ht": 3.0, "Area": 8.0, "peo": 0.0, "tread": 0}},
    "shaft":       {"dtype": "plr_shaft",
                    "params": {"Ht": 3.0, "area": 4.0, "perim": 8.0, "rough": 0.003}},
    "open":        {"dtype": "dor_door",
                    "params": {"ht": 2.1, "wd": 2.0, "cd": 0.78}},
}

# --- GEOMETRY ANALYSIS ---

def _extract_zones(breps, room_names):
    """Lightweight zone extraction for geometry matching only.
    Returns list of zone dicts with brep, name, bbox data."""
    zones = []
    for i, brep in enumerate(breps):
        name = room_names[i] if i < len(room_names) else "Room{}".format(i + 1)
        bb = brep.GetBoundingBox(True)
        zones.append({
            'name': name,
            'brep': brep,
            'bbox_min_z': bb.Min.Z,
            'bbox_max_z': bb.Max.Z,
            'height': bb.Max.Z - bb.Min.Z if bb.Max.Z > bb.Min.Z else 3.0,
        })
    return zones

def _detect_envelope_faces(zones, tolerance=0.01):
    """Find exterior vertical faces -> one opening per face.
    Uses bbox proximity to skip expensive ClosestPoint calls."""
    # Pre-compute inflated bboxes for all zones
    zone_bboxes = []
    for z in zones:
        bb = z['brep'].GetBoundingBox(True)
        bb.Inflate(tolerance * 10)
        zone_bboxes.append(bb)

    envelopes = []
    for zi, zone in enumerate(zones):
        brep = zone['brep']
        for fi in range(brep.Faces.Count):
            face = brep.Faces[fi]
            u_mid = face.Domain(0).Mid
            v_mid = face.Domain(1).Mid
            pt = face.PointAt(u_mid, v_mid)
            normal = face.NormalAt(u_mid, v_mid)

            if abs(normal.Z) > 0.7:
                continue  # skip floors/ceilings

            # Check if shared with another zone -- bbox gate first
            is_interior = False
            for zj, other in enumerate(zones):
                if zj == zi:
                    continue
                if not zone_bboxes[zj].Contains(pt):
                    continue  # face centre not even near this zone
                cp = other['brep'].ClosestPoint(pt)
                if cp.IsValid and pt.DistanceTo(cp) < tolerance * 10:
                    is_interior = True
                    break
            if is_interior:
                continue

            amp = rg.AreaMassProperties.Compute(face)
            area = amp.Area if amp else 1.0
            azimuth = math.degrees(math.atan2(normal.X, normal.Y))
            if azimuth < 0:
                azimuth += 360
            relHt = pt.Z - zone['bbox_min_z']

            envelopes.append({
                'zone': zone['name'], 'area': round(area, 2),
                'azimuth': round(azimuth, 1), 'relHt': round(relHt, 2),
            })
    return envelopes

def _detect_adjacencies(zones, tolerance=0.1):
    """Find shared faces between zone Breps -> interior connections.
    Uses tight bbox overlap to skip expensive BrepBrep intersections."""
    connections = []
    n = len(zones)
    for i in range(n):
        for j in range(i + 1, n):
            bbi = zones[i]['brep'].GetBoundingBox(True)
            bbj = zones[j]['brep'].GetBoundingBox(True)
            # Tight gap check: bboxes must be within tolerance on ALL axes
            gap_x = max(bbi.Min.X, bbj.Min.X) - min(bbi.Max.X, bbj.Max.X)
            gap_y = max(bbi.Min.Y, bbj.Min.Y) - min(bbi.Max.Y, bbj.Max.Y)
            gap_z = max(bbi.Min.Z, bbj.Min.Z) - min(bbi.Max.Z, bbj.Max.Z)
            if gap_x > tolerance or gap_y > tolerance or gap_z > tolerance:
                continue  # bboxes clearly separated -- skip
            result = rg.Intersect.Intersection.BrepBrep(
                zones[i]['brep'], zones[j]['brep'], tolerance)
            if result and len(result[1]) > 0:
                connections.append({
                    'zone_a': zones[i]['name'],
                    'zone_b': zones[j]['name'],
                })
    return connections

def _detect_levels(zones, floor_tolerance=0.3):
    """Group zones into levels by Z base, assign level index to each zone."""
    z_bases = sorted(set(round(z['bbox_min_z'], 1) for z in zones))
    level_idx = 1
    current_base = z_bases[0] if z_bases else 0
    level_map = {}
    for zb in z_bases:
        if zb - current_base > floor_tolerance:
            level_idx += 1
            current_base = zb
        level_map[round(zb, 1)] = level_idx
    for z in zones:
        z['level'] = level_map.get(round(z['bbox_min_z'], 1), 1)
    return len(set(level_map.values()))

def _detect_vertical_connections(zones, tolerance=0.1):
    """Find vertically stacked zone pairs (ceiling<->floor adjacency)."""
    vertical = []
    n = len(zones)
    for i in range(n):
        for j in range(i + 1, n):
            if zones[i].get('level', 1) == zones[j].get('level', 1):
                continue
            top_i = zones[i]['bbox_max_z']
            bot_j = zones[j]['bbox_min_z']
            top_j = zones[j]['bbox_max_z']
            bot_i = zones[i]['bbox_min_z']

            below, above = None, None
            if abs(top_i - bot_j) < tolerance:
                below, above = zones[i], zones[j]
            elif abs(top_j - bot_i) < tolerance:
                below, above = zones[j], zones[i]

            if below and above:
                # Level height for stairwell/shaft elements
                level_ht = round(above['bbox_min_z'] - below['bbox_min_z'], 2)
                if level_ht <= 0:
                    level_ht = below['height']
                vertical.append({
                    'zone_below': below['name'],
                    'zone_above': above['name'],
                    'level_ht': level_ht,
                })
    return vertical

def _match_breps_to_zones(breps, zones, tolerance=0.5):
    """For each brep, find touching zones (sorted by distance).
    Returns list of (brep_index, centroid, normal, bbox, touching_zones)."""
    results = []
    # Pre-compute zone bboxes inflated by tolerance
    zone_bboxes = []
    for z in zones:
        bb = z['brep'].GetBoundingBox(True)
        bb.Inflate(tolerance)
        zone_bboxes.append(bb)

    for bi, brep in enumerate(breps):
        if brep is None:
            continue
        amp = rg.AreaMassProperties.Compute(brep)
        if not amp or amp.Area < 0.01:
            continue
        centroid = amp.Centroid
        area = amp.Area

        normal = None
        if brep.Faces.Count > 0:
            face = brep.Faces[0]
            u = face.Domain(0).Mid
            v = face.Domain(1).Mid
            normal = face.NormalAt(u, v)

        bb = brep.GetBoundingBox(True)
        dx = bb.Max.X - bb.Min.X
        dy = bb.Max.Y - bb.Min.Y
        dz = bb.Max.Z - bb.Min.Z

        touching = []
        for zi, zone in enumerate(zones):
            # Skip if centroid not even near this zone's bbox
            if not zone_bboxes[zi].Contains(centroid):
                continue
            cp = zone['brep'].ClosestPoint(centroid)
            if cp.IsValid:
                dist = centroid.DistanceTo(cp)
                if dist < tolerance:
                    touching.append((dist, zone))
        touching.sort(key=lambda x: x[0])

        results.append({
            'index': bi, 'centroid': centroid, 'normal': normal,
            'area': area, 'bb': bb,
            'height': dz if dz > 0.01 else 1.0,
            'width': max(dx, dy) if max(dx, dy) > 0.01 else area / max(dz, 0.01),
            'touching': touching,
        })
    return results

# --- CONVERSION ---

def _envelope_to_opening(env, preset_params):
    """Convert one envelope face detection to an opening entry."""
    return {
        'dtype': 'plr_test1',
        'params': dict(preset_params),  # copy
        'zone_a': None,
        'zone_b': env['zone'],
        'relHt': env['relHt'],
        'mult': env['area'],
        'wazm': env['azimuth'],
        'wind_pressure': True,
        'desc': 'envelope_{}'.format(env['zone']),
    }

def _adjacency_to_opening(conn, preset_params):
    """Convert auto-detected adjacency to an opening entry."""
    return {
        'dtype': 'dor_door',
        'params': dict(preset_params),
        'zone_a': conn['zone_a'],
        'zone_b': conn['zone_b'],
        'relHt': 0.0,
        'mult': 1.0,
        'wazm': 0.0,
        'wind_pressure': False,
        'desc': 'adj_{}_{}'.format(conn['zone_a'], conn['zone_b']),
    }

def _window_to_opening(match, state, window_el="typical"):
    """Convert matched window Brep to an opening entry.
    
    state: one of "open"/"tilted"/"closed"/"fixed" from window_states list.
    window_el: "tight"/"typical"/"leaky" — controls frame seal quality for
               closed/fixed windows (overrides WINDOW_STATE_MAP Flow params).
    """
    if not match['touching']:
        return None
    zone = match['touching'][0][1]
    h = match['height']
    w = match['width']

    state = state.lower().strip() if state else "closed"
    if state not in WINDOW_STATE_MAP:
        state = "closed"
    smap = WINDOW_STATE_MAP[state]

    normal = match['normal']
    azimuth = 0.0
    if normal and abs(normal.Z) < 0.7:
        azimuth = math.degrees(math.atan2(normal.X, normal.Y))
        if azimuth < 0:
            azimuth += 360

    relHt = match['centroid'].Z - zone['bbox_min_z']
    if relHt < 0:
        relHt = 0.5

    if smap['type'] == 'dor_door':
        eff_ht = h * smap['ht_factor']
        if eff_ht < 0.01:
            eff_ht = 0.01
        return {
            'dtype': 'dor_door',
            'params': {'ht': round(eff_ht, 3), 'wd': round(w, 3),
                       'cd': smap['cd']},
            'zone_a': None,
            'zone_b': zone['name'],
            'relHt': round(relHt, 2),
            'mult': 1.0,
            'wazm': round(azimuth, 1),
            'wind_pressure': True,
            'desc': 'window_{}_{}'.format(state, zone['name']),
        }
    else:
        # plr_test1: perimeter crack leak
        # Use window_el preset to override frame seal quality
        win_preset = WINDOW_EL_PRESETS.get(
            str(window_el), WINDOW_EL_PRESETS["typical"])
        perimeter = 2.0 * (h + w)
        return {
            'dtype': 'plr_test1',
            'params': {'dP': win_preset['dP'], 'Flow': win_preset['Flow'],
                       'expt': win_preset['expt']},
            'zone_a': None,
            'zone_b': zone['name'],
            'relHt': round(relHt, 2),
            'mult': round(perimeter, 2),
            'wazm': round(azimuth, 1),
            'wind_pressure': True,
            'desc': 'window_{}_{}'.format(state, zone['name']),
        }

def _door_to_opening(match, state):
    """Convert matched door Brep to opening entry (interior or exterior)."""
    state = state.lower().strip() if state else "open"
    if state not in DOOR_STATE_MAP:
        state = "open"
    smap = DOOR_STATE_MAP[state]

    h = match['height']
    w = match['width']
    eff_ht = smap.get('ht_override', h * smap['ht_factor'])
    cd = smap['cd']

    if len(match['touching']) >= 2:
        # Interior door
        zone_a = match['touching'][0][1]
        zone_b = match['touching'][1][1]
        base_z = min(zone_a['bbox_min_z'], zone_b['bbox_min_z'])
        relHt = match['bb'].Min.Z - base_z
        if relHt < 0:
            relHt = 0.0
        return {
            'dtype': 'dor_door',
            'params': {'ht': round(eff_ht, 3), 'wd': round(w, 3), 'cd': cd},
            'zone_a': zone_a['name'],
            'zone_b': zone_b['name'],
            'relHt': round(relHt, 2),
            'mult': 1.0,
            'wazm': 0.0,
            'wind_pressure': False,
            'desc': 'door_{}_{}_{}'.format(state, zone_a['name'], zone_b['name']),
        }
    elif len(match['touching']) == 1:
        # Exterior door
        zone = match['touching'][0][1]
        relHt = match['bb'].Min.Z - zone['bbox_min_z']
        if relHt < 0:
            relHt = 0.0
        azimuth = 0.0
        normal = match['normal']
        if normal and abs(normal.Z) < 0.7:
            azimuth = math.degrees(math.atan2(normal.X, normal.Y))
            if azimuth < 0:
                azimuth += 360
        return {
            'dtype': 'dor_door',
            'params': {'ht': round(eff_ht, 3), 'wd': round(w, 3), 'cd': cd},
            'zone_a': None,
            'zone_b': zone['name'],
            'relHt': round(relHt, 2),
            'mult': 1.0,
            'wazm': round(azimuth, 1),
            'wind_pressure': True,
            'desc': 'door_ext_{}_{}'.format(state, zone['name']),
        }
    return None

# --- MAIN ASSEMBLY ---

def build_openings(zones, envelope_el, window_el, interior_el, vertical_el,
                   window_breps, window_states, door_breps, door_states):
    """Assemble complete openings list from geometry + presets.
    
    Returns (openings_list, counts_dict).
    """
    openings = []
    counts = {'envelope': 0, 'adjacency': 0, 'window': 0,
              'door_int': 0, 'door_ext': 0, 'frame_leak': 0,
              'vertical': 0, 'orphan': 0}

    # 1. Envelope faces
    env_params = ENVELOPE_PRESETS.get(str(envelope_el), ENVELOPE_PRESETS["typical"])
    envelopes = _detect_envelope_faces(zones)
    for env in envelopes:
        openings.append(_envelope_to_opening(env, env_params))
        counts['envelope'] += 1

    # 2. Adjacencies
    connections = _detect_adjacencies(zones)

    # 3. Doors (detect + filter adjacencies they replace)
    door_pairs_covered = set()
    if door_breps:
        if not door_states:
            door_states = ["closed"] * len(door_breps)
        while len(door_states) < len(door_breps):
            door_states.append("closed")

        door_matches = _match_breps_to_zones(door_breps, zones)
        for dm in door_matches:
            di = dm['index']
            st = door_states[di] if di < len(door_states) else "closed"
            entry = _door_to_opening(dm, st)
            if entry:
                openings.append(entry)
                if entry.get('zone_a') and entry.get('zone_b'):
                    pair = tuple(sorted([entry['zone_a'], entry['zone_b']]))
                    door_pairs_covered.add(pair)
                    counts['door_int'] += 1
                else:
                    counts['door_ext'] += 1

                # Companion: door frame perimeter leakage (plr_test1).
                # Always present regardless of door state — air leaks
                # around the frame even when the door is fully open.
                dp = entry.get('params', {})
                door_ht = dp.get('ht', 2.1)
                door_wd = dp.get('wd', 0.9)
                perim = 2.0 * (door_ht + door_wd)  # metres of frame crack
                leak_entry = {
                    'dtype': 'plr_test1',
                    'params': dict(DOOR_FRAME_LEAK),
                    'zone_a': entry.get('zone_a'),
                    'zone_b': entry.get('zone_b'),
                    'relHt': entry.get('relHt', 0.0),
                    'mult': round(perim, 2),
                    'wazm': entry.get('wazm', 0.0),
                    'wind_pressure': entry.get('wind_pressure', False),
                    'desc': entry.get('desc', 'door').replace(
                        'door_', 'frameleak_', 1),
                }
                openings.append(leak_entry)
                counts['frame_leak'] += 1
            else:
                counts['orphan'] += 1

    # 4. Remaining adjacencies (not covered by explicit doors)
    int_params = INTERIOR_PRESETS.get(str(interior_el), INTERIOR_PRESETS["door_undercut"])
    for conn in connections:
        pair = tuple(sorted([conn['zone_a'], conn['zone_b']]))
        if pair not in door_pairs_covered:
            entry = _adjacency_to_opening(conn, int_params)
            openings.append(entry)
            counts['adjacency'] += 1

            # Companion frame leakage (same logic as explicit doors).
            # Use standard interior door dimensions for perimeter.
            adj_ht = int_params.get('ht', 2.1)
            adj_wd = int_params.get('wd', 0.9)
            # For undercut (ht=0.01), use standard frame size, not undercut dims
            frame_ht = max(adj_ht, 2.1)
            frame_wd = max(adj_wd, 0.9)
            perim = 2.0 * (frame_ht + frame_wd)
            leak_entry = {
                'dtype': 'plr_test1',
                'params': dict(DOOR_FRAME_LEAK),
                'zone_a': conn['zone_a'],
                'zone_b': conn['zone_b'],
                'relHt': 0.0,
                'mult': round(perim, 2),
                'wazm': 0.0,
                'wind_pressure': False,
                'desc': 'frameleak_adj_{}_{}'.format(
                    conn['zone_a'], conn['zone_b']),
            }
            openings.append(leak_entry)
            counts['frame_leak'] += 1

    # 5. Windows (superposed on envelope, per-window state)
    if window_breps:
        if not window_states:
            window_states = ["closed"] * len(window_breps)
        while len(window_states) < len(window_breps):
            window_states.append("closed")

        win_matches = _match_breps_to_zones(window_breps, zones)
        for wm in win_matches:
            wi = wm['index']
            st = window_states[wi] if wi < len(window_states) else "closed"
            entry = _window_to_opening(wm, st, window_el)
            if entry:
                openings.append(entry)
                counts['window'] += 1

    # 6. Vertical connections (floor/ceiling adjacency between levels)
    n_levels = _detect_levels(zones)
    if n_levels > 1:
        vert_conns = _detect_vertical_connections(zones)
        vert_preset = VERTICAL_PRESETS.get(
            str(vertical_el), VERTICAL_PRESETS["floor_leak"])
        for vc in vert_conns:
            params = dict(vert_preset['params'])
            # Override level height from detected geometry
            if vert_preset['dtype'] == 'plr_stair':
                params['Ht'] = vc['level_ht']
            elif vert_preset['dtype'] == 'plr_shaft':
                params['Ht'] = vc['level_ht']
            openings.append({
                'dtype': vert_preset['dtype'],
                'params': params,
                'zone_a': vc['zone_below'],
                'zone_b': vc['zone_above'],
                'relHt': 0.0,
                'mult': 1.0,
                'wazm': 0.0,
                'wind_pressure': False,
                'desc': 'vertical_{}_{}'.format(
                    vc['zone_below'], vc['zone_above']),
            })
            counts['vertical'] += 1

    return openings, counts

# --- GH EXECUTION ---

if 'breps' not in dir() or not breps:
    breps = []
if 'room_names' not in dir() or not room_names:
    room_names = ["Room{}".format(i + 1) for i in range(len(breps))]
if 'window_breps' not in dir() or not window_breps:
    window_breps = []
if 'window_states' not in dir() or not window_states:
    window_states = []
if 'door_breps' not in dir() or not door_breps:
    door_breps = []
if 'door_states' not in dir() or not door_states:
    door_states = []
if 'envelope_el' not in dir() or not envelope_el:
    envelope_el = "typical"
if 'window_el' not in dir() or not window_el:
    window_el = "typical"
if 'interior_el' not in dir() or not interior_el:
    interior_el = "door_undercut"
if 'vertical_el' not in dir() or not vertical_el:
    vertical_el = "floor_leak"
if 'run' not in dir():
    run = False

STICKY_KEY = "GDS_CONTAM_OPENINGS_CACHE"

openings_json = "[]"
msg = ""

# Restore cached result when not running
if not run:
    cached = sc.sticky.get(STICKY_KEY)
    if cached:
        openings_json = cached['json']
        msg = "[cached] " + cached['msg']
    else:
        msg = "Set run=True to analyse geometry. {} Breps connected.".format(len(breps))
elif not breps:
    msg = "No Breps connected. Wire room geometry."
else:
    try:
        zones = _extract_zones(breps, room_names)
        openings, counts = build_openings(
            zones, envelope_el, window_el, interior_el, vertical_el,
            window_breps, window_states, door_breps, door_states)

        openings_json = json.dumps(openings, indent=None)

        parts = []
        total = 0
        for k in ['envelope', 'adjacency', 'door_int', 'door_ext',
                   'frame_leak', 'window', 'vertical']:
            if counts[k] > 0:
                parts.append("{} {}".format(counts[k], k))
                total += counts[k]
        if counts.get('orphan', 0) > 0:
            parts.append("{} orphan(skipped)".format(counts['orphan']))
        msg = "{} openings: {}".format(total, ", ".join(parts))
        
        # Show active presets in msg for verification
        env_flow = ENVELOPE_PRESETS.get(str(envelope_el), ENVELOPE_PRESETS["typical"]).get("Flow", "?")
        win_flow = WINDOW_EL_PRESETS.get(str(window_el), WINDOW_EL_PRESETS["typical"]).get("Flow", "?")
        msg += "\n env={} (F={}), win_el={} (F={}), win={}, int={}".format(
            envelope_el, env_flow, window_el, win_flow,
            window_states[:3] if window_states else "[]",
            interior_el)

        # Cache for downstream use without re-running
        sc.sticky[STICKY_KEY] = {'json': openings_json, 'msg': msg}

    except Exception as e:
        msg = "ERROR: {}".format(str(e))
        import traceback
        msg += "\n" + traceback.format_exc()
# ---------- end gds_contam_openings ----------

# ----
# GDS Code
panel = Panel("C:\Users\cdu113\Downloads\GDS_CONTAMX_Dev\gds_contam_viewer.py")

# ----
# System Components
panel_2 = Panel("C:\Windows\py.exe")

program_data = ClusterInput()
sim_start = ClusterInput()
sim_end = ClusterInput()
epw_path = ClusterInput()
run_2 = ClusterInput()
gds_contam_runv2 = IronPython2Script(
    breps=blds_2,
    T_indoor=23,
    openings_json=gds_contam_openings.openings_json,
    program_data=program_data,
    sim_start=sim_start,
    sim_end=sim_end,
    epw_path=epw_path,
    contamx_path="C:\Program Files (x86)\NIST\CONTAM 3.4.0.6\contamx3.exe",
    cpython_path=panel_2,
    script_path="C:\Users\cdu113\Downloads\GDS_CONTAMX_Dev\gds_contam_v3.py",
    run=run_2)  # -> msg, prj_path, results_json, co2_data; inputs breps: list of Brep, room_names: list of String, T_indoor: list of Double, openings_json: String, program_data: list of String, sim_start: String, sim_end: String, epw_path: String, contamx_path: String, cpython_path: String, script_path: String, run: Boolean
# ---------- gds_contam_runv2: IronPython ----------
# -*- coding: utf-8 -*-
"""
GDS CONTAM IAQ Simulation Runner
================================

SPDX-License-Identifier: BSD-3-Clause
Copyright (c) 2026 SyracuseCoE, Syracuse University. All rights reserved.

Redistribution and use in source and binary forms, with or without
modification, are permitted provided that the conditions stated in the
LICENSE file distributed with this project are met.

Author: Chengbo Du <cdu113@syr.edu>

Run a CONTAM IAQ simulation. Extract geometry from Breps, assemble the
spec, and dispatch to gds_contam_v3.py via CPython subprocess. Schedule
parsing, seasonal partitioning, PRJ generation, ContamX execution, and
SIM result stitching are handled on the CPython side.

INPUTS:
  breps         : list[Brep]  - Room geometry (closed Breps)
  room_names    : list[str]   - Room names matching breps
  T_indoor      : list[float] - Indoor temperature [C] per room (default 20)
  occupants     : list[int]   - Occupants per room (overridden by program_data)
  program_data  : list[str]   - HB ProgramType JSON per room (optional;
                                derives occupants and schedules; seasonal
                                schedules with the # convention are accepted)
  ambient_co2   : float       - Outdoor CO2 [ppm] (default 415)
  openings_json : str         - JSON from GDS_CONTAM_OPENINGS (required)
  T_outdoor     : float       - Outdoor temperature [C] (default 0)
  wind_speed    : float       - Wind speed [m/s] (default 5)
  wind_dir      : float       - Wind direction [deg, 0=N] (default 0)
  sim_start     : str         - "MM-DD" (default "01-01")
  sim_end       : str         - "MM-DD" (default: sim_start + sim_days)
  sim_days      : int         - Legacy; overridden by sim_end when connected
  epw_path      : str         - EPW file (optional; needs WTH conversion)
  wth_path      : str         - WTH file (optional; takes priority over EPW)
  contamx_path  : str         - Path to contamx3.exe
  cpython_path  : str         - Path to CPython interpreter
  script_path   : str         - Path to gds_contam_v3.py
  run           : bool        - Set True to execute

OUTPUTS:
  prj_path     : str             - Path to .prj file
  results_json : str             - Path to _summary.json
  co2_data     : DataTree[float] - Hourly CO2 ppm per zone
  msg          : str             - Status / diagnostics
"""

import Rhino.Geometry as rg
import rhinoscriptsyntax as rs
import os, json, subprocess, sys
import scriptcontext as sc
import math

# --- GEOMETRY EXTRACTION ---

def _extract_floor_polygon(brep, base_z, tolerance=0.15):
    """Extract the floor outline of a Brep as a 2D polygon.

    Finds the bottom-most horizontal face (near base_z) and returns
    its outer boundary vertices projected to XY.

    Returns list of [x, y] pairs, or None if no suitable face found.
    """
    best_face = None
    best_area = 0.0

    for fi in range(brep.Faces.Count):
        face = brep.Faces[fi]
        u_mid = face.Domain(0).Mid
        v_mid = face.Domain(1).Mid
        normal = face.NormalAt(u_mid, v_mid)
        pt = face.PointAt(u_mid, v_mid)

        # Floor face: horizontal normal, centroid Z near base_z
        if abs(normal.Z) < 0.7:
            continue
        if abs(pt.Z - base_z) > tolerance:
            continue

        amp = rg.AreaMassProperties.Compute(face)
        area = amp.Area if amp else 0.0
        if area > best_area:
            best_area = area
            best_face = face

    if best_face is None:
        return None

    # Get the outer boundary loop
    loop = best_face.OuterLoop
    if loop is None:
        return None

    crv3d = loop.To3dCurve()
    if crv3d is None:
        return None

    # Try polyline extraction first (fast, exact for box rooms)
    pts = []
    result = crv3d.TryGetPolyline()
    if result[0]:
        polyline = result[1]
        for pi in range(polyline.Count - 1):  # skip closing duplicate
            p = polyline[pi]
            pts.append([round(float(p.X), 2), round(float(p.Y), 2)])
    else:
        # Densify: sample the curve at intervals
        length = crv3d.GetLength()
        n_samples = max(8, int(length / 0.5))
        params = crv3d.DivideByCount(n_samples, True)
        if params:
            for t in params:
                p = crv3d.PointAt(t)
                pts.append([round(float(p.X), 2), round(float(p.Y), 2)])

    if len(pts) < 3:
        return None

    return pts

def extract_zone_data(breps, room_names, T_indoor=None):
    """Extract volume, height, centroid from each Brep.
    
    Returns fully serialized zone dicts (no Rhino objects) ready for JSON.
    """
    zones = []
    for i, brep in enumerate(breps):
        name = room_names[i] if i < len(room_names) else "Room{}".format(i+1)
        T = T_indoor[i] if T_indoor and i < len(T_indoor) else 20.0
        if T is None:
            T = 20.0

        vmp = rg.VolumeMassProperties.Compute(brep)
        vol = vmp.Volume if vmp else 100.0

        bb = brep.GetBoundingBox(True)
        height = bb.Max.Z - bb.Min.Z
        if height <= 0:
            height = 3.0

        # Serialize all values to JSON-safe primitives
        zd = {
            'name': name,
            'volume': round(vol, 2),
            'height': round(height, 2),
            'T_C': T,
            'bbox_min_z': bb.Min.Z,
            'bbox_max_z': bb.Max.Z,
            'level': 1,
        }

        # Centroid
        if vmp and vmp.Centroid:
            c = vmp.Centroid
            zd['cx'] = round(float(c.X), 2)
            zd['cy'] = round(float(c.Y), 2)
            zd['cz'] = round(float(c.Z), 2)
        else:
            c = bb.Center
            zd['cx'] = round(float(c.X), 2)
            zd['cy'] = round(float(c.Y), 2)
            zd['cz'] = round(float(c.Z), 2)

        # Bounding box
        zd['bb_min'] = [round(float(bb.Min.X), 2), round(float(bb.Min.Y), 2)]
        zd['bb_max'] = [round(float(bb.Max.X), 2), round(float(bb.Max.Y), 2)]

        # Floor polygon
        zd['floor_polygon'] = _extract_floor_polygon(brep, bb.Min.Z)

        zones.append(zd)
    return zones

# --- MULTI-LEVEL SUPPORT ---

def detect_levels(zones, floor_tolerance=0.3):
    """Group zones into levels based on their Z positions.
    
    Returns updated zones with 'level' field and a list of Level definitions.
    """
    z_bases = sorted(set(round(z['bbox_min_z'], 1) for z in zones))

    levels = []
    current_base = z_bases[0] if z_bases else 0
    level_idx = 1
    level_map = {}

    for zb in z_bases:
        if zb - current_base > floor_tolerance:
            level_idx += 1
            current_base = zb
        level_map[round(zb, 1)] = level_idx

    for z in zones:
        zb = round(z['bbox_min_z'], 1)
        z['level'] = level_map.get(zb, 1)

    level_defs = []
    for lv in sorted(set(level_map.values())):
        lv_zones = [z for z in zones if z['level'] == lv]
        if lv_zones:
            ref_ht = min(z['bbox_min_z'] for z in lv_zones)
            del_ht = max(z['height'] for z in lv_zones)
            level_defs.append({
                'index': lv,
                'refht': round(ref_ht, 2),
                'delht': round(del_ht, 2),
                'name': "Level{}".format(lv)
            })

    return zones, level_defs

# --- SPEC ASSEMBLY ---

def _parse_date_str(date_str):
    """Parse 'MM-DD' or 'MM/DD' to [month, day]. Returns None on failure."""
    if not date_str or not isinstance(date_str, str):
        return None
    date_str = date_str.strip().replace('/', '-')
    parts = date_str.split('-')
    if len(parts) != 2:
        return None
    try:
        m, d = int(parts[0]), int(parts[1])
        if 1 <= m <= 12 and 1 <= d <= 31:
            return [m, d]
    except (ValueError, TypeError):
        pass
    return None

def build_raw_spec(zones, openings,
                   occupants=None, program_data=None,
                   ambient_co2=415,
                   T_outdoor=0, wind_speed=5, wind_dir=0,
                   sim_start=None, sim_end=None, sim_days=1,
                   epw_path="", wth_path="", contamx_path="",
                   output_dir=""):
    """Assemble raw JSON spec for gds_contam_v3.py.
    
    Unlike the old build_spec, this does NO schedule/program parsing.
    Raw program_data strings are passed through for v3 to handle.
    
    Simulation period:
      - If sim_start and sim_end both given: use date range
      - If only sim_start: start from there for sim_days days
      - If neither: Jan 1 for sim_days days (legacy)
    """
    if not output_dir:
        output_dir = os.path.join(os.environ.get('USERPROFILE', ''),
                                  'Documents', 'GDS_CONTAM')
    if not os.path.exists(output_dir):
        os.makedirs(output_dir)

    # Guard numerics
    sim_days = sim_days if sim_days else 1
    T_outdoor = T_outdoor if T_outdoor is not None else 0.0
    wind_speed = wind_speed if wind_speed is not None else 5.0
    wind_dir = wind_dir if wind_dir is not None else 0.0
    ambient_co2 = float(ambient_co2) if ambient_co2 is not None else 415.0

    # Resolve simulation period
    start = _parse_date_str(sim_start) if isinstance(sim_start, str) else None
    end = _parse_date_str(sim_end) if isinstance(sim_end, str) else None
    if not start:
        start = [1, 1]

    spec = {
        'output_prj': os.path.join(output_dir, 'gds_model.prj'),
        'contamx_path': contamx_path,
        'location': {'lat': 43.04, 'lon': -76.14, 'timezone': -5, 'altitude': 127},
        'simulation': {
            'start_date': start,
            'timestep_min': 5,
            'output_hr': 1,
            'sim_af': 1,
        },
        'ambient_co2_ppm': ambient_co2,
        'species': ['CO2', 'PM2.5'],
        'zones': zones,  # already serialized (no Rhino objects)
        'openings': openings if openings else [],
        'sources': [],
    }

    # Simulation end date or days
    if end:
        spec['simulation']['end_date'] = end
    else:
        spec['simulation']['days'] = int(sim_days)

    # Contaminant solver mode
    total_days = int(sim_days)
    if end:
        # Approximate days for solver mode selection
        month_days = [0, 31, 28, 31, 30, 31, 30, 31, 31, 30, 31, 30, 31]
        s_doy = sum(month_days[:start[0]]) + start[1]
        e_doy = sum(month_days[:end[0]]) + end[1]
        total_days = (e_doy - s_doy + 1) if e_doy >= s_doy else (365 - s_doy + e_doy + 1)
    # sim_mf: 2=transient-cyclic (multi-day), 3=transient-non-cyclic (single-day)
    spec['simulation']['sim_mf'] = 2 if total_days > 1 else 3

    # Weather
    if wth_path and os.path.exists(str(wth_path)):
        spec['weather'] = {
            'mode': 'wth',
            'wth_path': str(wth_path),
            'epw_path': str(epw_path) if epw_path else ''
        }
    elif epw_path and os.path.exists(str(epw_path)):
        spec['weather'] = {'mode': 'epw', 'epw_path': str(epw_path)}
    else:
        spec['weather'] = {
            'mode': 'steady_state',
            'T_C': float(T_outdoor),
            'wind_speed': float(wind_speed),
            'wind_dir': float(wind_dir)
        }

    # Program data: pass raw JSON strings for v3 to parse
    if program_data:
        spec['program_data'] = program_data

    # Manual occupants fallback (used by v3 if program_data parsing fails)
    if occupants:
        spec['occupants'] = []
        for i, occ in enumerate(occupants):
            if occ and occ > 0 and i < len(zones):
                spec['occupants'].append({
                    'zone': zones[i]['name'],
                    'species': 'CO2',
                    'occupants': int(occ)
                })

    return spec

def run_contam_pipeline(spec, cpython_path, script_path):
    """Write JSON, call CPython, read results back."""

    json_dir = os.path.dirname(spec['output_prj'])
    json_path = os.path.join(json_dir, 'gds_spec.json')
    with open(json_path, 'w') as f:
        json.dump(spec, f, indent=2)

    # Clean environment: strip Rhino's Python paths
    clean_env = {}
    for k, v in os.environ.items():
        clean_env[k] = v
    for poison_key in ['PYTHONPATH', 'PYTHONHOME', 'PYTHONSTARTUP',
                       'IRONPYTHONPATH', 'IRONPYTHONSTARTUP']:
        clean_env.pop(poison_key, None)
    if 'PATH' in clean_env:
        parts = clean_env['PATH'].split(';')
        parts = [p for p in parts if '.rhinocode' not in p.lower()]
        clean_env['PATH'] = ';'.join(parts)

    cmd = [cpython_path, script_path, 'from_json', json_path]
    result = subprocess.Popen(
        cmd, stdout=subprocess.PIPE, stderr=subprocess.PIPE,
        env=clean_env)
    stdout, stderr = result.communicate()

    msg = stdout.decode('utf-8', errors='replace')
    err = stderr.decode('utf-8', errors='replace')

    if err.strip():
        msg += "\n[STDERR] " + err.strip()

    summary_path = spec['output_prj'].replace('.prj', '_summary.json')
    results = None
    if os.path.exists(summary_path):
        with open(summary_path, 'r') as f:
            results = json.load(f)

    return msg, err, results, summary_path

# --- MAIN GH EXECUTION ---

# Default values for optional inputs
if 'breps' not in dir() or not breps:
    breps = []
if 'room_names' not in dir() or not room_names:
    room_names = ["Room{}".format(i+1) for i in range(len(breps))]
if 'T_indoor' not in dir() or not T_indoor:
    T_indoor = [20.0] * len(breps)
if 'occupants' not in dir() or not occupants:
    occupants = [0] * len(breps)
if 'program_data' not in dir() or not program_data:
    program_data = []
else:
    # Sanitize: GH may pass 0.0 or None for unconnected items
    _clean = []
    for pd in program_data:
        if isinstance(pd, str) and pd.strip() and pd.strip()[0] == '{':
            _clean.append(pd)
        elif isinstance(pd, dict):
            _clean.append(json.dumps(pd))
    program_data = _clean
if 'ambient_co2' not in dir() or ambient_co2 is None:
    ambient_co2 = 415.0
if 'openings_json' not in dir() or not openings_json:
    openings_json = "[]"
if 'T_outdoor' not in dir() or T_outdoor is None:
    T_outdoor = 0.0
if 'wind_speed' not in dir() or wind_speed is None:
    wind_speed = 5.0
if 'wind_dir' not in dir() or wind_dir is None:
    wind_dir = 0.0
# New: sim_start / sim_end (date range)
if 'sim_start' not in dir() or not sim_start:
    sim_start = ""
if 'sim_end' not in dir() or not sim_end:
    sim_end = ""
# Legacy: sim_days (still supported as fallback)
if 'sim_days' not in dir() or not sim_days:
    sim_days = 1
if 'epw_path' not in dir() or not epw_path:
    epw_path = ""
if 'wth_path' not in dir() or not wth_path:
    wth_path = ""
if 'contamx_path' not in dir() or not contamx_path:
    contamx_path = r"C:\Program Files (x86)\NIST\CONTAM 3.4.0.6\contamx3.exe"
if 'cpython_path' not in dir() or not cpython_path:
    cpython_path = r"C:\Windows\py.exe"
if 'script_path' not in dir() or not script_path:
    script_path = ""
if 'run' not in dir():
    run = False

# Outputs
prj_path = ""
results_json = ""
co2_data = None
msg = ""

if not run:
    try:
        n_openings = len(json.loads(openings_json))
    except Exception:
        n_openings = 0
    msg = "Set run=True. {} Breps, {} openings loaded.".format(
        len(breps), n_openings)
elif not breps:
    msg = "ERROR: No Breps connected."
elif not script_path or not os.path.exists(script_path):
    msg = "ERROR: Set script_path to gds_contam_v3.py location."
elif not os.path.exists(contamx_path):
    msg = "ERROR: contamx3.exe not found at: {}".format(contamx_path)
else:
    try:
        # Step 1: Extract geometry (returns serialized dicts — no Rhino objects)
        zones = extract_zone_data(breps, room_names, T_indoor)
        msg = "Extracted {} zones. ".format(len(zones))

        # Step 2: Detect levels
        zones, level_defs = detect_levels(zones)
        msg += "{} level(s). ".format(len(level_defs))

        # Step 3: Parse openings from interpreter
        try:
            openings = json.loads(openings_json) if isinstance(openings_json, str) else openings_json
        except Exception:
            openings = []
        msg += "{} openings. ".format(len(openings))

        # Step 4: Build raw spec (no schedule parsing — v3 handles that)
        output_dir = os.path.join(os.environ.get('USERPROFILE', '.'),
                                  'Documents', 'GDS_CONTAM')
        spec = build_raw_spec(
            zones, openings,
            occupants=occupants, program_data=program_data,
            ambient_co2=ambient_co2,
            T_outdoor=T_outdoor, wind_speed=wind_speed, wind_dir=wind_dir,
            sim_start=sim_start, sim_end=sim_end, sim_days=sim_days,
            epw_path=epw_path, wth_path=wth_path,
            contamx_path=contamx_path, output_dir=output_dir)

        # Step 4b: Wireless occupancy bridge (Hub → CONTAM, no wiring needed)
        # If program_data is not wired, check sc.sticky for Hub's occupancy export.
        # Priority: program_data (wired) > contam_occupancy (wireless) > manual occupants
        if not program_data:
            import scriptcontext as _sc
            _occ = _sc.sticky.get("GDS_CONTAM_OCC")
            if _occ and isinstance(_occ, dict) and _occ.get('rooms'):
                spec['contam_occupancy'] = _occ
                n_occ_rooms = len(_occ['rooms'])
                # Check for seasonal data
                n_seasonal = sum(1 for r in _occ['rooms'].values()
                                 if r.get('seasonal'))
                occ_msg = "{} rooms from Hub occupancy".format(n_occ_rooms)
                if n_seasonal:
                    occ_msg += " ({} with seasonal)".format(n_seasonal)
                msg += occ_msg + ". "

        # Pre-run summary
        n_prog = len(program_data)
        n_occ_manual = len(spec.get('occupants', []))
        has_contam_occ = bool(spec.get('contam_occupancy'))
        if n_prog > 0:
            msg += "{} program_data entries -> v3 will parse. ".format(n_prog)
        elif has_contam_occ:
            pass  # already reported above
        elif n_occ_manual > 0:
            msg += "{} manual occupant sources. ".format(n_occ_manual)
        else:
            msg += "WARNING: no occupants or program_data. "

        # Weather summary
        wx = spec.get('weather', {})
        wx_mode = wx.get('mode', 'unknown')
        if wx_mode == 'wth':
            msg += "Weather: WTH. "
        elif wx_mode == 'epw':
            msg += "Weather: EPW. "
        else:
            msg += "Weather: steady T={}C. ".format(wx.get('T_C', '?'))

        # Sim period summary
        sim_cfg = spec.get('simulation', {})
        sd = sim_cfg.get('start_date', [1, 1])
        ed = sim_cfg.get('end_date')
        if ed:
            msg += "Sim: {}/{} -> {}/{}. ".format(sd[0], sd[1], ed[0], ed[1])
        else:
            msg += "Sim: {}/{} +{} days. ".format(
                sd[0], sd[1], sim_cfg.get('days', '?'))

        # Step 5: Run pipeline (v3 does all simulation logic)
        stdout, stderr, results, summary_path = run_contam_pipeline(
            spec, cpython_path, script_path)

        prj_path = spec['output_prj']
        results_json = summary_path

        # Check if PRJ was created
        if os.path.exists(prj_path):
            msg += "PRJ created. "
        else:
            msg += "WARNING: PRJ not created. "

        # Show v3 pipeline output (includes schedule info, seasonal partitions)
        if stdout.strip():
            msg += stdout.strip() + " "

        # Step 6: Extract CO2 data for GH visualization
        if results:
            from Grasshopper import DataTree
            from Grasshopper.Kernel.Data import GH_Path

            co2_data = DataTree[float]()
            zone_names_res = results.get('zones', [])
            for zi, zname in enumerate(zone_names_res):
                path = GH_Path(zi)
                for entry in results.get('hourly', []):
                    zd = entry.get('zone_data', {}).get(zname, {})
                    co2_data.Add(zd.get('CO2_ppm', 0.0), path)

            msg += "Results: {} zones x {} hours.".format(
                len(zone_names_res),
                len(results.get('hourly', [])))

            # Show seasonal segments if present
            segments = results.get('seasonal_segments', [])
            if segments:
                msg += "\n--- SEASONAL SEGMENTS ({}) ---".format(len(segments))
                for seg in segments:
                    msg += "\n  {}/{} - {}/{}: {}".format(
                        seg.get('start', [0, 0])[0], seg.get('start', [0, 0])[1],
                        seg.get('end', [0, 0])[0], seg.get('end', [0, 0])[1],
                        seg.get('label', ''))

    except Exception as e:
        msg = "ERROR: {}".format(str(e))
        import traceback
        msg += "\n" + traceback.format_exc()
# ---------- end gds_contam_runv2 ----------
auto_open = ClusterInput()
run_3 = ClusterInput()
gds_contam_view = Python3Script(prj_path=gds_contam_runv2.prj_path, viewer_path=panel, auto_open=auto_open, run=run_3)  # -> msg, dashboard; inputs prj_path: String, cpython_path: String, viewer_path: String, auto_open: Boolean, run: Boolean
# ---------- gds_contam_view: Python ----------
# -*- coding: utf-8 -*-
"""
GDS CONTAM Results Viewer
=========================

SPDX-License-Identifier: BSD-3-Clause
Copyright (c) 2026 SyracuseCoE, Syracuse University. All rights reserved.

Redistribution and use in source and binary forms, with or without
modification, are permitted provided that the conditions stated in the
LICENSE file distributed with this project are met.

Author: Chengbo Du <cdu113@syr.edu>

Render CONTAM simulation results as an HTML dashboard via
gds_contam_viewer.py (CPython subprocess).

INPUTS:
  prj_path     : str   - Path to .prj file (from CONTAM runner)
  cpython_path : str   - Path to CPython exe (default "C:\\Windows\\py.exe")
  viewer_path  : str   - Path to gds_contam_viewer.py
  auto_open    : bool  - Open dashboard in browser (default True)
  run          : bool  - Set True to generate dashboard

OUTPUTS:
  dashboard    : str   - Path to generated HTML dashboard
  msg          : str   - Status / error messages
"""

import os
import subprocess

# --- DEFAULTS ---

if 'prj_path' not in dir() or not prj_path:
    prj_path = ""
if 'cpython_path' not in dir() or not cpython_path:
    cpython_path = r"C:\Windows\py.exe"
if 'viewer_path' not in dir() or not viewer_path:
    viewer_path = ""
if 'auto_open' not in dir():
    auto_open = True
if 'run' not in dir():
    run = False

# --- OUTPUTS ---

dashboard = ""
msg = ""

# --- MAIN ---

if not run:
    msg = "Set run=True to generate dashboard."

elif not prj_path:
    msg = "ERROR: No prj_path connected. Wire from CONTAM runner."

elif not os.path.exists(prj_path):
    # PRJ not found — check for summary JSON instead
    summary_path = prj_path.replace('.prj', '_summary.json')
    sim_path = prj_path.replace('.prj', '.sim')
    
    # Report what exists in the output folder
    folder = os.path.dirname(prj_path)
    if os.path.exists(folder):
        files = os.listdir(folder)
        msg = "ERROR: PRJ not found at: {}\n".format(prj_path)
        msg += "Files in {}: {}\n".format(folder, ", ".join(files) if files else "(empty)")
        msg += "The CONTAM simulation likely failed. "
        msg += "Test manually:\n  {} {} from_json {}".format(
            cpython_path,
            viewer_path.replace('viewer', 'v3') if viewer_path else '<script_path>',
            os.path.join(folder, 'gds_spec.json'))
    else:
        msg = "ERROR: Output folder does not exist: {}".format(folder)

elif not viewer_path or not os.path.exists(viewer_path):
    msg = "ERROR: Set viewer_path to gds_contam_viewer.py location."

elif not os.path.exists(cpython_path):
    msg = "ERROR: CPython not found at: {}".format(cpython_path)

else:
    try:
        # Determine mode: prefer summary JSON (has correct ppm from gds_contam_v3's
        # SIMReader) over raw SIM binary (viewer's parser can misalign on large models)
        sim_path = prj_path.replace('.prj', '.sim')
        summary_path = prj_path.replace('.prj', '_summary.json')

        if os.path.exists(summary_path):
            # JSON mode: pre-computed correct values from pipeline
            cmd = [cpython_path, viewer_path, '--from-json', summary_path]
            mode_msg = "JSON summary"
        elif os.path.exists(sim_path):
            # Fallback: parse PRJ + SIM binary directly
            cmd = [cpython_path, viewer_path, prj_path]
            mode_msg = "PRJ+SIM"
        else:
            msg = "ERROR: No _summary.json or .sim found alongside {}".format(prj_path)
            cmd = None
            mode_msg = ""

        if cmd:
            # Clean environment: strip Rhino's Python paths so CPython
            # uses its own stdlib (prevents SRE module mismatch)
            env = {}
            for k, v in os.environ.items():
                env[k] = v
            for poison_key in ['PYTHONPATH', 'PYTHONHOME', 'PYTHONSTARTUP',
                               'IRONPYTHONPATH', 'IRONPYTHONSTARTUP']:
                env.pop(poison_key, None)
            if 'PATH' in env:
                parts = env['PATH'].split(';')
                parts = [p for p in parts if '.rhinocode' not in p.lower()]
                env['PATH'] = ';'.join(parts)

            if not auto_open:
                env['GDS_NO_BROWSER'] = '1'

            proc = subprocess.Popen(
                cmd,
                stdout=subprocess.PIPE,
                stderr=subprocess.PIPE,
                env=env)
            stdout, stderr = proc.communicate()

            out_text = stdout.decode('utf-8', errors='replace').strip()
            err_text = stderr.decode('utf-8', errors='replace').strip()

            # Expected dashboard path
            dashboard = prj_path.replace('.prj', '_dashboard.html')

            if os.path.exists(dashboard):
                size_kb = os.path.getsize(dashboard) / 1024.0
                msg = "Dashboard generated ({} mode, {:.0f} KB): {}".format(
                    mode_msg, size_kb, dashboard)
                if out_text:
                    msg += "\n" + out_text
            else:
                msg = "Viewer ran but no dashboard file found.\n"
                if out_text:
                    msg += "stdout: {}\n".format(out_text)
                if err_text:
                    msg += "stderr: {}\n".format(err_text)

    except Exception as e:
        import traceback
        msg = "ERROR: {}\n{}".format(str(e), traceback.format_exc())
# ---------- end gds_contam_view ----------
data = Data([gds_contam_openings.msg, gds_contam_runv2.msg, gds_contam_view.msg])
data_2 = ClusterOutput(data)

# ==== cluster DesignCase

# ----
# Simulation Parameters
toggle = BooleanToggle(True)
panel = Panel("daily")
simoutput = HBSimulationOutput(zone_energy_use=toggle, surface_temperature=toggle, surface_energy_flow=toggle)  # -> report, sim_output; plug-in component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
simcontrol = HBSimulationControl()  # -> sim_control; plug-in component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
shadowcalc = HBShadowCalculation(solar_dist="FullExterior")  # -> shadow_calc; plug-in component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
analysisperiod = LBAnalysisPeriod(start_month="1", start_day=1, start_hour=0, end_month="12")  # -> period, hoys, dates; plug-in component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
sizingpar = HBSizingParameter()  # -> sizing; plug-in component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
customoutput = HBCustomSimulationOutput(base_sim_output=simoutput.sim_output, output_names="Zone Mean Air Temperature")  # -> report, sim_output; plug-in component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
simpar = HBSimulationParameter(
    north="10",
    output=customoutput.sim_output,
    run_period=analysisperiod.period,
    timestep="4",
    sim_control=simcontrol,
    shadow_calc=shadowcalc,
    sizing=sizingpar)  # -> sim_par; plug-in component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

model = ClusterInput()
epw_file = ClusterInput()
# Output:Table:SummaryReports,AllSummaryAndMonthly;
settings = ClusterInput()
# Output:Variable, *, Water Heater Use Side Inlet Temperature, Monthly;
# Output:Variable, *, Water Heater Use Side Outlet Temperature, Monthly;
# Output:Variable, *, Water Heater Tank Temperature, Monthly;
# Output:Variable, *, Water Heater Heating Energy, Monthly;
# Output:Variable, *, Site Mains Water Temperature, Monthly;
gds_comfortparser = IronPython2Script(settings=settings)  # -> report, clothing, air_vel, work_eff, ankle_vel, comfort_model, ashrae_warnings; inputs settings: String
# ---------- gds_comfortparser: IronPython ----------
"""
GDS Comfort Parser
Parses comfort settings string from GDS Hub and outputs individual parameters.
-
Inputs:
    _settings: Settings string from GDS Hub (JSON or key=value format)
Outputs:
    clothing: Clothing insulation (clo)
    air_vel: Air velocity (m/s)
    work_eff: Work efficiency (0-1)
    ankle_vel: Ankle air velocity (m/s)
    comfort_model: Comfort model type
    ashrae_warnings: Enable ASHRAE 55 warnings
    report: Parse status
"""

import json

# Initialize outputs as None (empty wire)
clothing = None
air_vel = None
work_eff = None
ankle_vel = None
comfort_model = None
ashrae_warnings = None
report = "No settings string"

def parse_json(s):
    """Parse JSON format: {"clothing": 0.7, "air_vel": 0.1}"""
    try:
        return json.loads(s)
    except:
        return None

def parse_keyvalue(s):
    """Parse key=value format: clothing=0.7;air_vel=0.1"""
    result = {}
    try:
        pairs = s.split(';')
        for pair in pairs:
            if '=' in pair:
                key, val = pair.strip().split('=', 1)
                key = key.strip().lower()
                val = val.strip()
                
                # Convert to appropriate type
                if val.lower() == 'true':
                    result[key] = True
                elif val.lower() == 'false':
                    result[key] = False
                elif val.lower() in ['none', '']:
                    continue  # Skip empty values
                else:
                    try:
                        result[key] = float(val)
                    except:
                        result[key] = val  # Keep as string
        return result
    except:
        return None

if _settings and _settings.strip():
    settings_str = _settings.strip()
    parsed = None
    
    # Try JSON first
    if settings_str.startswith('{'):
        parsed = parse_json(settings_str)
        fmt = "JSON"
    else:
        # Try key=value format
        parsed = parse_keyvalue(settings_str)
        fmt = "key=value"
    
    if parsed:
        # Extract values (None if not present)
        clothing = parsed.get('clothing')
        air_vel = parsed.get('air_vel') or parsed.get('air_velocity')
        work_eff = parsed.get('work_eff') or parsed.get('work_efficiency')
        ankle_vel = parsed.get('ankle_vel') or parsed.get('ankle_velocity')
        comfort_model = parsed.get('comfort_model') or parsed.get('model')
        ashrae_warnings = parsed.get('ashrae_warnings') or parsed.get('warnings')
        
        # Count how many values were parsed
        count = sum(1 for v in [clothing, air_vel, work_eff, ankle_vel, comfort_model, ashrae_warnings] if v is not None)
        report = "Parsed {} ({} values)".format(fmt, count)
    else:
        report = "Error: Could not parse settings string"
else:
    report = "No settings string provided"
# ---------- end gds_comfortparser ----------
modeltoosm = HBModelToOSM(model=model, epw_file=epw_file, write=Toggle(True), run=Toggle(False))  # -> report, jsons, osw, osm, idf, sql, zsz, rdd, html; plug-in component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
gds_comfortinjector = IronPython2Script(
    idf_path=modeltoosm.idf,
    clothing=gds_comfortparser.clothing,
    air_vel=gds_comfortparser.air_vel,
    work_eff=gds_comfortparser.work_eff,
    ankle_vel=gds_comfortparser.ankle_vel,
    comfort_model=gds_comfortparser.comfort_model,
    ashrae_warnings=gds_comfortparser.ashrae_warnings)  # -> report, idf_path
#   port gme: Give Me Everything: Generate all reports from EnergyPlus.
# ---------- gds_comfortinjector: IronPython ----------
"""
GDS Comfort Injector
Injects Fanger thermal comfort model into IDF file.
Place between HB Model to OSM (run_=False) and HB Run IDF.
-
Inputs:
    _idf_path: IDF file path from HB Model to OSM
    clothing_: Clothing insulation (clo), default 0.7
    air_vel_: Air velocity (m/s), default 0.1
    work_eff_: Work efficiency (0-1), default 0
    ankle_vel_: Ankle level air velocity (m/s), default None
    comfort_model_: Comfort model type, default "Fanger"
                   Options: Fanger, Pierce, KSU, AdaptiveASH55, AdaptiveCEN15251
    ashrae_warnings_: Enable ASHRAE 55 warnings, default False
    gme_: Give Me Everything - if True, includes all E+ summary reports
          (AllSummaryAndMonthly). Default False uses a curated subset
          that covers GDS dashboard needs with smaller SQL file size.
Outputs:
    idf_path: Modified IDF path (pass to HB Run IDF)
    report: Status message
"""

import os
import re


def inject_comfort_model(idf_path, clothing=0.7, air_vel=0.1, work_eff=0, 
                         ankle_vel=None, comfort_model="Fanger", 
                         ashrae_warnings=False):
    """Add thermal comfort model to all People objects"""
    
    with open(idf_path, 'r') as f:
        content = f.read()
    
    people_count = content.count('People,')
    
    # Check if already modified
    if '!- Thermal Comfort Model Type 1' in content:
        return -1, people_count
    
    modified_count = 0
    warnings_str = "Yes" if ashrae_warnings else "No"
    
    # Build schedules
    comfort_schedules = """
!-   ===========  GDS THERMAL COMFORT SCHEDULES  ===========
ScheduleTypeLimits,
  GDS_Any_Number,,,Continuous;

Schedule:Constant,
  GDS_Work_Efficiency_Schedule,GDS_Any_Number,{work_eff};

Schedule:Constant,
  GDS_Clothing_Schedule,GDS_Any_Number,{clothing};

Schedule:Constant,
  GDS_Air_Velocity_Schedule,GDS_Any_Number,{air_vel};
""".format(work_eff=work_eff, clothing=clothing, air_vel=air_vel)

    # Add ankle velocity schedule if specified
    if ankle_vel is not None:
        comfort_schedules += """
Schedule:Constant,
  GDS_Ankle_Velocity_Schedule,GDS_Any_Number,{ankle_vel};
""".format(ankle_vel=ankle_vel)
    
    if 'GDS_Work_Efficiency_Schedule' not in content:
        if 'Version,' in content:
            ver_end = content.find(';', content.find('Version,')) + 1
            content = content[:ver_end] + '\n' + comfort_schedules + content[ver_end:]
        else:
            content = comfort_schedules + content
    
    # Build comfort fields for People object
    ankle_sched = "GDS_Ankle_Velocity_Schedule" if ankle_vel is not None else ""
    
    comfort_fields = [
        '  ,                                       !- Carbon Dioxide Generation Rate',
        '  {},                                     !- Enable ASHRAE 55 Comfort Warnings'.format(warnings_str),
        '  EnclosureAveraged,                      !- Mean Radiant Temperature Calculation Type',
        '  ,                                       !- Surface Name/Angle Factor List Name',
        '  GDS_Work_Efficiency_Schedule,           !- Work Efficiency Schedule Name',
        '  ClothingInsulationSchedule,             !- Clothing Insulation Calculation Method',
        '  ,                                       !- Clothing Insulation Calculation Method Schedule',
        '  GDS_Clothing_Schedule,                  !- Clothing Insulation Schedule Name',
        '  GDS_Air_Velocity_Schedule,              !- Air Velocity Schedule Name',
        '  {},                                     !- Ankle Level Air Velocity Schedule Name'.format(ankle_sched),
        '  {};                                     !- Thermal Comfort Model Type 1'.format(comfort_model),
    ]
    
    # Modify People objects
    lines = content.split('\n')
    new_lines = []
    
    for line in lines:
        if 'activity level schedule name' in line.lower() and ';' in line:
            line = line.replace(';', ',')
            new_lines.append(line)
            new_lines.extend(comfort_fields)
            modified_count += 1
        else:
            new_lines.append(line)
    
    content = '\n'.join(new_lines)
    
    # Add output variables based on comfort model
    output_vars = """
!-   ===========  GDS THERMAL COMFORT OUTPUTS  ===========
Output:Variable,*,Zone Mean Radiant Temperature,Timestep;
Output:Variable,*,Zone Air Relative Humidity,Timestep;
Output:Variable,*,Zone Operative Temperature,Timestep;
Output:Variable,*,Zone Mean Air Temperature,Timestep;
Output:Variable,*,Zone Heating Setpoint Not Met Time,Timestep;
Output:Variable,*,Zone Cooling Setpoint Not Met Time,Timestep;
"""
    
    # Add model-specific outputs
    if comfort_model == "Fanger":
        output_vars += """Output:Variable,*,Zone Thermal Comfort Fanger Model PMV,Timestep;
Output:Variable,*,Zone Thermal Comfort Fanger Model PPD,Timestep;
"""
    elif comfort_model == "Pierce":
        output_vars += """Output:Variable,*,Zone Thermal Comfort Pierce Model Standard Effective Temperature,Timestep;
Output:Variable,*,Zone Thermal Comfort Pierce Model Discomfort Index,Timestep;
"""
    elif comfort_model == "KSU":
        output_vars += """Output:Variable,*,Zone Thermal Comfort KSU Model Thermal Sensation Vote,Timestep;
"""
    elif comfort_model == "AdaptiveASH55":
        output_vars += """Output:Variable,*,Zone Thermal Comfort ASHRAE 55 Adaptive Model Running Average Outdoor Air Temperature,Timestep;
Output:Variable,*,Zone Thermal Comfort ASHRAE 55 Adaptive Model Temperature,Timestep;
"""
    elif comfort_model == "AdaptiveCEN15251":
        output_vars += """Output:Variable,*,Zone Thermal Comfort CEN 15251 Adaptive Model Running Average Outdoor Air Temperature,Timestep;
Output:Variable,*,Zone Thermal Comfort CEN 15251 Adaptive Model Temperature,Timestep;
"""
    
    if 'GDS THERMAL COMFORT OUTPUTS' not in content:
        content += output_vars
    
    with open(idf_path, 'w') as f:
        f.write(content)
    
    return modified_count, people_count


def inject_summary_reports(idf_path, gme=False):
    """Inject Output:Table:SummaryReports into IDF. Always runs, even if comfort already injected.
    
    Args:
        gme: Give Me Everything. True = AllSummaryAndMonthly, False = curated subset.
    Returns:
        str: which mode was applied, or 'skipped' if already correct.
    """
    with open(idf_path, 'r') as f:
        content = f.read()
    
    if gme:
        summary_value = 'AllSummaryAndMonthly'
    else:
        summary_value = ('\n    AllMonthly,\n'
                         '    AnnualBuildingUtilityPerformanceSummary,\n'
                         '    InputVerificationandResultsSummary,\n'
                         '    EnvelopeSummary,\n'
                         '    EquipmentSummary,\n'
                         '    SystemSummary,\n'
                         '    HVACSizingSummary,\n'
                         '    SensibleHeatGainSummary,\n'
                         '    Standard62.1Summary')
    
    target_tag = 'AllSummaryAndMonthly' if gme else 'GDS SUMMARY REPORTS'
    modified = False
    
    if target_tag not in content:
        if 'Output:Table:SummaryReports' in content:
            content = re.sub(
                r'Output:Table:SummaryReports,\s*[^;]+;',
                'Output:Table:SummaryReports,\n    {};\n'.format(summary_value),
                content)
        else:
            content += """
!-   ===========  GDS SUMMARY REPORTS  ===========
Output:Table:SummaryReports,
    {};
""".format(summary_value)
        modified = True
    
    # Ensure Output:SQLite is SimpleAndTabular (not just Simple)
    # Without this, TabularDataWithStrings table won't exist in the SQL
    if 'Output:SQLite' in content:
        content = re.sub(
            r'Output:SQLite\s*,\s*[^;]+;',
            'Output:SQLite,\n    SimpleAndTabular;',
            content)
    else:
        content += """
!-   ===========  GDS SQL OUTPUT  ===========
Output:SQLite,
    SimpleAndTabular;
"""
    modified = True
    
    # Inject facility-level meters for monthly energy parsing
    if 'GDS ENERGY METERS' not in content:
        content += """
!-   ===========  GDS ENERGY METERS  ===========
!- Facility totals
Output:Meter,Electricity:Facility,Monthly;
Output:Meter,NaturalGas:Facility,Monthly;
Output:Meter,DistrictCooling:Facility,Monthly;
Output:Meter,DistrictHeatingWater:Facility,Monthly;
Output:Meter,DistrictHeatingSteam:Facility,Monthly;
Output:Meter,FuelOilNo1:Facility,Monthly;
Output:Meter,FuelOilNo2:Facility,Monthly;
Output:Meter,Propane:Facility,Monthly;
!- End-use sub-meters
Output:Meter,Heating:Electricity,Monthly;
Output:Meter,Heating:NaturalGas,Monthly;
Output:Meter,Heating:DistrictHeatingWater,Monthly;
Output:Meter,Heating:DistrictHeatingSteam,Monthly;
Output:Meter,Cooling:Electricity,Monthly;
Output:Meter,Cooling:NaturalGas,Monthly;
Output:Meter,Cooling:DistrictCooling,Monthly;
Output:Meter,InteriorLights:Electricity,Monthly;
Output:Meter,InteriorEquipment:Electricity,Monthly;
Output:Meter,InteriorEquipment:NaturalGas,Monthly;
Output:Meter,Fans:Electricity,Monthly;
Output:Meter,Pumps:Electricity,Monthly;
Output:Meter,WaterSystems:Electricity,Monthly;
Output:Meter,WaterSystems:NaturalGas,Monthly;
"""
        modified = True
    
    if modified:
        with open(idf_path, 'w') as f:
            f.write(content)
    
    mode = 'AllSummaryAndMonthly' if gme else 'GDS Curated'
    return mode + ' + SQLite:SimpleAndTabular'


# Main
idf_path = None
report = "No IDF path"

# Set defaults if not provided
clo = clothing_ if clothing_ else 0.7
vel = air_vel_ if air_vel_ else 0.1
eff = work_eff_ if work_eff_ else 0
ankle = ankle_vel_ if ankle_vel_ else None
model = comfort_model_ if comfort_model_ else "Fanger"
warnings = ashrae_warnings_ if ashrae_warnings_ else False
give_me_everything = gme_ if gme_ else False

if _idf_path:
    if os.path.exists(_idf_path):
        try:
            mod_count, total_count = inject_comfort_model(
                _idf_path, clo, vel, eff, ankle, model, warnings)
            rpt_mode = inject_summary_reports(_idf_path, give_me_everything)
            idf_path = _idf_path
            if mod_count == -1:
                report = "Already modified ({} People)\nReports: {}".format(
                    total_count, rpt_mode)
            else:
                report = "Injected {}: {}/{} People\nClo={}, Vel={} m/s\nReports: {}".format(
                    model, mod_count, total_count, clo, vel, rpt_mode)
        except Exception as ex:
            report = "Error: {}".format(str(ex))
    else:
        report = "IDF not found"
# ---------- end gds_comfortinjector ----------
shwpatcher = IronPython2Script(idf_path=gds_comfortinjector.idf_path, tank_vol_m3="0.25")  # -> report, idf_path; inputs idf_path: String, tank_vol_m3: Double
# ---------- shwpatcher: IronPython ----------
# GDS SHW Tank Volume Patcher
# Place between ComfortInjector.idf_path -> Run IDF._idf
#
# This function exists as currently HB does not expose the Tank Volumn setting.
#
# Inputs:
#   _idf_path (str): IDF file path from upstream component
#   _tank_vol_m3 (float): Tank volume in m3 (default 0.25 = 66 gal)
#
# Outputs:
#   idf_path (str): Same path, passed through after patching
#   report (str): What was changed

import os
import re

idf_path = None
report = "No IDF path"

if _idf_path and os.path.isfile(str(_idf_path)):
    vol = float(_tank_vol_m3) if _tank_vol_m3 else 0.25
    
    with open(str(_idf_path), 'r') as f:
        content = f.read()
    
    pattern = r'([\d.eE+\-]+)(,\s*!-\s*Tank Volume \{m3\})'
    match = re.search(pattern, content)
    
    if match:
        old_val = match.group(1)
        content = content[:match.start()] + str(vol) + match.group(2) + content[match.end():]
        
        with open(str(_idf_path), 'w') as f:
            f.write(content)
        
        idf_path = _idf_path
        report = "Tank: {} -> {} m3 ({:.0f} gal)".format(old_val, vol, vol * 264.172)
    else:
        idf_path = _idf_path
        report = "No WaterHeater:Mixed found - passed through unchanged"
elif _idf_path:
    idf_path = _idf_path
    report = "File not found: {}".format(_idf_path)
# ---------- end shwpatcher ----------
panel_2 = Panel("""Site:GroundTemperature:BuildingSurface,
    13.3, 12.4, 12.6, 13.3, 15.8, 18.0, 19.8, 20.8, 20.6, 19.3, 17.3, 15.1;""")
runidf = HBRunIDF(idf=shwpatcher.idf_path, epw_file=epw_file, add_str=panel_2, cpu_count=Slider(4, range=1..8), run=Toggle(True))  # -> report, sql, zsz, rdd, html; plug-in component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
sql = ClusterOutput(runidf.sql)
report = ClusterOutput(runidf.report)
customresult = HBReadCustomResult(sql=runidf.sql, output_names="Zone Mean Air Temperature")  # -> results; plug-in component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
faceresult = HBReadFaceResult()  # -> face_indoor_temp, face_outdoor_temp, face_energy_flow; plug-in component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
panel_3 = Panel(runidf.report)
colorrooms = HBColorRooms(data=flatten(customresult), rooms_model=flatten(model))  # -> report, mesh, wire_frame, legend, title, rooms, colors, values, vis_set; plug-in component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

# ----
# Import Results
roomenergyresult = HBReadRoomEnergyResult(sql=runidf.sql)  # -> cooling, heating, lighting, electric_equip, gas_equip, process, hot_water, fan_electric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; plug-in component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

cooling = ClusterOutput(roomenergyresult.cooling)
heating = ClusterOutput(roomenergyresult.heating)

# ----
# Visualize Results
panel_4 = Panel("Cooling")
legendpar = LBLegendParameters(seg_count="10", num_decimals="0", text_height="1.5")  # -> leg_par; plug-in component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
massarithop = LBMassArithmeticOperation(data=flatten(roomenergyresult.cooling), type=panel_4)  # -> data; plug-in component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
massarithop_2 = LBMassArithmeticOperation(data=flatten(roomenergyresult.heating), type="Heating")  # -> data; plug-in component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
monthlychart = LBMonthlyChart(data=[massarithop, massarithop_2], base_pt="-200,0,0", stack=Toggle(True), legend_par=legendpar)  # -> report, data_mesh, data_lines, col_lines, legend, borders, labels, y_title, title, vis_set; plug-in component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

# ==== cluster GDS_BakeRefer_door
brep = ClusterInput()
bld_name = ClusterInput()
bool = ClusterInput()
bool_2 = Boolean(bool)
layer = ClusterInput()

refbake = ReferenceByBakeName(BakeName=bld_name, Key="*", Val="*", lightweight=False, DisableAutoUpdate=False)
lng = ListLength(List=refbake)
brep_2 = Brep(brep)
bld_name_2 = Data(bld_name)
graft = GraftTree(Tree=brep_2, IncludeEmptyLists=True, IncludeNullItems=True)
list = ValueList({"AddSuffix", "Overwrite", "ThrowError", "UseExisting"}, selected="UseExisting")
ef_att = EleFrontAttributes(Layer=layer, maintainBakeName=False)
viewer = ParamViewer(graft)
tstat = TreeStatistics(Tree=viewer)  # -> Paths, Length, Count
dup = DuplicateData(Data=ef_att, Number=tstat.Length, Order=True)
bld_name_3 = ClusterOutput(bld_name_2)

brep_3 = Brep(refbake)
bool_3 = Boolean(lng)
expression = Expression(x=bool_3, y=bool_2, Expression="If(y=false, If(x=true,false,true),true)")

bool_4 = Boolean(expression)
panel = Panel(bool_4)
bksettings = BakeSettings(
    AutoPushBlockDefinition=bool_4,
    AutoManifestGhostGeometry=bool_4,
    BlockNamesHandling=list,
    DimStyleNameHandling=list,
    MaterialNameHandling=list)
bake = BakeObjects(
    Geometry=brep_2,
    Attributes=dup,
    BakeName=bld_name_2,
    BakeSettings=bksettings,
    Bake=panel,
    createGroups=False,
    preset="Safest")  # -> Message, Ghosts

G = ClusterOutput(refbake)
